# Grasshopper definition CALLINGHOUSE.gh (Grasshopper 1.0.8)
# plug-ins: Pufferfish, Human

units = Data()  # disabled

elements = Data()  # disabled
boolean_toggle = BooleanToggle(True)  # disabled
python_3_script = Python3Script(RUN=boolean_toggle, units=units, elements=elements)  # -> out, csv_path, db_path, json_path, success; inputs units: list, elements: list; disabled
# ---------- python_3_script: Python ----------
import csv
import os
import sqlite3
import json

def safe_extract(value, default=0.0):
    if value is None:
        return default
    if isinstance(value, list):
        return value[0] if value else default
    return value

def extract_panel_data(units):
    return [[str(unit.unit_id or ""), str(unit.unit_name or ""), str(unit.orientation or ""), 
             str(unit.level or ""), str(panel.name or ""), 
             float(safe_extract(panel.wwr, 0.0)), 
             str(safe_extract(panel.orientation, "")), 
             float(safe_extract(panel.sda, 0.0)), 
             float(safe_extract(panel.viewscore, 0.0)), 
             float(safe_extract(panel.radiation, 0.0)), 
             str(safe_extract(panel.connected_room, "")), 
             str(safe_extract(panel.architectural_geometry.description, ""))]
            for unit in units for panel in unit.panels]

def extract_element_data(elements):
    return [[elem._id, elem.description, len(elem.glass), len(elem.solid), 
             elem.source_plane is not None, len(elem.glass) + len(elem.solid)]
            for elem in elements]

def create_database(db_path, panel_data, element_data):
    conn = sqlite3.connect(db_path)
    cursor = conn.cursor()
    
    # facade_sql table
    cursor.execute("DROP TABLE IF EXISTS building_sql")
    cursor.execute("""CREATE TABLE building_sql (unit_id TEXT, unit_name TEXT, unit_orientation TEXT, 
                      unit_level TEXT, panel_name TEXT, WWR REAL, panel_orientation TEXT, sda REAL,
                      viewscore REAL, radiation REAL, connected_room TEXT, component TEXT)""")
    cursor.executemany("INSERT INTO building_sql VALUES (?,?,?,?,?,?,?,?,?,?,?,?)", panel_data)
    
    # facade_elements table
    cursor.execute("DROP TABLE IF EXISTS components_library")
    cursor.execute("""CREATE TABLE components_library (element_id TEXT, description TEXT, glass_count INTEGER,
                      solid_count INTEGER, has_source_plane BOOLEAN, total_geometries INTEGER)""")
    cursor.executemany("INSERT INTO components_library VALUES (?,?,?,?,?,?)", element_data)
    
    conn.commit()
    conn.close()

def create_json_descriptions(folder, facade_sql_desc, facade_elements_desc):
    os.makedirs(os.path.join(folder, "knowledge"), exist_ok=True)
    json_path = os.path.join(folder, "knowledge", "table_descriptions.json")
    
    data = [
        {"name": "building_sql", "content": facade_sql_desc, "vector": []},
        {"name": "components_library", "content": facade_elements_desc, "vector": []}
    ]
    
    with open(json_path, 'w') as f:
        json.dump(data, f, indent=2)
    return json_path

def verify_csv(csv_path):
    with open(csv_path, 'r') as f:
        reader = csv.reader(f)
        headers = next(reader)
        rows = list(reader)
    print(f"CSV: {len(headers)} columns, {len(rows)} rows")
    return len(rows) > 0

def verify_database(db_path):
    conn = sqlite3.connect(db_path)
    cursor = conn.cursor()
    
    cursor.execute("SELECT name FROM sqlite_master WHERE type='table'")
    tables = [row[0] for row in cursor.fetchall()]
    
    for table in tables:
        cursor.execute(f"SELECT COUNT(*) FROM {table}")
        count = cursor.fetchone()[0]
        print(f"Table '{table}': {count} rows")
    
    conn.close()
    return len(tables) == 2

def verify_json(json_path):
    with open(json_path, 'r') as f:
        data = json.load(f)
    print(f"JSON: {len(data)} table descriptions")
    return all('name' in item and 'content' in item for item in data)

# Main execution
if RUN:
    headers = ['unit_id','unit_name','unit_orientation','unit_level','panel_name','WWR',
               'panel_orientation','sda','viewscore','radiation','connected_room','component']
    
    panel_data = extract_panel_data(units)
    element_data = extract_element_data(elements)
    
    # Create CSV
    csv_path = os.path.join(folder, 'building_data.csv')
    with open(csv_path, 'w', newline='') as f:
        writer = csv.writer(f)
        writer.writerow(headers)
        writer.writerows(panel_data)
    
    # Create database
    db_path = os.path.join(folder, "building_data.db")
    create_database(db_path, panel_data, element_data)
    
    # Create JSON descriptions
    json_path = create_json_descriptions(folder, facade_sql_table_description, facade_elements_table_description)
    
    print(f"Created: CSV({len(panel_data)} rows), DB(2 tables), JSON")

    # Verify everything works
    csv_ok = verify_csv(csv_path)
    db_ok = verify_database(db_path) 
    json_ok = verify_json(json_path)

    success = csv_ok and db_ok and json_ok
    print(f"Verification: {'✓ All passed' if success else '✗ Some failed'}")

# Outputs
csv_path if RUN else None
db_path if RUN else None  
json_path if RUN else None
success if RUN else False
# ---------- end python_3_script ----------

panel = Panel("can you generate a frank lloyd write house in 3d using python grasshopper code? so i can visualize it in grasshopper")
trigger = Trigger(Interval=1, TimerInterval=5, Target=python_3_script_5)  # disabled
# what is the WWR for the units with sda smaller than 30?
# return the units who have viewscores higher than .7?
# return all the panels with their unit id that have connected room as bedroom
file_path = FilePath("G:\My Drive\MACAD\AiAI_MODULE\STUDIO\data\knowledge_pool\merged.json")  # disabled
panel_2 = Panel(file_path)  # disabled
number_slider = Slider(4, range=0..10)  # disabled
number_slider_2 = Slider(4545, range=0..1000000)  # disabled
table_description_path = Data(python_3_script.json_path)  # disabled
db_path = Data(python_3_script.db_path)  # disabled
python_3_script_2 = Python3Script(site_seed=Slider(0, range=0..10), site_type=Slider(0, range=0..100))  # -> out, a; inputs site_seed: Int32, site_type: Int32
# ---------- python_3_script_2: Python ----------
"""
Grasshopper Python Script - Multi-Site Generator for Generative House Design
Author: Site Generation Tool
Description: Creates urban, suburban, and rural sites with context for testing generative house models

INPUTS:
- site_type: Integer (0=Urban, 1=Suburban, 2=Rural)
- site_seed: Integer for randomization
- show_context: Boolean to show neighboring buildings
- show_features: Boolean to show landscape features
"""

import Rhino.Geometry as rg
import math
import random

# Initialize outputs
site_boundary = []
buildable_area = []
setback_lines = []
context_buildings = []
roads = []
landscape_features = []
site_info = []

# Set random seed for reproducibility
if site_seed:
    random.seed(site_seed)
else:
    random.seed(42)

def create_urban_site():
    """Generate narrow urban townhouse lot with party walls"""
    
    # Site dimensions (narrow and deep)
    width = 7.5  # 7.5m (25ft) typical townhouse width
    depth = 30   # 30m (100ft) depth
    
    # Create site boundary
    pts = [
        rg.Point3d(0, 0, 0),
        rg.Point3d(width, 0, 0),
        rg.Point3d(width, depth, 0),
        rg.Point3d(0, depth, 0),
        rg.Point3d(0, 0, 0)
    ]
    boundary = rg.PolylineCurve(pts)
    
    # Setbacks (minimal for urban)
    front_setback = 3
    rear_setback = 3
    side_setback = 0  # Party walls, no side setback
    
    # Buildable area
    build_pts = [
        rg.Point3d(side_setback, front_setback, 0),
        rg.Point3d(width - side_setback, front_setback, 0),
        rg.Point3d(width - side_setback, depth - rear_setback, 0),
        rg.Point3d(side_setback, depth - rear_setback, 0),
        rg.Point3d(side_setback, front_setback, 0)
    ]
    buildable = rg.PolylineCurve(build_pts)
    
    # Create context buildings (adjacent townhouses)
    context = []
    if show_context:
        # Left neighbor
        left_pts = [
            rg.Point3d(-width, 0, 0),
            rg.Point3d(0, 0, 0),
            rg.Point3d(0, depth, 0),
            rg.Point3d(-width, depth, 0)
        ]
        left_building = rg.Brep.CreatePlanarBreps(rg.PolylineCurve(left_pts + [left_pts[0]]))[0]
        left_building = rg.Brep.CreateFromOffsetFace(
            left_building.Faces[0], 9, True, True, 0.01)[0]  # 9m height
        context.append(left_building)
        
        # Right neighbor
        right_pts = [
            rg.Point3d(width, 0, 0),
            rg.Point3d(width * 2, 0, 0),
            rg.Point3d(width * 2, depth, 0),
            rg.Point3d(width, depth, 0)
        ]
        right_building = rg.Brep.CreatePlanarBreps(rg.PolylineCurve(right_pts + [right_pts[0]]))[0]
        right_building = rg.Brep.CreateFromOffsetFace(
            right_building.Faces[0], 9, True, True, 0.01)[0]  # 9m height
        context.append(right_building)
    
    # Create street
    road_pts = [
        rg.Point3d(-width * 2, -8, 0),
        rg.Point3d(width * 3, -8, 0),
        rg.Point3d(width * 3, -3, 0),
        rg.Point3d(-width * 2, -3, 0),
        rg.Point3d(-width * 2, -8, 0)
    ]
    road = rg.PolylineCurve(road_pts)
    
    # Info text
    info = "URBAN SITE\nWidth: {}m\nDepth: {}m\nBuildable: {}sqm\nFAR potential: 3.0".format(
        width, depth, round(width * (depth - front_setback - rear_setback), 1))
    
    return boundary, buildable, context, road, [], info

def create_suburban_site():
    """Generate typical suburban lot with front/back/side yards"""
    
    # Site dimensions (wider suburban lot)
    width = 20   # 20m (65ft) width
    depth = 35   # 35m (115ft) depth
    
    # Create site boundary
    pts = [
        rg.Point3d(0, 0, 0),
        rg.Point3d(width, 0, 0),
        rg.Point3d(width, depth, 0),
        rg.Point3d(0, depth, 0),
        rg.Point3d(0, 0, 0)
    ]
    boundary = rg.PolylineCurve(pts)
    
    # Setbacks (typical suburban)
    front_setback = 7.5
    rear_setback = 7.5
    side_setback = 3
    
    # Buildable area
    build_pts = [
        rg.Point3d(side_setback, front_setback, 0),
        rg.Point3d(width - side_setback, front_setback, 0),
        rg.Point3d(width - side_setback, depth - rear_setback, 0),
        rg.Point3d(side_setback, depth - rear_setback, 0),
        rg.Point3d(side_setback, front_setback, 0)
    ]
    buildable = rg.PolylineCurve(build_pts)
    
    # Create context buildings (neighboring houses)
    context = []
    if show_context:
        # Left neighbor house
        left_house_w = 12
        left_house_d = 15
        left_x = -width - 5
        left_y = front_setback + random.uniform(-2, 2)
        
        left_pts = [
            rg.Point3d(left_x, left_y, 0),
            rg.Point3d(left_x + left_house_w, left_y, 0),
            rg.Point3d(left_x + left_house_w, left_y + left_house_d, 0),
            rg.Point3d(left_x, left_y + left_house_d, 0)
        ]
        left_house = rg.Brep.CreatePlanarBreps(rg.PolylineCurve(left_pts + [left_pts[0]]))[0]
        left_house = rg.Brep.CreateFromOffsetFace(
            left_house.Faces[0], 6, True, True, 0.01)[0]  # 6m height
        context.append(left_house)
        
        # Right neighbor house
        right_x = width + 8
        right_y = front_setback + random.uniform(-2, 2)
        
        right_pts = [
            rg.Point3d(right_x, right_y, 0),
            rg.Point3d(right_x + left_house_w, right_y, 0),
            rg.Point3d(right_x + left_house_w, right_y + left_house_d, 0),
            rg.Point3d(right_x, right_y + left_house_d, 0)
        ]
        right_house = rg.Brep.CreatePlanarBreps(rg.PolylineCurve(right_pts + [right_pts[0]]))[0]
        right_house = rg.Brep.CreateFromOffsetFace(
            right_house.Faces[0], 6, True, True, 0.01)[0]
        context.append(right_house)
    
    # Create curved suburban street
    road_curve = rg.Curve.CreateInterpolatedCurve(
        [rg.Point3d(-width * 1.5, -10, 0),
         rg.Point3d(width * 0.5, -12, 0),
         rg.Point3d(width * 2.5, -10, 0)], 3)
    road = road_curve.Offset(rg.Plane.WorldXY, 5, 0.01, rg.CurveOffsetCornerStyle.Sharp)[0]
    
    # Add landscape features
    features = []
    if show_features:
        # Add trees
        for i in range(3):
            tree_x = random.uniform(2, width - 2)
            tree_y = random.uniform(depth - rear_setback + 2, depth - 2)
            tree = rg.Circle(rg.Point3d(tree_x, tree_y, 0), 2)
            features.append(tree.ToNurbsCurve())
    
    # Info text
    buildable_area_sqm = (width - 2 * side_setback) * (depth - front_setback - rear_setback)
    info = "SUBURBAN SITE\nWidth: {}m\nDepth: {}m\nBuildable: {}sqm\nFAR potential: 0.6".format(
        width, depth, round(buildable_area_sqm, 1))
    
    return boundary, buildable, context, road, features, info

def create_rural_site():
    """Generate irregular rural lot with topography and natural features"""
    
    # Create irregular boundary (larger rural lot)
    boundary_pts = [
        rg.Point3d(0, 0, 0),
        rg.Point3d(45, 3, 0),
        rg.Point3d(50, 35, 0),
        rg.Point3d(48, 55, 0),
        rg.Point3d(30, 60, 0),
        rg.Point3d(5, 50, 0),
        rg.Point3d(-5, 20, 0),
        rg.Point3d(0, 0, 0)
    ]
    boundary = rg.Curve.CreateInterpolatedCurve(boundary_pts, 3)
    
    # Larger setbacks for rural
    # Create buildable area as offset from boundary
    buildable = boundary.Offset(rg.Plane.WorldXY, -8, 0.01, rg.CurveOffsetCornerStyle.Sharp)[0]
    
    # No immediate context buildings for rural
    context = []
    if show_context:
        # Add distant barn or structure
        barn_pts = [
            rg.Point3d(60, 20, 0),
            rg.Point3d(75, 20, 0),
            rg.Point3d(75, 35, 0),
            rg.Point3d(60, 35, 0)
        ]
        barn = rg.Brep.CreatePlanarBreps(rg.PolylineCurve(barn_pts + [barn_pts[0]]))[0]
        barn = rg.Brep.CreateFromOffsetFace(barn.Faces[0], 5, True, True, 0.01)[0]
        context.append(barn)
    
    # Create winding rural road
    road_pts = [
        rg.Point3d(-20, -15, 0),
        rg.Point3d(10, -18, 0),
        rg.Point3d(40, -15, 0),
        rg.Point3d(70, -10, 0)
    ]
    road = rg.Curve.CreateInterpolatedCurve(road_pts, 3)
    
    # Add natural features
    features = []
    if show_features:
        # Create pond
        pond_center = rg.Point3d(35, 45, 0)
        pond = rg.Ellipse(rg.Plane(pond_center, rg.Vector3d.ZAxis), 8, 5)
        features.append(pond.ToNurbsCurve())
        
        # Create tree clusters
        tree_clusters = [
            rg.Point3d(10, 40, 0),
            rg.Point3d(15, 38, 0),
            rg.Point3d(12, 43, 0),
            rg.Point3d(5, 15, 0),
            rg.Point3d(8, 12, 0),
            rg.Point3d(45, 20, 0),
            rg.Point3d(43, 25, 0)
        ]
        for pt in tree_clusters:
            tree = rg.Circle(pt, 2.5)
            features.append(tree.ToNurbsCurve())
        
        # Create creek/stream
        creek_pts = [
            rg.Point3d(0, 30, 0),
            rg.Point3d(8, 32, 0),
            rg.Point3d(18, 30, 0),
            rg.Point3d(25, 35, 0),
            rg.Point3d(35, 38, 0)
        ]
        creek = rg.Curve.CreateInterpolatedCurve(creek_pts, 3)
        features.append(creek)
    
    # Calculate approximate area
    area_mass = rg.AreaMassProperties.Compute(boundary)
    buildable_mass = rg.AreaMassProperties.Compute(buildable)
    
    # Info text
    info = "RURAL SITE\nTotal Area: {}sqm\nBuildable: {}sqm\nFAR potential: 0.2\nFeatures: Pond, Trees, Creek".format(
        round(area_mass.Area, 1), round(buildable_mass.Area, 1))
    
    return boundary, buildable, context, road, features, info


show_context = True
show_features = True


# Main execution based on site_type
if site_type == 0:  # Urban
    boundary, buildable, context, road, features, info = create_urban_site()
elif site_type == 1:  # Suburban
    boundary, buildable, context, road, features, info = create_suburban_site()
elif site_type == 2:  # Rural
    boundary, buildable, context, road, features, info = create_rural_site()
else:
    # Default to suburban
    boundary, buildable, context, road, features, info = create_suburban_site()

# Assign outputs
site_boundary = boundary
buildable_area = buildable
context_buildings = context
roads = road
landscape_features = features
site_info = info

# Create setback visualization lines
if buildable:
    setback_lines = buildable
# ---------- end python_3_script_2 ----------
python_3_script_3 = Python3Script()  # -> out, block_boundary, sidewalks, curb_lines, lot_boundaries, building_footprints, stoops, rear_yards, tree_pits, site_info
# ---------- python_3_script_3: Python ----------
"""
BROWNSTONE BLOCK GENERATOR (Brooklyn-Style) — v2 (no stoop/tree collisions, no building/sidewalk overlap)
Grasshopper Python Component

INPUTS (optional):
- block_length   : float (m)   – along street (default 183.0 ≈ 600 ft)
- block_width    : float (m)   – property line to property line across streets (default 60.96 ≈ 200 ft)
- lot_width      : float (m)   – typical lot width (default 6.1 ≈ 20 ft)
- front_setback  : float (m)   – building face behind front lot line (default 3.05 ≈ 10 ft)
- rear_yard      : float (m)   – required rear yard depth (default 9.14 ≈ 30 ft)
- sidewalk_w     : float (m)   – sidewalk depth OUTSIDE the property line (default 4.5 ≈ 15 ft)
- building_max_d : float (m)   – max building depth from front facade (default 17.0 ≈ 56 ft)
- seed           : int         – random seed (default 42)
- vary_widths    : bool        – vary lot widths (default False)

OUTPUTS:
- block_boundary       : Curve  (property line rectangle)
- curb_lines           : List[Curve] (street curb lines outside the property)
- sidewalks            : List[Curve] (rectangles outside the property)
- lot_boundaries       : List[Curve]
- building_footprints  : List[Curve]
- stoops               : List[Curve] (always inside the lot)
- rear_yards           : List[Curve]
- tree_pits            : List[Curve] (circles in sidewalk)
- site_info            : List[str]
"""

import Rhino.Geometry as rg
import math, random

# -------------------- Inputs & defaults --------------------
def _val(name, default):
    return globals()[name] if name in globals() and globals()[name] is not None else default

block_length   = float(_val('block_length',   183.0))   # ~600 ft
block_width    = float(_val('block_width',     60.96))  # ~200 ft | property-line to property-line
lot_width_in   = _val('lot_width',              6.10)   # ~20 ft
front_setback  = float(_val('front_setback',    3.05))  # ~10 ft
rear_yard      = float(_val('rear_yard',        9.14))  # ~30 ft
sidewalk_w     = float(_val('sidewalk_w',       4.50))  # ~15 ft (OUTSIDE property)
building_max_d = float(_val('building_max_d',  17.00))  # ~56 ft cap
seed           = int(_val('seed',               42))
vary_widths    = bool(_val('vary_widths',    False))

random.seed(seed)

# Derived (property rectangle centered at origin)
half_w   = block_width * 0.5            # property half-depth (~100 ft)
lot_depth= half_w                        # lot depth to block centerline
x0, x1   = -block_length*0.5, block_length*0.5
y_top    =  half_w                       # front lot line (north side)
y_bot    = -half_w                       # front lot line (south side)

# Walkside/curb OUTSIDE property:
# north sidewalk: [y_top, y_top + sidewalk_w]
# south sidewalk: [y_bot - sidewalk_w, y_bot]
curb_y_N = y_top + sidewalk_w            # curb line north
curb_y_S = y_bot - sidewalk_w            # curb line south

# Safety gaps to stay inside property line
PROP_LINE_GAP = 0.25                     # keep geometry at least this far inside property line

# -------------------- Outputs --------------------
block_boundary      = None
curb_lines          = []
sidewalks           = []
lot_boundaries      = []
building_footprints = []
stoops              = []
rear_yards          = []
tree_pits           = []
site_info           = []

# -------------------- Helpers --------------------
def rect_poly(xmin, ymin, xmax, ymax):
    pts = [
        rg.Point3d(xmin, ymin, 0),
        rg.Point3d(xmax, ymin, 0),
        rg.Point3d(xmax, ymax, 0),
        rg.Point3d(xmin, ymax, 0),
        rg.Point3d(xmin, ymin, 0)
    ]
    return rg.PolylineCurve(pts)

def line_curve(p0, p1):
    return rg.PolylineCurve([p0, p1])

def make_block():
    # Outer PROPERTY rectangle (lots must stay inside this)
    return rect_poly(x0, y_bot, x1, y_top)

def make_sidewalks_and_curbs():
    # Sidewalk rectangles OUTSIDE property
    sw_n = rect_poly(x0, y_top, x1, y_top + sidewalk_w)
    sw_s = rect_poly(x0, y_bot - sidewalk_w, x1, y_bot)
    sidewalks = [sw_n, sw_s]
    # Curbs at outer sidewalk edges
    curb_n = line_curve(rg.Point3d(x0, curb_y_N, 0), rg.Point3d(x1, curb_y_N, 0))
    curb_s = line_curve(rg.Point3d(x0, curb_y_S, 0), rg.Point3d(x1, curb_y_S, 0))
    return sidewalks, [curb_n, curb_s]

def lot_widths_for_length(L, base_w, vary=False):
    if not vary:
        n = max(1, int(math.floor(L / base_w)))
        leftover = L - n * base_w
        start = -L * 0.5 + leftover * 0.5
        xs = [start + i * base_w for i in range(n+1)]
        return [base_w] * n, xs
    else:
        palette = [5.03, 6.10, 7.62]  # ~16.5', 20', 25'
        widths, total = [], 0.0
        while total + min(palette) <= L:
            w = random.choice(palette)
            if total + w > L:
                small = [p for p in palette if total + p <= L]
                if small:
                    w = random.choice(small)
                else:
                    break
            widths.append(w); total += w
        leftover = L - total
        start = -L * 0.5 + leftover * 0.5
        xs = [start]
        for w in widths: xs.append(xs[-1] + w)
        return widths, xs

def layout_row(y_front, is_north_side, widths, xs_edges):
    """
    All geometry stays INSIDE property line:
      - Buildings front face: at least PROP_LINE_GAP behind y_front
      - Stoops: never cross y_front - PROP_LINE_GAP (north) or y_front + PROP_LINE_GAP (south)
      - Sidewalks/trees live OUTSIDE property → guaranteed no overlap
    """
    for i in range(len(widths)):
        lx0, lx1 = xs_edges[i], xs_edges[i+1]
        # Lot rectangle (from property line to centerline)
        ly0 = y_front
        ly1 = y_front - lot_depth if is_north_side else y_front + lot_depth
        lot_crv = rect_poly(lx0, min(ly0, ly1), lx1, max(ly0, ly1))
        lot_boundaries.append(lot_crv)

        # Effective front line we must not cross (stay inside by PROP_LINE_GAP)
        if is_north_side:
            front_limit = y_front - PROP_LINE_GAP
        else:
            front_limit = y_front + PROP_LINE_GAP

        # Compute max build depth to keep required rear yard
        max_depth_by_yard = lot_depth - front_setback - rear_yard
        b_depth = max(0.0, min(building_max_d, max_depth_by_yard))
        if b_depth <= 0.25:
            site_info.append("Lot {} ({}): width {:.2f} m – No build (too shallow)".format(
                i+1, "N" if is_north_side else "S", (lx1-lx0)))
            continue

        side_margin = 0.15  # visual party-wall sliver
        bx0, bx1 = lx0 + side_margin, lx1 - side_margin

        # Building front line using input setback
        if is_north_side:
            bf_y = y_front - front_setback
            # Clamp to stay inside property
            bf_y = min(bf_y, front_limit)
            br_y = bf_y - b_depth
            b_crv = rect_poly(bx0, br_y, bx1, bf_y)
            building_footprints.append(b_crv)

            # Rear yard
            ry0 = br_y
            ry1 = max(ry0 - rear_yard, y_front - lot_depth)
            rear_yards.append(rect_poly(lx0, ry1, lx1, ry0))

            # Stoop strictly inside lot
            # Max allowed projection before property line
            max_stoop_len = max(0.0, (y_front - PROP_LINE_GAP) - bf_y)
            stoop_len = min(max_stoop_len, 2.5, max(0.0, front_setback - 0.5))
            if stoop_len > 0.0:
                mid = 0.5*(bx0+bx1); s_half = min(0.8, 0.4*(bx1-bx0))
                sx0, sx1 = mid - s_half, mid + s_half
                sy0, sy1 = bf_y, bf_y + stoop_len
                # safety clamp
                sy1 = min(sy1, y_front - PROP_LINE_GAP)
                stoops.append(rect_poly(sx0, sy0, sx1, sy1))

        else:
            bf_y = y_front + front_setback
            bf_y = max(bf_y, front_limit)
            br_y = bf_y + b_depth
            b_crv = rect_poly(bx0, bf_y, bx1, br_y)
            building_footprints.append(b_crv)

            ry1 = br_y
            ry0 = min(ry1 + rear_yard, y_front + lot_depth)
            rear_yards.append(rect_poly(lx0, ry1, lx1, ry0))

            max_stoop_len = max(0.0, bf_y - (y_front + PROP_LINE_GAP))
            stoop_len = min(max_stoop_len, 2.5, max(0.0, front_setback - 0.5))
            if stoop_len > 0.0:
                mid = 0.5*(bx0+bx1); s_half = min(0.8, 0.4*(bx1-bx0))
                sx0, sx1 = mid - s_half, mid + s_half
                sy1, sy0 = bf_y, bf_y - stoop_len
                sy0 = max(sy0, y_front + PROP_LINE_GAP)
                stoops.append(rect_poly(sx0, sy0, sx1, sy1))

        site_info.append("Lot {} ({}): {:.2f}×{:.2f} m | b_depth {:.2f} m | rear yard {:.2f} m".format(
            i+1, "N" if is_north_side else "S", (lx1-lx0), lot_depth, b_depth, rear_yard))

def add_street_trees(spacing_m=9.0, pit_radius=0.55):
    # Trees centered in sidewalks (which are OUTSIDE property)
    y_n = y_top + sidewalk_w * 0.5
    y_s = y_bot - sidewalk_w * 0.5

    L = block_length
    # start half-spacing in to look nice at ends
    count   = int(math.floor((L - spacing_m) / spacing_m)) + 1
    start_x = -0.5*L + 0.5*spacing_m
    xs = [start_x + i*spacing_m for i in range(count)]

    for xx in xs:
        tree_pits.append(rg.Circle(rg.Point3d(xx, y_n, 0), pit_radius).ToNurbsCurve())
        tree_pits.append(rg.Circle(rg.Point3d(xx, y_s, 0), pit_radius).ToNurbsCurve())

# -------------------- Build the block --------------------
block_boundary = make_block()

# Sidewalks and curbs OUTSIDE property
_sw, _curbs = make_sidewalks_and_curbs()
sidewalks.extend(_sw)
curb_lines.extend(_curbs)

# Two rows of lots/buildings INSIDE property
widths_N, edges_N = lot_widths_for_length(block_length, lot_width_in, vary=vary_widths)
layout_row(y_top,  True,  widths_N, edges_N)

widths_S, edges_S = lot_widths_for_length(block_length, lot_width_in, vary=vary_widths)
layout_row(y_bot,  False, widths_S, edges_S)

# Trees in sidewalks
add_street_trees(spacing_m=9.0, pit_radius=0.55)
# ---------- end python_3_script_3 ----------
python_3_script_4 = Python3Script()  # -> out, right_of_way, curb_lines, sidewalks, parkways, property_lines, lot_boundaries, house_footprints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
# ---------- python_3_script_4: Python ----------
"""
SUBURBAN LOT GENERATOR (California / Long Island)

Grasshopper Python Component

INPUTS (all optional; sensible defaults applied):
- region          : str  -> "CA" or "LI" (affects typical setbacks/depths). Default "CA"
- block_length    : float (m) length along street (default 183.0 ≈ 600 ft)
- lot_width       : float (m) typical lot width (default CA: 15.0 ≈ 50 ft, LI: 18.3 ≈ 60 ft)
- lot_depth       : float (m) depth from property line to back (default CA: 30.5 ≈ 100 ft, LI: 36.6 ≈ 120 ft)
- front_setback   : float (m) default CA: 6.0, LI: 7.6
- side_setback    : float (m) default CA: 1.5, LI: 2.4
- rear_setback    : float (m) default CA: 6.0, LI: 9.0
- sidewalk_w      : float (m) default 1.8
- parkway_w       : float (m) default 1.8
- carriageway_w   : float (m) curb-to-curb pave width (default 10.5)
- both_sides      : bool default True (generate lots on both sides)
- vary_widths     : bool default False (use common local widths to fill the block neatly)
- double_driveway : bool default True (double-width driveway), else single
- seed            : int default 42

OUTPUTS:
- right_of_way      : Curve (outer rectangle around street + sidewalks + parkways)
- curb_lines        : List[Curve] (2)
- sidewalks         : List[Curve] (up to 2 rectangles)
- parkways          : List[Curve] (up to 2 rectangles)
- property_lines    : List[Curve] (front property lines north/south that lots align to)
- lot_boundaries    : List[Curve] (closed)
- house_footprints  : List[Curve] (closed, inside setbacks)
- garage_pads       : List[Curve] (closed, front bay)
- driveways         : List[Curve] (rectangles from curb to garage)
- rear_yards        : List[Curve] (closed)
- tree_pits         : List[Curve] (circles in parkway, auto-skip at driveways)
- site_info         : List[str] (per lot)
"""

import Rhino.Geometry as rg
import math, random

# -------------------- Inputs & defaults --------------------
def _val(name, default):
    return globals()[name] if name in globals() and globals()[name] is not None else default

region         = str(_val('region', "CA")).upper()
block_length   = float(_val('block_length', 183.0))
seed           = int(_val('seed', 42))
both_sides     = bool(_val('both_sides', True))
vary_widths    = bool(_val('vary_widths', False))
double_drive   = bool(_val('double_driveway', True))

# Region presets
if region == "LI":
    lot_width_def   = 18.3   # ~60 ft
    lot_depth_def   = 36.6   # ~120 ft
    front_set_def   = 7.6    # ~25 ft
    side_set_def    = 2.4    # ~8 ft
    rear_set_def    = 9.0    # ~30 ft
else:
    lot_width_def   = 15.0   # ~50 ft
    lot_depth_def   = 30.5   # ~100 ft
    front_set_def   = 6.0    # ~20 ft
    side_set_def    = 1.5    # ~5 ft
    rear_set_def    = 6.0    # ~20 ft

lot_width     = float(_val('lot_width',     lot_width_def))
lot_depth     = float(_val('lot_depth',     lot_depth_def))
front_setback = float(_val('front_setback', front_set_def))
side_setback  = float(_val('side_setback',  side_set_def))
rear_setback  = float(_val('rear_setback',  rear_set_def))
sidewalk_w    = float(_val('sidewalk_w',    1.8))
parkway_w     = float(_val('parkway_w',     1.8))
carriage_w    = float(_val('carriageway_w', 10.5))

random.seed(seed)

# Derived ROW
row_half = (carriage_w * 0.5) + sidewalk_w + parkway_w  # from centerline to far curb + walk + parkway
right_of_way_y0 = -row_half
right_of_way_y1 =  row_half

# Driveway + garage defaults
drive_w  = 5.5 if double_drive else 3.0   # ~18 ft or ~10 ft
garage_d = 6.0                            # ~20 ft deep bay inside lot
garage_extra_w = 0.6                      # garage a tad wider than driveway
tree_spacing = 10.0                       # meters between street trees
tree_radius  = 0.5                        # tree pit radius
tree_keepout = 0.5                        # extra lateral buffer from driveway edge

# Safety gap to keep geometry within lines
PROP_GAP = 0.15

# -------------------- Outputs --------------------
right_of_way     = None
curb_lines       = []
sidewalks        = []
parkways         = []
property_lines   = []
lot_boundaries   = []
house_footprints = []
garage_pads      = []
driveways        = []
rear_yards       = []
tree_pits        = []
site_info        = []

# -------------------- Helpers --------------------
def rect_poly(xmin, ymin, xmax, ymax):
    pts = [
        rg.Point3d(xmin, ymin, 0),
        rg.Point3d(xmax, ymin, 0),
        rg.Point3d(xmax, ymax, 0),
        rg.Point3d(xmin, ymax, 0),
        rg.Point3d(xmin, ymin, 0)
    ]
    return rg.PolylineCurve(pts)

def line_curve(p0, p1):
    return rg.PolylineCurve([p0, p1])

def lot_widths_for_length(L, base_w, vary=False, region="CA"):
    if not vary:
        n = max(1, int(math.floor(L / base_w)))
        leftover = L - n * base_w
        start = -L*0.5 + leftover*0.5
        xs = [start + i*base_w for i in range(n+1)]
        return [base_w]*n, xs
    # palettes of common local widths (meters)
    if region == "LI":
        palette = [15.24, 18.29, 21.34]  # ~50', 60', 70'
    else:
        palette = [12.19, 15.24, 18.29]  # ~40', 50', 60'
    widths, total = [], 0.0
    while total + min(palette) <= L:
        w = random.choice(palette)
        if total + w > L:
            small = [p for p in palette if total + p <= L]
            if small:
                w = random.choice(small)
            else:
                break
        widths.append(w); total += w
    leftover = L - total
    start = -L*0.5 + leftover*0.5
    xs = [start]
    for w in widths: xs.append(xs[-1] + w)
    return widths, xs

def make_row_geometry(side="N"):
    """
    side: "N" for north (y positive), "S" for south (y negative)
    Returns a dict of y refs for curb, parkway band, sidewalk band, and property front line.
    """
    if side == "N":
        curb_y     =  right_of_way_y1
        park_min_y =  curb_y - parkway_w
        park_max_y =  curb_y
        walk_min_y =  park_min_y - sidewalk_w
        walk_max_y =  park_min_y
        prop_y     =  walk_min_y  # property front line is at back of sidewalk
    else:
        curb_y     =  right_of_way_y0
        park_min_y =  curb_y
        park_max_y =  curb_y + parkway_w
        walk_min_y =  park_max_y
        walk_max_y =  park_max_y + sidewalk_w
        prop_y     =  walk_max_y  # back of sidewalk
    return {
        "curb_y": curb_y,
        "park_min": min(park_min_y, park_max_y),
        "park_max": max(park_min_y, park_max_y),
        "walk_min": min(walk_min_y, walk_max_y),
        "walk_max": max(walk_min_y, walk_max_y),
        "prop_y": prop_y
    }

def layout_lots_on_side(side, widths, xs_edges):
    yref = make_row_geometry(side)
    curb_y, prop_y = yref["curb_y"], yref["prop_y"]
    # Bands
    park_rect = rect_poly(-block_length*0.5, yref["park_min"],  block_length*0.5, yref["park_max"])
    walk_rect = rect_poly(-block_length*0.5, yref["walk_min"],  block_length*0.5, yref["walk_max"])
    parkways.append(park_rect)
    sidewalks.append(walk_rect)
    property_lines.append(line_curve(rg.Point3d(-block_length*0.5, prop_y, 0), rg.Point3d(block_length*0.5, prop_y, 0)))
    curb_lines.append(line_curve(rg.Point3d(-block_length*0.5, curb_y, 0), rg.Point3d(block_length*0.5, curb_y, 0)))

    is_north = (side == "N")
    depth_sign = 1.0 if is_north else -1.0

    # Collect driveway spans to later avoid trees
    driveway_spans = []

    for i in range(len(widths)):
        lx0, lx1 = xs_edges[i], xs_edges[i+1]
        lw = lx1 - lx0

        # Lot rect (property line to back)
        back_y = prop_y + depth_sign * lot_depth
        lot_crv = rect_poly(lx0, min(prop_y, back_y), lx1, max(prop_y, back_y))
        lot_boundaries.append(lot_crv)

        # Buildable width and house plan width
        plan_w = max(0.0, lw - 2.0*side_setback)
        # House depth (keep rear yard)
        max_house_depth = max(0.0, lot_depth - front_setback - rear_setback)
        if max_house_depth < 2.0 or plan_w < 4.0:
            site_info.append("Lot {} ({}): width {:.2f} m -> no build (too small)".format(
                i+1, side, lw))
            continue

        # Building front line at setback
        bf_y = prop_y + depth_sign * front_setback
        # House rectangle (centered)
        hx0 = lx0 + side_setback + PROP_GAP
        hx1 = lx1 - side_setback - PROP_GAP
        hdepth = min(max_house_depth, 20.0 if region=="CA" else 22.0)  # a sensible cap
        hnear = bf_y
        hfar  = bf_y + depth_sign * hdepth
        house = rect_poly(hx0, min(hnear, hfar), hx1, max(hnear, hfar))
        house_footprints.append(house)

        # Garage bay (front portion of house)
        gw = min(plan_w, drive_w + garage_extra_w)
        # Place garage off one side (alternating left/right by lot index)
        left_bias = (i % 2 == 0)
        if left_bias:
            gx0 = hx0
            gx1 = min(hx0 + gw, hx1)
        else:
            gx1 = hx1
            gx0 = max(hx1 - gw, hx0)

        gy0 = bf_y
        gy1 = bf_y + depth_sign * min(garage_d, hdepth)  # keep inside house depth
        garage = rect_poly(gx0, min(gy0, gy1), gx1, max(gy0, gy1))
        garage_pads.append(garage)

        # Driveway (from curb to garage front line across parkway+sidewalk+front yard)
        # Drive aligned to garage center
        gmid = 0.5*(gx0 + gx1)
        dx0 = gmid - 0.5*drive_w
        dx1 = gmid + 0.5*drive_w
        dy0 = curb_y
        dy1 = bf_y  # to garage front line
        drv = rect_poly(dx0, min(dy0, dy1), dx1, max(dy0, dy1))
        driveways.append(drv)
        driveway_spans.append((dx0, dx1))

        # Rear yard (house back to lot rear, within lot)
        ry_a = hfar
        ry_b = prop_y + depth_sign * (front_setback + hdepth + rear_setback)
        # clamp to lot bounds
        rear_min = min(back_y, ry_a)
        rear_max = max(back_y, ry_a)
        if is_north:
            rmin = min(ry_a, back_y)
            rmax = max(ry_a, back_y)
        else:
            rmin = min(back_y, ry_a)
            rmax = max(back_y, ry_a)
        # make a rectangular band across full lot width
        rear = rect_poly(lx0, min(ry_a, back_y), lx1, max(ry_a, back_y))
        rear_yards.append(rear)

        site_info.append(
            "Lot {} ({}): {:.2f}×{:.2f} m | house {:.2f}×{:.2f} m | driveway {:.2f} m"
            .format(i+1, side, lw, lot_depth, (hx1-hx0), abs(hdepth), drive_w)
        )

    # Street trees (in parkway), avoid driveway spans
    # Parkway centerline y:
    py = 0.5*(yref["park_min"] + yref["park_max"])
    L = block_length
    count = int(math.floor((L - tree_spacing)/tree_spacing)) + 1
    start_x = -0.5*L + 0.5*tree_spacing
    for k in range(count):
        xx = start_x + k*tree_spacing
        # skip if within any driveway span + buffer
        blocked = False
        for (sx0, sx1) in driveway_spans:
            if (xx > (sx0 - tree_radius - tree_keepout)) and (xx < (sx1 + tree_radius + tree_keepout)):
                blocked = True
                break
        if not blocked:
            tree_pits.append(rg.Circle(rg.Point3d(xx, py, 0), tree_radius).ToNurbsCurve())

# -------------------- Build ROW + sides --------------------
# Right-of-way rectangle (for reference)
right_of_way = rect_poly(-block_length*0.5, right_of_way_y0, block_length*0.5, right_of_way_y1)

# Generate lot widths (shared for both sides to keep symmetry)
widths, edges = lot_widths_for_length(block_length, lot_width, vary=vary_widths, region=region)

# North side
layout_lots_on_side("N", widths, edges)

# South side (optional)
if both_sides:
    layout_lots_on_side("S", widths, edges)
# ---------- end python_3_script_4 ----------
number_slider_3 = Slider(10, range=0..112)  # disabled
python_3_script_5 = Python3Script()  # -> out, ai_response
# ---------- python_3_script_5: Python ----------
# GHPython (CPython in Rhino 8) or Python Script with requests available
import requests

ai_response = ""
user_input = ""
timestamp = ""
error = None

try:
    r = requests.get("http://127.0.0.1:5000/last", timeout=1)  # use 127.0.0.1, not localhost
    if r.ok:
        data = r.json()
        ai_response = data.get("ai_response", "")
        user_input  = data.get("user_input", "")
        timestamp   = data.get("timestamp", "")
    else:
        error = "HTTP {}".format(r.status_code)
except Exception as e:
    error = str(e)
# ---------- end python_3_script_5 ----------
# {
#   name: Pond View L-Shaped House,
#   description: 3-bedroom house oriented to maximize pond views with L-shaped layout embracing the landscape,
#   nodes: [
#     {id: entry, type: entry, x: 7, y: 10, width: 2, height: 2, color: #795548, doorPosition: north, wallThickness: 0.2},
#     {id: foyer, type: circulation, x: 7, y: 8, width: 2, height: 2, color: #795548, wallThickness: 0.1},
#     {id: hallway, type: circulation, x: 5, y: 7, width: 8, height: 1, color: #795548, wallThickness: 0.1},
#     {id: living, type: living_room, x: 7, y: 3, width: 6, height: 5, color: #4CAF50, wallThickness: 0.15, features: [pond_view, floor_to_ceiling_windows]},
#     {id: dining, type: dining_room, x: 4, y: 4, width: 3, height: 4, color: #9C27B0, wallThickness: 0.15, features: [pond_view]},
#     {id: kitchen, type: kitchen, x: 1, y: 5, width: 3, height: 3, color: #FF9800, wallThickness: 0.15, features: [island, pond_view]},
#     {id: terrace, type: outdoor_deck, x: 7, y: 0, width: 6, height: 3, color: #8BC34A, wallThickness: 0, features: [covered, pond_facing]},
#     {id: bedroom_master, type: bedroom_master, x: 13, y: 5, width: 4, height: 4, color: #2196F3, wallThickness: 0.15, features: [pond_view, tree_view]},
#     {id: bathroom_master, type: bathroom_master, x: 13, y: 9, width: 2.5, height: 2.5, color: #FFC107, wallThickness: 0.1},
#     {id: walkin_closet, type: storage, x: 15.5, y: 9, width: 1.5, height: 2.5, color: #9E9E9E, wallThickness: 0.1},
#     {id: bedroom_2, type: bedroom_secondary, x: 9, y: 10, width: 3.5, height: 3, color: #2196F3, wallThickness: 0.15, features: [tree_view]},
#     {id: bedroom_3, type: bedroom_secondary, x: 12.5, y: 12, width: 3.5, height: 3, color: #2196F3, wallThickness: 0.15, features: [tree_view]},
#     {id: bathroom_common, type: bathroom_common, x: 10, y: 8, width: 2, height: 2, color: #FFC107, wallThickness: 0.1},
#     {id: study, type: study, x: 4, y: 8, width: 3, height: 2.5, color: #607D8B, wallThickness: 0.15},
#     {id: garage, type: garage, x: 4, y: 11, width: 4, height: 3, color: #757575, wallThickness: 0.2, doorPosition: north},
#     {id: laundry, type: utility, x: 1, y: 8, width: 2, height: 2, color: #9E9E9E, wallThickness: 0.15}
#   ],
#   edges: [
#     {from: entry, to: foyer},
#     {from: foyer, to: hallway},
#     {from: foyer, to: living},
#     {from: hallway, to: living},
#     {from: hallway, to: dining},
#     {from: hallway, to: kitchen},
#     {from: hallway, to: bedroom_master},
#     {from: hallway, to: bedroom_2},
#     {from: hallway, to: bedroom_3},
#     {from: hallway, to: bathroom_common},
#     {from: hallway, to: study},
#     {from: hallway, to: laundry},
#     {from: living, to: dining},
#     {from: dining, to: kitchen},
#     {from: living, to: terrace},
#     {from: bedroom_master, to: bathroom_master},
#     {from: bathroom_master, to: walkin_closet},
#     {from: garage, to: laundry},
#     {from: garage, to: entry}
#   ],
#   site: {
#     width: 18,
#     height: 16,
#     features: {
#       pond: {x: 10, y: -3, radius: 4},
#       trees: [
#         {x: 2, y: 13, radius: 1.5},
#         {x: 3, y: 15, radius: 1.2},
#         {x: 16, y: 3, radius: 1.8},
#         {x: 17, y: 2, radius: 1.3}
#       ],
#       road: {type: access, position: north}
#     }
#   },
#   design_principles: {
#     orientation: L-shaped plan with main axis north-south,
#     views: Living spaces and master bedroom oriented to pond,
#     privacy: Bedrooms positioned with tree buffer zones,
#     circulation: Central hallway connecting all spaces,
#     outdoor: Covered terrace extends living space to pond
#   }
# }
panel_3 = Panel("""south
north
east
west""")
boolean_toggle_2 = BooleanToggle(True)  # disabled
python_3_script_6 = Python3Script(num_lots=number_slider, seed=number_slider_2)  # -> out, site_boundaries, buildable_zones, water_features, tree_zones, access_roads, site_info; inputs num_lots: Int32, seed: Int32; disabled
# ---------- python_3_script_6: Python ----------
"""
SIMPLIFIED RURAL LOT GENERATOR
Grasshopper Python Component for Quick Site Variations

INPUTS:
- num_lots: Integer (1-20) - Number of lots to generate
- seed: Integer - Random seed for variations
- one_per_lot: Boolean (optional) - Force exactly 1 buildable zone per lot

OUTPUTS:
- site_boundaries: Site boundary curves
- buildable_zones: Building areas (rectangles)
- water_features: Ponds/streams
- tree_zones: Tree circles
- access_roads: Entry roads (curves routed around obstacles)
- site_info: Data for each lot
"""

import Rhino
import Rhino.Geometry as rg
import math
import random
import heapq

# -------------------------
# Output lists
# -------------------------
site_boundaries = []
buildable_zones = []
water_features = []
tree_zones = []
access_roads = []
site_info = []

# -------------------------
# Defaults
# -------------------------
if num_lots is None: num_lots = 4
if seed is None:     seed = 42
if 'one_per_lot' not in globals() or one_per_lot is None:
    one_per_lot = True

# -------------------------
# Tunables
# -------------------------
TOL               = 1e-3
TREE_CLEAR_PAD    = 0.0   # keep 0 for hard no-intersection
WATER_CLEAR_PAD   = 0.0
ROAD_STEP_DEFAULT = 5.0   # A* grid spacing (m)
ROAD_CLEAR        = 2.5   # min clearance road→obstacles (m)
ROAD_MAX_RETRIES  = 2     # retries with smaller step if path fails
SMOOTH_SAMPLES    = 25    # samples for line-of-sight checks

# Lot size definitions (in meters)
LOT_SIZES = {
    "Small":  {"width": 50,  "depth": 60,  "building_size": 15},
    "Medium": {"width": 70,  "depth": 80,  "building_size": 20},
    "Large":  {"width": 100, "depth": 100, "building_size": 30},
    "XL":     {"width": 150, "depth": 120, "building_size": 40}
}

# -------------------------
# Helpers (polyline extraction fixed for your Rhino)
# -------------------------
def curve_contains_point(curve, pt, tol=TOL):
    try:
        rc = curve.Contains(pt, rg.Plane.WorldXY, tol)
    except TypeError:
        rc = curve.Contains(pt)
    return rc in (rg.PointContainment.Inside, rg.PointContainment.Coincident)

def poly_points(crv, min_count=5):
    """Get polyline points from a curve. Prefer TryGetPolyline; fallback to uniform sampling."""
    try:
        ok, pl = crv.TryGetPolyline()
        if ok:
            return [pl[i] for i in range(pl.Count)]
    except Exception:
        pass
    # Fallback: sample points along domain
    dom = crv.Domain
    n = max(min_count, 5)
    pts = [crv.PointAt(dom.T0 + (dom.T1-dom.T0)*i/float(n-1)) for i in range(n)]
    return pts

def rect_polyline(x, y, w, h):
    pts = [
        rg.Point3d(x, y, 0),
        rg.Point3d(x + w, y, 0),
        rg.Point3d(x + w, y + h, 0),
        rg.Point3d(x, y + h, 0),
        rg.Point3d(x, y, 0)
    ]
    return rg.PolylineCurve(pts)

def rect_corners(rect_crv):
    pts = poly_points(rect_crv)
    return pts[:4] if len(pts) >= 4 else pts

def rect_inside_boundary(boundary, rect_crv, tol=TOL):
    # Prefer robust region containment
    try:
        rel = rg.Curve.PlanarClosedCurveRelationship(rect_crv, boundary, rg.Plane.WorldXY, tol)
        return rel == rg.RegionContainment.AInsideB
    except:
        # Fallback: all corners inside & no intersections
        corners = rect_corners(rect_crv)
        if any(not curve_contains_point(boundary, c, tol) for c in corners):
            return False
        ccx = Rhino.Geometry.Intersect.Intersection.CurveCurve(boundary, rect_crv, tol, tol)
        return (ccx is None) or (ccx.Count == 0)

def curves_intersect(a, b, tol=TOL):
    ccx = Rhino.Geometry.Intersect.Intersection.CurveCurve(a, b, tol, tol)
    return (ccx is not None) and (ccx.Count > 0)

def closed_curves_disjoint(a_closed, b_closed, tol=TOL):
    try:
        rel = rg.Curve.PlanarClosedCurveRelationship(a_closed, b_closed, rg.Plane.WorldXY, tol)
        if rel != rg.RegionContainment.Disjoint:
            return False
    except:
        pass
    if curves_intersect(a_closed, b_closed, tol):
        return False
    return True

def _circle_from_curve(curve):
    ok, circ = curve.TryGetCircle()
    return ok, circ

def min_dist_point_to_curve(pt, crv):
    ok, t = crv.ClosestPoint(pt)
    if not ok:
        return float('inf')
    p = crv.PointAt(t)
    return pt.DistanceTo(p)

def segment_clear(segment_start, segment_end, boundary, trees, waters, extra_clear, samples=SMOOTH_SAMPLES):
    """Check that segment stays inside boundary and outside obstacles with clearance."""
    for i in range(samples+1):
        t = float(i)/samples
        x = (1-t)*segment_start.X + t*segment_end.X
        y = (1-t)*segment_start.Y + t*segment_end.Y
        p = rg.Point3d(x, y, 0)
        if not curve_contains_point(boundary, p):
            return False
        # trees
        for tree in trees:
            ok, circ = _circle_from_curve(tree)
            if ok:
                if p.DistanceTo(circ.Center) < (circ.Radius + extra_clear - 1e-6):
                    return False
            else:
                bb = tree.GetBoundingBox(True)
                r  = 0.5*max(bb.Max.X-bb.Min.X, bb.Max.Y-bb.Min.Y)
                c  = bb.Center
                if p.DistanceTo(c) < (r + extra_clear - 1e-6):
                    return False
        # water
        for w in waters:
            if min_dist_point_to_curve(p, w) < (extra_clear - 1e-6):
                return False
    # also check curve intersections
    seg_crv = rg.PolylineCurve([segment_start, segment_end])
    for w in waters:
        if curves_intersect(seg_crv, w):
            return False
    for tcrv in trees:
        if curves_intersect(seg_crv, tcrv):
            return False
    return True

# -------------------------
# Lot generation
# -------------------------
def create_organic_boundary(width, depth, center_x, center_y):
    num_sides = random.randint(6, 10)
    pts = []
    for i in range(num_sides):
        angle = (2 * math.pi * i / num_sides) + random.uniform(-0.2, 0.2)
        avg_radius = (width + depth) / 4.0
        radius = avg_radius + random.uniform(-avg_radius * 0.3, avg_radius * 0.3)
        x = center_x + width/2.0 + radius * math.cos(angle)
        y = center_y + depth/2.0 + radius * math.sin(angle)
        pts.append(rg.Point3d(x, y, 0))
    pts.append(pts[0])
    return rg.PolylineCurve(pts)

def add_water_feature(boundary):
    features = []
    bbox = boundary.GetBoundingBox(True)
    if random.random() < 0.5:
        feature_type = random.choice(["pond", "stream"])
        if feature_type == "pond":
            for _ in range(30):
                x = random.uniform(bbox.Min.X + 15, bbox.Max.X - 15)
                y = random.uniform(bbox.Min.Y + 15, bbox.Max.Y - 15)
                if not curve_contains_point(boundary, rg.Point3d(x, y, 0)):
                    continue
                radius = random.uniform(5, 12)
                pond = rg.Circle(rg.Point3d(x, y, 0), radius)
                rect = rect_polyline(x - radius, y - radius, 2*radius, 2*radius)
                if rect_inside_boundary(boundary, rect):
                    features.append(pond.ToNurbsCurve())
                    break
        else:
            pts = []
            for i in range(5):
                t = i/4.0
                x = bbox.Min.X + (bbox.Max.X - bbox.Min.X)*(0.1 + 0.8*t)
                y = bbox.Min.Y + (bbox.Max.Y - bbox.Min.Y)*(0.2 + 0.6*t + math.sin(t*math.pi)*0.2)
                pts.append(rg.Point3d(x, y, 0))
            if curve_contains_point(boundary, pts[0]) and curve_contains_point(boundary, pts[-1]):
                features.append(rg.Curve.CreateInterpolatedCurve(pts, 3))
    return features

def add_trees(boundary, density):
    trees = []
    tree_positions = []
    bbox = boundary.GetBoundingBox(True)
    num_clusters = int(density)
    for _ in range(num_clusters):
        for _try in range(30):
            x = random.uniform(bbox.Min.X + 5, bbox.Max.X - 5)
            y = random.uniform(bbox.Min.Y + 5, bbox.Max.Y - 5)
            if curve_contains_point(boundary, rg.Point3d(x, y, 0)):
                break
        else:
            continue
        for _ in range(random.randint(3, 6)):
            attempts = 0
            while attempts < 20:
                tx = x + random.uniform(-8, 8)
                ty = y + random.uniform(-8, 8)
                pt = rg.Point3d(tx, ty, 0)
                if not curve_contains_point(boundary, pt):
                    attempts += 1
                    continue
                r = random.uniform(2, 4)
                valid = True
                for ep, er in tree_positions:
                    if pt.DistanceTo(ep) < (r + er + 1.0):
                        valid = False
                        break
                if valid:
                    tree = rg.Circle(pt, r)
                    trees.append(tree.ToNurbsCurve())
                    tree_positions.append((pt, r))
                    break
                attempts += 1
    return trees

def _tree_center_and_radius(curve):
    ok, circ = curve.TryGetCircle()
    if ok:
        return circ.Center, circ.Radius
    bb = curve.GetBoundingBox(True)
    center = bb.Center
    radius = 0.5*max(bb.Max.X-bb.Min.X, bb.Max.Y-bb.Min.Y)
    return center, radius

# -------------------------
# Pad placement (no intersections)
# -------------------------
def pad_intersects_obstacles(pad_rect, trees, waters):
    for tcrv in trees:
        if not closed_curves_disjoint(pad_rect, tcrv):
            return True
    for w in waters:
        if w.IsClosed:
            if not closed_curves_disjoint(pad_rect, w):
                return True
        else:
            if curves_intersect(pad_rect, w):
                return True
    return False

def place_building_zones(boundary, size_info, trees, waters):
    zones = []
    bbox = boundary.GetBoundingBox(True)
    building_size = size_info["building_size"]
    w, h = building_size, building_size*0.8

    front_setback = 9 if size_info == LOT_SIZES["Small"] else 12
    side_setback  = 3 if size_info == LOT_SIZES["Small"] else 5
    rear_setback  = 7.5

    x_min = bbox.Min.X + side_setback
    x_max = bbox.Max.X - side_setback - w
    y_min = bbox.Min.Y + front_setback
    y_max = bbox.Max.Y - rear_setback - h

    if (x_max <= x_min) or (y_max <= y_min):
        return zones

    desired_zones = 1 if one_per_lot else random.randint(1,2)
    attempts_per_zone = 100

    for zi in range(desired_zones):
        placed = False
        for _ in range(attempts_per_zone):
            x = random.uniform(x_min, x_max)
            y = random.uniform(y_min, y_max)
            rect = rect_polyline(x, y, w, h)

            if not rect_inside_boundary(boundary, rect):
                continue
            if pad_intersects_obstacles(rect, trees, waters):
                continue

            ok_spacing = True
            for ex in zones:
                c1 = rect.GetBoundingBox(True).Center
                c2 = ex.GetBoundingBox(True).Center
                if rg.Point3d(c1.X, c1.Y, 0).DistanceTo(rg.Point3d(c2.X, c2.Y, 0)) < building_size*1.2:
                    ok_spacing = False
                    break
            if not ok_spacing:
                continue

            zones.append(rect)
            placed = True
            break

        if not placed and zi == 0:
            for _ in range(120):
                x = random.uniform(bbox.Min.X + 5, bbox.Max.X - w - 5)
                y = random.uniform(bbox.Min.Y + 5, bbox.Max.Y - h - 5)
                rect = rect_polyline(x, y, w, h)
                if not rect_inside_boundary(boundary, rect):
                    continue
                if pad_intersects_obstacles(rect, trees, waters):
                    continue
                zones.append(rect)
                break

    return zones

# -------------------------
# Road routing (A* inside lot, obstacle-avoiding)
# -------------------------
def snap_to_grid(pt, origin, step):
    gx = int(round((pt.X - origin.X)/step))
    gy = int(round((pt.Y - origin.Y)/step))
    return gx, gy

def grid_to_point(g, origin, step):
    x = origin.X + g[0]*step
    y = origin.Y + g[1]*step
    return rg.Point3d(x, y, 0)

def is_blocked_point(p, boundary, trees, waters, extra_clear):
    if not curve_contains_point(boundary, p):
        return True
    for tcrv in trees:
        ok, circ = _circle_from_curve(tcrv)
        if ok:
            if p.DistanceTo(circ.Center) < (circ.Radius + extra_clear):
                return True
        else:
            bb = tcrv.GetBoundingBox(True)
            r  = 0.5*max(bb.Max.X-bb.Min.X, bb.Max.Y-bb.Min.Y)
            c  = bb.Center
            if p.DistanceTo(c) < (r + extra_clear):
                return True
    for w in waters:
        if min_dist_point_to_curve(p, w) < extra_clear:
            return True
    return False

def build_nav_mask(boundary, trees, waters, pads, step):
    bb = boundary.GetBoundingBox(True)
    ox = math.floor(bb.Min.X/step)*step
    oy = math.floor(bb.Min.Y/step)*step
    origin = rg.Point3d(ox, oy, 0)

    def blocked_ij(i, j):
        p = grid_to_point((i,j), origin, step)
        for rect in pads:
            if curve_contains_point(rect, p):
                return True
        return is_blocked_point(p, boundary, trees, waters, ROAD_CLEAR)

    return origin, blocked_ij, bb

def astar_path(start_pt, goal_pt, origin, blocked_ij, bb, step, max_expand=50000):
    si, sj = snap_to_grid(start_pt, origin, step)
    gi, gj = snap_to_grid(goal_pt,  origin, step)

    imin = int(math.floor((bb.Min.X - origin.X)/step)) - 2
    jmin = int(math.floor((bb.Min.Y - origin.Y)/step)) - 2
    imax = int(math.ceil((bb.Max.X - origin.X)/step)) + 2
    jmax = int(math.ceil((bb.Max.Y - origin.Y)/step)) + 2

    def in_bounds(i,j):
        return (imin <= i <= imax) and (jmin <= j <= jmax)

    def h(i,j):
        return math.hypot(i-gi, j-gj)

    def nearest_free(i0, j0, r=4):
        best = None
        bestd = 1e9
        for di in range(-r, r+1):
            for dj in range(-r, r+1):
                ii, jj = i0+di, j0+dj
                if not in_bounds(ii, jj): continue
                if blocked_ij(ii, jj):     continue
                d = di*di + dj*dj
                if d < bestd:
                    bestd = d
                    best = (ii, jj)
        return best

    if blocked_ij(si, sj):
        nf = nearest_free(si, sj, r=4)
        if nf is None: return None
        si, sj = nf
    if blocked_ij(gi, gj):
        nf = nearest_free(gi, gj, r=4)
        if nf is None: return None
        gi, gj = nf

    open_set = []
    heapq.heappush(open_set, (h(si,sj), 0.0, (si,sj), None))
    came = {}
    gscore = {(si,sj): 0.0}
    visited = set()
    expands = 0

    moves = [(-1,0,1.0),(1,0,1.0),(0,-1,1.0),(0,1,1.0),
             (-1,-1,math.sqrt(2)),(-1,1,math.sqrt(2)),
             (1,-1,math.sqrt(2)), (1,1,math.sqrt(2))]

    while open_set:
        _, g, node, parent = heapq.heappop(open_set)
        if node in visited: continue
        came[node] = parent
        visited.add(node)
        expands += 1
        if expands > max_expand:
            return None

        if node == (gi, gj):
            path = []
            cur = node
            while cur is not None:
                path.append(cur)
                cur = came[cur]
            path.reverse()
            pts = [grid_to_point(n, origin, step) for n in path]
            return pts

        i, j = node
        for di,dj,cost in moves:
            ii, jj = i+di, j+dj
            if not in_bounds(ii, jj): continue
            if blocked_ij(ii, jj):    continue
            ng = g + cost
            if (ii,jj) not in gscore or ng < gscore[(ii,jj)]:
                gscore[(ii,jj)] = ng
                f = ng + h(ii,jj)
                heapq.heappush(open_set, (f, ng, (ii,jj), node))
    return None

def los_simplify(points, boundary, trees, waters, extra_clear, samples=SMOOTH_SAMPLES):
    if not points or len(points) <= 2:
        return points[:]
    simplified = [points[0]]
    i = 0
    while i < len(points)-1:
        j = len(points)-1
        while j > i+1:
            if segment_clear(points[i], points[j], boundary, trees, waters, extra_clear, samples):
                break
            j -= 1
        simplified.append(points[j])
        i = j
    return simplified

def pick_entry_point(boundary):
    bb = boundary.GetBoundingBox(True)
    return rg.Point3d((bb.Min.X + bb.Max.X)/2.0, bb.Min.Y, 0)

def pick_pad_approach_point(pad_rect, from_point):
    pts = poly_points(pad_rect)
    if len(pts) < 2:
        return pad_rect.GetBoundingBox(True).Center
    edges = []
    for i in range(1, len(pts)):
        a = pts[i-1]; b = pts[i]
        mid = rg.Point3d((a.X+b.X)/2.0, (a.Y+b.Y)/2.0, 0)
        edges.append((mid, a, b))
    best = min(edges, key=lambda e: e[0].DistanceTo(from_point))
    return best[0]

def route_road(boundary, trees, waters, pads):
    if not pads:
        return None
    entry = pick_entry_point(boundary)
    target = pick_pad_approach_point(pads[0], entry)

    step = ROAD_STEP_DEFAULT
    for _attempt in range(ROAD_MAX_RETRIES+1):
        origin, blocked, bb = build_nav_mask(boundary, trees, waters, pads, step)
        pts = astar_path(entry, target, origin, blocked, bb, step)
        if pts is None:
            step *= 0.5
            continue
        pts = los_simplify(pts, boundary, trees, waters, ROAD_CLEAR)
        crv = rg.PolylineCurve(pts) if len(pts) == 2 else rg.Curve.CreateInterpolatedCurve(pts, 3)

        ok = True
        for tcrv in trees:
            if curves_intersect(crv, tcrv):
                ok = False; break
        if ok:
            for w in waters:
                if curves_intersect(crv, w):
                    ok = False; break
        if ok:
            return crv
        step *= 0.5
    return None

# -------------------------
# MAIN
# -------------------------
def create_organic_boundary(width, depth, center_x, center_y):
    num_sides = random.randint(6, 10)
    pts = []
    for i in range(num_sides):
        angle = (2 * math.pi * i / num_sides) + random.uniform(-0.2, 0.2)
        avg_radius = (width + depth) / 4.0
        radius = avg_radius + random.uniform(-avg_radius * 0.3, avg_radius * 0.3)
        x = center_x + width/2.0 + radius * math.cos(angle)
        y = center_y + depth/2.0 + radius * math.sin(angle)
        pts.append(rg.Point3d(x, y, 0))
    pts.append(pts[0])
    return rg.PolylineCurve(pts)

def generate():
    lot_types = ["Small", "Medium", "Large", "XL"]
    grid_cols = 4
    spacing   = 200

    for i in range(int(num_lots)):
        random.seed(int(seed) + i*100)

        lot_type = lot_types[i % 4] if i < 4 else random.choice(lot_types)
        size_info = LOT_SIZES[lot_type]

        col = i % grid_cols
        row = i // grid_cols
        cx  = col * spacing
        cy  = row * spacing

        boundary = create_organic_boundary(size_info["width"], size_info["depth"], cx, cy)

        waters = add_water_feature(boundary) if lot_type in ["Large", "XL"] else []
        tree_density = 2 if lot_type == "Small" else (3 if lot_type == "Medium" else 5)
        trees  = add_trees(boundary, tree_density)

        pads   = place_building_zones(boundary, size_info, trees, waters)
        road   = route_road(boundary, trees, waters, pads)

        info = "{} LOT #{}\nSize: {}x{}m\nTrees: {}\nPads: {}\nRoad: {}".format(
            lot_type.upper(), i+1,
            size_info["width"], size_info["depth"],
            len(trees), len(pads),
            "Yes" if road else "No path"
        )

        site_boundaries.append(boundary)
        buildable_zones.extend(pads)
        water_features.extend(waters)
        tree_zones.extend(trees)
        if road: access_roads.append(road)
        site_info.append(info)

generate()
# ---------- end python_3_script_6 ----------
panel_4 = Panel("""south
north
east
west""")
toggle = BooleanToggle(False)  # disabled
panel_5 = Panel("""south
north
east
west""")
python_3_script_7 = Python3Script(json_text=python_3_script_5.ai_response)  # -> out, Centers, Volumes, Names, Edges, Colors
# ---------- python_3_script_7: Python ----------
# Grasshopper Python (Rhino 7/8). Inputs: json_text
# Outputs: Volumes (Breps), Centers (Points), Names (Strings), Edges (Curves), Colors (System.Drawing.Color[])

import json, re, math
import Rhino.Geometry as rg
import System.Drawing as sd

# -------------------------
# Helpers: robust JSON parse
# -------------------------
def _strip_fences(s):
    return re.sub(r'^\s*```(?:json)?\s*|\s*```\s*$', '', s, flags=re.S)

def _extract_json(s):
    s = _strip_fences(s or "")
    start = s.find('{')
    if start < 0: raise ValueError("No '{' found")
    i = start; depth = 0; in_str = False; esc = False
    while i < len(s):
        ch = s[i]
        if in_str:
            if esc: esc = False
            elif ch == '\\': esc = True
            elif ch == '"': in_str = False
        else:
            if ch == '"': in_str = True
            elif ch == '{': depth += 1
            elif ch == '}':
                depth -= 1
                if depth == 0: return s[start:i+1]
        i += 1
    raise ValueError("Unbalanced braces")

def parse_json(text):
    js = _extract_json(text)
    return json.loads(js)

# -------------------------
# Geometry heuristics
# -------------------------
def type_params(room_type, name):
    t = (room_type or "").lower()
    n = (name or "").lower()
    min_w, aspect = 2.6, 1.4
    if "circulation" in t or "hall" in n: return 1.20, 3.0
    if "stair" in n:                     return 2.00, 1.2
    if "bath" in n or "wc" in n:         return 1.60, 1.1
    if "kitchen" in n:                   return 2.40, 1.5
    if "living" in n or "dining" in n:   return 3.50, 1.6
    if "bed" in n or "private" in t:     return 2.80, 1.3
    if "outdoor" in t or "terrace" in n: return 3.00, 2.0
    if "service" in t:                   return 2.40, 1.4
    if "public" in t:                    return 3.20, 1.5
    return min_w, aspect

def dims_from_area(area_m2, min_w, aspect):
    A = max(0.1, float(area_m2))
    w = math.sqrt(A * aspect)
    h = A / w
    if w < min_w:
        w = float(min_w); h = A / w
    ratio = w / max(0.001, h)
    if ratio < 0.55:
        w = math.sqrt(A * 0.55); h = A / w
    elif ratio > 2.5:
        w = math.sqrt(A * 2.5);  h = A / w
    return w, h

def rect_brep_centered(cx, cy, z, w, h, tol=1e-6):
    hw, hh = 0.5 * w, 0.5 * h
    pts = [
        rg.Point3d(cx - hw, cy - hh, z),
        rg.Point3d(cx + hw, cy - hh, z),
        rg.Point3d(cx + hw, cy + hh, z),
        rg.Point3d(cx - hw, cy + hh, z),
        rg.Point3d(cx - hw, cy - hh, z),
    ]
    crv = rg.Polyline(pts).ToNurbsCurve()
    breps = rg.Brep.CreatePlanarBreps(crv, tol)
    return (breps[0] if breps and len(breps) else None), crv

# -------------------------
# Sun orientation → color
# -------------------------
_BASE_DIRS = {
    'n': (0.0, 1.0),
    'e': (1.0, 0.0),
    's': (0.0,-1.0),
    'w': (-1.0,0.0)
}

def parse_sun_to_vector(s):
    """Parse 'south', 'south-east', 'SE', 'south-east' (unicode dash) → 2D unit vector. None if unknown."""
    if not s: return None
    t = s.lower()
    # normalize separators (space, _, -, en/em dashes, non-breaking hyphen)
    t = re.sub(u"[\\s_\\-\\u2010-\\u2015]+", " ", t)   # collapse to spaces
    t = t.replace("north", "n").replace("south", "s").replace("east", "e").replace("west", "w")
    t = t.replace("northeast","n e").replace("northwest","n w").replace("southeast","s e").replace("southwest","s w")
    parts = re.findall(r"[nsew]", t)
    if not parts: return None
    vx = sum(_BASE_DIRS[p][0] for p in parts)
    vy = sum(_BASE_DIRS[p][1] for p in parts)
    mag = math.hypot(vx, vy)
    if mag == 0: return None
    return (vx/mag, vy/mag)

def hsv_to_color(h_deg, s=0.85, v=0.95):
    """HSV (0-360, 0-1, 0-1) → System.Drawing.Color"""
    h = (h_deg % 360.0) / 60.0
    i = int(math.floor(h)) % 6
    f = h - math.floor(h)
    p = v * (1.0 - s)
    q = v * (1.0 - s * f)
    t = v * (1.0 - s * (1.0 - f))
    r,g,b = {
        0: (v,t,p),
        1: (q,v,p),
        2: (p,v,t),
        3: (p,q,v),
        4: (t,p,v),
        5: (v,p,q),
    }[i]
    return sd.Color.FromArgb(int(r*255), int(g*255), int(b*255))

def sun_to_color(s):
    """Map orientation to a hue. Default gray if unknown."""
    v = parse_sun_to_vector(s)
    if v is None:
        return sd.Color.FromArgb(200,200,200)
    # angle from +X axis (east). Hue wraps 0..360
    ang = math.degrees(math.atan2(v[1], v[0]))  # E=0°, N=90°, W=180°, S=-90°
    hue = (ang + 360.0) % 360.0
    return hsv_to_color(hue, s=0.85, v=0.95)

# -------------------------
# Main
# -------------------------
Volumes, Centers, Names, Edges, Colors = [], [], [], [], []

try:
    data = parse_json(json_text)
except Exception as e:
    ghenv.Component.AddRuntimeMessage(2, "JSON parse error: {}".format(e))
    data = None

if data:
    nodes = data.get("nodes", {})
    edges = data.get("edges", [])

    # Parameters
    floor_height = 3.2  # meters per floor
    z0 = 0.0            # ground datum
    centers_by_id = {}

    # 1) Create room rectangles + colors
    for rid, info in nodes.items():
        name  = info.get("name", rid)
        rtype = info.get("type", "")
        floor = int(info.get("floor", 0))
        cx, cy = info.get("coords", [0.0, 0.0])[:2]
        A      = float(info.get("area_m2", 12.0))
        sun    = info.get("sun", "")

        min_w, aspect = type_params(rtype, name)
        w, h = dims_from_area(A, min_w, aspect)
        z = z0 + floor * floor_height

        brep, _ = rect_brep_centered(cx, cy, z, w, h)
        if brep is None:
            ghenv.Component.AddRuntimeMessage(2, "Failed to build rectangle for '{}'".format(name))
            continue

        Volumes.append(brep)
        Centers.append(rg.Point3d(cx, cy, z))
        Names.append(name)
        centers_by_id[rid] = rg.Point3d(cx, cy, z)

        Colors.append(sun_to_color(sun))

    # 2) Relationship edges (center-to-center lines)
    for pair in edges:
        if not isinstance(pair, (list, tuple)) or len(pair) != 2:
            continue
        a, b = pair
        pa = centers_by_id.get(a)
        pb = centers_by_id.get(b)
        if pa and pb:
            Edges.append(rg.Line(pa, pb).ToNurbsCurve())

# Optional debug
# print("Rooms:", len(Volumes), "Edges:", len(Edges))
# ---------- end python_3_script_7 ----------
panel_6 = Panel("""south
north
east
west""")
rectangle = Rectangle(Plane=PlaneXY(0, 0, 0), XSize=Slider(40, range=0..100), YSize=Slider(40, range=0..100), Radius=0)  # -> Rectangle, Length
number_slider_4 = Slider(3, range=0..10)  # disabled
curve = Curve(python_3_script_3.stoops)
curve_2 = Curve(python_3_script_3.sidewalks)
list_length = ListLength(List=panel_3)
py3 = Python3Script(db_path=db_path, table_descriptions_path=table_description_path, knowledge_pool_path=file_path, run=toggle)  # -> out, a, question_classification, response, unit_ids, panel_types; disabled
# ---------- py3: Python ----------
import requests
import re
from ghpythonlib.treehelpers import list_to_tree

url = 'http://localhost:5000/llm_call'
# print(f"Sending db_path: {db_path}")
payload = {
    'input': input_text,
    'db_path': db_path,
    'table_descriptions_path':table_descriptions_path,
    'knowledge_pool_path':knowledge_pool_path,
}
print(payload)


response = None
question_classification = None
json_data = None

if run:
    response = requests.post(url, json=payload)
    
    if response.status_code == 200:
        data = response.json()
        response = data['response']
        
        # Extract question classification from first json_values item
        if data['json_values'] and len(data['json_values']) > 0:
            first_item = data['json_values'][0]
            question_classification = first_item.get('question classification', 'unknown')
            json_data = data['json_values']
        
        # print(f"Response: {out}")
        # print(f"Classification: {question_classification}")
        print(f"Full data: {data}")
    else:
        out = "Failed to connect:"

print(response)
if isinstance(response, list):
    response = list_to_tree(response)



# def parse_output_string(response_string):
#     # Extract tuples using regex
#     pattern = r'\((\d+),\s*\'([^\']+)\'\)'
#     matches = re.findall(pattern, response_string)
    
#     # Convert to separate lists
#     unit_ids = [int(match[0]) for match in matches]
#     panel_types = [match[1] for match in matches]
    
#     return unit_ids, panel_types

# # Parse the response
# unit_ids, panel_types = parse_output_string(a)

# print(f"Unit IDs: {unit_ids[:5]}...")  # First 5
# print(f"Panel Types: {panel_types[:5]}...")  # First 5
# print(f"Total entries: {len(unit_ids)}")
# ---------- end py3 ----------
list_length_2 = ListLength(List=panel_4)
python_3_script_8 = Python3Script(run=Toggle(False), project_name="housesv0", input_text=panel, api_mode="local", model="gpt-oss-20b")  # -> out, response
# ---------- python_3_script_8: Python ----------
import requests
import re
from ghpythonlib.treehelpers import list_to_tree

url = 'http://localhost:5000/llm_call'
# print(f"Sending db_path: {db_path}")
payload = {
    'input_text': str(input_text),
    'api_mode': str(api_mode),
    'model': str(model),
    'project_name': str(project_name)
}

print(payload)


response = None
question_classification = None
json_data = None

if run:
    response = requests.post(url, json=payload)
    
    if response.status_code == 200:
        data = response.json()
        response = data['response']
        print(response)
        
        # # Extract question classification from first json_values item
        # if data['json_values'] and len(data['json_values']) > 0:
        #     first_item = data['json_values'][0]
        #     question_classification = first_item.get('question classification', 'unknown')
        #     json_data = data['json_values']
        
        # # print(f"Response: {out}")
        # # print(f"Classification: {question_classification}")
        # print(f"Full data: {data}")
    else:
        out = "Failed to connect:"
# ---------- end python_3_script_8 ----------
list_length_3 = ListLength(List=panel_5)
curve_3 = Curve(python_3_script_4.house_footprints)
list_length_4 = ListLength(List=panel_6)
curve_4 = Curve(python_3_script_6.tree_zones)  # disabled
curve_5 = Curve(python_3_script_6.buildable_zones)  # disabled
curve_6 = Curve(python_3_script_6.access_roads)  # disabled
construct_domain = ConstructDomain(DomainStart=0, DomainEnd=list_length)
curve_7 = Curve(python_3_script_6.site_boundaries)  # disabled
panel_7 = Panel(python_3_script_5.ai_response)
construct_domain_2 = ConstructDomain(DomainStart=0, DomainEnd=list_length_2)
construct_domain_3 = ConstructDomain(DomainStart=0, DomainEnd=list_length_3)
negative = Negative(Value=number_slider_4)  # disabled
number_slider_5 = Slider(3, range=0..10)  # disabled
construct_domain_4 = ConstructDomain(DomainStart=0, DomainEnd=list_length_4)
data_recorder = DataRecorder(python_3_script_5.ai_response, DataLimit=-10, RecordData=True)
boundary_surfaces = BoundarySurfaces(Edges=curve_4)  # disabled
number_slider_6 = Slider(4, range=0..10)  # disabled
number_slider_7 = Slider(313344, range=0..1000000)  # disabled
colour_swatch = ColourSwatch(SwatchColor=RGB(0, 0, 0))  # disabled
boundary_surfaces_2 = BoundarySurfaces(Edges=curve_7)  # disabled
area = Area(Geometry=curve_5)  # -> Area, Centroid; disabled
brep = Brep(python_3_script_7.Volumes)
offset_curve = OffsetCurve(Curve=curve_6, Plane=PlaneXY(0, 0, 0), Distance=number_slider_4, BothSides=negative, Kinks=0, CapType=1)  # disabled
number_slider_8 = Slider(1000, range=0..1000)
random = Random(Range=construct_domain, Number=1, Seed=number_slider_8)
round = Round(Number=random)  # -> Nearest, Floor, Ceiling
number_slider_9 = Slider(4, range=0..1000)
random_2 = Random(Range=construct_domain_2, Number=1, Seed=number_slider_9)
round_2 = Round(Number=random_2)  # -> Nearest, Floor, Ceiling
number_slider_10 = Slider(2, range=0..1000)
random_3 = Random(Range=construct_domain_3, Number=1, Seed=number_slider_10)
round_3 = Round(Number=random_3)  # -> Nearest, Floor, Ceiling
number_slider_11 = Slider(0, range=0..1000)
random_4 = Random(Range=construct_domain_4, Number=1, Seed=number_slider_11)
round_4 = Round(Number=random_4)  # -> Nearest, Floor, Ceiling
curve_8 = Curve(python_3_script_7.Edges)
unit_z = UnitZ(Factor=Slider(2.8, range=0..10))
text_tag_3d = TextTag3D(Location=python_3_script_7.Centers, Text=python_3_script_7.Names, Size=Slider(0.6, range=0..1), Justification=7)
custom_preview_lineweights = CustomPreviewLineweights(Geometry=curve_7, Shader=colour_swatch, Thickness=number_slider_5, Absolute=False)  # disabled
boundary_surfaces_3 = BoundarySurfaces(Edges=curve_5)  # disabled
list_item = ListItem(List=panel_3, Index=round.Floor, Wrap=True)
boundary_surfaces_4 = BoundarySurfaces(Edges=offset_curve)  # disabled
list_item_2 = ListItem(List=panel_4, Index=round_2.Floor, Wrap=True)
panel_8 = Panel(python_3_script_8.response)
list_item_3 = ListItem(List=panel_5, Index=round_3.Floor, Wrap=True)
colour_swatch_2 = ColourSwatch(SwatchColor=RGB(106, 217, 78))  # disabled
list_item_4 = ListItem(List=panel_6, Index=round_4.Floor, Wrap=True)
colour_swatch_3 = ColourSwatch(SwatchColor=RGB(158, 158, 158))  # disabled
circle = Circle(Plane=python_3_script_7.Centers, Radius=1)
extrude = Extrude(Base=brep, Direction=unit_z)
colour_swatch_4 = ColourSwatch(SwatchColor=RGB(240, 182, 182))  # disabled
colour_swatch_5 = ColourSwatch(SwatchColor=RGB(255, 255, 255))  # disabled
python_3_script_9 = Python3Script(
    seed=number_slider_9,
    sides_min=Slider(4, range=0..10),
    sides_max=Slider(8, range=0..10),
    tree_clusters=Slider(8, range=0..10),
    ROAD_FILLET_RADIUS=Slider(2, range=0..10),
    ROAD_MIN_SEG_LEN=Slider(2, range=0..10),
    entrance_side=list_item_2)  # -> out, site_boundaries, buildable_zones, water_features, tree_zones, access_roads, site_info; inputs seed: Int32, ROAD_FILLET_RADIUS: Int32, ROAD_MIN_SEG_LEN: Int32
# ---------- python_3_script_9: Python ----------
"""
SINGLE LOT GENERATOR (Fast, Pond-Guaranteed, Hardened)
Grasshopper Python Component

GOAL:
- Generate ONE large lot (default "XL")
- Always include an organic pond (and possibly a stream)
- Trees & pads placed quickly (site-aware, always inside boundary)
- Road touches boundary & pad, straight ends, filleted interior (no tiny curls)
- Auto-retry site features if road fails (few quick attempts)
- Hardened against invalid curves (no CurveCurve null crashes)

INPUTS (optional sliders/text):
- seed: Integer - Random seed
- one_per_lot: Boolean (default True)
- entrance_side: "south" | "north" | "east" | "west" (default "south")
- lot_type: "Large" | "XL" (default "XL")
- tree_clusters: Integer - clusters of trees (≈3–5 trees/cluster)
- sides_min / sides_max: Integers - polygon side count range
- pad_tree_clear (m), pad_water_clear (m), pad_setback (m)
- pond_radius (m), tree_water_clear (m)

OUTPUTS:
- site_boundaries: [single boundary curve]
- buildable_zones: [rect(s)]
- water_features: [pond (always) + optional stream]
- tree_zones: [tree circles]
- access_roads: [single road curve]
- site_info: [string summary]
"""

import Rhino
import Rhino.Geometry as rg
import math
import random
import heapq

# -------------------------
# Output lists
# -------------------------
site_boundaries = []
buildable_zones = []
water_features = []
tree_zones = []
access_roads = []
site_info = []

# -------------------------
# Defaults / Inputs
# -------------------------
if 'seed' not in globals() or seed is None: seed = 42
if 'one_per_lot' not in globals() or one_per_lot is None: one_per_lot = True
if 'entrance_side' not in globals() or entrance_side not in ("south","north","east","west"):
    entrance_side = "south"
if 'lot_type' not in globals() or lot_type not in ("Large","XL"): lot_type = "XL"
if 'sides_min' not in globals() or sides_min is None: sides_min = 7
if 'sides_max' not in globals() or sides_max is None: sides_max = 10
if 'tree_clusters' not in globals() or tree_clusters is None: tree_clusters = 4

# Pad & water clearances (sliders recommended)
if 'pad_tree_clear' not in globals() or pad_tree_clear is None: pad_tree_clear = 2.0
if 'pad_water_clear' not in globals() or pad_water_clear is None: pad_water_clear = 5.0
if 'pad_setback'    not in globals() or pad_setback    is None: pad_setback    = 10.0  # inward setback from boundary


if 'tree_water_clear' not in globals() or tree_water_clear is None: tree_water_clear = 0.3
# ---- Pond shape sliders (add Number/Integer Sliders in GH to these names) ----
if 'pond_radius'      not in globals() or pond_radius is None:      pond_radius = 15.0   # overall size
if 'pond_points'      not in globals() or pond_points is None:      pond_points = 48    # smoothness (more = smoother)
if 'pond_noise'       not in globals() or pond_noise is None:       pond_noise = 0.22   # wobbliness amplitude
if 'pond_lobes_min'   not in globals() or pond_lobes_min is None:   pond_lobes_min = 2  # low freq (fewer lobes)
if 'pond_lobes_max'   not in globals() or pond_lobes_max is None:   pond_lobes_max = 4  # high freq (more lobes)

# Smooth approach into the pad
if 'MAX_DEFLECTION_DEG' not in globals() or MAX_DEFLECTION_DEG is None:
    MAX_DEFLECTION_DEG = 55.0    # corner softening threshold before fillet
if 'APPROACH_LEAD_IN' not in globals() or APPROACH_LEAD_IN is None:
    APPROACH_LEAD_IN = max(6.0, 1.6*ROAD_FILLET_RADIUS, 1.2*ROAD_MIN_SEG_LEN)
# -------------------------
# Tunables (favor speed)
# -------------------------
TOL                  = 1e-3
ROAD_STEP_DEFAULT    = 6.0     # coarse grid
ROAD_CLEAR           = 2.5     # road clearance to trees/water
ROAD_MAX_RETRIES     = 1
SMOOTH_SAMPLES       = 12
ROAD_TOUCH_INSET     = 0.5
PAD_APPROACH_CLEAR   = 0.6
ROAD_MIN_SEG_LEN     = 3.5
ROAD_FILLET_RADIUS   = 9.0
ANGLE_COLLINEAR_DEG  = 5.0
SAMPLE_PER_METER     = 0.35
MAX_SITE_RETRIES     = 2
TURN_PENALTY         = 0.20     # A* turn cost (straighter paths)

# Pond shape controls
POND_POINTS     = 48
POND_NOISE_AMPL = 0.22
POND_LOBES_MIN  = 2
POND_LOBES_MAX  = 6

# Pad & fillet hygiene
PAD_SOFTEN_STEPS    = [0.0, 0.4, 0.8]
MIN_PAD_SCALE       = 0.70
GRID_DENSITY_MULT   = 1.25
MIN_FILLETABLE_SEG  = 1.2 * ROAD_FILLET_RADIUS
MIN_FILLET_ARC_LEN  = 1.5

# Lot sizes (m)
LOT_SIZES = {
    "Large": {"width": 100, "depth": 100, "building_size": 30},
    "XL":    {"width": 150, "depth": 120, "building_size": 40}
}

# -------------------------
# Safety helpers (avoid null/invalid curve crashes)
# -------------------------
def is_valid_curve(c):
    try:
        return (c is not None) and hasattr(c, "IsValid") and c.IsValid
    except:
        return False

def sanitize_curves(curves):
    out = []
    for c in (curves or []):
        if not is_valid_curve(c): continue
        try:
            L = 0.0
            try: L = c.GetLength()
            except: L = 0.0
            bb = c.GetBoundingBox(True)
            span = max(bb.Max.X - bb.Min.X, bb.Max.Y - bb.Min.Y)
            if (L and L > 1e-9) or span > 1e-6 or c.IsClosed:
                out.append(c)
        except:
            pass
    return out

# -------------------------
# Geometry helpers
# -------------------------
def curve_contains_point(curve, pt, tol=TOL):
    if not is_valid_curve(curve): return False
    try:
        rc = curve.Contains(pt, rg.Plane.WorldXY, tol)
    except TypeError:
        rc = curve.Contains(pt)
    return rc in (rg.PointContainment.Inside, rg.PointContainment.Coincident)

def poly_points(crv, min_count=5):
    if not is_valid_curve(crv): return []
    try:
        ok, pl = crv.TryGetPolyline()
        if ok: return [pl[i] for i in range(pl.Count)]
    except Exception:
        pass
    dom = crv.Domain
    n = max(min_count, 5)
    return [crv.PointAt(dom.T0 + (dom.T1-dom.T0)*i/float(n-1)) for i in range(n)]

def rect_polyline(x, y, w, h):
    pts = [rg.Point3d(x,y,0), rg.Point3d(x+w,y,0), rg.Point3d(x+w,y+h,0),
           rg.Point3d(x,y+h,0), rg.Point3d(x,y,0)]
    return rg.PolylineCurve(pts)

def rect_corners(rect_crv):
    pts = poly_points(rect_crv)
    return pts[:4] if len(pts) >= 4 else pts

def curves_intersect(a, b, tol=TOL):
    if not is_valid_curve(a) or not is_valid_curve(b): return False
    try:
        ccx = Rhino.Geometry.Intersect.Intersection.CurveCurve(a, b, tol, tol)
        return (ccx is not None) and (ccx.Count > 0)
    except:
        return False

def closed_curves_disjoint(a_closed, b_closed, tol=TOL):
    if not is_valid_curve(a_closed) or not is_valid_curve(b_closed): return True
    try:
        rel = rg.Curve.PlanarClosedCurveRelationship(a_closed, b_closed, rg.Plane.WorldXY, tol)
        if rel != rg.RegionContainment.Disjoint: return False
    except:
        pass
    return not curves_intersect(a_closed, b_closed, tol)

def curve_inside_boundary(boundary, closed_curve, tol=TOL):
    if not is_valid_curve(boundary) or not is_valid_curve(closed_curve): return False
    try:
        rel = rg.Curve.PlanarClosedCurveRelationship(closed_curve, boundary, rg.Plane.WorldXY, tol)
        return rel == rg.RegionContainment.AInsideB
    except:
        L = max(8, int(max(1.0, closed_curve.GetLength())/4.0))
        for i in range(L+1):
            p = closed_curve.PointAtNormalizedLength(float(i)/max(1, L))
            if not curve_contains_point(boundary, p): return False
        return True

def _circle_from_curve(curve):
    if not is_valid_curve(curve): return False, None
    ok, circ = curve.TryGetCircle()
    return ok, circ

def min_dist_point_to_curve(pt, crv):
    if not is_valid_curve(crv): return float('inf')
    try:
        ok, t = crv.ClosestPoint(pt)
        if not ok: return float('inf')
        p = crv.PointAt(t)
        return pt.DistanceTo(p)
    except:
        return float('inf')

def distance(a, b): return a.DistanceTo(b)

def angle_deg(u, v):
    uu = rg.Vector3d(u); vv = rg.Vector3d(v)
    if uu.IsTiny() or vv.IsTiny(): return 0.0
    uu.Unitize(); vv.Unitize()
    d = max(-1.0, min(1.0, rg.Vector3d.Multiply(uu, vv)))
    return math.degrees(math.acos(d))

def curve_centroid(closed_curve):
    if not is_valid_curve(closed_curve):
        return rg.Point3d(0,0,0)
    try:
        amp = rg.AreaMassProperties.Compute(closed_curve)
        if amp: return amp.Centroid
    except:
        pass
    return closed_curve.GetBoundingBox(True).Center

# -------------------------
# Lot & features
# -------------------------
def create_organic_boundary(width, depth, center_x=0.0, center_y=0.0):
    num_sides = random.randint(int(sides_min), int(sides_max))
    pts = []
    for i in range(num_sides):
        angle = (2*math.pi*i/num_sides) + random.uniform(-0.18, 0.18)
        avg_radius = (width + depth)/4.0
        radius = avg_radius + random.uniform(-avg_radius*0.25, avg_radius*0.25)
        x = center_x + width/2.0 + radius * math.cos(angle)
        y = center_y + depth/2.0 + radius * math.sin(angle)
        pts.append(rg.Point3d(x, y, 0))
    pts.append(pts[0])
    return rg.PolylineCurve(pts)

def make_organic_blob(center, base_r, rng=None, pts=POND_POINTS, ampl=POND_NOISE_AMPL,
                      lobes_min=POND_LOBES_MIN, lobes_max=POND_LOBES_MAX):
    if rng is None: rng = random
    cx, cy = center.X, center.Y
    comps = []
    for _ in range(rng.randint(2, 3)):
        f  = rng.randint(lobes_min, lobes_max)
        ph = rng.uniform(0.0, 2.0*math.pi)
        w  = rng.uniform(0.35, 1.0)
        comps.append((f, ph, w))
    pts3d = []
    for i in range(pts):
        t = 2.0*math.pi * i / float(pts)
        k = 1.0
        for f, ph, w in comps:
            k += ampl * w * math.sin(f*t + ph)
        r = max(0.2*base_r, base_r * k)
        pts3d.append(rg.Point3d(cx + r*math.cos(t), cy + r*math.sin(t), 0.0))
    try:
        crv = rg.NurbsCurve.CreateThroughPoints(pts3d, 3, True)
        if crv and crv.IsClosed: return crv
    except:
        pass
    pts3d.append(pts3d[0])
    crv = rg.Curve.CreateInterpolatedCurve(pts3d, 3)
    if not crv.IsClosed: crv.MakeClosed(TOL)
    return crv

def add_water_feature(boundary, must_have_pond=True):
    features = []
    bbox = boundary.GetBoundingBox(True)

    # Pond (guaranteed)
    placed_pond = False
    for _ in range(40):
        x = random.uniform(bbox.Min.X + 18, bbox.Max.X - 18)
        y = random.uniform(bbox.Min.Y + 18, bbox.Max.Y - 18)
        if not curve_contains_point(boundary, rg.Point3d(x, y, 0)): continue
        base_r = float(pond_radius)
        pond = make_organic_blob(
            rg.Point3d(x, y, 0),
            base_r,
            random,
            int(pond_points),
            float(pond_noise),
            int(pond_lobes_min),
            int(pond_lobes_max)
        )
        if pond and pond.IsClosed and curve_inside_boundary(boundary, pond):
            features.append(pond); placed_pond = True; break
    if must_have_pond and not placed_pond:
        c = curve_centroid(boundary)
        features.append(rg.Circle(c, float(pond_radius)).ToNurbsCurve())

    # Optional stream
    if random.random() < 0.4:
        pts = []
        for i in range(5):
            t = i/4.0
            x = bbox.Min.X + (bbox.Max.X - bbox.Min.X)*(0.15 + 0.7*t)
            y = bbox.Min.Y + (bbox.Max.Y - bbox.Min.Y)*(0.25 + 0.5*t + math.sin(t*math.pi)*0.18)
            pts.append(rg.Point3d(x, y, 0))
        if curve_contains_point(boundary, pts[0]) and curve_contains_point(boundary, pts[-1]):
            features.append(rg.Curve.CreateInterpolatedCurve(pts, 3))

    return sanitize_curves(features)

def add_trees(boundary, density, waters):
    """Clusters of trees that DO NOT intersect water (ponds/streams)."""
    waters = sanitize_curves(waters)
    trees = []
    tree_positions = []
    bbox = boundary.GetBoundingBox(True)
    num_clusters = int(max(0, density))

    def tree_hits_water(center_pt, radius):
        circ_crv = rg.Circle(center_pt, radius).ToNurbsCurve()
        for w in waters:
            if w.IsClosed:
                if not closed_curves_disjoint(circ_crv, w):
                    return True
            else:
                if min_dist_point_to_curve(center_pt, w) < (radius + float(tree_water_clear) - 1e-6):
                    return True
        return False

    for _ in range(num_clusters):
        # cluster center
        for _try in range(20):
            x = random.uniform(bbox.Min.X + 6, bbox.Max.X - 6)
            y = random.uniform(bbox.Min.Y + 6, bbox.Max.Y - 6)
            cpt = rg.Point3d(x, y, 0)
            if not curve_contains_point(boundary, cpt): 
                continue
            if tree_hits_water(cpt, 0.0):
                continue
            break
        else:
            continue

        # trees in the cluster
        for _ in range(random.randint(3, 5)):
            attempts = 0
            while attempts < 16:
                tx = x + random.uniform(-7, 7)
                ty = y + random.uniform(-7, 7)
                pt = rg.Point3d(tx, ty, 0)
                if not curve_contains_point(boundary, pt):
                    attempts += 1; continue
                r = random.uniform(2, 4)

                ok = True
                for ep, er in tree_positions:
                    if pt.DistanceTo(ep) < (r + er + 1.0):
                        ok = False; break
                if not ok:
                    attempts += 1; continue

                if tree_hits_water(pt, r):
                    attempts += 1; continue

                trees.append(rg.Circle(pt, r).ToNurbsCurve())
                tree_positions.append((pt, r))
                break

    return sanitize_curves(trees)

# -------------------------
# Pads (site-aware, robust)
# -------------------------
def oriented_rect(center, w, h, angle_rad):
    hw, hh = 0.5*w, 0.5*h
    pts = [rg.Point3d(-hw,-hh,0), rg.Point3d(hw,-hh,0), rg.Point3d(hw,hh,0),
           rg.Point3d(-hw,hh,0), rg.Point3d(-hw,-hh,0)]
    crv = rg.PolylineCurve(pts)
    R = rg.Transform.Rotation(angle_rad, rg.Vector3d(0,0,1), rg.Point3d(0,0,0))
    T = rg.Transform.Translation(center - rg.Point3d(0,0,0))
    crv.Transform(R); crv.Transform(T)
    return crv

def rect_has_clearance(rect_crv, trees, waters, tree_clear, water_clear, samples=32):
    trees  = sanitize_curves(trees)
    waters = sanitize_curves(waters)
    for i in range(samples):
        p = rect_crv.PointAtNormalizedLength(float(i)/max(1, samples-1))
        for tcrv in trees:
            ok, circ = _circle_from_curve(tcrv)
            if ok:
                if p.DistanceTo(circ.Center) < (circ.Radius + tree_clear - 1e-6): return False
            else:
                bb = tcrv.GetBoundingBox(True)
                r  = 0.5*max(bb.Max.X-bb.Min.X, bb.Max.Y-bb.Min.Y)
                c  = bb.Center
                if p.DistanceTo(c) < (r + tree_clear - 1e-6): return False
        for w in waters:
            if min_dist_point_to_curve(p, w) < (water_clear - 1e-6): return False
    for w in waters:
        if curves_intersect(rect_crv, w): return False
    for t in trees:
        if curves_intersect(rect_crv, t): return False
    return True

def inward_offset(curve, setback):
    """Return largest inward offset loop by 'setback' (or None if impossible)."""
    if not is_valid_curve(curve): return None
    if setback <= 0: return curve
    def pick_inside(offsets):
        best = None; bestA = -1.0
        if not offsets: return None
        for c in offsets:
            if not is_valid_curve(c) or not c.IsClosed: continue
            cent = curve_centroid(c)
            if curve_contains_point(curve, cent):
                amp = rg.AreaMassProperties.Compute(c)
                A = amp.Area if amp else 0.0
                if A > bestA: bestA, best = A, c
        return best
    try:
        offs = curve.Offset(rg.Plane.WorldXY, -abs(float(setback)), TOL, rg.CurveOffsetCornerStyle.Sharp)
        best = pick_inside(offs)
        if best: return best
        offs = curve.Offset(rg.Plane.WorldXY,  abs(float(setback)), TOL, rg.CurveOffsetCornerStyle.Sharp)
        return pick_inside(offs)
    except:
        return None

def place_building_zones(boundary, size_info, trees, waters, one_per=True):
    """Site-aware placement: inside inward-offset envelope, buffered from features; returns 1 pad if feasible."""
    envelope = inward_offset(boundary, float(pad_setback))
    if envelope is None:
        envelope = inward_offset(boundary, max(0.0, 0.5*float(pad_setback))) or boundary

    zones = []
    building_size = size_info["building_size"]
    base_w, base_h = building_size, building_size*0.8

    # entry bias
    _, entry_in = boundary_touch_points(boundary, entrance_side, 0.5)

    # sample inside envelope
    bb = envelope.GetBoundingBox(True)
    margin = 6.0
    span_x = max(0.1, (bb.Max.X - bb.Min.X - 2*margin))
    span_y = max(0.1, (bb.Max.Y - bb.Min.Y - 2*margin))
    xs = int(max(6, (span_x / max(6.0, base_w*0.6)) * GRID_DENSITY_MULT))
    ys = int(max(6, (span_y / max(6.0, base_h*0.6)) * GRID_DENSITY_MULT))
    gx = [bb.Min.X+margin + i*(span_x/max(1, xs-1)) for i in range(xs)]
    gy = [bb.Min.Y+margin + j*(span_y/max(1, ys-1)) for j in range(ys)]

    # orientations: axis + face entry
    angs = [0.0, math.pi/2]
    def angle_to(a, b):
        v = rg.Vector3d(b.X-a.X, b.Y-a.Y, 0.0)
        if v.IsTiny(): return 0.0
        return math.atan2(v.Y, v.X)
    facing = []
    if gx and gy:
        for ix in range(0, len(gx), max(1, len(gx)//4)):
            for iy in range(0, len(gy), max(1, len(gy)//4)):
                cpt = rg.Point3d(gx[ix], gy[iy], 0)
                facing.append(angle_to(cpt, entry_in))
    angs += facing + [a + math.pi/2 for a in facing]
    angs = [((a + 2*math.pi) % (2*math.pi)) for a in angs]
    angs = [angs[i] for i in range(len(angs)) if i == 0 or abs(angs[i]-angs[i-1]) > 1e-3]

    # scoring: short drive + pleasant pond distance
    W_DRIVE, W_POND = -0.06, 0.08
    IDEAL_MIN, IDEAL_MAX = 18.0, 60.0
    def pond_score(pt):
        if not waters: return 0.0
        dmin = min(min_dist_point_to_curve(pt, w) for w in waters)
        if dmin < IDEAL_MIN:  return (dmin-IDEAL_MIN)*0.02
        if dmin > IDEAL_MAX:  return (IDEAL_MAX-dmin)*0.01
        mid = 0.5*(IDEAL_MIN+IDEAL_MAX)
        return 1.0 - abs(dmin - mid)/(0.5*(IDEAL_MAX-IDEAL_MIN))
    def score_rect(rect):
        c = rect.GetBoundingBox(True).Center
        return W_DRIVE * c.DistanceTo(entry_in) + W_POND * pond_score(rg.Point3d(c.X, c.Y, 0))

    trees  = sanitize_curves(trees)
    waters = sanitize_curves(waters)

    for soften in PAD_SOFTEN_STEPS:
        for scale in [1.0, 0.9, 0.8, MIN_PAD_SCALE]:
            w, h = base_w*scale, base_h*scale
            best_rect, best_score = None, -1e9
            tree_clear = max(0.0, float(pad_tree_clear)  - soften)
            water_clear= max(0.0, float(pad_water_clear) - soften)

            for x in gx:
                for y in gy:
                    p = rg.Point3d(x, y, 0)
                    if not curve_contains_point(envelope, p): continue
                    for a in angs:
                        rect = oriented_rect(p, w, h, a)
                        if not curve_inside_boundary(envelope, rect): continue
                        if not rect_has_clearance(rect, trees, waters, tree_clear, water_clear): continue
                        ok_spacing = True
                        for ex in zones:
                            if not closed_curves_disjoint(rect, ex):
                                ok_spacing = False; break
                            c1 = rect.GetBoundingBox(True).Center; c2 = ex.GetBoundingBox(True).Center
                            if rg.Point3d(c1.X,c1.Y,0).DistanceTo(rg.Point3d(c2.X,c2.Y,0)) < (building_size*scale)*1.2:
                                ok_spacing = False; break
                        if not ok_spacing: continue
                        sc = score_rect(rect)
                        if sc > best_score:
                            best_score, best_rect = sc, rect

            if best_rect is not None:
                zones.append(best_rect)
                return zones

    # emergency tiny pad (still inside envelope)
    c = curve_centroid(envelope)
    tiny = oriented_rect(rg.Point3d(c.X, c.Y, 0), base_w*0.6, base_h*0.6, 0.0)
    if curve_inside_boundary(envelope, tiny):
        zones.append(tiny)
    return zones

# -------------------------
# Road routing (fast A* + realistic geometry)
# -------------------------
# ---------- ROAD ROUTING (compact, smooth, pad-tangent) ----------
# Tunables (use GH sliders if you like)
APPROACH_LEAD_IN   = float(globals().get('APPROACH_LEAD_IN',  max(6.0, 1.6*ROAD_FILLET_RADIUS, 1.2*ROAD_MIN_SEG_LEN)))
MAX_DEFLECTION_DEG = float(globals().get('MAX_DEFLECTION_DEG', 55.0))

sanitize_curves = lambda L: [c for c in (L or []) if (c is not None and getattr(c, "IsValid", True))]

def pad_edge_mid_and_normal(pad_rect, prefer_from):
    pts = poly_points(pad_rect); 
    if len(pts) < 4: c = pad_rect.GetBoundingBox(True).Center; return rg.Point3d(c.X,c.Y,0), rg.Vector3d(0,1,0)
    c = pad_rect.GetBoundingBox(True).Center; mids=[]; norms=[]
    for i in range(4):
        a,b = pts[i], pts[(i+1)%4]; m = rg.Point3d((a.X+b.X)*.5,(a.Y+b.Y)*.5,0); n = rg.Vector3d(m.X-c.X,m.Y-c.Y,0); 
        (n.Unitize() if not n.IsTiny() else None); mids.append(m); norms.append(n)
    d = rg.Vector3d(prefer_from.X-c.X, prefer_from.Y-c.Y, 0); 
    if not d.IsTiny(): d.Unitize()
    i = max(range(4), key=lambda k: rg.Vector3d.Multiply(norms[k], d))
    return mids[i], norms[i]

def pick_pad_approach_point(pad_rect, from_point, apron_out=PAD_APPROACH_CLEAR, lead=APPROACH_LEAD_IN):
    mid, n = pad_edge_mid_and_normal(pad_rect, from_point)                    # outward normal n
    goal   = rg.Point3d(mid.X + n.X*max(.25,apron_out), mid.Y + n.Y*max(.25,apron_out), 0)  # OUTSIDE apron
    pre    = rg.Point3d(goal.X - n.X*lead,              goal.Y - n.Y*lead,              0)  # farther OUTSIDE
    return mid, goal, pre

snap_to_grid = lambda p,o,s: (int(round((p.X-o.X)/s)), int(round((p.Y-o.Y)/s)))
grid_to_point= lambda ij,o,s: rg.Point3d(o.X+ij[0]*s, o.Y+ij[1]*s, 0)

def build_nav_mask(boundary, trees, waters, pads, step, clearance):
    trees,waters,pads = map(sanitize_curves,(trees,waters,pads))
    bb = boundary.GetBoundingBox(True); origin = rg.Point3d(math.floor(bb.Min.X/step)*step, math.floor(bb.Min.Y/step)*step, 0)
    def blocked_ij(i,j):
        p = grid_to_point((i,j), origin, step)
        if any(curve_contains_point(r,p) for r in pads): return True
        if not curve_contains_point(boundary,p): return True
        for t in trees:
            ok,c = _circle_from_curve(t); 
            if ok and p.DistanceTo(c.Center) < c.Radius + clearance: return True
            if not ok:
                bb = t.GetBoundingBox(True); r=0.5*max(bb.Max.X-bb.Min.X, bb.Max.Y-bb.Min.Y); 
                if p.DistanceTo(bb.Center) < r + clearance: return True
        if any(min_dist_point_to_curve(p,w) < clearance for w in waters): return True
        return False
    return origin, blocked_ij, bb

_dir_angle = lambda a,b: 0.0 if (a is None or b is None) else abs((math.atan2(b[1],b[0]) - math.atan2(a[1],a[0]) + math.pi)%(2*math.pi)-math.pi)

def astar_path(start_pt, goal_pt, origin, blocked_ij, bb, step, max_expand=35000):
    si,sj = snap_to_grid(start_pt,origin,step); gi,gj = snap_to_grid(goal_pt,origin,step)
    imin = int(math.floor((bb.Min.X-origin.X)/step))-2; imax = int(math.ceil((bb.Max.X-origin.X)/step))+2
    jmin = int(math.floor((bb.Min.Y-origin.Y)/step))-2; jmax = int(math.ceil((bb.Max.Y-origin.Y)/step))+2
    inb  = lambda i,j: (imin<=i<=imax) and (jmin<=j<=jmax)
    h    = lambda i,j: math.hypot(i-gi,j-gj)
    def nearest_free(i0,j0,r=3):
        best=None;bestd=1e9
        for di in range(-r,r+1):
            for dj in range(-r,r+1):
                ii,jj=i0+di,j0+dj
                if inb(ii,jj) and not blocked_ij(ii,jj):
                    d=di*di+dj*dj
                    if d<bestd: bestd=d; best=(ii,jj)
        return best
    if blocked_ij(si,sj): nf=nearest_free(si,sj);  (si,sj) = nf if nf else (si,sj)
    if blocked_ij(gi,gj): nf=nearest_free(gi,gj);  (gi,gj) = nf if nf else (gi,gj)
    open_set=[]; heapq.heappush(open_set,(h(si,sj),0.0,(si,sj),None,None))
    came={}; gscore={(si,sj):0.0}; visited=set(); moves=[(-1,0,1.0),(1,0,1.0),(0,-1,1.0),(0,1,1.0),(-1,-1,math.sqrt(2)),(-1,1,math.sqrt(2)),(1,-1,math.sqrt(2)),(1,1,math.sqrt(2))]
    expands=0
    while open_set:
        _,g,node,parent,prev=heapq.heappop(open_set)
        if node in visited: continue
        came[node]=parent; visited.add(node); expands+=1
        if expands>max_expand: return None
        if node==(gi,gj):
            path=[]; cur=node
            while cur is not None: path.append(cur); cur=came[cur]
            path.reverse(); return [grid_to_point(n,origin,step) for n in path]
        i,j=node
        for di,dj,c in moves:
            ii,jj=i+di,j+dj
            if not inb(ii,jj) or blocked_ij(ii,jj): continue
            ang_cost=float(TURN_PENALTY)*(_dir_angle(prev,(di,dj))/math.pi)
            ng=g+c+ang_cost
            if (ii,jj) not in gscore or ng<gscore[(ii,jj)]:
                gscore[(ii,jj)]=ng; heapq.heappush(open_set,(ng+h(ii,jj),ng,(ii,jj),node,(di,dj)))
    return None

def segment_clear(a,b,boundary,trees,waters,clear,samples=SMOOTH_SAMPLES):
    trees,waters = map(sanitize_curves,(trees,waters))
    for k in range(samples+1):
        t=float(k)/samples; p=rg.Point3d(a.X+(b.X-a.X)*t, a.Y+(b.Y-a.Y)*t,0)
        if not curve_contains_point(boundary,p): return False
        for tr in trees:
            ok,c=_circle_from_curve(tr)
            if ok and p.DistanceTo(c.Center)<c.Radius+clear-1e-6: return False
            if not ok:
                bb=tr.GetBoundingBox(True); r=0.5*max(bb.Max.X-bb.Min.X,bb.Max.Y-bb.Min.Y)
                if p.DistanceTo(bb.Center)<r+clear-1e-6: return False
        if any(min_dist_point_to_curve(p,w)<clear-1e-6 for w in waters): return False
    seg=rg.PolylineCurve([a,b])
    if any(curves_intersect(seg,w) for w in waters): return False
    if any(curves_intersect(seg,t) for t in trees):  return False
    return True

def los_simplify(P,boundary,trees,waters,clear,samples=SMOOTH_SAMPLES):
    if not P or len(P)<=2: return P[:]
    out=[P[0]]; i=0
    while i<len(P)-1:
        j=len(P)-1
        while j>i+1 and not segment_clear(P[i],P[j],boundary,trees,waters,clear,samples): j-=1
        out.append(P[j]); i=j
    return out

def simplify_collinear(P,th=ANGLE_COLLINEAR_DEG):
    if len(P)<3: return P[:]
    out=[P[0]]
    for i in range(1,len(P)-1):
        a,b,c=P[i-1],P[i],P[i+1]
        v1=rg.Vector3d(b.X-a.X,b.Y-a.Y,0); v2=rg.Vector3d(c.X-b.X,c.Y-b.Y,0)
        if angle_deg(v1,v2)>th: out.append(b)
    out.append(P[-1]); return out

def enforce_min_end_segments(P,m=ROAD_MIN_SEG_LEN):
    Q=P[:]
    if len(Q)>=2 and Q[0].DistanceTo(Q[1])<m and len(Q)>2: Q.pop(1)
    if len(Q)>=2 and Q[-2].DistanceTo(Q[-1])<m and len(Q)>2: Q.pop(-2)
    return Q

def soften_sharp_vertices(P,max_defl=MAX_DEFLECTION_DEG,min_leg=ROAD_MIN_SEG_LEN):
    if len(P)<3: return P[:]
    O=[P[0]]
    for i in range(1,len(P)-1):
        a,b,c=P[i-1],P[i],P[i+1]
        v1=rg.Vector3d(b.X-a.X,b.Y-a.Y,0); v2=rg.Vector3d(c.X-b.X,c.Y-b.Y,0)
        if v1.IsTiny() or v2.IsTiny(): O.append(b); continue
        ang=angle_deg(v1,v2)
        if ang>max_defl and a.DistanceTo(b)>min_leg and b.DistanceTo(c)>min_leg:
            v1.Unitize(); v2.Unitize(); bis=v1+v2
            if not bis.IsTiny(): bis.Unitize(); d=min(a.DistanceTo(b),b.DistanceTo(c))*0.25; O.append(rg.Point3d(b.X+bis.X*d,b.Y+bis.Y*d,0))
            else: O.append(b)
        else: O.append(b)
    O.append(P[-1]); return O

def _polyline_min_seg_len(P):
    return min((P[i-1].DistanceTo(P[i]) for i in range(1,len(P))), default=1e9)

def _prune_for_fillet(P,min_len): 
    Q=P[:]
    while len(Q)>=3 and (Q[0].DistanceTo(Q[1])<min_len or Q[-2].DistanceTo(Q[-1])<min_len):
        if len(Q)>=3 and Q[0].DistanceTo(Q[1])<min_len: Q.pop(1)
        if len(Q)>=3 and Q[-2].DistanceTo(Q[-1])<min_len: Q.pop(-2)
    return Q

def build_polycurve_with_straight_ends(touch_b, mids, touch_pad):
    if not mids: return rg.LineCurve(touch_b,touch_pad)
    pts=_prune_for_fillet(mids, MIN_FILLETABLE_SEG)
    if len(pts)<=2:
        pc=rg.PolyCurve(); pc.Append(rg.LineCurve(touch_b,pts[0]))
        if len(pts)==2: pc.Append(rg.PolylineCurve(pts)); pc.Append(rg.LineCurve(pts[1],touch_pad))
        else: pc.Append(rg.LineCurve(pts[0],touch_pad))
        return pc
    r=min(ROAD_FILLET_RADIUS,0.45*_polyline_min_seg_len(pts)); pl=rg.PolylineCurve(pts)
    cur=None
    if r>(MIN_FILLET_ARC_LEN*0.5) and pl.PointCount>=3:
        try: tmp=rg.Curve.CreateFilletCornersCurve(pl,r,TOL,math.radians(1.0)); 
        except: tmp=None
        if tmp and tmp.GetLength()>=MIN_FILLET_ARC_LEN*3.0: cur=tmp
    cur=cur or pl
    pc=rg.PolyCurve(); pc.Append(rg.LineCurve(touch_b,cur.PointAtStart)); pc.Append(cur); pc.Append(rg.LineCurve(cur.PointAtEnd,touch_pad)); return pc

def curve_clear(crv,boundary,trees,waters,clear,sample_per_m=SAMPLE_PER_METER):
    if crv is None: return False
    trees,waters = map(sanitize_curves,(trees,waters))
    n=max(10,int(crv.GetLength()*sample_per_m))
    for k in range(n):
        p=crv.PointAtNormalizedLength(float(k)/max(1,n-1))
        if not curve_contains_point(boundary,p): return False
        for t in trees:
            ok,c=_circle_from_curve(t)
            if (ok and p.DistanceTo(c.Center)<c.Radius+clear-1e-6) or (not ok and p.DistanceTo(t.GetBoundingBox(True).Center)<0.5*max(t.GetBoundingBox(True).Max.X-t.GetBoundingBox(True).Min.X,t.GetBoundingBox(True).Max.Y-t.GetBoundingBox(True).Min.Y)+clear-1e-6): 
                return False
        if any(min_dist_point_to_curve(p,w)<clear-1e-6 for w in waters): return False
    if any(curves_intersect(crv,w) for w in waters): return False
    if any(curves_intersect(crv,t) for t in trees):  return False
    return True

def boundary_touch_points(boundary, side="south", start_inset=ROAD_TOUCH_INSET):
    bb=boundary.GetBoundingBox(True); cx=.5*(bb.Min.X+bb.Max.X); cy=.5*(bb.Min.Y+bb.Max.Y)
    anchor = rg.Point3d(cx, bb.Min.Y-20,0) if side=="south" else (rg.Point3d(cx, bb.Max.Y+20,0) if side=="north" else (rg.Point3d(bb.Min.X-20,cy,0) if side=="west" else rg.Point3d(bb.Max.X+20,cy,0)))
    ok,t=boundary.ClosestPoint(anchor); t = t if ok else boundary.Domain.T0
    touch=boundary.PointAt(t); cen=curve_centroid(boundary); v=rg.Vector3d(cen.X-touch.X, cen.Y-touch.Y,0); v=rg.Vector3d(0,1,0) if v.IsTiny() else v; v.Unitize()
    return touch, rg.Point3d(touch.X+v.X*max(.1,start_inset), touch.Y+v.Y*max(.1,start_inset),0)

# --- Route to the outside apron (no geometry enters the pad) ---
def route_centerline(boundary, trees, waters, pad_rect, entry_side, step, clearance, pad_clear):
    touch_b, entry_in      = boundary_touch_points(boundary, entry_side, ROAD_TOUCH_INSET)
    _edge_mid, goal, pre   = pick_pad_approach_point(pad_rect, entry_in, pad_clear)  # goal==outside apron

    # fast direct try
    if segment_clear(entry_in, goal, boundary, trees, waters, clearance):
        crv = build_polycurve_with_straight_ends(touch_b, [entry_in, goal], goal)    # end AT apron
        return crv if curve_clear(crv, boundary, trees, waters, clearance) else None

    target = pre or goal
    for _ in range(ROAD_MAX_RETRIES+1):
        origin, blocked, bb = build_nav_mask(boundary, trees, waters, [pad_rect], step, clearance)
        pts = astar_path(entry_in, target, origin, blocked, bb, step)
        if pts:
            pts = soften_sharp_vertices(simplify_collinear(los_simplify(pts, boundary, trees, waters, clearance)), 
                                        float(globals().get('MAX_DEFLECTION_DEG', 55.0)), ROAD_MIN_SEG_LEN)
            pts = enforce_min_end_segments(pts, ROAD_MIN_SEG_LEN)
            crv = build_polycurve_with_straight_ends(touch_b, pts, goal)             # end AT apron
            if curve_clear(crv, boundary, trees, waters, clearance):
                if not pts or segment_clear(pts[-1], goal, boundary, trees, waters, clearance):
                    return crv
        step *= 0.5
    return None

def route_road(boundary, trees, waters, pads):
    if not pads: return None
    sides=[entrance_side, ("east" if entrance_side in ("south","north") else "south")]
    steps=[ROAD_STEP_DEFAULT, ROAD_STEP_DEFAULT*0.5]; clear=[ROAD_CLEAR]; offs=[PAD_APPROACH_CLEAR, 0.4]
    tb,ein=boundary_touch_points(boundary,sides[0],ROAD_TOUCH_INSET)
    pads_sorted=sorted(pads,key=lambda pr: pr.GetBoundingBox(True).Center.DistanceTo(ein))
    for p in pads_sorted:
        for s in sides:
            for st in steps:
                for c in clear:
                    for o in offs:
                        r=route_centerline(boundary,trees,waters,p,s,st,c,o)
                        if r: return r
    p=pads_sorted[0]; tb,ein=boundary_touch_points(boundary,sides[0],ROAD_TOUCH_INSET); tp,_g,_pre=pick_pad_approach_point(p,ein,offs[-1],APPROACH_LEAD_IN)
    direct=rg.PolylineCurve([tb,ein,tp]); 
    return direct if curve_clear(direct,boundary,trees,waters,clear[0]) else None
# ---------- END ----------


# -------------------------
# MAIN (single-lot, fast)
# -------------------------
def generate_single_lot():
    random.seed(int(seed))

    size_info = LOT_SIZES[lot_type]
    boundary  = create_organic_boundary(size_info["width"], size_info["depth"], 0.0, 0.0)

    road = None; pads = []; waters = []; trees = []
    for _attempt in range(MAX_SITE_RETRIES + 1):
        waters = add_water_feature(boundary, must_have_pond=True)
        trees  = add_trees(boundary, int(tree_clusters), waters)
        pads   = place_building_zones(boundary, size_info, trees, waters, one_per=one_per_lot)

        # global sanitize (belt & suspenders)
        waters = sanitize_curves(waters)
        trees  = sanitize_curves(trees)
        pads   = sanitize_curves(pads)

        if pads:
            road = route_road(boundary, trees, waters, pads)
        if road is not None:
            break

    # Outputs
    site_boundaries.append(boundary)
    buildable_zones.extend(pads)
    water_features.extend(waters)
    tree_zones.extend(trees)
    if road: access_roads.append(road)

    info = "{} LOT\nSize: {}x{}m\nTrees: {}\nPads: {}\nWater features: {}\nRoad: {}".format(
        lot_type.upper(),
        size_info["width"], size_info["depth"],
        len(trees), len(pads), len(waters),
        "Yes" if road else "No path"
    )
    site_info.append(info)

# Run
generate_single_lot()
# ---------- end python_3_script_9 ----------
python_3_script_10 = Python3Script(num_lots=number_slider_6, seed=number_slider_7)  # -> out, site_boundaries, buildable_zones, water_features, tree_zones, access_roads, site_info; inputs num_lots: Int32, seed: Int32; disabled
# ---------- python_3_script_10: Python ----------
"""
SIMPLIFIED RURAL LOT GENERATOR
Grasshopper Python Component for Quick Site Variations

INPUTS:
- num_lots: Integer (1-20) - Number of lots to generate
- seed: Integer - Random seed for variations
- one_per_lot: Boolean (optional) - Force exactly 1 buildable zone per lot
- entrance_side: Text (optional) - "south" | "north" | "east" | "west" (default "south")
- road_to_all_pads: Boolean (optional) - Route a road to every pad (default False)

OUTPUTS:
- site_boundaries: Site boundary curves
- buildable_zones: Building areas (rectangles)
- water_features: Ponds/streams
- tree_zones: Tree circles
- access_roads: Entry roads (curves routed around obstacles)
- site_info: Data for each lot
"""

import Rhino
import Rhino.Geometry as rg
import math
import random
import heapq

# -------------------------
# Output lists
# -------------------------
site_boundaries = []
buildable_zones = []
water_features = []
tree_zones = []
access_roads = []
site_info = []

# -------------------------
# Defaults
# -------------------------
if num_lots is None: num_lots = 4
if seed is None:     seed = 42
if 'one_per_lot' not in globals() or one_per_lot is None:
    one_per_lot = True

# Optional new inputs (safe defaults if not wired)
if 'entrance_side' not in globals() or entrance_side not in ("south","north","east","west"):
    entrance_side = "south"
if 'road_to_all_pads' not in globals() or road_to_all_pads is None:
    road_to_all_pads = False

# -------------------------
# Tunables
# -------------------------
TOL                  = 1e-3
TREE_CLEAR_PAD       = 0.0
WATER_CLEAR_PAD      = 0.0
ROAD_STEP_DEFAULT    = 5.0     # A* grid spacing (m)
ROAD_CLEAR           = 2.5     # min clearance to trees/water (m)
ROAD_MAX_RETRIES     = 2       # per parameter set (we also sweep alternative params)
SMOOTH_SAMPLES       = 25      # LOS checks
ROAD_TOUCH_INSET     = 0.5     # m inside boundary for first navigable point
PAD_APPROACH_CLEAR   = 0.6     # m outside pad edge for goal point
ROAD_MIN_SEG_LEN     = 3.0     # min straight segment length at both ends (m)
ROAD_FILLET_RADIUS   = 8.0     # realistic turning radius for interior corners (m)
ANGLE_COLLINEAR_DEG  = 5.0     # collapse nearly-straight vertices
SAMPLE_PER_METER     = 0.5     # curve sampling density for clearance checks

# Lot size definitions (in meters)
LOT_SIZES = {
    "Small":  {"width": 50,  "depth": 60,  "building_size": 15},
    "Medium": {"width": 70,  "depth": 80,  "building_size": 20},
    "Large":  {"width": 100, "depth": 100, "building_size": 30},
    "XL":     {"width": 150, "depth": 120, "building_size": 40}
}

# -------------------------
# Helpers (polyline extraction fixed for Rhino)
# -------------------------
def curve_contains_point(curve, pt, tol=TOL):
    try:
        rc = curve.Contains(pt, rg.Plane.WorldXY, tol)
    except TypeError:
        rc = curve.Contains(pt)
    return rc in (rg.PointContainment.Inside, rg.PointContainment.Coincident)

def poly_points(crv, min_count=5):
    try:
        ok, pl = crv.TryGetPolyline()
        if ok:
            return [pl[i] for i in range(pl.Count)]
    except Exception:
        pass
    dom = crv.Domain
    n = max(min_count, 5)
    return [crv.PointAt(dom.T0 + (dom.T1-dom.T0)*i/float(n-1)) for i in range(n)]

def rect_polyline(x, y, w, h):
    pts = [
        rg.Point3d(x, y, 0),
        rg.Point3d(x + w, y, 0),
        rg.Point3d(x + w, y + h, 0),
        rg.Point3d(x, y + h, 0),
        rg.Point3d(x, y, 0)
    ]
    return rg.PolylineCurve(pts)

def rect_corners(rect_crv):
    pts = poly_points(rect_crv)
    return pts[:4] if len(pts) >= 4 else pts

def rect_inside_boundary(boundary, rect_crv, tol=TOL):
    try:
        rel = rg.Curve.PlanarClosedCurveRelationship(rect_crv, boundary, rg.Plane.WorldXY, tol)
        return rel == rg.RegionContainment.AInsideB
    except:
        corners = rect_corners(rect_crv)
        if any(not curve_contains_point(boundary, c, tol) for c in corners):
            return False
        ccx = Rhino.Geometry.Intersect.Intersection.CurveCurve(boundary, rect_crv, tol, tol)
        return (ccx is None) or (ccx.Count == 0)

def curves_intersect(a, b, tol=TOL):
    ccx = Rhino.Geometry.Intersect.Intersection.CurveCurve(a, b, tol, tol)
    return (ccx is not None) and (ccx.Count > 0)

def closed_curves_disjoint(a_closed, b_closed, tol=TOL):
    try:
        rel = rg.Curve.PlanarClosedCurveRelationship(a_closed, b_closed, rg.Plane.WorldXY, tol)
        if rel != rg.RegionContainment.Disjoint:
            return False
    except:
        pass
    if curves_intersect(a_closed, b_closed, tol):
        return False
    return True

def _circle_from_curve(curve):
    ok, circ = curve.TryGetCircle()
    return ok, circ

def min_dist_point_to_curve(pt, crv):
    ok, t = crv.ClosestPoint(pt)
    if not ok:
        return float('inf')
    p = crv.PointAt(t)
    return pt.DistanceTo(p)

def distance(a, b):
    return a.DistanceTo(b)

def angle_deg(u, v):
    uu = rg.Vector3d(u); vv = rg.Vector3d(v)
    if uu.IsTiny() or vv.IsTiny(): return 0.0
    uu.Unitize(); vv.Unitize()
    d = max(-1.0, min(1.0, rg.Vector3d.Multiply(uu, vv)))
    return math.degrees(math.acos(d))

def segment_clear(a, b, boundary, trees, waters, extra_clear, samples=SMOOTH_SAMPLES):
    for i in range(samples+1):
        t = float(i)/samples
        p = rg.Point3d((1-t)*a.X + t*b.X, (1-t)*a.Y + t*b.Y, 0)
        if not curve_contains_point(boundary, p): return False
        for tree in trees:
            ok, circ = _circle_from_curve(tree)
            if ok:
                if p.DistanceTo(circ.Center) < (circ.Radius + extra_clear - 1e-6): return False
            else:
                bb = tree.GetBoundingBox(True)
                r  = 0.5*max(bb.Max.X-bb.Min.X, bb.Max.Y-bb.Min.Y)
                c  = bb.Center
                if p.DistanceTo(c) < (r + extra_clear - 1e-6): return False
        for w in waters:
            if min_dist_point_to_curve(p, w) < (extra_clear - 1e-6): return False
    seg_crv = rg.PolylineCurve([a, b])
    for w in waters:
        if curves_intersect(seg_crv, w): return False
    for tcrv in trees:
        if curves_intersect(seg_crv, tcrv): return False
    return True

def curve_clear(crv, boundary, trees, waters, extra_clear, sample_per_m=SAMPLE_PER_METER):
    if crv is None: return False
    length = crv.GetLength()
    n = max(10, int(length * sample_per_m))
    tvals = [float(i)/max(1, n-1) for i in range(n)]
    for t in tvals:
        p = crv.PointAtNormalizedLength(t)
        if not curve_contains_point(boundary, p): return False
        for tree in trees:
            ok, circ = _circle_from_curve(tree)
            if ok:
                if p.DistanceTo(circ.Center) < (circ.Radius + extra_clear - 1e-6): return False
            else:
                bb = tree.GetBoundingBox(True)
                r  = 0.5*max(bb.Max.X-bb.Min.X, bb.Max.Y-bb.Min.Y)
                c  = bb.Center
                if p.DistanceTo(c) < (r + extra_clear - 1e-6): return False
        for w in waters:
            if min_dist_point_to_curve(p, w) < (extra_clear - 1e-6): return False
    # intersection check as well
    for w in waters:
        if curves_intersect(crv, w): return False
    for tcrv in trees:
        if curves_intersect(crv, tcrv): return False
    return True

def curve_centroid(closed_curve):
    try:
        amp = rg.AreaMassProperties.Compute(closed_curve)
        if amp: return amp.Centroid
    except: pass
    return closed_curve.GetBoundingBox(True).Center

# -------------------------
# Lot generation
# -------------------------
def create_organic_boundary(width, depth, center_x, center_y):
    num_sides = random.randint(6, 10)
    pts = []
    for i in range(num_sides):
        angle = (2 * math.pi * i / num_sides) + random.uniform(-0.2, 0.2)
        avg_radius = (width + depth) / 4.0
        radius = avg_radius + random.uniform(-avg_radius * 0.3, avg_radius * 0.3)
        x = center_x + width/2.0 + radius * math.cos(angle)
        y = center_y + depth/2.0 + radius * math.sin(angle)
        pts.append(rg.Point3d(x, y, 0))
    pts.append(pts[0])
    return rg.PolylineCurve(pts)

def add_water_feature(boundary):
    features = []
    bbox = boundary.GetBoundingBox(True)
    if random.random() < 0.5:
        feature_type = random.choice(["pond", "stream"])
        if feature_type == "pond":
            for _ in range(30):
                x = random.uniform(bbox.Min.X + 15, bbox.Max.X - 15)
                y = random.uniform(bbox.Min.Y + 15, bbox.Max.Y - 15)
                if not curve_contains_point(boundary, rg.Point3d(x, y, 0)): continue
                radius = random.uniform(5, 12)
                pond = rg.Circle(rg.Point3d(x, y, 0), radius)
                rect = rect_polyline(x - radius, y - radius, 2*radius, 2*radius)
                if rect_inside_boundary(boundary, rect):
                    features.append(pond.ToNurbsCurve()); break
        else:
            pts = []
            for i in range(5):
                t = i/4.0
                x = bbox.Min.X + (bbox.Max.X - bbox.Min.X)*(0.1 + 0.8*t)
                y = bbox.Min.Y + (bbox.Max.Y - bbox.Min.Y)*(0.2 + 0.6*t + math.sin(t*math.pi)*0.2)
                pts.append(rg.Point3d(x, y, 0))
            if curve_contains_point(boundary, pts[0]) and curve_contains_point(boundary, pts[-1]):
                features.append(rg.Curve.CreateInterpolatedCurve(pts, 3))
    return features

def add_trees(boundary, density):
    trees = []
    tree_positions = []
    bbox = boundary.GetBoundingBox(True)
    num_clusters = int(density)
    for _ in range(num_clusters):
        for _try in range(30):
            x = random.uniform(bbox.Min.X + 5, bbox.Max.X - 5)
            y = random.uniform(bbox.Min.Y + 5, bbox.Max.Y - 5)
            if curve_contains_point(boundary, rg.Point3d(x, y, 0)): break
        else:
            continue
        for _ in range(random.randint(3, 6)):
            attempts = 0
            while attempts < 20:
                tx = x + random.uniform(-8, 8)
                ty = y + random.uniform(-8, 8)
                pt = rg.Point3d(tx, ty, 0)
                if not curve_contains_point(boundary, pt):
                    attempts += 1; continue
                r = random.uniform(2, 4)
                valid = True
                for ep, er in tree_positions:
                    if pt.DistanceTo(ep) < (r + er + 1.0):
                        valid = False; break
                if valid:
                    tree = rg.Circle(pt, r)
                    trees.append(tree.ToNurbsCurve())
                    tree_positions.append((pt, r))
                    break
                attempts += 1
    return trees

def _tree_center_and_radius(curve):
    ok, circ = curve.TryGetCircle()
    if ok: return circ.Center, circ.Radius
    bb = curve.GetBoundingBox(True)
    center = bb.Center
    radius = 0.5*max(bb.Max.X-bb.Min.X, bb.Max.Y-bb.Min.Y)
    return center, radius

# -------------------------
# Pad placement (no intersections)
# -------------------------
def pad_intersects_obstacles(pad_rect, trees, waters):
    for tcrv in trees:
        if not closed_curves_disjoint(pad_rect, tcrv): return True
    for w in waters:
        if w.IsClosed:
            if not closed_curves_disjoint(pad_rect, w): return True
        else:
            if curves_intersect(pad_rect, w): return True
    return False

def place_building_zones(boundary, size_info, trees, waters):
    zones = []
    bbox = boundary.GetBoundingBox(True)
    building_size = size_info["building_size"]
    w, h = building_size, building_size*0.8

    front_setback = 9 if size_info == LOT_SIZES["Small"] else 12
    side_setback  = 3 if size_info == LOT_SIZES["Small"] else 5
    rear_setback  = 7.5

    x_min = bbox.Min.X + side_setback
    x_max = bbox.Max.X - side_setback - w
    y_min = bbox.Min.Y + front_setback
    y_max = bbox.Max.Y - rear_setback - h

    if (x_max <= x_min) or (y_max <= y_min):
        return zones

    desired_zones = 1 if one_per_lot else random.randint(1,2)
    attempts_per_zone = 100

    for zi in range(desired_zones):
        placed = False
        for _ in range(attempts_per_zone):
            x = random.uniform(x_min, x_max)
            y = random.uniform(y_min, y_max)
            rect = rect_polyline(x, y, w, h)

            if not rect_inside_boundary(boundary, rect): continue
            if pad_intersects_obstacles(rect, trees, waters): continue

            ok_spacing = True
            for ex in zones:
                c1 = rect.GetBoundingBox(True).Center
                c2 = ex.GetBoundingBox(True).Center
                if rg.Point3d(c1.X, c1.Y, 0).DistanceTo(rg.Point3d(c2.X, c2.Y, 0)) < building_size*1.2:
                    ok_spacing = False; break
            if not ok_spacing: continue

            zones.append(rect); placed = True; break

        if not placed and zi == 0:
            for _ in range(120):
                x = random.uniform(bbox.Min.X + 5, bbox.Max.X - w - 5)
                y = random.uniform(bbox.Min.Y + 5, bbox.Max.Y - h - 5)
                rect = rect_polyline(x, y, w, h)
                if not rect_inside_boundary(boundary, rect): continue
                if pad_intersects_obstacles(rect, trees, waters): continue
                zones.append(rect); break

    return zones

# -------------------------
# Road routing (A* inside lot, obstacle-avoiding)
# -------------------------
def snap_to_grid(pt, origin, step):
    gx = int(round((pt.X - origin.X)/step))
    gy = int(round((pt.Y - origin.Y)/step))
    return gx, gy

def grid_to_point(g, origin, step):
    x = origin.X + g[0]*step
    y = origin.Y + g[1]*step
    return rg.Point3d(x, y, 0)

def is_blocked_point(p, boundary, trees, waters, extra_clear):
    if not curve_contains_point(boundary, p): return True
    for tcrv in trees:
        ok, circ = _circle_from_curve(tcrv)
        if ok:
            if p.DistanceTo(circ.Center) < (circ.Radius + extra_clear): return True
        else:
            bb = tcrv.GetBoundingBox(True)
            r  = 0.5*max(bb.Max.X-bb.Min.X, bb.Max.Y-bb.Min.Y)
            c  = bb.Center
            if p.DistanceTo(c) < (r + extra_clear): return True
    for w in waters:
        if min_dist_point_to_curve(p, w) < extra_clear: return True
    return False

def build_nav_mask(boundary, trees, waters, pads, step, clearance):
    bb = boundary.GetBoundingBox(True)
    ox = math.floor(bb.Min.X/step)*step
    oy = math.floor(bb.Min.Y/step)*step
    origin = rg.Point3d(ox, oy, 0)

    def blocked_ij(i, j):
        p = grid_to_point((i,j), origin, step)
        for rect in pads:
            if curve_contains_point(rect, p):
                return True
        return is_blocked_point(p, boundary, trees, waters, clearance)

    return origin, blocked_ij, bb

def astar_path(start_pt, goal_pt, origin, blocked_ij, bb, step, max_expand=50000):
    si, sj = snap_to_grid(start_pt, origin, step)
    gi, gj = snap_to_grid(goal_pt,  origin, step)

    imin = int(math.floor((bb.Min.X - origin.X)/step)) - 2
    jmin = int(math.floor((bb.Min.Y - origin.Y)/step)) - 2
    imax = int(math.ceil((bb.Max.X - origin.X)/step)) + 2
    jmax = int(math.ceil((bb.Max.Y - origin.Y)/step)) + 2

    def in_bounds(i,j): return (imin <= i <= imax) and (jmin <= j <= jmax)
    def h(i,j): return math.hypot(i-gi, j-gj)

    def nearest_free(i0, j0, r=4):
        best = None; bestd = 1e9
        for di in range(-r, r+1):
            for dj in range(-r, r+1):
                ii, jj = i0+di, j0+dj
                if not in_bounds(ii, jj): continue
                if blocked_ij(ii, jj):     continue
                d = di*di + dj*dj
                if d < bestd: bestd = d; best = (ii, jj)
        return best

    if blocked_ij(si, sj):
        nf = nearest_free(si, sj, r=4)
        if nf is None: return None
        si, sj = nf
    if blocked_ij(gi, gj):
        nf = nearest_free(gi, gj, r=4)
        if nf is None: return None
        gi, gj = nf

    open_set = []
    heapq.heappush(open_set, (h(si,sj), 0.0, (si,sj), None))
    came = {}; gscore = {(si,sj): 0.0}; visited = set(); expands = 0

    moves = [(-1,0,1.0),(1,0,1.0),(0,-1,1.0),(0,1,1.0),
             (-1,-1,math.sqrt(2)),(-1,1,math.sqrt(2)),
             (1,-1,math.sqrt(2)), (1,1,math.sqrt(2))]

    while open_set:
        _, g, node, parent = heapq.heappop(open_set)
        if node in visited: continue
        came[node] = parent; visited.add(node); expands += 1
        if expands > max_expand: return None

        if node == (gi, gj):
            path = []; cur = node
            while cur is not None:
                path.append(cur); cur = came[cur]
            path.reverse()
            return [grid_to_point(n, origin, step) for n in path]

        i, j = node
        for di,dj,cost in moves:
            ii, jj = i+di, j+dj
            if not in_bounds(ii, jj): continue
            if blocked_ij(ii, jj):    continue
            ng = g + cost
            if (ii,jj) not in gscore or ng < gscore[(ii,jj)]:
                gscore[(ii,jj)] = ng
                f = ng + h(ii,jj)
                heapq.heappush(open_set, (f, ng, (ii,jj), node))
    return None

def los_simplify(points, boundary, trees, waters, extra_clear, samples=SMOOTH_SAMPLES):
    if not points or len(points) <= 2:
        return points[:]
    simplified = [points[0]]
    i = 0
    while i < len(points)-1:
        j = len(points)-1
        while j > i+1:
            if segment_clear(points[i], points[j], boundary, trees, waters, extra_clear, samples): break
            j -= 1
        simplified.append(points[j]); i = j
    return simplified

def simplify_collinear(points, ang_thresh_deg=ANGLE_COLLINEAR_DEG):
    if len(points) < 3: return points[:]
    keep = [points[0]]
    for i in range(1, len(points)-1):
        a, b, c = points[i-1], points[i], points[i+1]
        v1 = rg.Vector3d(b.X-a.X, b.Y-a.Y, 0)
        v2 = rg.Vector3d(c.X-b.X, c.Y-b.Y, 0)
        if angle_deg(v1, v2) > ang_thresh_deg:
            keep.append(b)
    keep.append(points[-1])
    return keep

def enforce_min_end_segments(points, min_len=ROAD_MIN_SEG_LEN):
    pts = points[:]
    # start
    if len(pts) >= 2 and distance(pts[0], pts[1]) < min_len:
        if len(pts) > 2:
            pts.pop(1)
        # if only 2 points remain, keep as is (handled later)
    # end
    if len(pts) >= 2 and distance(pts[-2], pts[-1]) < min_len:
        if len(pts) > 2:
            pts.pop(-2)
    return pts

def pad_midpoints(pad_rect):
    pts = poly_points(pad_rect)
    if len(pts) < 2:
        c = pad_rect.GetBoundingBox(True).Center
        return [c]
    mids = []
    for i in range(1, len(pts)):
        a = pts[i-1]; b = pts[i]
        mids.append(rg.Point3d(0.5*(a.X+b.X), 0.5*(a.Y+b.Y), 0.0))
    return mids

def boundary_touch_points(boundary, side="south", start_inset=ROAD_TOUCH_INSET):
    bb = boundary.GetBoundingBox(True)
    cx = 0.5*(bb.Min.X + bb.Max.X)
    cy = 0.5*(bb.Min.Y + bb.Max.Y)

    if side == "south":
        anchor = rg.Point3d(cx, bb.Min.Y - 20.0, 0)
    elif side == "north":
        anchor = rg.Point3d(cx, bb.Max.Y + 20.0, 0)
    elif side == "west":
        anchor = rg.Point3d(bb.Min.X - 20.0, cy, 0)
    else:  # east
        anchor = rg.Point3d(bb.Max.X + 20.0, cy, 0)

    ok, t = boundary.ClosestPoint(anchor)
    if not ok: t = boundary.Domain.T0
    touch = boundary.PointAt(t)

    centroid = curve_centroid(boundary)
    v = rg.Vector3d(centroid.X - touch.X, centroid.Y - touch.Y, 0.0)
    if v.IsTiny(): v = rg.Vector3d(0, 1, 0)
    v.Unitize()

    inset = max(0.1, start_inset)
    entry = rg.Point3d(touch.X + v.X*inset, touch.Y + v.Y*inset, 0.0)
    return touch, entry

def pick_pad_approach_point(pad_rect, from_point, offset=PAD_APPROACH_CLEAR):
    mids = pad_midpoints(pad_rect)
    best_mid = min(mids, key=lambda m: m.DistanceTo(from_point))
    dirv = rg.Vector3d(from_point.X - best_mid.X, from_point.Y - best_mid.Y, 0.0)
    if dirv.IsTiny():
        pc = pad_rect.GetBoundingBox(True).Center
        dirv = rg.Vector3d(best_mid.X - pc.X, best_mid.Y - pc.Y, 0.0)
    dirv.Unitize()
    goal = rg.Point3d(best_mid.X + dirv.X*max(0.2, offset),
                      best_mid.Y + dirv.Y*max(0.2, offset), 0.0)
    return best_mid, goal

def build_polycurve_with_straight_ends(touch_b, mid_points, touch_pad):
    """
    - straight line from boundary touch to first interior point (after cleanup)
    - filleted mid polyline (interior corners only)
    - straight final line from last interior point to pad touch
    """
    if not mid_points:
        return rg.LineCurve(touch_b, touch_pad)

    # Fillet interior corners of mid polyline (endpoints are mid_points[0] and mid_points[-1])
    mid_pl = rg.PolylineCurve(mid_points)
    filleted = None
    try:
        # Only fillet if there are interior corners
        if mid_pl.PointCount >= 3:
            filleted = rg.Curve.CreateFilletCornersCurve(mid_pl, ROAD_FILLET_RADIUS, TOL, math.radians(1.0))
    except:
        filleted = None

    mid_curve = filleted if filleted is not None else mid_pl

    pcs = rg.PolyCurve()
    pcs.Append(rg.LineCurve(touch_b, mid_curve.PointAtStart))
    pcs.Append(mid_curve)
    pcs.Append(rg.LineCurve(mid_curve.PointAtEnd, touch_pad))
    return pcs

def route_centerline(boundary, trees, waters, pad_rect, entry_side, step, clearance, pad_clear):
    # entry & goal
    touch_b, entry_in = boundary_touch_points(boundary, entry_side, ROAD_TOUCH_INSET)
    touch_pad, goal    = pick_pad_approach_point(pad_rect, entry_in, pad_clear)

    # A* with retries for this parameter set
    for _attempt in range(ROAD_MAX_RETRIES+1):
        origin, blocked, bb = build_nav_mask(boundary, trees, waters, [pad_rect], step, clearance)
        pts = astar_path(entry_in, goal, origin, blocked, bb, step)
        if pts is None:
            step *= 0.5  # finer grid
            continue

        # clean/simplify interior path
        if len(pts) >= 2:
            pts = los_simplify(pts, boundary, trees, waters, clearance)
            pts = simplify_collinear(pts)
            if pts: pts[0] = entry_in  # keep exact first interior

        # enforce realistic ends (remove tiny stubs)
        pts = enforce_min_end_segments(pts, ROAD_MIN_SEG_LEN)

        # compose curve with straight ends
        crv = build_polycurve_with_straight_ends(touch_b, pts, touch_pad)

        # global clearance check on final curve
        if curve_clear(crv, boundary, trees, waters, clearance):
            # also ensure the final straight is clear (belt & suspenders)
            if len(pts) == 0:
                ok_tail = segment_clear(crv.PointAtStart, crv.PointAtEnd, boundary, trees, waters, clearance)
            else:
                ok_tail = segment_clear(pts[-1], touch_pad, boundary, trees, waters, clearance)
            if ok_tail:
                return crv
        # else: refine resolution and retry
        step *= 0.5

    return None

def route_road(boundary, trees, waters, pads):
    """
    Robust routing:
    - Tries preferred entrance side, then alternatives
    - Tries coarser->finer grids
    - Gradually relaxes clearance & pad approach offset
    - Guarantees straight first & last segments, filleted interior (no tiny stubs)
    """
    if not pads:
        return None if not road_to_all_pads else []

    # order sides: preferred first, then rotate
    sides_all = ["south","east","north","west"]
    if entrance_side in sides_all:
        sides = [entrance_side] + [s for s in sides_all if s != entrance_side]
    else:
        sides = sides_all[:]

    steps      = [ROAD_STEP_DEFAULT, ROAD_STEP_DEFAULT*0.5, ROAD_STEP_DEFAULT*0.25]
    clearances = [ROAD_CLEAR, ROAD_CLEAR*0.8, ROAD_CLEAR*0.6]
    pad_offsets= [PAD_APPROACH_CLEAR, max(0.3, PAD_APPROACH_CLEAR*0.8)]

    def try_one(pad_rect):
        # Try combinations until success
        for s in sides:
            for c in clearances:
                for st in steps:
                    for po in pad_offsets:
                        crv = route_centerline(boundary, trees, waters, pad_rect, s, st, c, po)
                        if crv is not None:
                            return crv
        # last-resort direct if corridor is clear
        touch_b, entry_in = boundary_touch_points(boundary, sides[0], ROAD_TOUCH_INSET)
        touch_pad, _goal  = pick_pad_approach_point(pad_rect, entry_in, pad_offsets[-1])
        direct = rg.PolylineCurve([touch_b, entry_in, touch_pad])
        if curve_clear(direct, boundary, trees, waters, clearances[-1]):
            return direct
        return None

    if road_to_all_pads:
        roads = []
        for p in pads:
            r = try_one(p)
            if r is not None:
                roads.append(r)
        return roads

    # Prefer the pad closest to the preferred entry direction (more realistic)
    touch_b, entry_in = boundary_touch_points(boundary, sides[0], ROAD_TOUCH_INSET)
    pads_sorted = sorted(pads, key=lambda pr: pr.GetBoundingBox(True).Center.DistanceTo(entry_in))
    for p in pads_sorted:
        r = try_one(p)
        if r is not None:
            return r
    return None

# -------------------------
# MAIN
# -------------------------
def generate():
    lot_types = ["Small", "Medium", "Large", "XL"]
    grid_cols = 4
    spacing   = 200

    for i in range(int(num_lots)):
        random.seed(int(seed) + i*100)

        lot_type  = lot_types[i % 4] if i < 4 else random.choice(lot_types)
        size_info = LOT_SIZES[lot_type]

        col = i % grid_cols
        row = i // grid_cols
        cx  = col * spacing
        cy  = row * spacing

        boundary = create_organic_boundary(size_info["width"], size_info["depth"], cx, cy)

        waters = add_water_feature(boundary) if lot_type in ["Large", "XL"] else []
        tree_density = 2 if lot_type == "Small" else (3 if lot_type == "Medium" else 5)
        trees  = add_trees(boundary, tree_density)

        pads   = place_building_zones(boundary, size_info, trees, waters)

        # --- Robust road creation: ensure each lot gets a road if feasible ---
        road = None
        if pads:
            road = route_road(boundary, trees, waters, pads)

        # If still failing, attempt a final simplified route to the closest pad
        if road is None and pads:
            # try a very fine grid & relaxed clearance just once more
            touch_b, entry_in = boundary_touch_points(boundary, entrance_side, ROAD_TOUCH_INSET)
            closest_pad = min(pads, key=lambda pr: pr.GetBoundingBox(True).Center.DistanceTo(entry_in))
            road = route_centerline(boundary, trees, waters, closest_pad,
                                    entrance_side, ROAD_STEP_DEFAULT*0.2, max(1.5, ROAD_CLEAR*0.5), max(0.25, PAD_APPROACH_CLEAR*0.6))

        # Compose info
        road_str = "Yes" if (road or (isinstance(road, list) and len(road)>0)) else "No path"
        if isinstance(road, list):
            road_str = "{} road(s)".format(len(road))

        info = "{} LOT #{}\nSize: {}x{}m\nTrees: {}\nPads: {}\nRoad: {}".format(
            lot_type.upper(), i+1,
            size_info["width"], size_info["depth"],
            len(trees), len(pads), road_str
        )

        # Collect outputs
        site_boundaries.append(boundary)
        buildable_zones.extend(pads)
        water_features.extend(waters)
        tree_zones.extend(trees)
        if road:
            if isinstance(road, list):
                access_roads.extend(road)
            else:
                access_roads.append(road)
        site_info.append(info)

generate()
# ---------- end python_3_script_10 ----------
number_slider_12 = Slider(3, range=0..10)  # disabled
python_3_script_11 = Python3Script(
    seed=number_slider_8,
    sides_min=Slider(4, range=0..10),
    sides_max=Slider(8, range=0..10),
    tree_clusters=Slider(8, range=0..10),
    entrance_side=list_item)  # -> out, site_boundaries, buildable_zones, water_features, tree_zones, access_roads, site_info; inputs seed: Int32
# ---------- python_3_script_11: Python ----------
"""
SINGLE LOT GENERATOR (Fast, Pond-Guaranteed)
Grasshopper Python Component

GOAL:
- Generate ONE large lot (default "XL")
- Always include a pond (and possibly a stream)
- Trees & pads placed quickly
- Road touches boundary & pad, straight ends, filleted interior
- Auto-retry site features if road fails (few quick attempts)

INPUTS:
- seed: Integer - Random seed
- one_per_lot: Boolean (optional) - Force exactly 1 buildable zone (default True)
- entrance_side: Text (optional) - "south" | "north" | "east" | "west" (default "south")
- road_to_all_pads: Boolean (optional) - (kept for compatibility; ignored here)
- lot_type: Text (optional) - "Large" | "XL" (default "XL")

OUTPUTS:
- site_boundaries: [single boundary curve]
- buildable_zones: [rects]
- water_features: [pond (always) + optional stream]
- tree_zones: [tree circles]
- access_roads: [single road curve]
- site_info: [string summary]
"""

import Rhino
import Rhino.Geometry as rg
import math
import random
import heapq

# -------------------------
# Output lists
# -------------------------
site_boundaries = []
buildable_zones = []
water_features = []
tree_zones = []
access_roads = []
site_info = []

# -------------------------
# Defaults / Inputs
# -------------------------
if 'seed' not in globals() or seed is None: seed = 42
if 'one_per_lot' not in globals() or one_per_lot is None: one_per_lot = True
if 'entrance_side' not in globals() or entrance_side not in ("south","north","east","west"):
    entrance_side = "south"
# Kept only for compatibility with your GH file
if 'road_to_all_pads' not in globals() or road_to_all_pads is None:
    road_to_all_pads = False
if 'lot_type' not in globals() or lot_type not in ("Large","XL"):
    lot_type = "XL"
if 'sides_min' not in globals() or sides_min is None: sides_min = 7
if 'sides_max' not in globals() or sides_max is None: sides_max = 10
if 'tree_clusters' not in globals() or tree_clusters is None:
    tree_clusters = 4  # default if slider not connected

# -------------------------
# Tunables (favor speed)
# -------------------------
TOL                  = 1e-3
ROAD_STEP_DEFAULT    = 6.0     # Coarser grid for speed (was 5.0)
ROAD_CLEAR           = 2.5     # min clearance to trees/water (m)
ROAD_MAX_RETRIES     = 1       # fewer retries per parameter set
SMOOTH_SAMPLES       = 12      # fewer samples for LOS checks (was 25)
ROAD_TOUCH_INSET     = 0.5     # m inside boundary for first navigable point
PAD_APPROACH_CLEAR   = 0.6     # m outside pad edge for goal point
ROAD_MIN_SEG_LEN     = 3.0     # min straight segment length at both ends (m)
ROAD_FILLET_RADIUS   = 8.0     # realistic turning radius (m)
ANGLE_COLLINEAR_DEG  = 5.0     # collapse nearly-straight vertices
SAMPLE_PER_METER     = 0.35    # curve sampling density for clearance checks (faster)
MAX_SITE_RETRIES     = 2       # re-roll site features if road fails
# --- Pond shape controls ---
POND_POINTS     = 48     # more points = smoother outline
POND_NOISE_AMPL = 0.22   # 0.1 subtle … 0.35 very wiggly
POND_LOBES_MIN  = 2      # low frequency undulations
POND_LOBES_MAX  = 6

# Lot size definitions (in meters)
LOT_SIZES = {
    "Large": {"width": 100, "depth": 100, "building_size": 30},
    "XL":    {"width": 150, "depth": 120, "building_size": 40}
}

# -------------------------
# Helpers
# -------------------------
def curve_contains_point(curve, pt, tol=TOL):
    try:
        rc = curve.Contains(pt, rg.Plane.WorldXY, tol)
    except TypeError:
        rc = curve.Contains(pt)
    return rc in (rg.PointContainment.Inside, rg.PointContainment.Coincident)

def poly_points(crv, min_count=5):
    try:
        ok, pl = crv.TryGetPolyline()
        if ok: return [pl[i] for i in range(pl.Count)]
    except Exception:
        pass
    dom = crv.Domain
    n = max(min_count, 5)
    return [crv.PointAt(dom.T0 + (dom.T1-dom.T0)*i/float(n-1)) for i in range(n)]

def rect_polyline(x, y, w, h):
    pts = [rg.Point3d(x,y,0), rg.Point3d(x+w,y,0), rg.Point3d(x+w,y+h,0),
           rg.Point3d(x,y+h,0), rg.Point3d(x,y,0)]
    return rg.PolylineCurve(pts)

def rect_corners(rect_crv):
    pts = poly_points(rect_crv)
    return pts[:4] if len(pts) >= 4 else pts

def curves_intersect(a, b, tol=TOL):
    ccx = Rhino.Geometry.Intersect.Intersection.CurveCurve(a, b, tol, tol)
    return (ccx is not None) and (ccx.Count > 0)

def closed_curves_disjoint(a_closed, b_closed, tol=TOL):
    try:
        rel = rg.Curve.PlanarClosedCurveRelationship(a_closed, b_closed, rg.Plane.WorldXY, tol)
        if rel != rg.RegionContainment.Disjoint: return False
    except: pass
    if curves_intersect(a_closed, b_closed, tol): return False
    return True

def rect_inside_boundary(boundary, rect_crv, tol=TOL):
    try:
        rel = rg.Curve.PlanarClosedCurveRelationship(rect_crv, boundary, rg.Plane.WorldXY, tol)
        return rel == rg.RegionContainment.AInsideB
    except:
        corners = rect_corners(rect_crv)
        if any(not curve_contains_point(boundary, c, tol) for c in corners):
            return False
        ccx = Rhino.Geometry.Intersect.Intersection.CurveCurve(boundary, rect_crv, tol, tol)
        return (ccx is None) or (ccx.Count == 0)

def _circle_from_curve(curve):
    ok, circ = curve.TryGetCircle()
    return ok, circ

def min_dist_point_to_curve(pt, crv):
    ok, t = crv.ClosestPoint(pt)
    if not ok: return float('inf')
    p = crv.PointAt(t)
    return pt.DistanceTo(p)

def distance(a, b): return a.DistanceTo(b)

def angle_deg(u, v):
    uu = rg.Vector3d(u); vv = rg.Vector3d(v)
    if uu.IsTiny() or vv.IsTiny(): return 0.0
    uu.Unitize(); vv.Unitize()
    d = max(-1.0, min(1.0, rg.Vector3d.Multiply(uu, vv)))
    return math.degrees(math.acos(d))

def curve_centroid(closed_curve):
    try:
        amp = rg.AreaMassProperties.Compute(closed_curve)
        if amp: return amp.Centroid
    except: pass
    return closed_curve.GetBoundingBox(True).Center

# -------------------------
# Lot & features
# -------------------------
def create_organic_boundary(width, depth, center_x=0.0, center_y=0.0):
    # Center near origin for single-lot display
    num_sides = random.randint(int(sides_min), int(sides_max))
    pts = []
    for i in range(num_sides):
        angle = (2*math.pi*i/num_sides) + random.uniform(-0.18, 0.18)
        avg_radius = (width + depth)/4.0
        radius = avg_radius + random.uniform(-avg_radius*0.25, avg_radius*0.25)
        x = center_x + width/2.0 + radius * math.cos(angle)
        y = center_y + depth/2.0 + radius * math.sin(angle)
        pts.append(rg.Point3d(x, y, 0))
    pts.append(pts[0])
    return rg.PolylineCurve(pts)

def closed_inside_boundary(boundary, closed_curve, tol=TOL):
    """Robust check that a closed curve lies inside the lot boundary."""
    try:
        rel = rg.Curve.PlanarClosedCurveRelationship(closed_curve, boundary, rg.Plane.WorldXY, tol)
        return rel == rg.RegionContainment.AInsideB
    except:
        # Fallback: sample points on the curve
        L = max(1, int(closed_curve.GetLength() / 2.0))
        for i in range(L+1):
            t = float(i)/max(1, L)
            p = closed_curve.PointAtNormalizedLength(t)
            if not curve_contains_point(boundary, p): 
                return False
        return True

def make_organic_blob(center, base_r, rng=None, pts=POND_POINTS, ampl=POND_NOISE_AMPL,
                      lobes_min=POND_LOBES_MIN, lobes_max=POND_LOBES_MAX):
    """
    Build a closed, organic pond by perturbing radius with a few sinusoidal lobes.
    Periodic NURBS gives smooth, looped result.
    """
    if rng is None: rng = random
    cx, cy = center.X, center.Y

    # choose 2–3 harmonic components
    comps = []
    for _ in range(rng.randint(2, 3)):
        f  = rng.randint(lobes_min, lobes_max)        # frequency
        ph = rng.uniform(0.0, 2.0*math.pi)            # phase
        w  = rng.uniform(0.35, 1.0)                   # weight
        comps.append((f, ph, w))

    pts3d = []
    for i in range(pts):
        t = 2.0*math.pi * i / float(pts)
        k = 1.0
        for f, ph, w in comps:
            k += ampl * w * math.sin(f*t + ph)
        r = max(0.2*base_r, base_r * k)              # keep radius positive
        pts3d.append(rg.Point3d(cx + r*math.cos(t), cy + r*math.sin(t), 0.0))

    # Prefer periodic NURBS (very smooth, closed)
    try:
        crv = rg.NurbsCurve.CreateThroughPoints(pts3d, 3, True)  # degree=3, periodic=True
        if crv and crv.IsClosed: 
            return crv
    except:
        pass

    # Fallback: interpolated curve; close by repeating start
    pts3d.append(pts3d[0])
    crv = rg.Curve.CreateInterpolatedCurve(pts3d, 3)
    if not crv.IsClosed: crv.MakeClosed(TOL)
    return crv

def add_water_feature(boundary, must_have_pond=True):
    """Always add a pond; maybe also a simple stream. Quick placement inside boundary."""
    features = []
    bbox = boundary.GetBoundingBox(True)

    # --- Pond (guaranteed) ---
    placed_pond = False
    for _ in range(40):
        x = random.uniform(bbox.Min.X + 12, bbox.Max.X - 12)
        y = random.uniform(bbox.Min.Y + 12, bbox.Max.Y - 12)
        if not curve_contains_point(boundary, rg.Point3d(x, y, 0)): continue
        # radius = random.uniform(6, 12)
        # pond = rg.Circle(rg.Point3d(x, y, 0), radius).ToNurbsCurve()
        # # Quick bounding box test against boundary via rect check
        # rect = rect_polyline(x - radius, y - radius, 2*radius, 2*radius)
        # if rect_inside_boundary(boundary, rect):
        #     features.append(pond); placed_pond = True; break
        base_r = random.uniform(4, 12)
        center = rg.Point3d(x, y, 0)
        pond   = make_organic_blob(center, base_r, random)

        # ensure entire blob sits inside lot
        if pond and pond.IsClosed and closed_inside_boundary(boundary, pond):
            features.append(pond); placed_pond = True; break
    if must_have_pond and not placed_pond:
        # Fallback pond at centroid
        c = curve_centroid(boundary)
        features.append(rg.Circle(c, 8.0).ToNurbsCurve())

    # --- Optional stream ---
    if random.random() < 0.4:
        pts = []
        for i in range(5):
            t = i/4.0
            x = bbox.Min.X + (bbox.Max.X - bbox.Min.X)*(0.15 + 0.7*t)
            y = bbox.Min.Y + (bbox.Max.Y - bbox.Min.Y)*(0.25 + 0.5*t + math.sin(t*math.pi)*0.18)
            pts.append(rg.Point3d(x, y, 0))
        if curve_contains_point(boundary, pts[0]) and curve_contains_point(boundary, pts[-1]):
            features.append(rg.Curve.CreateInterpolatedCurve(pts, 3))
    return features

def add_trees(boundary, density):
    """Small, fast clusters."""
    trees = []
    tree_positions = []
    bbox = boundary.GetBoundingBox(True)
    num_clusters = int(density)
    for _ in range(num_clusters):
        # pick a cluster center
        for _try in range(15):
            x = random.uniform(bbox.Min.X + 6, bbox.Max.X - 6)
            y = random.uniform(bbox.Min.Y + 6, bbox.Max.Y - 6)
            if curve_contains_point(boundary, rg.Point3d(x, y, 0)): break
        else:
            continue
        # a few trees per cluster
        for _ in range(random.randint(3, 5)):
            attempts = 0
            while attempts < 12:
                tx = x + random.uniform(-7, 7)
                ty = y + random.uniform(-7, 7)
                pt = rg.Point3d(tx, ty, 0)
                if not curve_contains_point(boundary, pt): attempts += 1; continue
                r = random.uniform(2, 4)
                valid = True
                for ep, er in tree_positions:
                    if pt.DistanceTo(ep) < (r + er + 1.0): valid = False; break
                if valid:
                    trees.append(rg.Circle(pt, r).ToNurbsCurve())
                    tree_positions.append((pt, r)); break
                attempts += 1
    return trees

# -------------------------
# Pads (axis-aligned, quick)
# -------------------------
def pad_intersects_obstacles(pad_rect, trees, waters):
    for tcrv in trees:
        if not closed_curves_disjoint(pad_rect, tcrv): return True
    for w in waters:
        if w.IsClosed:
            if not closed_curves_disjoint(pad_rect, w): return True
        else:
            if curves_intersect(pad_rect, w): return True
    return False
def curve_inside_boundary(boundary, closed_curve, tol=TOL):
    try:
        rel = rg.Curve.PlanarClosedCurveRelationship(closed_curve, boundary, rg.Plane.WorldXY, tol)
        return rel == rg.RegionContainment.AInsideB
    except:
        L = max(8, int(closed_curve.GetLength()/4.0))
        for i in range(L+1):
            p = closed_curve.PointAtNormalizedLength(float(i)/max(1, L))
            if not curve_contains_point(boundary, p):
                return False
        return True

def oriented_rect(center, w, h, angle_rad):
    hw, hh = 0.5*w, 0.5*h
    pts = [rg.Point3d(-hw,-hh,0), rg.Point3d(hw,-hh,0), rg.Point3d(hw,hh,0),
           rg.Point3d(-hw,hh,0), rg.Point3d(-hw,-hh,0)]
    crv = rg.PolylineCurve(pts)
    R = rg.Transform.Rotation(angle_rad, rg.Vector3d(0,0,1), rg.Point3d(0,0,0))
    T = rg.Transform.Translation(center - rg.Point3d(0,0,0))
    crv.Transform(R); crv.Transform(T)
    return crv

def rect_has_clearance(rect_crv, trees, waters, tree_clear, water_clear, samples=40):
    for i in range(samples):
        p = rect_crv.PointAtNormalizedLength(float(i)/max(1, samples-1))
        for tcrv in trees:
            ok, circ = tcrv.TryGetCircle()
            if ok:
                if p.DistanceTo(circ.Center) < (circ.Radius + tree_clear - 1e-6):
                    return False
            else:
                bb = tcrv.GetBoundingBox(True)
                r  = 0.5*max(bb.Max.X-bb.Min.X, bb.Max.Y-bb.Min.Y)
                c  = bb.Center
                if p.DistanceTo(c) < (r + tree_clear - 1e-6):
                    return False
        for w in waters:
            if min_dist_point_to_curve(p, w) < (water_clear - 1e-6):
                return False
    for w in waters:
        if curves_intersect(rect_crv, w): return False
    for t in trees:
        if curves_intersect(rect_crv, t): return False
    return True

def rect_scaled_about_center(rect_crv, scale):
    bb = rect_crv.GetBoundingBox(True)
    c  = bb.Center
    S  = rg.Transform.Scale(c, scale)
    dup = rect_crv.DuplicateCurve()
    dup.Transform(S)
    return dup
    
def place_building_zones(boundary, size_info, trees, waters, one_per=True):
    zones = []
    bbox = boundary.GetBoundingBox(True)
    building_size = size_info["building_size"]
    w, h = building_size, building_size*0.8

    # Simple setbacks from BBox (fast)
    front_setback = 12 if size_info == LOT_SIZES["XL"] else 12
    side_setback  = 5
    rear_setback  = 7.5

    x_min = bbox.Min.X + side_setback
    x_max = bbox.Max.X - side_setback - w
    y_min = bbox.Min.Y + front_setback
    y_max = bbox.Max.Y - rear_setback - h
    if (x_max <= x_min) or (y_max <= y_min): return zones

    desired_zones = 1 if one_per else random.randint(1,2)
    attempts_per_zone = 60  # faster

    for zi in range(desired_zones):
        placed = False
        for _ in range(attempts_per_zone):
            x = random.uniform(x_min, x_max)
            y = random.uniform(y_min, y_max)
            rect = rect_polyline(x, y, w, h)
            if not rect_inside_boundary(boundary, rect): continue
            if pad_intersects_obstacles(rect, trees, waters): continue
            # spacing from existing pads
            ok_spacing = True
            for ex in zones:
                c1 = rect.GetBoundingBox(True).Center
                c2 = ex.GetBoundingBox(True).Center
                if rg.Point3d(c1.X, c1.Y, 0).DistanceTo(rg.Point3d(c2.X, c2.Y, 0)) < building_size*1.2:
                    ok_spacing = False; break
            if not ok_spacing: continue
            zones.append(rect); placed = True; break

        # tiny fallback: relaxed search box if first pad failed
        if not placed and zi == 0:
            for _ in range(60):
                x = random.uniform(bbox.Min.X + 6, bbox.Max.X - w - 6)
                y = random.uniform(bbox.Min.Y + 6, bbox.Max.Y - h - 6)
                rect = rect_polyline(x, y, w, h)
                if not rect_inside_boundary(boundary, rect): continue
                if pad_intersects_obstacles(rect, trees, waters): continue
                zones.append(rect); break

    return zones

# -------------------------
# Road routing (fast A* + realistic geometry)
# -------------------------
def snap_to_grid(pt, origin, step):
    gx = int(round((pt.X - origin.X)/step))
    gy = int(round((pt.Y - origin.Y)/step))
    return gx, gy

def grid_to_point(g, origin, step):
    x = origin.X + g[0]*step
    y = origin.Y + g[1]*step
    return rg.Point3d(x, y, 0)

def is_blocked_point(p, boundary, trees, waters, extra_clear):
    if not curve_contains_point(boundary, p): return True
    for tcrv in trees:
        ok, circ = _circle_from_curve(tcrv)
        if ok:
            if p.DistanceTo(circ.Center) < (circ.Radius + extra_clear): return True
        else:
            bb = tcrv.GetBoundingBox(True)
            r  = 0.5*max(bb.Max.X-bb.Min.X, bb.Max.Y-bb.Min.Y)
            c  = bb.Center
            if p.DistanceTo(c) < (r + extra_clear): return True
    for w in waters:
        if min_dist_point_to_curve(p, w) < extra_clear: return True
    return False

def build_nav_mask(boundary, trees, waters, pads, step, clearance):
    bb = boundary.GetBoundingBox(True)
    ox = math.floor(bb.Min.X/step)*step
    oy = math.floor(bb.Min.Y/step)*step
    origin = rg.Point3d(ox, oy, 0)
    def blocked_ij(i, j):
        p = grid_to_point((i,j), origin, step)
        for rect in pads:
            if curve_contains_point(rect, p): return True
        return is_blocked_point(p, boundary, trees, waters, clearance)
    return origin, blocked_ij, bb

def astar_path(start_pt, goal_pt, origin, blocked_ij, bb, step, max_expand=40000):
    si, sj = snap_to_grid(start_pt, origin, step)
    gi, gj = snap_to_grid(goal_pt,  origin, step)

    imin = int(math.floor((bb.Min.X - origin.X)/step)) - 2
    jmin = int(math.floor((bb.Min.Y - origin.Y)/step)) - 2
    imax = int(math.ceil((bb.Max.X - origin.X)/step)) + 2
    jmax = int(math.ceil((bb.Max.Y - origin.Y)/step)) + 2

    def in_bounds(i,j): return (imin <= i <= imax) and (jmin <= j <= jmax)
    def h(i,j): return math.hypot(i-gi, j-gj)

    def nearest_free(i0, j0, r=3):
        best = None; bestd = 1e9
        for di in range(-r, r+1):
            for dj in range(-r, r+1):
                ii, jj = i0+di, j0+dj
                if not in_bounds(ii, jj): continue
                if blocked_ij(ii, jj):     continue
                d = di*di + dj*dj
                if d < bestd: bestd = d; best = (ii, jj)
        return best

    if blocked_ij(si, sj):
        nf = nearest_free(si, sj, r=3)
        if nf is None: return None
        si, sj = nf
    if blocked_ij(gi, gj):
        nf = nearest_free(gi, gj, r=3)
        if nf is None: return None
        gi, gj = nf

    open_set = []
    heapq.heappush(open_set, (h(si,sj), 0.0, (si,sj), None))
    came = {}; gscore = {(si,sj): 0.0}; visited = set(); expands = 0

    moves = [(-1,0,1.0),(1,0,1.0),(0,-1,1.0),(0,1,1.0),
             (-1,-1,math.sqrt(2)),(-1,1,math.sqrt(2)),
             (1,-1,math.sqrt(2)), (1,1,math.sqrt(2))]

    while open_set:
        _, g, node, parent = heapq.heappop(open_set)
        if node in visited: continue
        came[node] = parent; visited.add(node); expands += 1
        if expands > max_expand: return None

        if node == (gi, gj):
            path = []; cur = node
            while cur is not None:
                path.append(cur); cur = came[cur]
            path.reverse()
            return [grid_to_point(n, origin, step) for n in path]

        i, j = node
        for di,dj,cost in moves:
            ii, jj = i+di, j+dj
            if not in_bounds(ii, jj): continue
            if blocked_ij(ii, jj):    continue
            ng = g + cost
            if (ii,jj) not in gscore or ng < gscore[(ii,jj)]:
                gscore[(ii,jj)] = ng
                f = ng + h(ii,jj)
                heapq.heappush(open_set, (f, ng, (ii,jj), node))
    return None

def segment_clear(a, b, boundary, trees, waters, extra_clear, samples=SMOOTH_SAMPLES):
    for i in range(samples+1):
        t = float(i)/samples
        p = rg.Point3d((1-t)*a.X + t*b.X, (1-t)*a.Y + t*b.Y, 0)
        if not curve_contains_point(boundary, p): return False
        for tree in trees:
            ok, circ = _circle_from_curve(tree)
            if ok:
                if p.DistanceTo(circ.Center) < (circ.Radius + extra_clear - 1e-6): return False
            else:
                bb = tree.GetBoundingBox(True)
                r  = 0.5*max(bb.Max.X-bb.Min.X, bb.Max.Y-bb.Min.Y)
                c  = bb.Center
                if p.DistanceTo(c) < (r + extra_clear - 1e-6): return False
        for w in waters:
            if min_dist_point_to_curve(p, w) < (extra_clear - 1e-6): return False
    seg_crv = rg.PolylineCurve([a, b])
    for w in waters:
        if curves_intersect(seg_crv, w): return False
    for tcrv in trees:
        if curves_intersect(seg_crv, tcrv): return False
    return True

def los_simplify(points, boundary, trees, waters, extra_clear, samples=SMOOTH_SAMPLES):
    if not points or len(points) <= 2: return points[:]
    simplified = [points[0]]
    i = 0
    while i < len(points)-1:
        j = len(points)-1
        while j > i+1:
            if segment_clear(points[i], points[j], boundary, trees, waters, extra_clear, samples): break
            j -= 1
        simplified.append(points[j]); i = j
    return simplified

def simplify_collinear(points, ang_thresh_deg=ANGLE_COLLINEAR_DEG):
    if len(points) < 3: return points[:]
    keep = [points[0]]
    for i in range(1, len(points)-1):
        a, b, c = points[i-1], points[i], points[i+1]
        v1 = rg.Vector3d(b.X-a.X, b.Y-a.Y, 0)
        v2 = rg.Vector3d(c.X-b.X, c.Y-b.Y, 0)
        if angle_deg(v1, v2) > ang_thresh_deg:
            keep.append(b)
    keep.append(points[-1])
    return keep

def enforce_min_end_segments(points, min_len=ROAD_MIN_SEG_LEN):
    pts = points[:]
    if len(pts) >= 2 and distance(pts[0], pts[1]) < min_len:
        if len(pts) > 2: pts.pop(1)
    if len(pts) >= 2 and distance(pts[-2], pts[-1]) < min_len:
        if len(pts) > 2: pts.pop(-2)
    return pts

def pad_midpoints(pad_rect):
    pts = poly_points(pad_rect)
    if len(pts) < 2:
        c = pad_rect.GetBoundingBox(True).Center
        return [c]
    mids = []
    for i in range(1, len(pts)):
        a = pts[i-1]; b = pts[i]
        mids.append(rg.Point3d(0.5*(a.X+b.X), 0.5*(a.Y+b.Y), 0.0))
    return mids

def boundary_touch_points(boundary, side="south", start_inset=ROAD_TOUCH_INSET):
    bb = boundary.GetBoundingBox(True)
    cx = 0.5*(bb.Min.X + bb.Max.X)
    cy = 0.5*(bb.Min.Y + bb.Max.Y)
    if side == "south": anchor = rg.Point3d(cx, bb.Min.Y - 20.0, 0)
    elif side == "north": anchor = rg.Point3d(cx, bb.Max.Y + 20.0, 0)
    elif side == "west":  anchor = rg.Point3d(bb.Min.X - 20.0, cy, 0)
    else:                 anchor = rg.Point3d(bb.Max.X + 20.0, cy, 0)
    ok, t = boundary.ClosestPoint(anchor)
    if not ok: t = boundary.Domain.T0
    touch = boundary.PointAt(t)
    centroid = curve_centroid(boundary)
    v = rg.Vector3d(centroid.X - touch.X, centroid.Y - touch.Y, 0.0)
    if v.IsTiny(): v = rg.Vector3d(0, 1, 0)
    v.Unitize()
    entry = rg.Point3d(touch.X + v.X*max(0.1, start_inset), touch.Y + v.Y*max(0.1, start_inset), 0.0)
    return touch, entry

def pick_pad_approach_point(pad_rect, from_point, offset=PAD_APPROACH_CLEAR):
    mids = pad_midpoints(pad_rect)
    best_mid = min(mids, key=lambda m: m.DistanceTo(from_point))
    dirv = rg.Vector3d(from_point.X - best_mid.X, from_point.Y - best_mid.Y, 0.0)
    if dirv.IsTiny():
        pc = pad_rect.GetBoundingBox(True).Center
        dirv = rg.Vector3d(best_mid.X - pc.X, best_mid.Y - pc.Y, 0.0)
    dirv.Unitize()
    goal = rg.Point3d(best_mid.X + dirv.X*max(0.2, offset),
                      best_mid.Y + dirv.Y*max(0.2, offset), 0.0)
    return best_mid, goal

def build_polycurve_with_straight_ends(touch_b, mid_points, touch_pad):
    if not mid_points:
        return rg.LineCurve(touch_b, touch_pad)
    mid_pl = rg.PolylineCurve(mid_points)
    filleted = None
    try:
        if mid_pl.PointCount >= 3:
            filleted = rg.Curve.CreateFilletCornersCurve(mid_pl, ROAD_FILLET_RADIUS, TOL, math.radians(1.0))
    except: filleted = None
    mid_curve = filleted if filleted is not None else mid_pl
    pcs = rg.PolyCurve()
    pcs.Append(rg.LineCurve(touch_b, mid_curve.PointAtStart))
    pcs.Append(mid_curve)
    pcs.Append(rg.LineCurve(mid_curve.PointAtEnd, touch_pad))
    return pcs

def curve_clear(crv, boundary, trees, waters, extra_clear, sample_per_m=SAMPLE_PER_METER):
    if crv is None: return False
    length = crv.GetLength()
    n = max(10, int(length * sample_per_m))
    tvals = [float(i)/max(1, n-1) for i in range(n)]
    for t in tvals:
        p = crv.PointAtNormalizedLength(t)
        if not curve_contains_point(boundary, p): return False
        for tree in trees:
            ok, circ = _circle_from_curve(tree)
            if ok:
                if p.DistanceTo(circ.Center) < (circ.Radius + extra_clear - 1e-6): return False
            else:
                bb = tree.GetBoundingBox(True)
                r  = 0.5*max(bb.Max.X-bb.Min.X, bb.Max.Y-bb.Min.Y)
                c  = bb.Center
                if p.DistanceTo(c) < (r + extra_clear - 1e-6): return False
        for w in waters:
            if min_dist_point_to_curve(p, w) < (extra_clear - 1e-6): return False
    for w in waters:
        if curves_intersect(crv, w): return False
    for tcrv in trees:
        if curves_intersect(crv, tcrv): return False
    return True

def route_centerline(boundary, trees, waters, pad_rect, entry_side, step, clearance, pad_clear):
    touch_b, entry_in     = boundary_touch_points(boundary, entry_side, ROAD_TOUCH_INSET)
    touch_pad, goal       = pick_pad_approach_point(pad_rect, entry_in, pad_clear)

    for _attempt in range(ROAD_MAX_RETRIES+1):
        origin, blocked, bb = build_nav_mask(boundary, trees, waters, [pad_rect], step, clearance)
        pts = astar_path(entry_in, goal, origin, blocked, bb, step)
        if pts is None:
            step *= 0.5
            continue
        if len(pts) >= 2:
            pts = los_simplify(pts, boundary, trees, waters, clearance)
            pts = simplify_collinear(pts)
            if pts: pts[0] = entry_in
        pts = enforce_min_end_segments(pts, ROAD_MIN_SEG_LEN)
        crv = build_polycurve_with_straight_ends(touch_b, pts, touch_pad)
        if curve_clear(crv, boundary, trees, waters, clearance):
            if len(pts) == 0:
                ok_tail = segment_clear(crv.PointAtStart, crv.PointAtEnd, boundary, trees, waters, clearance)
            else:
                ok_tail = segment_clear(pts[-1], touch_pad, boundary, trees, waters, clearance)
            if ok_tail: return crv
        step *= 0.5
    return None

def route_road(boundary, trees, waters, pads):
    if not pads: return None
    # Fast sweep: preferred side, then one alternate
    sides = [entrance_side]
    if entrance_side in ("south","north"): sides.append("east")
    else: sides.append("south")

    steps      = [ROAD_STEP_DEFAULT, ROAD_STEP_DEFAULT*0.5]
    clearances = [ROAD_CLEAR]
    pad_offsets= [PAD_APPROACH_CLEAR, 0.4]

    # Choose pad closest to preferred entry direction
    touch_b, entry_in = boundary_touch_points(boundary, sides[0], ROAD_TOUCH_INSET)
    pads_sorted = sorted(pads, key=lambda pr: pr.GetBoundingBox(True).Center.DistanceTo(entry_in))

    for p in pads_sorted:
        for s in sides:
            for st in steps:
                for c in clearances:
                    for po in pad_offsets:
                        r = route_centerline(boundary, trees, waters, p, s, st, c, po)
                        if r is not None: return r
    # Last resort: straight polyline if clear
    p = pads_sorted[0]
    t_b, e_in = boundary_touch_points(boundary, sides[0], ROAD_TOUCH_INSET)
    t_pad, _g = pick_pad_approach_point(p, e_in, pad_offsets[-1])
    direct = rg.PolylineCurve([t_b, e_in, t_pad])
    if curve_clear(direct, boundary, trees, waters, clearances[0]): return direct
    return None

# -------------------------
# MAIN (single-lot, fast)
# -------------------------
def generate_single_lot():
    random.seed(int(seed))

    size_info = LOT_SIZES[lot_type]
    # Center lot near (0,0) for easy viewing
    boundary = create_organic_boundary(size_info["width"], size_info["depth"], 0.0, 0.0)

    # Try a few quick re-rolls if road cannot be routed
    road = None; pads = []; waters = []; trees = []
    for attempt in range(MAX_SITE_RETRIES + 1):
        # Always include a pond; maybe a stream
        waters = add_water_feature(boundary, must_have_pond=True)
        # Tree density: modest for speed/clarity
        tree_density = int(max(0, tree_clusters))
        trees = add_trees(boundary, tree_density)
        pads = place_building_zones(boundary, size_info, trees, waters, one_per=one_per_lot)
        if pads:
            road = route_road(boundary, trees, waters, pads)
        if road is not None:
            break  # success; stop trying

    # ---- Outputs (single lot only) ----
    site_boundaries.append(boundary)
    buildable_zones.extend(pads)
    water_features.extend(waters)
    tree_zones.extend(trees)
    if road: access_roads.append(road)

    info = "{} LOT\nSize: {}x{}m\nTrees: {}\nPads: {}\nWater features: {}\nRoad: {}".format(
        lot_type.upper(),
        size_info["width"], size_info["depth"],
        len(trees), len(pads), len(waters),
        "Yes" if road else "No path"
    )
    site_info.append(info)

# Run
generate_single_lot()
# ---------- end python_3_script_11 ----------
python_3_script_12 = Python3Script(
    seed=number_slider_10,
    sides_min=Slider(4, range=0..10),
    sides_max=Slider(8, range=0..10),
    tree_clusters=Slider(4, range=0..10),
    ROAD_FILLET_RADIUS=Slider(2, range=0..10),
    ROAD_MIN_SEG_LEN=Slider(2, range=0..10),
    entrance_side=list_item_3)  # -> out, site_boundaries, buildable_zones, water_features, tree_zones, access_roads, site_info; inputs seed: Int32, ROAD_FILLET_RADIUS: Int32, ROAD_MIN_SEG_LEN: Int32
# ---------- python_3_script_12: Python ----------
"""
SINGLE LOT GENERATOR — fast, pond-guaranteed, smooth roads, crash-hardened
(Grasshopper Python / RhinoCommon)
"""

import Rhino, Rhino.Geometry as rg, math, random, heapq

# ---------- IO defaults ----------
site_boundaries, buildable_zones, water_features, tree_zones, access_roads, site_info = [],[],[],[],[],[]
seed             = 42  if 'seed'             not in globals() or seed is None             else seed
one_per_lot      = True if 'one_per_lot'      not in globals() or one_per_lot is None      else one_per_lot
entrance_side    = "south" if 'entrance_side' not in globals() or entrance_side not in ("south","north","east","west") else entrance_side
lot_type         = "XL"  if 'lot_type'        not in globals() or lot_type not in ("Large","XL") else lot_type
sides_min        = 7    if 'sides_min'        not in globals() or sides_min is None        else sides_min
sides_max        = 10   if 'sides_max'        not in globals() or sides_max is None        else sides_max
tree_clusters    = 4    if 'tree_clusters'    not in globals() or tree_clusters is None    else tree_clusters
pad_tree_clear   = 2.0  if 'pad_tree_clear'   not in globals() or pad_tree_clear is None   else pad_tree_clear
pad_water_clear  = 5.0  if 'pad_water_clear'  not in globals() or pad_water_clear is None  else pad_water_clear
pad_setback      = 10.0 if 'pad_setback'      not in globals() or pad_setback is None      else pad_setback
tree_water_clear = 0.3  if 'tree_water_clear' not in globals() or tree_water_clear is None else tree_water_clear
pond_radius      = 15.0 if 'pond_radius'      not in globals() or pond_radius is None      else pond_radius
pond_points      = 48   if 'pond_points'      not in globals() or pond_points is None      else pond_points
pond_noise       = 0.22 if 'pond_noise'       not in globals() or pond_noise is None       else pond_noise
pond_lobes_min   = 2    if 'pond_lobes_min'   not in globals() or pond_lobes_min is None   else pond_lobes_min
pond_lobes_max   = 6    if 'pond_lobes_max'   not in globals() or pond_lobes_max is None   else pond_lobes_max

# ---------- Tunables ----------
TOL=1e-3; ROAD_STEP_DEFAULT=6.0; ROAD_CLEAR=2.5; ROAD_MAX_RETRIES=1; SMOOTH_SAMPLES=12
ROAD_TOUCH_INSET=0.5; PAD_APPROACH_CLEAR=0.6; ROAD_MIN_SEG_LEN=3.5; ROAD_FILLET_RADIUS=9.0
ANGLE_COLLINEAR_DEG=5.0; SAMPLE_PER_METER=0.35; MAX_SITE_RETRIES=2; TURN_PENALTY=0.20
PAD_SOFTEN_STEPS=[0.0,0.4,0.8]; MIN_PAD_SCALE=0.70; GRID_DENSITY_MULT=1.25
MIN_FILLETABLE_SEG=1.2*ROAD_FILLET_RADIUS; MIN_FILLET_ARC_LEN=1.5
LOT_SIZES={"Large":{"width":100,"depth":100,"building_size":30},"XL":{"width":150,"depth":120,"building_size":40}}
APPROACH_LEAD_IN=float(globals().get('APPROACH_LEAD_IN',max(6.0,1.6*ROAD_FILLET_RADIUS,1.2*ROAD_MIN_SEG_LEN)))
MAX_DEFLECTION_DEG=float(globals().get('MAX_DEFLECTION_DEG',55.0))

# ---------- Small, safe helpers ----------
is_valid = lambda c: (c is not None and getattr(c,"IsValid",True))
def sanitize(L): 
    out=[]; 
    for c in (L or []):
        if not is_valid(c): continue
        try: 
            bb=c.GetBoundingBox(True); span=max(bb.Max.X-bb.Min.X,bb.Max.Y-bb.Min.Y)
            if (getattr(c,"GetLength",None) and c.GetLength()>1e-9) or span>1e-6 or c.IsClosed: out.append(c)
        except: pass
    return out
def contains(curve,pt,tol=TOL):
    if not is_valid(curve): return False
    try: r=curve.Contains(pt,rg.Plane.WorldXY,tol)
    except: r=curve.Contains(pt)
    return r in (rg.PointContainment.Inside,rg.PointContainment.Coincident)
def ccx(a,b,tol=TOL):
    if not(is_valid(a) and is_valid(b)): return False
    try: x=Rhino.Geometry.Intersect.Intersection.CurveCurve(a,b,tol,tol); return x and x.Count>0
    except: return False
def inside(bdry,closed,tol=TOL):
    if not(is_valid(bdry) and is_valid(closed)): return False
    try: return rg.Curve.PlanarClosedCurveRelationship(closed,bdry,rg.Plane.WorldXY,tol)==rg.RegionContainment.AInsideB
    except:
        n=max(8,int(max(1.0,closed.GetLength())/4.0))
        return all(contains(bdry,closed.PointAtNormalizedLength(float(i)/n)) for i in range(n+1))
def centroid(c):
    if not is_valid(c): return rg.Point3d(0,0,0)
    amp=rg.AreaMassProperties.Compute(c); 
    return (amp.Centroid if amp else c.GetBoundingBox(True).Center)
def poly_pts(c, n=5):
    if not is_valid(c): return []
    try: ok,pl=c.TryGetPolyline(); 
    except: ok=False
    if ok: return [pl[i] for i in range(pl.Count)]
    dom=c.Domain; n=max(n,5); 
    return [c.PointAt(dom.T0+(dom.T1-dom.T0)*i/float(n-1)) for i in range(n)]
def min_dist_pt_crv(p,c):
    if not is_valid(c): return 1e9
    try: ok,t=c.ClosestPoint(p); 
    except: ok=False
    return p.DistanceTo(c.PointAt(t)) if ok else 1e9
def angle_deg(u,v):
    u=rg.Vector3d(u); v=rg.Vector3d(v); 
    if u.IsTiny() or v.IsTiny(): return 0.0
    u.Unitize(); v.Unitize(); d=max(-1.0,min(1.0,rg.Vector3d.Multiply(u,v)))
    return math.degrees(math.acos(d))

# ---------- Lot + features ----------
def organic_boundary(w,d,cx=0,cy=0):
    n=random.randint(int(sides_min),int(sides_max)); pts=[]
    for i in range(n):
        a=2*math.pi*i/n+random.uniform(-.18,.18); R=(w+d)/4.0+random.uniform(-(w+d)/16,(w+d)/16)
        pts.append(rg.Point3d(cx+w/2+R*math.cos(a), cy+d/2+R*math.sin(a),0))
    pts.append(pts[0]); return rg.PolylineCurve(pts)

def blob(center,r,pts=pond_points,noise=pond_noise,fmin=pond_lobes_min,fmax=pond_lobes_max):
    cx,cy=center.X,center.Y; comps=[(random.randint(fmin,fmax),random.uniform(0,2*math.pi),random.uniform(.35,1.0)) for _ in range(random.randint(2,3))]
    P=[]
    for i in range(int(pts)):
        t=2*math.pi*i/float(pts); k=1.0+sum(noise*w*math.sin(f*t+ph) for f,ph,w in comps); rr=max(.2*r,r*k)
        P.append(rg.Point3d(cx+rr*math.cos(t),cy+rr*math.sin(t),0))
    try: crv=rg.NurbsCurve.CreateThroughPoints(P,3,True); 
    except: crv=None
    if crv and crv.IsClosed: return crv
    P.append(P[0]); crv=rg.Curve.CreateInterpolatedCurve(P,3); 
    if not crv.IsClosed: crv.MakeClosed(TOL)
    return crv

def add_water(boundary):
    feats=[]; bb=boundary.GetBoundingBox(True); placed=False
    for _ in range(40):
        p=rg.Point3d(random.uniform(bb.Min.X+18,bb.Max.X-18),random.uniform(bb.Min.Y+18,bb.Max.Y-18),0)
        if contains(boundary,p):
            pond=blob(p,float(pond_radius)); 
            if pond and pond.IsClosed and inside(boundary,pond): feats.append(pond); placed=True; break
    if not placed: feats.append(rg.Circle(centroid(boundary),float(pond_radius)).ToNurbsCurve())
    if random.random()<.4:
        pts=[rg.Point3d(bb.Min.X+(bb.Max.X-bb.Min.X)*(0.15+0.7*t),
                        bb.Min.Y+(bb.Max.Y-bb.Min.Y)*(0.25+0.5*t+math.sin(t*math.pi)*0.18),0) for t in[0,.25,.5,.75,1]]
        if contains(boundary,pts[0]) and contains(boundary,pts[-1]): feats.append(rg.Curve.CreateInterpolatedCurve(pts,3))
    return sanitize(feats)

def add_trees(boundary,clusters,waters):
    waters=sanitize(waters); trees=[]; pos=[]; bb=boundary.GetBoundingBox(True)
    def hits_water(cpt,r):
        circ=rg.Circle(cpt,r).ToNurbsCurve()
        for w in waters:
            if w.IsClosed and (ccx(circ,w) or inside(w,circ)): return True
            if not w.IsClosed and min_dist_pt_crv(cpt,w)<(r+tree_water_clear-1e-6): return True
        return False
    for _ in range(int(max(0,clusters))):
        for _try in range(20):
            cx=random.uniform(bb.Min.X+6,bb.Max.X-6); cy=random.uniform(bb.Min.Y+6,bb.Max.Y-6); cpt=rg.Point3d(cx,cy,0)
            if contains(boundary,cpt) and not hits_water(cpt,0.0): break
        else: continue
        for _ in range(random.randint(3,5)):
            for _t in range(16):
                p=rg.Point3d(cx+random.uniform(-7,7),cy+random.uniform(-7,7),0); r=random.uniform(2,4)
                if not contains(boundary,p): continue
                if any(p.DistanceTo(ep)<(r+er+1.0) for ep,er in pos): continue
                if hits_water(p,r): continue
                trees.append(rg.Circle(p,r).ToNurbsCurve()); pos.append((p,r)); break
    return sanitize(trees)

# ---------- Pads ----------
def inward_offset(curve,dist):
    if dist<=0: return curve
    def pick(L):
        best=None; A=-1
        for c in (L or []):
            if is_valid(c) and c.IsClosed and contains(curve,centroid(c)):
                amp=rg.AreaMassProperties.Compute(c); area=amp.Area if amp else 0
                if area>A: A, best = area, c
        return best
    try:
        o=curve.Offset(rg.Plane.WorldXY,-abs(float(dist)),TOL,rg.CurveOffsetCornerStyle.Sharp); b=pick(o)
        return b or pick(curve.Offset(rg.Plane.WorldXY,abs(float(dist)),TOL,rg.CurveOffsetCornerStyle.Sharp))
    except: return None

def oriented_rect(c,w,h,a):
    hw,hh=.5*w,.5*h; pts=[rg.Point3d(-hw,-hh,0),rg.Point3d(hw,-hh,0),rg.Point3d(hw,hh,0),rg.Point3d(-hw,hh,0),rg.Point3d(-hw,-hh,0)]
    crv=rg.PolylineCurve(pts); crv.Transform(rg.Transform.Rotation(a,rg.Vector3d(0,0,1),rg.Point3d(0,0,0))); crv.Transform(rg.Transform.Translation(c-rg.Point3d(0,0,0))); return crv

def rect_clear(rect,trees,waters,tc,wc,samples=32):
    trees,waters=sanitize(trees),sanitize(waters)
    for i in range(samples):
        p=rect.PointAtNormalizedLength(float(i)/max(1,samples-1))
        for t in trees:
            ok,c=t.TryGetCircle()
            if (ok and p.DistanceTo(c.Center)<(c.Radius+tc-1e-6)) or (not ok and p.DistanceTo(t.GetBoundingBox(True).Center)<0.5*max(t.GetBoundingBox(True).Max.X-t.GetBoundingBox(True).Min.X,t.GetBoundingBox(True).Max.Y-t.GetBoundingBox(True).Min.Y)+tc-1e-6): return False
        if any(min_dist_pt_crv(p,w)<(wc-1e-6) for w in waters): return False
    return not any(ccx(rect,w) for w in waters) and not any(ccx(rect,t) for t in trees)

def boundary_touch_points(boundary,side="south",start_inset=ROAD_TOUCH_INSET):
    bb=boundary.GetBoundingBox(True); cx=.5*(bb.Min.X+bb.Max.X); cy=.5*(bb.Min.Y+bb.Max.Y)
    anchor={"south":rg.Point3d(cx,bb.Min.Y-20,0),"north":rg.Point3d(cx,bb.Max.Y+20,0),"west":rg.Point3d(bb.Min.X-20,cy,0),"east":rg.Point3d(bb.Max.X+20,cy,0)}[side]
    ok,t=boundary.ClosestPoint(anchor); t=t if ok else boundary.Domain.T0; touch=boundary.PointAt(t)
    v=rg.Vector3d(centroid(boundary).X-touch.X, centroid(boundary).Y-touch.Y,0); v=rg.Vector3d(0,1,0) if v.IsTiny() else v; v.Unitize()
    return touch, rg.Point3d(touch.X+v.X*max(.1,start_inset), touch.Y+v.Y*max(.1,start_inset),0)

def place_pads(boundary,size,trees,waters,one_per=True):
    env=inward_offset(boundary,float(pad_setback)) or inward_offset(boundary,max(0,.5*float(pad_setback))) or boundary
    zones=[]; b=size["building_size"]; base_w,base_h=b,b*0.8; _,entry_in=boundary_touch_points(boundary,entrance_side,.5)
    bb=env.GetBoundingBox(True); margin=6.0; sx=max(.1,bb.Max.X-bb.Min.X-2*margin); sy=max(.1,bb.Max.Y-bb.Min.Y-2*margin)
    xs=int(max(6,(sx/max(6.0,base_w*.6))*GRID_DENSITY_MULT)); ys=int(max(6,(sy/max(6.0,base_h*.6))*GRID_DENSITY_MULT))
    GX=[bb.Min.X+margin+i*(sx/max(1,xs-1)) for i in range(xs)]; GY=[bb.Min.Y+margin+j*(sy/max(1,ys-1)) for j in range(ys)]
    def ang(a,b): v=rg.Vector3d(b.X-a.X,b.Y-a.Y,0); return 0.0 if v.IsTiny() else math.atan2(v.Y,v.X)
    angs=[0.0,math.pi/2]; faces=[ang(rg.Point3d(GX[ix],GY[iy],0),entry_in) for ix in range(0,len(GX),max(1,len(GX)//4)) for iy in range(0,len(GY),max(1,len(GY)//4))]
    angs=sorted({(a%(2*math.pi)) for a in angs+faces+[a+math.pi/2 for a in faces]})
    W_DRIVE,W_POND=-0.06,0.08; IDEAL_MIN,IDEAL_MAX=18.0,60.0
    def pond_score(pt):
        if not waters: return 0.0
        d=min(min_dist_pt_crv(pt,w) for w in waters); 
        if d<IDEAL_MIN: return (d-IDEAL_MIN)*.02
        if d>IDEAL_MAX: return (IDEAL_MAX-d)*.01
        mid=.5*(IDEAL_MIN+IDEAL_MAX); return 1.0-abs(d-mid)/(.5*(IDEAL_MAX-IDEAL_MIN))
    score=lambda r: W_DRIVE*r.GetBoundingBox(True).Center.DistanceTo(entry_in)+W_POND*pond_score(rg.Point3d(r.GetBoundingBox(True).Center.X,r.GetBoundingBox(True).Center.Y,0))
    trees,waters=sanitize(trees),sanitize(waters)
    for soft in PAD_SOFTEN_STEPS:
        for sc in [1.0,.9,.8,MIN_PAD_SCALE]:
            w,h=base_w*sc,base_h*sc; best=None; bestS=-1e9
            for x in GX:
                for y in GY:
                    p=rg.Point3d(x,y,0); 
                    if not contains(env,p): continue
                    for a in angs:
                        r=oriented_rect(p,w,h,a)
                        if not inside(env,r): continue
                        if not rect_clear(r,trees,waters,max(0.0,pad_tree_clear-soft),max(0.0,pad_water_clear-soft)): continue
                        if any((not inside(env,ex) or not rg.Curve.PlanarClosedCurveRelationship(r,ex,rg.Plane.WorldXY,TOL)==rg.RegionContainment.Disjoint) for ex in zones): continue
                        s=score(r); 
                        if s>bestS: bestS,best=s,r
            if best is not None: zones.append(best); return zones
    c=centroid(env); tiny=oriented_rect(rg.Point3d(c.X,c.Y,0),base_w*.6,base_h*.6,0.0)
    if inside(env,tiny): zones.append(tiny)
    return zones

# ---------- Road routing (A*, smooth, pad-tangent) ----------
snap = lambda p,o,s:(int(round((p.X-o.X)/s)),int(round((p.Y-o.Y)/s)))
pt   = lambda ij,o,s: rg.Point3d(o.X+ij[0]*s,o.Y+ij[1]*s,0)
def pad_edge_mid_and_normal(pad, prefer_from):
    pts=poly_pts(pad); c=pad.GetBoundingBox(True).Center
    if len(pts)<4: return rg.Point3d(c.X,c.Y,0), rg.Vector3d(0,1,0)
    mids=[rg.Point3d(.5*(pts[i].X+pts[(i+1)%4].X),.5*(pts[i].Y+pts[(i+1)%4].Y),0) for i in range(4)]
    norms=[rg.Vector3d(m.X-c.X,m.Y-c.Y,0) for m in mids]
    [n.Unitize() for n in norms if not n.IsTiny()]; d=rg.Vector3d(prefer_from.X-c.X,prefer_from.Y-c.Y,0); 
    if not d.IsTiny(): d.Unitize()
    i=max(range(4),key=lambda k: rg.Vector3d.Multiply(norms[k],d))
    return mids[i], norms[i]
def pad_apron(pad,from_pt,apron=PAD_APPROACH_CLEAR,lead=APPROACH_LEAD_IN):
    mid,n=pad_edge_mid_and_normal(pad,from_pt)
    goal=rg.Point3d(mid.X+n.X*max(.25,apron),mid.Y+n.Y*max(.25,apron),0)
    pre =rg.Point3d(goal.X-n.X*lead,        goal.Y-n.Y*lead,        0)
    return goal,pre
def nav_mask(boundary,trees,waters,pads,step,clear):
    trees,waters,pads=map(sanitize,(trees,waters,pads))
    bb=boundary.GetBoundingBox(True); origin=rg.Point3d(math.floor(bb.Min.X/step)*step,math.floor(bb.Min.Y/step)*step,0)
    def blocked(i,j):
        p=pt((i,j),origin,step)
        if any(contains(r,p) for r in pads) or not contains(boundary,p): return True
        for t in trees:
            ok,c=t.TryGetCircle()
            if (ok and p.DistanceTo(c.Center)<c.Radius+clear) or (not ok and p.DistanceTo(t.GetBoundingBox(True).Center)<0.5*max(t.GetBoundingBox(True).Max.X-t.GetBoundingBox(True).Min.X,t.GetBoundingBox(True).Max.Y-t.GetBoundingBox(True).Min.Y)+clear): return True
        return any(min_dist_pt_crv(p,w)<clear for w in waters)
    return origin,blocked,bb
def astar(start,goal,origin,blocked,bb,step,max_expand=35000):
    si,sj=snap(start,origin,step); gi,gj=snap(goal,origin,step)
    imin=int(math.floor((bb.Min.X-origin.X)/step))-2; imax=int(math.ceil((bb.Max.X-origin.X)/step))+2
    jmin=int(math.floor((bb.Min.Y-origin.Y)/step))-2; jmax=int(math.ceil((bb.Max.Y-origin.Y)/step))+2
    inb=lambda i,j: imin<=i<=imax and jmin<=j<=jmax; H=lambda i,j: math.hypot(i-gi,j-gj)
    def near(i0,j0,r=3):
        best=None; d0=1e9
        for di in range(-r,r+1):
            for dj in range(-r,r+1):
                ii,jj=i0+di,j0+dj
                if inb(ii,jj) and not blocked(ii,jj):
                    d=di*di+dj*dj
                    if d<d0: d0,best=d,(ii,jj)
        return best
    if blocked(si,sj): nf=near(si,sj); 
    if blocked(si,sj) and nf: si,sj=nf
    if blocked(gi,gj): nf=near(gi,gj); 
    if blocked(gi,gj) and nf: gi,gj=nf
    open=[(H(si,sj),0.0,(si,sj),None,None)]; came={}; g={(si,sj):0.0}; seen=set()
    moves=[(-1,0,1.0),(1,0,1.0),(0,-1,1.0),(0,1,1.0),(-1,-1,math.sqrt(2)),(-1,1,math.sqrt(2)),(1,-1,math.sqrt(2)),(1,1,math.sqrt(2))]
    ang=lambda a,b: 0.0 if (a is None or b is None) else abs((math.atan2(b[1],b[0])-math.atan2(a[1],a[0])+math.pi)%(2*math.pi)-math.pi)
    n=0
    while open:
        _,gc,node,parent,prev=heapq.heappop(open)
        if node in seen: continue
        came[node]=parent; seen.add(node); n+=1
        if n>max_expand: return None
        if node==(gi,gj):
            path=[]; cur=node
            while cur is not None: path.append(cur); cur=came[cur]
            path.reverse(); return [pt(k,origin,step) for k in path]
        i,j=node
        for di,dj,c in moves:
            ii,jj=i+di,j+dj
            if not inb(ii,jj) or blocked(ii,jj): continue
            ng=gc+c+TURN_PENALTY*(ang(prev,(di,dj))/math.pi)
            if (ii,jj) not in g or ng<g[(ii,jj)]:
                g[(ii,jj)]=ng; heapq.heappush(open,(ng+H(ii,jj),ng,(ii,jj),node,(di,dj)))
    return None
def seg_clear(a,b,bdry,trees,waters,clear,samp=SMOOTH_SAMPLES):
    trees,waters=map(sanitize,(trees,waters))
    for i in range(samp+1):
        t=float(i)/samp; p=rg.Point3d(a.X+(b.X-a.X)*t,a.Y+(b.Y-a.Y)*t,0)
        if not contains(bdry,p): return False
        for tcrv in trees:
            ok,c=tcrv.TryGetCircle(); 
            if (ok and p.DistanceTo(c.Center)<c.Radius+clear-1e-6) or (not ok and p.DistanceTo(tcrv.GetBoundingBox(True).Center)<0.5*max(tcrv.GetBoundingBox(True).Max.X-tcrv.GetBoundingBox(True).Min.X,tcrv.GetBoundingBox(True).Max.Y-tcrv.GetBoundingBox(True).Min.Y)+clear-1e-6): return False
        if any(min_dist_pt_crv(p,w)<clear-1e-6 for w in waters): return False
    return not any(ccx(rg.PolylineCurve([a,b]),w) for w in waters) and not any(ccx(rg.PolylineCurve([a,b]),t) for t in trees)
def los(P,bdry,trees,waters,clear,samp=SMOOTH_SAMPLES):
    if not P or len(P)<=2: return P[:]
    out=[P[0]]; i=0
    while i<len(P)-1:
        j=len(P)-1
        while j>i+1 and not seg_clear(P[i],P[j],bdry,trees,waters,clear,samp): j-=1
        out.append(P[j]); i=j
    return out
def collinear(P,th=ANGLE_COLLINEAR_DEG):
    if len(P)<3: return P[:]
    out=[P[0]]
    for i in range(1,len(P)-1):
        a,b,c=P[i-1],P[i],P[i+1]
        if angle_deg(rg.Vector3d(b.X-a.X,b.Y-a.Y,0), rg.Vector3d(c.X-b.X,c.Y-b.Y,0))>th: out.append(b)
    out.append(P[-1]); return out
def soften(P,max_defl=MAX_DEFLECTION_DEG,min_leg=ROAD_MIN_SEG_LEN):
    if len(P)<3: return P[:]
    Q=[P[0]]
    for i in range(1,len(P)-1):
        a,b,c=P[i-1],P[i],P[i+1]
        v1=rg.Vector3d(b.X-a.X,b.Y-a.Y,0); v2=rg.Vector3d(c.X-b.X,c.Y-b.Y,0)
        if v1.IsTiny() or v2.IsTiny(): Q.append(b); continue
        ang=angle_deg(v1,v2)
        if ang>max_defl and a.DistanceTo(b)>min_leg and b.DistanceTo(c)>min_leg:
            v1.Unitize(); v2.Unitize(); bis=v1+v2
            if not bis.IsTiny(): bis.Unitize(); d=min(a.DistanceTo(b),b.DistanceTo(c))*.25; Q.append(rg.Point3d(b.X+bis.X*d,b.Y+bis.Y*d,0))
            else: Q.append(b)
        else: Q.append(b)
    Q.append(P[-1]); return Q
def end_min(P,m=ROAD_MIN_SEG_LEN):
    Q=P[:]
    if len(Q)>=3 and Q[0].DistanceTo(Q[1])<m: Q.pop(1)
    if len(Q)>=3 and Q[-2].DistanceTo(Q[-1])<m: Q.pop(-2)
    return Q
def min_seg(P): 
    return min((P[i-1].DistanceTo(P[i]) for i in range(1,len(P))), default=1e9)
def prune_for_fillet(P,mn): 
    Q=P[:]
    while len(Q)>=3 and (Q[0].DistanceTo(Q[1])<mn or Q[-2].DistanceTo(Q[-1])<mn):
        if Q[0].DistanceTo(Q[1])<mn: Q.pop(1)
        if len(Q)>=3 and Q[-2].DistanceTo(Q[-1])<mn: Q.pop(-2)
    return Q
def poly_to_curve(touch,midpts,goal):
    if not midpts: return rg.LineCurve(touch,goal)
    pts=prune_for_fillet(midpts,MIN_FILLETABLE_SEG)
    if len(pts)<=2:
        pc=rg.PolyCurve(); pc.Append(rg.LineCurve(touch,pts[0]))
        if len(pts)==2: pc.Append(rg.PolylineCurve(pts)); pc.Append(rg.LineCurve(pts[1],goal))
        else: pc.Append(rg.LineCurve(pts[0],goal))
        return pc
    r=min(ROAD_FILLET_RADIUS,0.45*min_seg(pts)); pl=rg.PolylineCurve(pts); cur=None
    if r>(MIN_FILLET_ARC_LEN*.5) and pl.PointCount>=3:
        try: tmp=rg.Curve.CreateFilletCornersCurve(pl,r,TOL,math.radians(1.0)); 
        except: tmp=None
        if tmp and tmp.GetLength()>=MIN_FILLET_ARC_LEN*3.0: cur=tmp
    cur=cur or pl; pc=rg.PolyCurve(); pc.Append(rg.LineCurve(touch,cur.PointAtStart)); pc.Append(cur); pc.Append(rg.LineCurve(cur.PointAtEnd,goal)); return pc
def curve_clear(crv,bdry,trees,waters,clear,ppm=SAMPLE_PER_METER):
    if crv is None: return False
    trees,waters=map(sanitize,(trees,waters)); n=max(10,int(crv.GetLength()*ppm))
    for i in range(n):
        p=crv.PointAtNormalizedLength(float(i)/max(1,n-1))
        if not contains(bdry,p): return False
        for t in trees:
            ok,c=t.TryGetCircle()
            if (ok and p.DistanceTo(c.Center)<c.Radius+clear-1e-6) or (not ok and p.DistanceTo(t.GetBoundingBox(True).Center)<0.5*max(t.GetBoundingBox(True).Max.X-t.GetBoundingBox(True).Min.X,t.GetBoundingBox(True).Max.Y-t.GetBoundingBox(True).Min.Y)+clear-1e-6): return False
        if any(min_dist_pt_crv(p,w)<clear-1e-6 for w in waters): return False
    return not any(ccx(crv,w) for w in waters) and not any(ccx(crv,t) for t in trees)

def route_centerline(boundary,trees,waters,pad,side,step,clear,pad_clear):
    touch,entry=boundary_touch_points(boundary,side,ROAD_TOUCH_INSET); goal,pre=pad_apron(pad,entry,pad_clear)
    if seg_clear(entry,goal,boundary,trees,waters,clear):
        crv=poly_to_curve(touch,[entry,goal],goal); 
        return crv if curve_clear(crv,boundary,trees,waters,clear) else None
    target=pre or goal
    for _ in range(ROAD_MAX_RETRIES+1):
        origin,blocked,bb=nav_mask(boundary,trees,waters,[pad],step,clear)
        P=astar(entry,target,origin,blocked,bb,step)
        if P:
            P=end_min(soften(collinear(los(P,boundary,trees,waters,clear))))
            crv=poly_to_curve(touch,P,goal)
            if curve_clear(crv,boundary,trees,waters,clear) and (not P or seg_clear(P[-1],goal,boundary,trees,waters,clear)): return crv
        step*=.5
    return None

def route_road(boundary,trees,waters,pads):
    if not pads: return None
    sides=[entrance_side, ("east" if entrance_side in ("south","north") else "south")]
    steps=[ROAD_STEP_DEFAULT,ROAD_STEP_DEFAULT*.5]; offs=[PAD_APPROACH_CLEAR,0.4]
    _,ein=boundary_touch_points(boundary,sides[0],ROAD_TOUCH_INSET)
    pads=sorted(pads,key=lambda p:p.GetBoundingBox(True).Center.DistanceTo(ein))
    for p in pads:
        for s in sides:
            for st in steps:
                for c in [ROAD_CLEAR]:
                    for o in offs:
                        r=route_centerline(boundary,trees,waters,p,s,st,c,o)
                        if r: return r
    p=pads[0]; tb,ein=boundary_touch_points(boundary,sides[0],ROAD_TOUCH_INSET); goal,_=pad_apron(p,ein,offs[-1],APPROACH_LEAD_IN)
    direct=rg.PolylineCurve([tb,ein,goal]); 
    return direct if curve_clear(direct,boundary,trees,waters,ROAD_CLEAR) else None

# ---------- MAIN ----------
def generate_single_lot():
    random.seed(int(seed))
    size=LOT_SIZES[lot_type]; boundary=organic_boundary(size["width"],size["depth"],0,0)
    road=None; pads=[]; waters=[]; trees=[]
    for _ in range(MAX_SITE_RETRIES+1):
        waters=add_water(boundary); trees=add_trees(boundary,int(tree_clusters),waters)
        pads=place_pads(boundary,size,trees,waters,one_per_lot)
        if pads: road=route_road(boundary,trees,waters,pads)
        if road: break
    site_boundaries.append(boundary); buildable_zones.extend(pads); water_features.extend(waters); tree_zones.extend(trees); 
    if road: access_roads.append(road)
    site_info.append("{} LOT\nSize: {}x{}m\nTrees: {}\nPads: {}\nWater features: {}\nRoad: {}".format(lot_type.upper(),size["width"],size["depth"],len(trees),len(pads),len(waters),"Yes" if road else "No path"))

generate_single_lot()
# ---------- end python_3_script_12 ----------
number_slider_13 = Slider(3, range=0..10)
python_3_script_13 = Python3Script(
    seed=number_slider_11,
    sides_min=Slider(4, range=0..10),
    sides_max=Slider(8, range=0..10),
    tree_clusters=Slider(6, range=0..10),
    ROAD_FILLET_RADIUS=Slider(2, range=0..10),
    ROAD_MIN_SEG_LEN=Slider(2, range=0..10),
    entrance_side=list_item_4,
    pad_area=Slider(2000, range=0..10000))  # -> out, site_boundaries, buildable_zones, water_features, tree_zones, access_roads, site_info; inputs seed: Int32, ROAD_FILLET_RADIUS: Int32, ROAD_MIN_SEG_LEN: Int32
# ---------- python_3_script_13: Python ----------
"""
Single Lot Generator — straightforward + robust
- Pad never overlaps trees or ponds (uses buffered pond & clearance tests)
- Road is a simple Polyline (few legs, no tiny segments, no hooks into pad)
- Pad size: control with GH sliders named `pad_area` (m2) and `pad_aspect` (W/H)
"""

import Rhino
import Rhino.Geometry as rg
import math, random, heapq

# ===================== Inputs / Defaults =====================
site_boundaries, buildable_zones, water_features, tree_zones, access_roads, site_info = [], [], [], [], [], []

seed = 42 if 'seed' not in globals() or seed is None else int(seed)
one_per_lot = True if 'one_per_lot' not in globals() or one_per_lot is None else bool(one_per_lot)
entrance_side = ("south" if 'entrance_side' not in globals() or entrance_side not in ("south","north","east","west") else entrance_side)
lot_type = "XL" if 'lot_type' not in globals() or lot_type not in ("Large","XL") else lot_type

sides_min = 7 if 'sides_min' not in globals() or sides_min is None else int(sides_min)
sides_max = 10 if 'sides_max' not in globals() or sides_max is None else int(sides_max)
tree_clusters = 4 if 'tree_clusters' not in globals() or tree_clusters is None else int(tree_clusters)

# clearances (meters)
pad_setback     = 10.0 if 'pad_setback'     not in globals() or pad_setback     is None else float(pad_setback)
pad_tree_clear  = 2.0  if 'pad_tree_clear'  not in globals() or pad_tree_clear  is None else float(pad_tree_clear)
pad_water_clear = 5.0  if 'pad_water_clear' not in globals() or pad_water_clear is None else float(pad_water_clear)
tree_water_clear= 0.3  if 'tree_water_clear'not in globals() or tree_water_clear is None else float(tree_water_clear)

pond_radius   = 15.0 if 'pond_radius'   not in globals() or pond_radius   is None else float(pond_radius)
pond_points   = 48   if 'pond_points'   not in globals() or pond_points   is None else int(pond_points)
pond_noise    = 0.22 if 'pond_noise'    not in globals() or pond_noise    is None else float(pond_noise)
pond_lobes_min= 2    if 'pond_lobes_min'not in globals() or pond_lobes_min is None else int(pond_lobes_min)
pond_lobes_max= 4    if 'pond_lobes_max'not in globals() or pond_lobes_max is None else int(pond_lobes_max)

# ========================= Tunables ==========================
TOL=1e-3

# road shaping
ROAD_STEP_DEFAULT=6.0     # A* grid step (fallback)
ROAD_CLEAR=2.5            # clearance to trees/water
ROAD_MIN_SEG_LEN=4.5      # remove shorter legs
MIN_BEND_KEEP_DEG=95.0    # delete bends sharper than this when safe
APPROACH_LEAD_IN=8.0      # last leg goes straight out of pad for this distance
TURN_PENALTY=0.50         # discourages zigzags in A*

MAX_SITE_RETRIES=2

# pad search grid density
GRID_DENSITY_MULT=1.25
PAD_SOFTEN_STEPS=(0.0,0.4,0.8)
MIN_PAD_SCALE=0.70

# lot presets (only size is used here)
LOT_SIZES={"Large":{"width":100,"depth":100,"building_size":30},
           "XL":   {"width":150,"depth":120,"building_size":40}}

# --- Pad size (from GH sliders "pad_area", "pad_aspect") ---
_default_w = LOT_SIZES[lot_type]["building_size"]; _default_h = _default_w*0.8
_default_area   = _default_w*_default_h
_default_aspect = _default_w/_default_h
pad_area   = _default_area   if 'pad_area'   not in globals() or pad_area   is None else float(pad_area)
pad_aspect = _default_aspect if 'pad_aspect' not in globals() or pad_aspect is None else float(pad_aspect)
PAD_W = math.sqrt(max(1.0,pad_area) * max(0.2, pad_aspect))
PAD_H = max(1.0, pad_area / PAD_W)

# ======================== Small helpers ======================
def _ok(c):
    try: return c is not None and c.IsValid
    except: return False

def _contains(crv, pt, tol=TOL):
    if not _ok(crv): return False
    try: rc = crv.Contains(pt, rg.Plane.WorldXY, tol)
    except TypeError: rc = crv.Contains(pt)
    return rc in (rg.PointContainment.Inside, rg.PointContainment.Coincident)

def _min_dist_pt_crv(pt, crv):
    if not _ok(crv): return float('inf')
    try:
        ok,t=crv.ClosestPoint(pt)
        return pt.DistanceTo(crv.PointAt(t)) if ok else float('inf')
    except: return float('inf')

def _curves_intersect(a, b, tol=TOL):
    try:
        ccx = Rhino.Geometry.Intersect.Intersection.CurveCurve(a, b, tol, tol)
        return bool(ccx and ccx.Count > 0)
    except: return False

def _closed_disjoint(a_closed, b_closed, tol=TOL):
    try:
        rel = rg.Curve.PlanarClosedCurveRelationship(a_closed, b_closed, rg.Plane.WorldXY, tol)
        return rel == rg.RegionContainment.Disjoint
    except: return not _curves_intersect(a_closed, b_closed, tol)

def _tree_radius_center(tree):
    try:
        ok,c = tree.TryGetCircle()
        if ok: return c.Radius, c.Center
    except: pass
    bb = tree.GetBoundingBox(True)
    return 0.5*max(bb.Max.X-bb.Min.X, bb.Max.Y-bb.Min.Y), bb.Center

def _centroid(closed):
    if not _ok(closed): return rg.Point3d(0,0,0)
    try:
        amp=rg.AreaMassProperties.Compute(closed)
        return amp.Centroid if amp else closed.GetBoundingBox(True).Center
    except: return closed.GetBoundingBox(True).Center

def _rect(center,w,h,ang):
    hw,hh=0.5*w,0.5*h
    pts=[rg.Point3d(-hw,-hh,0), rg.Point3d(hw,-hh,0), rg.Point3d(hw,hh,0), rg.Point3d(-hw,hh,0), rg.Point3d(-hw,-hh,0)]
    crv=rg.PolylineCurve(pts)
    R=rg.Transform.Rotation(ang, rg.Vector3d(0,0,1), rg.Point3d(0,0,0))
    T=rg.Transform.Translation(center - rg.Point3d(0,0,0))
    crv.Transform(R); crv.Transform(T)
    return crv

def _inward_offset(crv, d):
    if not _ok(crv) or d<=0: return crv
    try:
        offs=crv.Offset(rg.Plane.WorldXY, -abs(float(d)), TOL, rg.CurveOffsetCornerStyle.Sharp) or []
        best=None; bestA=-1.0
        for c in offs:
            if not _ok(c) or not c.IsClosed: continue
            A=(rg.AreaMassProperties.Compute(c).Area if rg.AreaMassProperties.Compute(c) else 0.0)
            if A>bestA and _contains(crv, c.GetBoundingBox(True).Center): best,bestA=c,A
        return best
    except: return None

def _angle_deg(u,v):
    uu=rg.Vector3d(u); vv=rg.Vector3d(v)
    if uu.IsTiny() or vv.IsTiny(): return 0.0
    uu.Unitize(); vv.Unitize()
    d=max(-1.0,min(1.0,rg.Vector3d.Multiply(uu,vv)))
    return math.degrees(math.acos(d))

def _curve_min_dist(a, b, sa=48, sb=48):
    if not (_ok(a) and _ok(b)): return float('inf')
    m=float('inf')
    for i in range(max(2, sa)):
        p=a.PointAtNormalizedLength(float(i)/(sa-1))
        m=min(m,_min_dist_pt_crv(p,b))
    for j in range(max(2, sb)):
        q=b.PointAtNormalizedLength(float(j)/(sb-1))
        m=min(m,_min_dist_pt_crv(q,a))
    return m

def _buffer_closed(closed, d):
    """Outward buffer for closed curve (choose largest-area offset > original)."""
    if not (_ok(closed) and d>0): return None
    try: A0=(rg.AreaMassProperties.Compute(closed).Area or 0.0)
    except: A0=0.0
    offs=(closed.Offset(rg.Plane.WorldXY, d, TOL, rg.CurveOffsetCornerStyle.Round) or [])
    best, bestA=None, -1.0
    for c in offs:
        if not (_ok(c) and c.IsClosed): continue
        try: A=rg.AreaMassProperties.Compute(c).Area
        except: A=-1.0
        if A>A0 and A>bestA: best, bestA=c, A
    return best

# ======================= Lot primitives ======================
def create_organic_boundary(w,d,cx=0,cy=0):
    n=random.randint(sides_min, sides_max); pts=[]
    for i in range(n):
        a=(2*math.pi*i/n)+random.uniform(-0.18,0.18)
        r0=(w+d)/4.0; r=r0+random.uniform(-0.25*r0,0.25*r0)
        pts.append(rg.Point3d(cx+w/2.0 + r*math.cos(a), cy+d/2.0 + r*math.sin(a),0))
    pts.append(pts[0]); return rg.PolylineCurve(pts)

def make_organic_blob(center, base_r, pts, ampl, lobes_min, lobes_max):
    comps=[(random.randint(lobes_min,lobes_max), random.uniform(0,2*math.pi), random.uniform(0.35,1.0))
           for _ in range(random.randint(2,3))]
    cx,cy=center.X,center.Y; P=[]
    for i in range(pts):
        t=2*math.pi*i/float(pts); k=1.0
        for f,ph,w in comps: k += ampl*w*math.sin(f*t+ph)
        r=max(0.2*base_r, base_r*k)
        P.append(rg.Point3d(cx+r*math.cos(t), cy+r*math.sin(t),0))
    try:
        crv=rg.NurbsCurve.CreateThroughPoints(P,3,True)
        if crv and crv.IsClosed: return crv
    except: pass
    P.append(P[0]); crv=rg.Curve.CreateInterpolatedCurve(P,3)
    if not crv.IsClosed: crv.MakeClosed(TOL)
    return crv

def add_water_feature(boundary, must_have_pond=True):
    features=[]; bb=boundary.GetBoundingBox(True); placed=False
    for _ in range(40):
        x=random.uniform(bb.Min.X+18, bb.Max.X-18); y=random.uniform(bb.Min.Y+18, bb.Max.Y-18)
        c=rg.Point3d(x,y,0)
        if not _contains(boundary,c): continue
        pond=make_organic_blob(c, pond_radius, pond_points, pond_noise, pond_lobes_min, pond_lobes_max)
        if _ok(pond) and pond.IsClosed: 
            # keep fully inside lot
            ok=True
            for k in range(36):
                p=pond.PointAtNormalizedLength(float(k)/35.0)
                if not _contains(boundary,p): ok=False; break
            if ok: features.append(pond); placed=True; break
    if must_have_pond and not placed:
        c=_centroid(boundary); features.append(rg.Circle(c, pond_radius).ToNurbsCurve())
    return [f for f in features if _ok(f)]

def add_trees(boundary, density, waters):
    trees=[]; positions=[]; bb=boundary.GetBoundingBox(True)
    waters=[w for w in (waters or []) if _ok(w)]
    def hits_water(center,r):
        for w in waters:
            if w.IsClosed:
                for a in [2*math.pi*k/12.0 for k in range(12)]:
                    p=rg.Point3d(center.X+(r+1e-6)*math.cos(a), center.Y+(r+1e-6)*math.sin(a),0)
                    if _contains(w,p) or _min_dist_pt_crv(p,w)<1e-3: return True
            else:
                if _min_dist_pt_crv(center,w) < r + tree_water_clear: return True
        return False
    for _ in range(max(0,int(density))):
        for _try in range(20):
            x=random.uniform(bb.Min.X+6, bb.Max.X-6); y=random.uniform(bb.Min.Y+6, bb.Max.Y-6)
            c=rg.Point3d(x,y,0)
            if _contains(boundary,c) and not hits_water(c,0.0): break
        else: continue
        for _n in range(random.randint(3,5)):
            for _try in range(20):
                tx=x+random.uniform(-7,7); ty=y+random.uniform(-7,7); r=random.uniform(2,4)
                p=rg.Point3d(tx,ty,0)
                if not _contains(boundary,p): continue
                if any(p.DistanceTo(ep)<(r+er+1.0) for ep,er in positions): continue
                if hits_water(p,r): continue
                trees.append(rg.Circle(p,r).ToNurbsCurve()); positions.append((p,r)); break
    return trees

# ==================== Pad placement (robust) =================
def boundary_touch_points(boundary, side="south", inset=0.5):
    bb=boundary.GetBoundingBox(True); cx=0.5*(bb.Min.X+bb.Max.X); cy=0.5*(bb.Min.Y+bb.Max.Y)
    anchor = (rg.Point3d(cx,bb.Min.Y-20,0) if side=="south" else
              rg.Point3d(cx,bb.Max.Y+20,0) if side=="north" else
              rg.Point3d(bb.Min.X-20,cy,0) if side=="west"  else
              rg.Point3d(bb.Max.X+20,cy,0))
    ok,t=boundary.ClosestPoint(anchor); t=t if ok else boundary.Domain.T0
    touch=boundary.PointAt(t); cen=_centroid(boundary)
    v=rg.Vector3d(cen.X-touch.X, cen.Y-touch.Y,0); v=rg.Vector3d(0,1,0) if v.IsTiny() else v; v.Unitize()
    return touch, rg.Point3d(touch.X+v.X*max(0.1,inset), touch.Y+v.Y*max(0.1,inset),0)

def _pad_is_clear(rect, trees, waters, tc, wc):
    """Pad valid iff no overlap with trees and disjoint from pond buffered by wc; also min wc to all water."""
    if not _ok(rect): return False
    trees=[t for t in (trees or []) if _ok(t)]; waters=[w for w in (waters or []) if _ok(w)]
    # Trees
    for t in trees:
        r,c=_tree_radius_center(t)
        if _contains(rect, c): return False
        if _min_dist_pt_crv(c, rect) < (r+tc-1e-6): return False
        if _curves_intersect(rect, t): return False
    # Water
    for w in waters:
        if _curves_intersect(rect, w): return False
        if w.IsClosed:
            buf=_buffer_closed(w, wc)
            if buf and not _closed_disjoint(rect, buf): return False
            try:
                rel=rg.Curve.PlanarClosedCurveRelationship(rect, w, rg.Plane.WorldXY, TOL)
                if rel != rg.RegionContainment.Disjoint: return False
            except:
                # fallback: sample rect on pond test
                for k in range(32):
                    p=rect.PointAtNormalizedLength(float(k)/31.0)
                    if _contains(w,p): return False
        if _curve_min_dist(rect, w) < (wc-1e-6): return False
    return True

def _rect_clear(rect, trees, waters, tc, wc, samples=96):
    """Return True if the rectangular pad is clear of trees and water.
       - No tree center inside pad
       - Distance from pad to each tree >= r + tc
       - No pad-water intersections
       - For closed ponds: regions must be disjoint
       - Clearance to any water (closed/open) >= wc
    """
    if not _ok(rect): return False
    trees  = [t for t in (trees  or []) if _ok(t)]
    waters = [w for w in (waters or []) if _ok(w)]

    # perimeter points for robust inside checks (also hits corners)
    ring = [rect.PointAtNormalizedLength(float(i)/(max(2, samples)-1)) for i in range(max(2, samples))]

    # ---- Trees ----
    for t in trees:
        r, c = _tree_radius_center(t)
        if _contains(rect, c):                      # tree center inside pad
            return False
        if _min_dist_pt_crv(c, rect) < r + tc - 1e-6:
            return False
        try:
            ccx = Rhino.Geometry.Intersect.Intersection.CurveCurve(rect, t, TOL, TOL)
            if ccx and ccx.Count > 0:               # paranoid guard
                return False
        except: 
            pass

    # ---- Water ----
    for w in waters:
        try:
            ccx = Rhino.Geometry.Intersect.Intersection.CurveCurve(rect, w, TOL, TOL)
            if ccx and ccx.Count > 0:               # no geometric crossings
                return False
        except:
            pass

        if w.IsClosed:
            # strict region-disjoint with pond
            try:
                rel = rg.Curve.PlanarClosedCurveRelationship(rect, w, rg.Plane.WorldXY, TOL)
                if rel != rg.RegionContainment.Disjoint:
                    return False
            except:
                # fallback: any pad-perimeter point inside pond?
                if any(_contains(w, p) for p in ring):
                    return False

        # numeric clearance to any water (closed or open)
        if _curve_min_dist(rect, w, samples, samples) < wc - 1e-6:
            return False

    return True


def _pad_is_clear(rect, trees, waters, tc, wc, samples=96):
    # simple alias so place_pads can call one function
    return _rect_clear(rect, trees, waters, tc, wc, samples)


# (Only if you DON'T already have this in your file, add it too.)
def _curve_inside(boundary, crv, samples=64):
    if not (_ok(boundary) and _ok(crv)): return False
    for i in range(samples):
        p = crv.PointAtNormalizedLength(float(i)/max(1, samples-1))
        if not _contains(boundary, p): 
            return False
    return True

# --- replace your place_pads with this version ---
def place_pads(boundary, size_info, trees, waters, one_per=True):
    if not _ok(boundary): return []

    # size from sliders (with optional overrides)
    default_area = (size_info.get("building_size", 40.0)**2) * 0.8
    A  = float(globals().get('pad_area',   default_area))
    AR = float(globals().get('pad_aspect', 1.25))
    W  = max(2.0, math.sqrt(max(1.0, A)*AR))
    H  = max(2.0, A/W)
    W  = float(globals().get('pad_width',  W))
    H  = float(globals().get('pad_height', H))
    angs = [0.0, math.pi*0.5]
    rdeg = float(globals().get('pad_rotation', 0.0))
    if abs(rdeg) > 1e-9: angs.append(math.radians(rdeg))

    # envelope with setback (fallback to boundary if offset fails)
    env = _inward_offset(boundary, pad_setback) or _inward_offset(boundary, 0.5*pad_setback) or boundary

    bb = env.GetBoundingBox(True); m = 6.0
    sx = max(0.1, bb.Max.X - bb.Min.X - 2*m)
    sy = max(0.1, bb.Max.Y - bb.Min.Y - 2*m)
    nx = max(6, int((sx / max(6.0, W*0.6)) * GRID_DENSITY_MULT))
    ny = max(6, int((sy / max(6.0, H*0.6)) * GRID_DENSITY_MULT))
    xs = [bb.Min.X + m + i*(sx/max(1, nx-1)) for i in range(nx)]
    ys = [bb.Min.Y + m + j*(sy/max(1, ny-1)) for j in range(ny)]

    # driveway bias
    _, entry_in = boundary_touch_points(boundary, entrance_side, 0.5)
    def _dpt(pt, crv):
        try:
            ok,t = crv.ClosestPoint(pt)
            return pt.DistanceTo(crv.PointAt(t)) if ok else 1e9
        except: return 1e9
    def pond_bonus(pt):
        if not waters: return 0.0
        d = min(_dpt(pt, w) for w in waters if _ok(w))
        return max(0.0, 1.0 - abs(d - 30.0)/25.0)

    best=None; bestS=-1e9
    for soften in PAD_SOFTEN_STEPS:
        tc = max(0.0, pad_tree_clear  - soften)
        wc = max(0.0, pad_water_clear - soften)
        found=False
        for s in (1.0, 0.9, 0.8, MIN_PAD_SCALE):
            w, h = W*s, H*s
            for x in xs:
                for y in ys:
                    p = rg.Point3d(x, y, 0)
                    if not _contains(env, p): continue
                    for a in angs:
                        r = _rect(p, w, h, a)
                        # must be fully inside setback envelope
                        if not _curve_inside(env, r, samples=64): continue
                        # must be clear of trees & water (with clearances)
                        if not _pad_is_clear(r, trees, waters, tc, wc): continue
                        c  = r.GetBoundingBox(True).Center
                        sc = -rg.Point3d(c.X, c.Y, 0).DistanceTo(entry_in)*0.05 + pond_bonus(rg.Point3d(c.X,c.Y,0))*0.5
                        if sc > bestS: best, bestS, found = r, sc, True
            if found: break
        if found: break

    # robust fallback: shrink at env center until it fits & is clear
    if not best:
        c = env.GetBoundingBox(True).Center
        for s in (0.85, 0.75, 0.65, 0.55):
            r = _rect(rg.Point3d(c.X, c.Y, 0), W*s, H*s, 0.0)
            if _curve_inside(env, r, samples=64) and _pad_is_clear(r, trees, waters, pad_tree_clear, pad_water_clear):
                best = r; break

    # final safety: pad must be fully inside the lot boundary
    if best and not _curve_inside(boundary, best, samples=64):
        best = None

    return [best] if best else []

def place_building_zones(boundary, size_info, trees, waters, one_per=True):
    return place_pads(boundary, size_info, trees, waters, one_per)

# ===================== Road (simple polyline) =================
def _edge_mid_and_normal(pad_rect, prefer_from):
    bb=pad_rect.GetBoundingBox(True)
    crn=[rg.Point3d(bb.Min.X,bb.Min.Y,0), rg.Point3d(bb.Max.X,bb.Min.Y,0),
         rg.Point3d(bb.Max.X,bb.Max.Y,0), rg.Point3d(bb.Min.X,bb.Max.Y,0)]
    mids=[]; norms=[]; c=bb.Center
    for i in range(4):
        a,b=crn[i], crn[(i+1)%4]; m=rg.Point3d((a.X+b.X)*.5,(a.Y+b.Y)*.5,0)
        n=rg.Vector3d(m.X-c.X, m.Y-c.Y, 0)
        if not n.IsTiny(): n.Unitize()
        mids.append(m); norms.append(n)
    d=rg.Vector3d(prefer_from.X-c.X, prefer_from.Y-c.Y,0)
    if not d.IsTiny(): d.Unitize()
    idx=max(range(4), key=lambda k: rg.Vector3d.Multiply(norms[k], d))
    return mids[idx], norms[idx]

def _goal_points(pad_rect, from_pt, apron_out=0.7, lead=APPROACH_LEAD_IN):
    mid,n=_edge_mid_and_normal(pad_rect, from_pt)
    goal=rg.Point3d(mid.X+n.X*max(0.25,apron_out), mid.Y+n.Y*max(0.25,apron_out),0)
    pre =rg.Point3d(goal.X+n.X*lead, goal.Y+n.Y*lead,0)
    return goal, pre, n

def _segment_clear(a,b,boundary,trees,waters,clear,pads=None):
    trees=[t for t in (trees or []) if _ok(t)]
    waters=[w for w in (waters or []) if _ok(w)]
    pads=[p for p in (pads or []) if _ok(p)]
    # parametric sampling + intersection checks
    S=12
    for i in range(S+1):
        t=float(i)/S; p=rg.Point3d(a.X+(b.X-a.X)*t, a.Y+(b.Y-a.Y)*t, 0)
        if not _contains(boundary,p): return False
        if any(_contains(P,p) for P in pads): return False
        for tr in trees:
            r,c=_tree_radius_center(tr)
            if p.DistanceTo(c) < r+clear-1e-6: return False
        if any(_min_dist_pt_crv(p,w) < clear-1e-6 for w in waters): return False
    seg=rg.PolylineCurve([a,b])
    if any(_curves_intersect(seg,w) for w in waters): return False
    if any(_curves_intersect(seg,P) for P in pads):   return False
    return True

def _drop_kinks(P, boundary, trees, waters, clear, pad=None, min_keep_deg=MIN_BEND_KEEP_DEG, passes=3):
    if len(P)<3: return list(P)
    for _ in range(passes):
        changed=False; Q=[P[0]]
        for i in range(1,len(P)-1):
            a,b,c=Q[-1], P[i], P[i+1]
            ang=_angle_deg(rg.Vector3d(b.X-a.X,b.Y-a.Y,0), rg.Vector3d(c.X-b.X,c.Y-b.Y,0))
            if ang < min_keep_deg and _segment_clear(a, c, boundary, trees, waters, clear, pads=[pad] if pad else None):
                changed=True  # drop the sharp vertex
            else:
                Q.append(b)
        Q.append(P[-1]); P=Q
        if not changed: break
    return P

def _merge_short_segments(P, min_len=ROAD_MIN_SEG_LEN):
    if len(P)<2: return list(P)
    Q=[P[0]]
    for i in range(1,len(P)):
        if Q[-1].DistanceTo(P[i]) < min_len:
            if i<len(P)-1: continue
        Q.append(P[i])
    R=[Q[0]]
    for i in range(1,len(Q)):
        if R[-1].DistanceTo(Q[i])>1e-6: R.append(Q[i])
    return R

# ---- A* fallback bits ----
def _snap(p,o,s): return (int(round((p.X-o.X)/s)), int(round((p.Y-o.Y)/s)))
def _grid(ij,o,s): return rg.Point3d(o.X+ij[0]*s, o.Y+ij[1]*s, 0)
def _build_mask(boundary, trees, waters, pads, step, clear):
    bb=boundary.GetBoundingBox(True)
    origin=rg.Point3d(math.floor(bb.Min.X/step)*step, math.floor(bb.Min.Y/step)*step, 0)
    trees=[t for t in (trees or []) if _ok(t)]; waters=[w for w in (waters or []) if _ok(w)]
    def blocked(i,j):
        p=_grid((i,j),origin,step)
        if not _contains(boundary,p): return True
        if any(_contains(r,p) for r in (pads or [])): return True
        for t in trees:
            r,c=_tree_radius_center(t)
            if p.DistanceTo(c) < r+clear: return True
        if any(_min_dist_pt_crv(p,w)<clear for w in waters): return True
        return False
    return origin, blocked, bb

def _dirang(a,b):
    if a is None or b is None: return 0.0
    A=math.atan2(a[1],a[0]); B=math.atan2(b[1],b[0])
    return abs((B-A+math.pi)%(2*math.pi)-math.pi)

def _astar(start, goal, origin, blocked, bb, step, max_expand=35000):
    si,sj=_snap(start,origin,step); gi,gj=_snap(goal,origin,step)
    imin=int(math.floor((bb.Min.X-origin.X)/step))-2; imax=int(math.ceil((bb.Max.X-origin.X)/step))+2
    jmin=int(math.floor((bb.Min.Y-origin.Y)/step))-2; jmax=int(math.ceil((bb.Max.Y-origin.Y)/step))+2
    inb=lambda i,j:(imin<=i<=imax) and (jmin<=j<=jmax)
    h=lambda i,j: math.hypot(i-gi,j-gj)
    def nearfree(i0,j0,r=3):
        best=None; d0=1e9
        for di in range(-r,r+1):
            for dj in range(-r,r+1):
                ii,jj=i0+di,j0+dj
                if inb(ii,jj) and not blocked(ii,jj):
                    d=di*di+dj*dj
                    if d<d0: d0=d; best=(ii,jj)
        return best
    if blocked(si,sj):
        nf=nearfree(si,sj); 
        if nf: si,sj=nf
    if blocked(gi,gj):
        nf=nearfree(gi,gj); 
        if nf: gi,gj=nf
    moves=[(-1,0,1.0),(1,0,1.0),(0,-1,1.0),(0,1,1.0),(-1,-1,math.sqrt(2)),(-1,1,math.sqrt(2)),(1,-1,math.sqrt(2)),(1,1,math.sqrt(2))]
    pq=[]; heapq.heappush(pq,(h(si,sj),0.0,(si,sj),None,None))
    came={}; g={(si,sj):0.0}; seen=set(); expands=0
    while pq:
        _,gc,node,parent,prev=heapq.heappop(pq)
        if node in seen: continue
        came[node]=parent; seen.add(node); expands+=1
        if expands>max_expand: return None
        if node==(gi,gj):
            path=[]; cur=node
            while cur is not None: path.append(cur); cur=came[cur]
            path.reverse(); return [_grid(n,origin,step) for n in path]
        i,j=node
        for di,dj,base in moves:
            ii,jj=i+di,j+dj
            if not inb(ii,jj) or blocked(ii,jj): continue
            ang=_dirang(prev,(di,dj)); ng=gc+base+TURN_PENALTY*(ang/math.pi)
            if (ii,jj) not in g or ng<g[(ii,jj)]:
                g[(ii,jj)]=ng; heapq.heappush(pq,(ng+h(ii,jj),ng,(ii,jj),node,(di,dj)))
    return None

# ---- router with simple fallbacks ----
def route_polyline(boundary, trees, waters, pad_rect, side, step, clear, apron_out):
    touch, entry = boundary_touch_points(boundary, side, 0.5)
    goal, pre, n = _goal_points(pad_rect, entry, apron_out, APPROACH_LEAD_IN)
    pads=[pad_rect]

    # 1) direct line
    if _segment_clear(entry, goal, boundary, trees, waters, clear, pads=pads):
        pts=[touch, entry, goal]
    else:
        # 2) L-shape candidates
        via1=rg.Point3d(entry.X, goal.Y, 0)
        via2=rg.Point3d(goal.X,  entry.Y, 0)
        paths=[]
        for via in (via1, via2):
            if (_segment_clear(entry, via, boundary, trees, waters, clear, pads=pads) and
                _segment_clear(via, goal, boundary, trees, waters, clear, pads=pads)):
                paths.append([touch, entry, via, goal])
        if paths:
            pts=min(paths, key=lambda P: sum(P[i].DistanceTo(P[i+1]) for i in range(len(P)-1)))
        else:
            # 3) A* fallback, then compress
            origin,blocked,bb=_build_mask(boundary, trees, waters, pads, step, clear)
            path=_astar(entry, pre, origin, blocked, bb, step) or _astar(entry, goal, origin, blocked, bb, step)
            if not path: return None
            # line-of-sight compression
            mid=[path[0]]
            for k in range(1,len(path)):
                if not _segment_clear(mid[-1], path[k], boundary, trees, waters, clear, pads=pads):
                    mid.append(path[k-1])
            mid.append(path[-1])
            pts=[touch, entry]+mid

    # keep last leg straight out of the pad and simplify
    if pts[-1].DistanceTo(goal)>1e-6: pts.append(goal)
    # drop vertices inside pad
    pts=[q for q in pts if not _contains(pad_rect, q)]
    pts=_drop_kinks(pts, boundary, trees, waters, clear, pad_rect, MIN_BEND_KEEP_DEG, passes=4)
    pts=_merge_short_segments(pts, ROAD_MIN_SEG_LEN)

    # final safety
    for i in range(len(pts)-1):
        if not _segment_clear(pts[i], pts[i+1], boundary, trees, waters, clear, pads=pads): return None
    return rg.PolylineCurve(pts) if len(pts)>=2 else None

def route_road(boundary, trees, waters, pads):
    if not pads: return None
    sides=[entrance_side, ("east" if entrance_side in ("south","north") else "south")]
    for p in pads:
        for s in sides:
            st=ROAD_STEP_DEFAULT
            for _ in range(2):
                r=route_polyline(boundary, trees, waters, p, s, st, ROAD_CLEAR, 0.7)
                if r: return r
                st*=0.5
    # last tiny fallback
    touch,entry=boundary_touch_points(boundary, sides[0], 0.5)
    goal,_,_=_goal_points(pads[0], entry, 0.7, APPROACH_LEAD_IN)
    if not (_segment_clear(touch, entry, boundary, trees, waters, ROAD_CLEAR, pads=pads) and
            _segment_clear(entry, goal,  boundary, trees, waters, ROAD_CLEAR, pads=pads)):
        return None
    return rg.PolylineCurve([touch,entry,goal])

# =========================== Main ============================
def run():
    random.seed(seed)
    size=LOT_SIZES[lot_type]
    boundary=create_organic_boundary(size["width"], size["depth"], 0,0)
    road=None; pads=[]; waters=[]; trees=[]
    for _ in range(MAX_SITE_RETRIES+1):
        waters=add_water_feature(boundary, True)
        trees =add_trees(boundary, tree_clusters, waters)
        pads  =place_building_zones(boundary, size, trees, waters, one_per_lot)
        road  =route_road(boundary, trees, waters, pads) if pads else None
        if pads and road: break

    site_boundaries.append(boundary)
    buildable_zones.extend(pads)
    water_features.extend(waters)
    tree_zones.extend(trees)
    if road: access_roads.append(road)

    info="{} LOT\nSize: {}x{}m\nTrees: {}\nPads: {}\nWater features: {}\nRoad: {}".format(
        lot_type.upper(), size["width"], size["depth"], len(trees), len(pads), len(waters),
        "Yes" if road else "No path")
    site_info.append(info)

run()
# ---------- end python_3_script_13 ----------
custom_preview = CustomPreview(Geometry=boundary_surfaces, Material=colour_swatch_2)  # disabled
custom_preview_2 = CustomPreview(Geometry=boundary_surfaces_3, Material=colour_swatch_4)  # disabled
colour = Colour(python_3_script_7.Colors)
number_slider_14 = Slider(3, range=0..10)
custom_preview_3 = CustomPreview(Geometry=boundary_surfaces_2, Material=colour_swatch_5)  # disabled
custom_preview_4 = CustomPreview(Geometry=boundary_surfaces_4, Material=colour_swatch_3)  # disabled
number_slider_15 = Slider(3, range=0..10)
number_slider_16 = Slider(3, range=0..10)
custom_preview_5 = CustomPreview(Geometry=extrude, Material=colour)
negative_2 = Negative(Value=number_slider_12)  # disabled
negative_3 = Negative(Value=number_slider_13)
curve_9 = Curve(python_3_script_10.tree_zones)  # disabled
curve_10 = Curve(python_3_script_10.access_roads)  # disabled
curve_11 = Curve(python_3_script_10.site_boundaries)  # disabled
curve_12 = Curve(python_3_script_10.water_features)  # disabled
curve_13 = Curve(python_3_script_10.buildable_zones)  # disabled
negative_4 = Negative(Value=number_slider_14)
curve_14 = Curve(python_3_script_11.tree_zones)
curve_15 = Curve(python_3_script_11.access_roads)
curve_16 = Curve(python_3_script_11.site_boundaries)
negative_5 = Negative(Value=number_slider_15)
curve_17 = Curve(python_3_script_11.water_features)
curve_18 = Curve(python_3_script_11.buildable_zones)
negative_6 = Negative(Value=number_slider_16)
number_slider_17 = Slider(3, range=0..10)  # disabled
curve_19 = Curve(python_3_script_9.tree_zones)
curve_20 = Curve(python_3_script_9.access_roads)
curve_21 = Curve(python_3_script_9.site_boundaries)
curve_22 = Curve(python_3_script_9.water_features)
curve_23 = Curve(python_3_script_9.buildable_zones)
curve_24 = Curve(python_3_script_12.tree_zones)
curve_25 = Curve(python_3_script_12.access_roads)
curve_26 = Curve(python_3_script_12.site_boundaries)
curve_27 = Curve(python_3_script_13.tree_zones)
curve_28 = Curve(python_3_script_12.water_features)
curve_29 = Curve(python_3_script_13.access_roads)
curve_30 = Curve(python_3_script_12.buildable_zones)
curve_31 = Curve(python_3_script_13.site_boundaries)
curve_32 = Curve(python_3_script_13.water_features)
curve_33 = Curve(python_3_script_13.buildable_zones)
offset_curve_2 = OffsetCurve(Curve=curve_10, Plane=PlaneXY(0, 0, 0), Distance=number_slider_12, BothSides=negative_2, Kinks=0, CapType=1)  # disabled
colour_swatch_6 = ColourSwatch(SwatchColor=RGB(0, 0, 0))  # disabled
offset_curve_3 = OffsetCurve(Curve=curve_15, Plane=PlaneXY(0, 0, 0), Distance=number_slider_13, BothSides=negative_3, Kinks=0, CapType=1)
boundary_surfaces_5 = BoundarySurfaces(Edges=curve_11)  # disabled
area_2 = Area(Geometry=curve_13)  # -> Area, Centroid; disabled
offset_curve_4 = OffsetCurve(Curve=curve_20, Plane=PlaneXY(0, 0, 0), Distance=number_slider_14, BothSides=negative_4, Kinks=0, CapType=1)
boundary_surfaces_6 = BoundarySurfaces(Edges=curve_13)  # disabled
offset_curve_5 = OffsetCurve(Curve=curve_25, Plane=PlaneXY(0, 0, 0), Distance=number_slider_15, BothSides=negative_5, Kinks=0, CapType=1)
offset_curve_6 = OffsetCurve(Curve=curve_29, Plane=PlaneXY(0, 0, 0), Distance=number_slider_16, BothSides=negative_6, Kinks=0, CapType=1)
area_3 = Area(Geometry=curve_18)  # -> Area, Centroid
boundary_surfaces_7 = BoundarySurfaces(Edges=offset_curve_2)  # disabled
area_4 = Area(Geometry=curve_23)  # -> Area, Centroid
boundary_surfaces_8 = BoundarySurfaces(Edges=curve_9)  # disabled
boundary_surfaces_9 = BoundarySurfaces(Edges=curve_12)  # disabled
area_5 = Area(Geometry=curve_30)  # -> Area, Centroid
custom_preview_lineweights_2 = CustomPreviewLineweights(Geometry=curve_11, Shader=colour_swatch_6, Thickness=number_slider_17, Absolute=False)  # disabled
area_6 = Area(Geometry=curve_33)  # -> Area, Centroid
boundary_surfaces_10 = BoundarySurfaces(Edges=curve_14)
boundary_surfaces_11 = BoundarySurfaces(Edges=curve_17)
boundary_surfaces_12 = BoundarySurfaces(Edges=curve_18)
boundary_surfaces_13 = BoundarySurfaces(Edges=offset_curve_3)
boundary_surfaces_14 = BoundarySurfaces(Edges=curve_19)
boundary_surfaces_15 = BoundarySurfaces(Edges=curve_22)
boundary_surfaces_16 = BoundarySurfaces(Edges=curve_23)
boundary_surfaces_17 = BoundarySurfaces(Edges=offset_curve_4)
boundary_surfaces_18 = BoundarySurfaces(Edges=curve_24)
boundary_surfaces_19 = BoundarySurfaces(Edges=curve_28)
boundary_surfaces_20 = BoundarySurfaces(Edges=curve_30)
boundary_surfaces_21 = BoundarySurfaces(Edges=curve_27)
boundary_surfaces_22 = BoundarySurfaces(Edges=offset_curve_5)
boundary_surfaces_23 = BoundarySurfaces(Edges=curve_32)
boundary_surfaces_24 = BoundarySurfaces(Edges=curve_33)
python_3_script_14 = Python3Script()  # -> out, a, b, c, d
# ---------- python_3_script_14: Python ----------
import Rhino.Geometry as rg

# ----------------- Parameters -----------------
width, height = 12.0, 8.0          # footprint size (m)
core_w, core_h = 3.0, 4.0         # atrium / light shaft
roof_depth   = 0.8                 # over‑hang depth
building_ht  = 3.5                 # overall building height

# ----------------- Helpers ---------------------------------
def rect(x, y, w, h):
    """Return a planar rectangle as a NurbsCurve."""
    plane = rg.Plane(rg.Point3d(x + w/2, y + h/2, 0), rg.Vector3d.ZAxis)
    return rg.Rectangle3d(plane, w, h).ToNurbsCurve()

def extrude(curve):
    """Extrude a planar curve to a solid of height building_ht."""
    vec = rg.Vector3d(0, 0, building_ht)
    return rg.Extrusion.Create(curve, building_ht, True)

# ----------------- Footprint ---------------------------------
footprint_curve = rect(0, 0, width, height)

# ----------------- Atrium (light shaft) ----------------------
core_x = (width - core_w)/2
core_y = (height - core_h)/2
atrium_curve = rect(core_x, core_y, core_w, core_h)
atrium_solid = extrude(atrium_curve)

# ----------------- Rooms ------------------------------------
rooms = []

# 1. Living / Dining (left side of atrium)
left_w = (width - core_w)/2
rooms.append(extrude(rect(0, 0, left_w, height)))

# 2. Bedroom / Office (right side of atrium)
rooms.append(extrude(rect(width-left_w, 0, left_w, height)))

# 3. Kitchen (back of atrium)
kitchen_h = 2.5
rooms.append(extrude(rect(core_x, height-kitchen_h, core_w, kitchen_h)))

# 4. Bathroom (adjacent to kitchen, 1 m wide)
bathroom_w = 1.0
rooms.append(extrude(rect(core_x+core_w/2-bathroom_w/2,
                          height-kitchen_h-1.5,
                          bathroom_w, 1.5)))

# 5. Storage / Utility (corner of left room, 1 m wide)
storage_w = 1.0
rooms.append(extrude(rect(0, height-1.5, storage_w, 1.5)))

# ----------------- Roof over‑hang ----------------------------
roof_pts = [
    rg.Point3d(0,          roof_depth, 0),
    rg.Point3d(width,      roof_depth, 0),
    rg.Point3d(width,      -roof_depth, 0),
    rg.Point3d(0,          -roof_depth, 0)
]
roof_curve = rg.PolylineCurve(roof_pts)
roof_surf  = rg.Surface.CreateExtrusion(roof_curve,
                                        rg.Vector3d(0,0,building_ht))

# ----------------- Outputs -----------------------------------
a = footprint_curve   # plan view (optional preview)
b = atrium_solid      # solid atrium
c = rooms             # list of all room solids
d = roof_surf         # roof surface
# ---------- end python_3_script_14 ----------
python_3_script_15 = Python3Script()  # -> out, a, b, c, d
# ---------- python_3_script_15: Python ----------
import Rhino.Geometry as rg

# ----------------- Parameters -----------------
width, height = 12.0, 8.0          # footprint size (m)
core_w, core_h = 3.0, 4.0         # atrium size
roof_depth   = 0.8                 # over‑hang depth
building_ht  = 3.5                 # overall building height

# ----------------- Helper ---------------------------------
def rect(x, y, w, h):
    """Return a planar rectangle as a NurbsCurve."""
    plane = rg.Plane(rg.Point3d(x + w/2, y + h/2, 0), rg.Vector3d.ZAxis)
    return rg.Rectangle3d(plane, w, h).ToNurbsCurve()

def extrude(curve, ht):
    """Extrude a planar curve to a solid."""
    plane = rg.Plane.WorldXY
    vec   = rg.Vector3d(0, 0, ht)
    return rg.Extrusion.Create(curve, ht, True)

# ----------------- Footprint ---------------------------------
footprint_curve = rect(0, 0, width, height)

# ----------------- Atrium (light shaft) ----------------------
core_x = (width - core_w)/2
core_y = (height - core_h)/2
atrium_curve = rect(core_x, core_y, core_w, core_h)
atrium_solid = extrude(atrium_curve, building_ht)

# ----------------- Rooms ------------------------------------
rooms = []

# Left side room
left_w  = (width - core_w)/2
rooms.append(extrude(rect(0, 0, left_w, height), building_ht))

# Right side room
rooms.append(extrude(rect(width-left_w, 0, left_w, height), building_ht))

# Kitchen at back of atrium
kitchen_h = 2.5
rooms.append(extrude(rect(core_x, height-kitchen_h, core_w, kitchen_h),
                     building_ht))

# ----------------- Roof over‑hang ----------------------------
roof_pts = [
    rg.Point3d(0,          roof_depth, 0),
    rg.Point3d(width,      roof_depth, 0),
    rg.Point3d(width,      -roof_depth, 0),
    rg.Point3d(0,          -roof_depth, 0)
]
roof_curve = rg.PolylineCurve(roof_pts)
roof_surf  = rg.Surface.CreateExtrusion(roof_curve, rg.Vector3d(0,0,building_ht))

# ----------------- Outputs -----------------------------------
a = footprint_curve   # plan view
b = atrium_solid      # solid atrium
c = rooms             # list of room solids
d = roof_surf         # roof surface
# ---------- end python_3_script_15 ----------
python_3_script_16 = Python3Script()  # -> out, a, b, c, d
# ---------- python_3_script_16: Python ----------
# ──────────────────────────────────────────────────────────────
# Parameters – change these to regenerate the model
footprint_len = 12.0          # m
footprint_wid = 8.0           # m
room_h        = 3.5            # m
atrium_w, atrium_d = 3.0, 4.0 # m (width × depth)
roof_overhang   = 0.8         # m
roof_pitch      = 0.05        # rise/run

# ──────────────────────────────────────────────────────────────
import Rhino.Geometry as rg

def rect_brep(x, y):
    """Return a rectangular Brep in the XY plane centred at origin."""
    return rg.Brep.CreateFromBox(
        rg.Box(rg.Plane.WorldXY,
               rg.Interval(-x/2.0, x/2.0),
               rg.Interval(-y/2.0, y/2.0),
               rg.Interval(0, 1)))   # unit height; we will scale later

# 1. Base footprint (extruded to room height)
base_extrude = rg.Brep.CreateFromBox(
    rg.Box(rg.Plane.WorldXY,
           rg.Interval(-footprint_len/2.0, footprint_len/2.0),
           rg.Interval(-footprint_wid/2.0, footprint_wid/2.0),
           rg.Interval(0, room_h))
)

# 2. Central atrium (cut through the base)
atrium_extrude = rg.Brep.CreateFromBox(
    rg.Box(rg.Plane.WorldXY,
           rg.Interval(-atrium_w/2.0, atrium_w/2.0),
           rg.Interval(-atrium_d/2.0, atrium_d/2.0),
           rg.Interval(0, room_h))
)

# 3. Subtract atrium from base
house = rg.Brep.CreateBooleanDifference(base_extrude, atrium_extrude, 0.01)[0]

# 4. Roof – a shallow overhang with slight pitch
roof_height = room_h + roof_pitch    # total height of the roof box
roof_brep = rg.Brep.CreateFromBox(
    rg.Box(rg.Plane.WorldXY,
           rg.Interval(-(footprint_len/2.0 + roof_overhang),
                       footprint_len/2.0 + roof_overhang),
           rg.Interval(-(footprint_wid/2.0 + roof_overhang),
                       footprint_wid/2.0 + roof_overhang),
           rg.Interval(room_h, roof_height))
)

# 5. Union everything
final = rg.Brep.CreateBooleanUnion([house, roof_brep], 0.01)[0]

# ──────────────────────────────────────────────────────────────
# Output the final Brep to Grasshopper
a = final   # 'a' is the output variable in ghPython
# ---------- end python_3_script_16 ----------
boundary_surfaces_25 = BoundarySurfaces(Edges=offset_curve_6)
python_3_script_17 = Python3Script()  # -> out, a, b, c, d
# ---------- python_3_script_17: Python ----------
# Parameters – edit these to regenerate the model
room_w   = 4.0          # width of one room (m)
room_d   = 5.0          # depth of one room (m)
room_h   = 3.0          # height of each room (m)

n_rooms  = 4            # number of rooms in the long direction
overhang = 0.8          # roof over‑hang (m)
pitch    = 0.05         # rise/run ratio

import Rhino.Geometry as rg

# Helper: create a single room box and translate it to its position
def make_room(index):
    b = rg.Brep.CreateFromBox(
        rg.Box(rg.Plane.WorldXY,
               rg.Interval(-room_w/2.0,  room_w/2.0),
               rg.Interval(-room_d/2.0,  room_d/2.0),
               rg.Interval(0,          room_h)))
    # move it along X so rooms line up
    t = rg.Transform.Translation(rg.Vector3d(index * room_w, 0, 0))
    b.Transform(t)
    return b

# Build all rooms and union them into one solid body
rooms   = [make_room(i) for i in range(n_rooms)]
body    = rg.Brep.CreateBooleanUnion(rooms, 0.01)[0]

# Roof – a single box that sits on top of the whole building
roof_top = room_h + pitch * (room_w  * n_rooms)
roof_box = rg.Brep.CreateFromBox(
    rg.Box(rg.Plane.WorldXY,
           rg.Interval(-(room_w*n_rooms/2.0 + overhang),
                       room_w*n_rooms/2.0 + overhang),
           rg.Interval(-room_d/2.0 - overhang,
                       room_d/2.0 + overhang),
           rg.Interval(room_h, roof_top)))

# Union body + roof
final = rg.Brep.CreateBooleanUnion([body, roof_box], 0.01)[0]

# Output the final Brep to Grasshopper
a = final   # 'a' is the output variable in ghPython
# ---------- end python_3_script_17 ----------
panel_9 = Panel(area_3.Area)
python_3_script_18 = Python3Script()  # -> out, a
# ---------- python_3_script_18: Python ----------
# GH-Python – Rhino/Grasshopper
import rhinoscriptsyntax as rs

# ---------- Parameters ----------
w, d = 30.0, 20.0          # footprint size
h_main, h_sec = 6.0, 4.0    # heights of main and secondary volumes
overhang = 1.5              # roof over‑hang height
n_volumes = 3               # number of stacked blocks

# ---------- Helper: create a box ----------
def make_box(x, y, bw, bd, bh):
    pts = [rs.CreatePoint(x, y, 0),
           rs.CreatePoint(x+bw, y, 0),
           rs.CreatePoint(x+bw, y+bd, 0),
           rs.CreatePoint(x, y+bd, 0)]
    base = rs.AddPolyline(pts + [pts[0]])
    return rs.ExtrudeCurveStraight(base, (0,0,0), (0,0,bh))

# ---------- Build stacked volumes ----------
volumes = []
z = 0
for i in range(n_volumes):
    bw = w *(1 - 0.05* i)          # taper width
    bd = d  *(1 - 0.07* i)          # taper depth
    bh = h_main if i == 0 else h_sec
    vol = make_box((w-bw)/2, (d-bd)/2, bw, bd, bh)
    rs.MoveObject(vol, (0,0,z))
    volumes.append(vol)
    z += bh

# ---------- Roof ----------
roof_pts = [rs.CreatePoint(0, 0, z+overhang),
            rs.CreatePoint(w, 0, z+overhang),
            rs.CreatePoint(w, d, z+overhang),
            rs.CreatePoint(0, d, z+overhang)]
roof = rs.AddPolyline(roof_pts + [roof_pts[0]])

# ---------- Output ----------
a = volumes + [roof]   # 'a' is the default output variable
# ---------- end python_3_script_18 ----------
colour_swatch_7 = ColourSwatch(SwatchColor=RGB(106, 217, 78))  # disabled
boundary_surfaces_26 = BoundarySurfaces(Edges=curve_16)
colour_swatch_8 = ColourSwatch(SwatchColor=RGB(19, 214, 201))  # disabled
panel_10 = Panel(area_4.Area)
panel_11 = Panel(area_5.Area)
boundary_surfaces_27 = BoundarySurfaces(Edges=curve_21)
panel_12 = Panel(area_6.Area)
colour_swatch_9 = ColourSwatch(SwatchColor=RGB(240, 182, 182))  # disabled
colour_swatch_10 = ColourSwatch(SwatchColor=RGBA(255, 255, 255, 0))  # disabled
boundary_surfaces_28 = BoundarySurfaces(Edges=curve_26)
boundary_surfaces_29 = BoundarySurfaces(Edges=curve_31)
brep_2 = Brep(python_3_script_15.b)
brep_3 = Brep(python_3_script_14.b)
brep_4 = Brep(python_3_script_15.a)
brep_5 = Brep(python_3_script_15.c)
brep_6 = Brep(python_3_script_16.b)
brep_7 = Brep(python_3_script_17.b)
brep_8 = Brep(python_3_script_14.a)
brep_9 = Brep(python_3_script_14.c)
brep_10 = Brep(python_3_script_16.a)
brep_11 = Brep(python_3_script_17.a)
brep_12 = Brep(python_3_script_16.c)
brep_13 = Brep(python_3_script_17.c)
custom_preview_6 = CustomPreview(Geometry=boundary_surfaces_8, Material=colour_swatch_7)  # disabled
custom_preview_7 = CustomPreview(Geometry=boundary_surfaces_9, Material=colour_swatch_8)  # disabled
custom_preview_8 = CustomPreview(Geometry=boundary_surfaces_7, Material=ColourSwatch(SwatchColor=RGB(158, 158, 158)))
custom_preview_9 = CustomPreview(Geometry=boundary_surfaces_5, Material=colour_swatch_10)  # disabled
custom_preview_10 = CustomPreview(Geometry=boundary_surfaces_6, Material=colour_swatch_9)  # disabled
custom_preview_11 = CustomPreview(Geometry=boundary_surfaces_10, Material=ColourSwatch(SwatchColor=RGB(106, 217, 78)))
custom_preview_12 = CustomPreview(Geometry=boundary_surfaces_11, Material=ColourSwatch(SwatchColor=RGB(19, 214, 201)))
custom_preview_13 = CustomPreview(Geometry=boundary_surfaces_13, Material=ColourSwatch(SwatchColor=RGB(158, 158, 158)))
custom_preview_14 = CustomPreview(Geometry=boundary_surfaces_12, Material=ColourSwatch(SwatchColor=RGB(240, 182, 182)))
custom_preview_15 = CustomPreview(Geometry=boundary_surfaces_26, Material=ColourSwatch(SwatchColor=RGBA(255, 255, 255, 0)))
custom_preview_16 = CustomPreview(Geometry=boundary_surfaces_14, Material=ColourSwatch(SwatchColor=RGB(106, 217, 78)))
custom_preview_lineweights_3 = CustomPreviewLineweights(Geometry=curve_16, Shader=ColourSwatch(SwatchColor=RGB(0, 0, 0)), Thickness=Slider(3, range=0..10), Absolute=False)
custom_preview_17 = CustomPreview(Geometry=boundary_surfaces_15, Material=ColourSwatch(SwatchColor=RGB(19, 214, 201)))
custom_preview_18 = CustomPreview(Geometry=boundary_surfaces_17, Material=ColourSwatch(SwatchColor=RGB(158, 158, 158)))
custom_preview_19 = CustomPreview(Geometry=boundary_surfaces_16, Material=ColourSwatch(SwatchColor=RGB(240, 182, 182)))
custom_preview_20 = CustomPreview(Geometry=boundary_surfaces_27, Material=ColourSwatch(SwatchColor=RGBA(255, 255, 255, 0)))
custom_preview_21 = CustomPreview(Geometry=boundary_surfaces_18, Material=ColourSwatch(SwatchColor=RGB(106, 217, 78)))
custom_preview_22 = CustomPreview(Geometry=boundary_surfaces_19, Material=ColourSwatch(SwatchColor=RGB(19, 214, 201)))
custom_preview_23 = CustomPreview(Geometry=boundary_surfaces_22, Material=ColourSwatch(SwatchColor=RGB(158, 158, 158)))
custom_preview_24 = CustomPreview(Geometry=boundary_surfaces_20, Material=ColourSwatch(SwatchColor=RGB(240, 182, 182)))
custom_preview_25 = CustomPreview(Geometry=boundary_surfaces_28, Material=ColourSwatch(SwatchColor=RGBA(255, 255, 255, 0)))
custom_preview_26 = CustomPreview(Geometry=boundary_surfaces_21, Material=ColourSwatch(SwatchColor=RGB(106, 217, 78)))
custom_preview_27 = CustomPreview(Geometry=boundary_surfaces_23, Material=ColourSwatch(SwatchColor=RGB(19, 214, 201)))
custom_preview_28 = CustomPreview(Geometry=boundary_surfaces_25, Material=ColourSwatch(SwatchColor=RGB(158, 158, 158)))
custom_preview_lineweights_4 = CustomPreviewLineweights(Geometry=curve_21, Shader=ColourSwatch(SwatchColor=RGB(0, 0, 0)), Thickness=Slider(3, range=0..10), Absolute=False)
custom_preview_29 = CustomPreview(Geometry=boundary_surfaces_24, Material=ColourSwatch(SwatchColor=RGB(240, 182, 182)))
custom_preview_30 = CustomPreview(Geometry=boundary_surfaces_29, Material=ColourSwatch(SwatchColor=RGBA(255, 255, 255, 0)))
custom_preview_lineweights_5 = CustomPreviewLineweights(Geometry=curve_26, Shader=ColourSwatch(SwatchColor=RGB(0, 0, 0)), Thickness=Slider(3, range=0..10), Absolute=False)
custom_preview_lineweights_6 = CustomPreviewLineweights(Geometry=curve_31, Shader=ColourSwatch(SwatchColor=RGB(0, 0, 0)), Thickness=Slider(3, range=0..10), Absolute=False)
