# Grasshopper definition PlotGeneration.gh (Grasshopper 1.0.8)
# plug-ins: CORE.Toolbox.Grasshopper, Pufferfish, Human, MetaHopper

# You are an architect conducting site analysis to inform building massing and program layout.
# Site Legend
# 
# North: Top of image
# Green circles: Trees
# Blue: Water feature
# Red: Buildable zone
# Grey: Access road
# Black: Property boundary
# GridLines: each square is 10x10 meters to give scale
# 
# Provide Architectural Response:
# 1. Site Reading (2 sentences)
# What is the site telling you? Identify the dominant spatial condition and opportunity.
# 2. Massing Concept
# Form: How is the planning layout?
# Logic: How does this form respond to the site and climate?
# Orientation: Building's primary axis and why
# 3. Program Distribution Strategy
# Describe where spaces go and why, like an architect would:
# Place living spaces [where] to [capture what]. Position bedrooms and any other rooms that can be a part of the house related to the users and the local culture [where] for [privacy/views/shade]. Locate entry [where] to [create what experience].
# 4. Critical Moves
# Three essential design decisions:
# 
# View axis: From [where] to [what]
# Threshold: How you enter and what you see
# Edge: How building meets [water/trees/road/site features]
# 
# 5. Spatial Diagram
# Simple relationship sketch. Provide also the location and orientation of where features are if north is on top of image and make sure to be explicit for instructions to someone else who hasn't been to the site.
# 
# Output
# Write as you would present to a client - clear design intent focused on experience and site response. Maximum 200 words.
# 
# Analyze this site and describe the massing strategy.
point = Point()
# You are analyzing a site diagram for architectural design in [CITY, LOCATION].
# Site Legend (interpret the image accordingly)
# 
# North = top of image
# 
# Green circles = Trees
# 
# Blue = Water feature (pond, stream, or pool)
# 
# Red = Buildable zone
# 
# Grey = Access road
# 
# Black = Property boundary
# 
# Grid = 10 × 10 m squares (scale reference)
# ## Inputs
# 1. Site diagram (interpret colors, boundaries, features, scale)
# 2. Location for climate/cultural context
# 
# ## Analysis Task
# Combine site reading with your knowledge of local climate, solar angles, prevailing winds, rainfall patterns, and cultural/building traditions for this specific location.
# 
# ## Output (JSON only, <150 words)
# {
#   "site_context": "2-sentence site condition + primary opportunity",
# "location": "city and climate",
#   "climate_strategy": {
#     "orientation": "Optimal building orientation for this latitude",
#     "form": "Massing response to local sun/wind/rain patterns",
#     "passive": "Key passive strategy for this climate zone"
#   },
#   "program_logic": {
#     "public": "Where/why based on site+climate (use cardinal directions)",
#     "private": "Where/why for bedrooms/quiet spaces",
#     "entry": "Placement considering arrival+weather protection"
#   },
#   "critical_decisions": {
#     "view": "Primary vista to capture",
#     "outdoor": "How to use exterior space in this climate",
#     "materials": "Brief suggestion based on local climate/tradition"
#   },
#   "local_wisdom": "One key insight specific to building in [LOCATION]"
# }
# 
# ## Instructions
# - Use your knowledge of the location's climate, typical weather patterns, and vernacular architecture
# - Every decision should reference both site conditions AND local context
# - Prioritize passive design strategies appropriate for the region and the location that is provided.
# -Provide the best location for the entry location based on the site conditions.
# - Valid JSON only
# You are an architect’s copilot. Analyze the provided site image and return a compact, structured site strategy that a second model will use to lay out building spaces.
# 
# INTERPRETATION LEGEND (from image)
# - North = top of image
# - East = right of image
# -West = left of image
# -South = bottom of image
# - Green circles = Trees
# - Blue = Water feature (pond/stream/pool)
# - Red = Buildable zone
# - Grey = Access road
# - Black = Property boundary
# - Grid = 10 × 10 m squares (scale reference)
# 
# REQUIREMENTS
# - Be location-aware: use cardinal directions (north/south/east/west) and “edge/corner/center” of the plot.
# - Prioritize climate response, privacy hierarchy, and cultural expectations.
# - Output **valid JSON only**, max ~200 words across text fields.
# - Do not include comments or extra text outside JSON.
# 
# OUTPUT JSON SCHEMA
# {
#   "site_reading": "<2-sentence summary: dominant spatial condition + key opportunity>",
#   "massing_concept": {
#     "form": "<linear | courtyard | L-shaped | cluster | bar | compact | other>",
#     "climate_response": "<how orientation/form addresses sun, wind, shade>",
#     "orientation": "<primary axis and why (e.g., east–west bar to shade south)>"
#   },
#   "program_strategy": {
#     "living_spaces": "<where & why (e.g., north edge to face trees, filtered light)>",
#     "private_spaces": "<where & why (e.g., east side for morning sun, privacy)>",
#     "entry": "<where & why (e.g., south edge from road, framed threshold)>"
#   },
#   "critical_moves": {
#     "view_axis": "from <location> to <feature>",
#     "threshold": "<entry sequence and first reveal>",
#     "edge": "<how building meets water/trees/road/boundary>"
#   },
#   "spatial_diagram": {
#     "living": "<relative placement>",
#     "bedrooms": "<relative placement>",
#     "kitchen_dining": "<relative placement>",
#     "entry": "<relative placement>",
#     "notes": "<key adjacencies/orientation cues>"
#   },
#   "early_adjacency_graph": {
#     "nodes": [
#       {
#         "id": "<lowercase identifier>",
#         "role": "<entry | living | kitchen | dining | bedroom | bath | service | outdoor | circulation>",
#         "preferred_zone": "<north|south|east|west|center|nw|ne|sw|se>",
#         "level": "<0|1|2>",
#         "priority": "<primary|secondary>",
#         "notes": "<short rationale>"
#       }
#     ],
#     "edges": [
#       ["<node_id_A>", "<node_id_B>", "<type: direct|visual|service>", "<strength: strong|moderate|weak>"]
#     ]
#   },
#   "site_features": {
#     "road_access": "<where (e.g., south edge, mid)>",
#     "water_feature": "<where (e.g., northwest corner, along north edge)>",
#     "tree_clusters": "<where (e.g., north band, sparse east)>",
#     "buildable_zone": "<shape & where (e.g., central rectangle set back from water)>",
#     "constraints": "<setbacks, no-build edges, flood/steep areas if any>"
#   }
# }
# You are an architect’s copilot.
# Analyze the provided site image and return a clear, structured **site strategy** that will guide another model in laying out building spaces.
# 
# ### INTERPRETATION LEGEND (from image)
# - North = top of image
# - East = right of image
# - West = left of image
# - South = bottom of image
# - Green circles = Trees
# - Blue = Water feature (pond, stream, or pool)
# - Red = Buildable zone
# - Grey = Access road
# - Black = Property boundary
# - Grid = 10 × 10 m squares (scale reference)
# 
# ### REQUIREMENTS
# - Always describe **where features and spaces are located** using cardinal directions and relative zones (north, south, east, west, center, NW, NE, SW, SE).
# - Be explicit: specify which edge or corner of the site features belong to.
# - Prioritize: **climate response**, **privacy hierarchy**, and **cultural expectations**.
# - Output must be **valid JSON only** (no extra text).
# - Limit descriptions to ~200 words across all text fields.
# 
# ---
# 
# ### OUTPUT JSON SCHEMA
# {
#   "site_reading": "<2-sentence summary: dominant spatial condition + key opportunity>",
# 
#   "massing_concept": {
#     "form": "<linear | courtyard | L-shaped | cluster | bar | compact | other>",
#     "climate_response": "<how form/orientation responds to sun, wind, shade>",
#     "orientation": "<primary axis and why (e.g., east–west bar to shade south)>"
#   },
# 
#   "program_strategy": {
#     "entry": "<where & why (e.g., south edge from road)>",
#     "living_spaces": "<where & why (e.g., north edge to face trees)>",
#     "private_spaces": "<where & why (e.g., east side for morning sun, privacy)>"
#   },
# 
#   "critical_moves": {
#     "view_axis": "from <location> to <feature>",
#     "threshold": "<entry sequence and first reveal>",
#     "edge": "<how building meets water/trees/road/boundary>"
#   },
# 
#   "spatial_diagram": {
#     "entry": "<relative placement, e.g., south edge from access road>",
#     "living": "<relative placement, e.g., north center facing trees>",
#     "bedrooms": "<relative placement, e.g., east edge for privacy>",
#     "kitchen_dining": "<relative placement, e.g., south near entry>",
#     "notes": "<key adjacencies/orientation cues>"
#   },
# 
#   "early_adjacency_graph": {
#     "nodes": [
#       {
#         "id": "<lowercase identifier>",
#         "role": "<entry | living | kitchen | dining | bedroom | bath | service | outdoor | circulation>",
#         "preferred_zone": "<north|south|east|west|center|nw|ne|sw|se>",
#         "level": "<0|1|2>",
#         "priority": "<primary|secondary>",
#         "notes": "<short rationale>"
#       }
#     ],
#     "edges": [
#       ["<node_id_A>", "<node_id_B>", "<connection type: direct|visual|service>", "<strength: strong|moderate|weak>"]
#     ]
#   },
# 
#   "site_features": {
#     "road_access": "<where, e.g., south edge mid>",
#     "water_feature": "<where, e.g., northwest corner>",
#     "tree_clusters": "<where, e.g., north band, sparse east>",
#     "buildable_zone": "<shape & where, e.g., central rectangle set back from water>",
#     "constraints": "<setbacks, no-build edges, flood/steep areas if any>"
#   }
# }
point_2 = Point()
# You are an architect conducting a site analysis to inform building massing and program layout.
# 
# Site Legend (interpret the image accordingly)
# 
# North = top of image
# 
# Green circles = Trees
# 
# Blue = Water feature (pond, stream, or pool)
# 
# Red = Buildable zone
# 
# Grey = Access road
# 
# Black = Property boundary
# 
# Grid = Each square is 10 × 10 m (scale reference)
# 
# Architectural Response (Max 200 words, clear intent for a client)
# 
# Site Reading (2 sentences)
# 
# What is the dominant spatial condition?
# 
# What opportunities does the site offer?
# 
# Massing Concept
# 
# Form: What is the organizing geometry or spatial logic?
# 
# Climate Response: How does form/orientation respond to sun, shade, wind?
# 
# Orientation: Primary building axis and why.
# 
# Program Distribution Strategy
# 
# Living/social spaces: where & why.
# 
# Bedrooms/private spaces: where & why (consider privacy, shade, or cultural values).
# 
# Entry: where & why (arrival experience).
# 
# Critical Moves (three design decisions)
# 
# View axis: From where to what?
# 
# Threshold: How entry sequence unfolds.
# 
# Edge: How building meets water/trees/road/site features.
# 
# Spatial Diagram (describe clearly in words)
# 
# Explain relative placement of rooms, road, water, and trees as if drawing a diagram for someone who hasn’t seen the site.
# You are an architect conducting site analysis for building massing and program layout.
# 
# Site Legend (interpret image accordingly)
# 
# North = top of image
# 
# Green circles = Trees
# 
# Blue = Water feature (pond/stream/pool)
# 
# Red = Buildable zone
# 
# Grey = Access road
# 
# Black = Property boundary
# 
# Grid = 10 × 10 m squares (scale reference)
# 
# Architectural Response (Max 200 words, client-facing clarity)
# 
# Site Reading: 2 sentences. State dominant spatial condition + site opportunities.
# 
# Massing Concept:
# 
# Form: organizing geometry.
# 
# Climate Response: orientation for sun/shade/wind.
# 
# Orientation: main axis & reason.
# 
# Program Strategy:
# 
# Living/social spaces: where & why.
# 
# Bedrooms/private spaces: where & why (privacy, shade, culture).
# 
# Entry: where & why (arrival experience).
# 
# Critical Moves (3 design decisions):
# 
# View axis: from → to.
# 
# Threshold: entry sequence.
# 
# Edge: how building meets water/trees/road.
# 
# Spatial Diagram (verbal): Describe relative placement of rooms, road, water, and trees clearly, as if sketching for someone off-site.
vec2pt = Vector2Pt(PointA=point, PointB=point_2, Unitize=False)  # -> Vector, Length
cameraposition = Python3Script(unitcenter=point, cameradir=vec2pt.Vector)  # -> out, a; inputs unitcenter: Point3d, cameradir: Vector3d; disabled
# ---------- cameraposition: Python ----------
# import rhinoscriptsyntax as rs

# view = rs.CurrentView()
# camera = x
# target = y
# if camera: rs.ViewCamera(view,camera)
# if camera: rs.ViewCameraTarget(view, camera, target)
import scriptcontext as sc
import Rhino.Geometry as rg
import rhinoscriptsyntax as rs

def zoom_view_to_brep(brep):
    # Get the bounding box of the brep.
    bbox = rs.BoundingBox(brep)
    if not bbox:
        rs.MessageBox("No bounding box.", 0, "Error")
        return

    # Compute the center of the bounding box.
    center = rs.PointDivide(rs.PointAdd(bbox[0], bbox[6]), 2.0)

    # For an axonometric view, choose a common isometric direction.
    direction = rs.VectorUnitize([0, 0, -1])

    # Use the diagonal of the bounding box to compute a good distance.
    diag = rs.Distance(bbox[0], bbox[6])
    distance = diag * 3

    # Compute the camera position by offsetting the center along the chosen direction.
    camera = rs.PointAdd(center, rs.VectorScale(direction, distance))

    # Get the active view via RhinoCommon.
    # Get the specified view by name instead of using the active view
    view_name = "Top"
    for view_obj in sc.doc.Views:
        print(view_obj.ActiveViewport.Name)
        if view_obj.ActiveViewport.Name == view_name:
            view = view_obj
            print(view.ActiveViewport.Name)
            break

    # Set the view to Parallel (axonometric) projection.
    # view.ActiveViewport.CameraParallelProjection = True

    # Use RhinoCommon's method to set both camera and target.
    view.ActiveViewport.SetCameraLocations(camera, center)
    
    # Redraw the view.
    view.Redraw()

# # Example usage:
# if brep:
#     zoom_view_to_brep(brep)
# else:
#     rs.MessageBox("No brep provided!", 0, "Error")

# unitcenter = 
# cameradir = 
distance = 1000
camera = rs.PointAdd(unitcenter, rs.VectorScale(cameradir, distance))
# Get the active view via RhinoCommon.
view = sc.doc.Views.ActiveView
view.ActiveViewport.Camera35mmLensLength = camlens
# Set the view to Parallel (axonometric) projection.
# view.ActiveViewport.CameraParallelProjection = True

# Use RhinoCommon's method to set both camera and target.
view.ActiveViewport.SetCameraLocations(camera, unitcenter)
# view.Camera35mmLensLength = 20
# Redraw the view.
view.Redraw()
# ---------- end cameraposition ----------
panel = Panel("""south
north
east
west""")
list_length = ListLength(List=panel)
number_slider = Slider(8, range=0..1000)
construct_domain = ConstructDomain(DomainStart=0, DomainEnd=list_length)
random = Random(Range=construct_domain, Number=1, Seed=number_slider)
# You are an architect’s copilot conducting a site analysis to directly inform space planning and layout.
# Your goal is to read the site diagram and return a structured analysis that identifies the location, orientation, and relationships of features.
# Your output must be clear enough for another AI to design a building massing and distribute spaces correctly.
# 
# Site Legend (interpret the image accordingly)
# 
# North = top of image
# 
# Green circles = Trees
# 
# Blue = Water feature (pond, stream, or pool)
# 
# Red = Buildable zone
# 
# Grey = Access road
# 
# Black = Property boundary
# 
# Grid = 10 × 10 m squares (scale reference)
# {
# "location": "city and climate",
#   "site_reading": "2-sentence summary of dominant spatial condition + opportunity",
#   "massing_concept": {
#     "form": "Organizing geometry ",
#     "climate_response": "How orientation/shape responds to sun, wind, shade",
#     "orientation": "Primary building axis and why"
#   },
#   "program_strategy": {
# "entry": "Where to place entry and the intended experience. This should make logical sense and relate to the site condiions"
#     "living_spaces": "Where to locate living/social spaces and why",
#     "private_spaces": "Where to locate bedrooms/private spaces and why",
# 
#   },
#   "critical_moves": {
#     "view_axis": "From [location] to [feature]",
#     "threshold": "How entry sequence unfolds",
#     "edge": "How the building meets road/trees/water"
#   },
#   "spatial_diagram": {
#     "living": "Relative location (e.g. north edge facing trees)",
#     "bedrooms": "Relative location (e.g. east side for shade/privacy)",
#     "kitchen_dining": "Relative location (e.g. near living, facing courtyard)",
#     "entry": "Relative location (e.g. south edge connected to road)",
#     "other": "Notes on adjacency and orientation of special features"
#   }
# }
# Rules:
# 
# Always specify cardinal directions (north, south, east, west) for space/feature placement.
# 
# Ensure program placement aligns with privacy, culture, and climate adaptation.
# 
# Keep total response under 200 words but fully structured in JSON.
# 
# Output must be valid JSON only.
round = Round(Number=random)  # -> Nearest, Floor, Ceiling
list_item = ListItem(List=panel, Index=round.Floor, Wrap=True)

# ---- group: Generate PLOT
python_3_script = Python3Script(
    seed=number_slider,
    sides_min=Slider(4, range=0..10),
    sides_max=Slider(6, range=0..10),
    tree_clusters=Slider(6, range=0..10),
    ROAD_FILLET_RADIUS=Slider(2, range=0..10),
    ROAD_MIN_SEG_LEN=Slider(2, range=0..10),
    entrance_side=list_item)  # -> out, site_boundaries, buildable_zones, water_features, tree_zones, access_roads, site_info; inputs seed: Int32, ROAD_FILLET_RADIUS: Int32, ROAD_MIN_SEG_LEN: Int32
# ---------- python_3_script: Python ----------
"""
Single Lot Generator — straightforward + robust
- Pad never overlaps trees or ponds (uses buffered pond & clearance tests)
- Road is a simple Polyline (few legs, no tiny segments, no hooks into pad)
- Pad size: control with GH sliders named `pad_area` (m2) and `pad_aspect` (W/H)
"""

import Rhino
import Rhino.Geometry as rg
import math, random, heapq

# ===================== Inputs / Defaults =====================
site_boundaries, buildable_zones, water_features, tree_zones, access_roads, site_info = [], [], [], [], [], []

seed = 42 if 'seed' not in globals() or seed is None else int(seed)
one_per_lot = True if 'one_per_lot' not in globals() or one_per_lot is None else bool(one_per_lot)
entrance_side = ("south" if 'entrance_side' not in globals() or entrance_side not in ("south","north","east","west") else entrance_side)
lot_type = "XL" if 'lot_type' not in globals() or lot_type not in ("Large","XL") else lot_type

sides_min = 7 if 'sides_min' not in globals() or sides_min is None else int(sides_min)
sides_max = 10 if 'sides_max' not in globals() or sides_max is None else int(sides_max)
tree_clusters = 4 if 'tree_clusters' not in globals() or tree_clusters is None else int(tree_clusters)

# clearances (meters)
pad_setback     = 10.0 if 'pad_setback'     not in globals() or pad_setback     is None else float(pad_setback)
pad_tree_clear  = 2.0  if 'pad_tree_clear'  not in globals() or pad_tree_clear  is None else float(pad_tree_clear)
pad_water_clear = 5.0  if 'pad_water_clear' not in globals() or pad_water_clear is None else float(pad_water_clear)
tree_water_clear= 0.3  if 'tree_water_clear'not in globals() or tree_water_clear is None else float(tree_water_clear)

pond_radius   = 15.0 if 'pond_radius'   not in globals() or pond_radius   is None else float(pond_radius)
pond_points   = 48   if 'pond_points'   not in globals() or pond_points   is None else int(pond_points)
pond_noise    = 0.22 if 'pond_noise'    not in globals() or pond_noise    is None else float(pond_noise)
pond_lobes_min= 2    if 'pond_lobes_min'not in globals() or pond_lobes_min is None else int(pond_lobes_min)
pond_lobes_max= 4    if 'pond_lobes_max'not in globals() or pond_lobes_max is None else int(pond_lobes_max)

# ========================= Tunables ==========================
TOL=1e-3

# road shaping
ROAD_STEP_DEFAULT=6.0     # A* grid step (fallback)
ROAD_CLEAR=2.5            # clearance to trees/water
ROAD_MIN_SEG_LEN=4.5      # remove shorter legs
MIN_BEND_KEEP_DEG=95.0    # delete bends sharper than this when safe
APPROACH_LEAD_IN=8.0      # last leg goes straight out of pad for this distance
TURN_PENALTY=0.50         # discourages zigzags in A*

MAX_SITE_RETRIES=2

# pad search grid density
GRID_DENSITY_MULT=1.25
PAD_SOFTEN_STEPS=(0.0,0.4,0.8)
MIN_PAD_SCALE=0.70

# lot presets (only size is used here)
LOT_SIZES={"Large":{"width":100,"depth":100,"building_size":30},
           "XL":   {"width":150,"depth":120,"building_size":40}}

# --- Pad size (from GH sliders "pad_area", "pad_aspect") ---
_default_w = LOT_SIZES[lot_type]["building_size"]; _default_h = _default_w*0.8
_default_area   = _default_w*_default_h
_default_aspect = _default_w/_default_h
pad_area   = _default_area   if 'pad_area'   not in globals() or pad_area   is None else float(pad_area)
pad_aspect = _default_aspect if 'pad_aspect' not in globals() or pad_aspect is None else float(pad_aspect)
PAD_W = math.sqrt(max(1.0,pad_area) * max(0.2, pad_aspect))
PAD_H = max(1.0, pad_area / PAD_W)

# ======================== Small helpers ======================
def _ok(c):
    try: return c is not None and c.IsValid
    except: return False

def _contains(crv, pt, tol=TOL):
    if not _ok(crv): return False
    try: rc = crv.Contains(pt, rg.Plane.WorldXY, tol)
    except TypeError: rc = crv.Contains(pt)
    return rc in (rg.PointContainment.Inside, rg.PointContainment.Coincident)

def _min_dist_pt_crv(pt, crv):
    if not _ok(crv): return float('inf')
    try:
        ok,t=crv.ClosestPoint(pt)
        return pt.DistanceTo(crv.PointAt(t)) if ok else float('inf')
    except: return float('inf')

def _curves_intersect(a, b, tol=TOL):
    try:
        ccx = Rhino.Geometry.Intersect.Intersection.CurveCurve(a, b, tol, tol)
        return bool(ccx and ccx.Count > 0)
    except: return False

def _closed_disjoint(a_closed, b_closed, tol=TOL):
    try:
        rel = rg.Curve.PlanarClosedCurveRelationship(a_closed, b_closed, rg.Plane.WorldXY, tol)
        return rel == rg.RegionContainment.Disjoint
    except: return not _curves_intersect(a_closed, b_closed, tol)

def _tree_radius_center(tree):
    try:
        ok,c = tree.TryGetCircle()
        if ok: return c.Radius, c.Center
    except: pass
    bb = tree.GetBoundingBox(True)
    return 0.5*max(bb.Max.X-bb.Min.X, bb.Max.Y-bb.Min.Y), bb.Center

def _centroid(closed):
    if not _ok(closed): return rg.Point3d(0,0,0)
    try:
        amp=rg.AreaMassProperties.Compute(closed)
        return amp.Centroid if amp else closed.GetBoundingBox(True).Center
    except: return closed.GetBoundingBox(True).Center

def _rect(center,w,h,ang):
    hw,hh=0.5*w,0.5*h
    pts=[rg.Point3d(-hw,-hh,0), rg.Point3d(hw,-hh,0), rg.Point3d(hw,hh,0), rg.Point3d(-hw,hh,0), rg.Point3d(-hw,-hh,0)]
    crv=rg.PolylineCurve(pts)
    R=rg.Transform.Rotation(ang, rg.Vector3d(0,0,1), rg.Point3d(0,0,0))
    T=rg.Transform.Translation(center - rg.Point3d(0,0,0))
    crv.Transform(R); crv.Transform(T)
    return crv

def _inward_offset(crv, d):
    if not _ok(crv) or d<=0: return crv
    try:
        offs=crv.Offset(rg.Plane.WorldXY, -abs(float(d)), TOL, rg.CurveOffsetCornerStyle.Sharp) or []
        best=None; bestA=-1.0
        for c in offs:
            if not _ok(c) or not c.IsClosed: continue
            A=(rg.AreaMassProperties.Compute(c).Area if rg.AreaMassProperties.Compute(c) else 0.0)
            if A>bestA and _contains(crv, c.GetBoundingBox(True).Center): best,bestA=c,A
        return best
    except: return None

def _angle_deg(u,v):
    uu=rg.Vector3d(u); vv=rg.Vector3d(v)
    if uu.IsTiny() or vv.IsTiny(): return 0.0
    uu.Unitize(); vv.Unitize()
    d=max(-1.0,min(1.0,rg.Vector3d.Multiply(uu,vv)))
    return math.degrees(math.acos(d))

def _curve_min_dist(a, b, sa=48, sb=48):
    if not (_ok(a) and _ok(b)): return float('inf')
    m=float('inf')
    for i in range(max(2, sa)):
        p=a.PointAtNormalizedLength(float(i)/(sa-1))
        m=min(m,_min_dist_pt_crv(p,b))
    for j in range(max(2, sb)):
        q=b.PointAtNormalizedLength(float(j)/(sb-1))
        m=min(m,_min_dist_pt_crv(q,a))
    return m

def _buffer_closed(closed, d):
    """Outward buffer for closed curve (choose largest-area offset > original)."""
    if not (_ok(closed) and d>0): return None
    try: A0=(rg.AreaMassProperties.Compute(closed).Area or 0.0)
    except: A0=0.0
    offs=(closed.Offset(rg.Plane.WorldXY, d, TOL, rg.CurveOffsetCornerStyle.Round) or [])
    best, bestA=None, -1.0
    for c in offs:
        if not (_ok(c) and c.IsClosed): continue
        try: A=rg.AreaMassProperties.Compute(c).Area
        except: A=-1.0
        if A>A0 and A>bestA: best, bestA=c, A
    return best

# ======================= Lot primitives ======================
def create_organic_boundary(w,d,cx=0,cy=0):
    n=random.randint(sides_min, sides_max); pts=[]
    for i in range(n):
        a=(2*math.pi*i/n)+random.uniform(-0.18,0.18)
        r0=(w+d)/4.0; r=r0+random.uniform(-0.25*r0,0.25*r0)
        pts.append(rg.Point3d(cx+w/2.0 + r*math.cos(a), cy+d/2.0 + r*math.sin(a),0))
    pts.append(pts[0]); return rg.PolylineCurve(pts)

def make_organic_blob(center, base_r, pts, ampl, lobes_min, lobes_max):
    comps=[(random.randint(lobes_min,lobes_max), random.uniform(0,2*math.pi), random.uniform(0.35,1.0))
           for _ in range(random.randint(2,3))]
    cx,cy=center.X,center.Y; P=[]
    for i in range(pts):
        t=2*math.pi*i/float(pts); k=1.0
        for f,ph,w in comps: k += ampl*w*math.sin(f*t+ph)
        r=max(0.2*base_r, base_r*k)
        P.append(rg.Point3d(cx+r*math.cos(t), cy+r*math.sin(t),0))
    try:
        crv=rg.NurbsCurve.CreateThroughPoints(P,3,True)
        if crv and crv.IsClosed: return crv
    except: pass
    P.append(P[0]); crv=rg.Curve.CreateInterpolatedCurve(P,3)
    if not crv.IsClosed: crv.MakeClosed(TOL)
    return crv

def add_water_feature(boundary, must_have_pond=True):
    features=[]; bb=boundary.GetBoundingBox(True); placed=False
    for _ in range(40):
        x=random.uniform(bb.Min.X+18, bb.Max.X-18); y=random.uniform(bb.Min.Y+18, bb.Max.Y-18)
        c=rg.Point3d(x,y,0)
        if not _contains(boundary,c): continue
        pond=make_organic_blob(c, pond_radius, pond_points, pond_noise, pond_lobes_min, pond_lobes_max)
        if _ok(pond) and pond.IsClosed: 
            # keep fully inside lot
            ok=True
            for k in range(36):
                p=pond.PointAtNormalizedLength(float(k)/35.0)
                if not _contains(boundary,p): ok=False; break
            if ok: features.append(pond); placed=True; break
    if must_have_pond and not placed:
        c=_centroid(boundary); features.append(rg.Circle(c, pond_radius).ToNurbsCurve())
    return [f for f in features if _ok(f)]

def add_trees(boundary, density, waters):
    trees=[]; positions=[]; bb=boundary.GetBoundingBox(True)
    waters=[w for w in (waters or []) if _ok(w)]
    def hits_water(center,r):
        for w in waters:
            if w.IsClosed:
                for a in [2*math.pi*k/12.0 for k in range(12)]:
                    p=rg.Point3d(center.X+(r+1e-6)*math.cos(a), center.Y+(r+1e-6)*math.sin(a),0)
                    if _contains(w,p) or _min_dist_pt_crv(p,w)<1e-3: return True
            else:
                if _min_dist_pt_crv(center,w) < r + tree_water_clear: return True
        return False
    for _ in range(max(0,int(density))):
        for _try in range(20):
            x=random.uniform(bb.Min.X+6, bb.Max.X-6); y=random.uniform(bb.Min.Y+6, bb.Max.Y-6)
            c=rg.Point3d(x,y,0)
            if _contains(boundary,c) and not hits_water(c,0.0): break
        else: continue
        for _n in range(random.randint(3,5)):
            for _try in range(20):
                tx=x+random.uniform(-7,7); ty=y+random.uniform(-7,7); r=random.uniform(2,4)
                p=rg.Point3d(tx,ty,0)
                if not _contains(boundary,p): continue
                if any(p.DistanceTo(ep)<(r+er+1.0) for ep,er in positions): continue
                if hits_water(p,r): continue
                trees.append(rg.Circle(p,r).ToNurbsCurve()); positions.append((p,r)); break
    return trees

# ==================== Pad placement (robust) =================
def boundary_touch_points(boundary, side="south", inset=0.5):
    bb=boundary.GetBoundingBox(True); cx=0.5*(bb.Min.X+bb.Max.X); cy=0.5*(bb.Min.Y+bb.Max.Y)
    anchor = (rg.Point3d(cx,bb.Min.Y-20,0) if side=="south" else
              rg.Point3d(cx,bb.Max.Y+20,0) if side=="north" else
              rg.Point3d(bb.Min.X-20,cy,0) if side=="west"  else
              rg.Point3d(bb.Max.X+20,cy,0))
    ok,t=boundary.ClosestPoint(anchor); t=t if ok else boundary.Domain.T0
    touch=boundary.PointAt(t); cen=_centroid(boundary)
    v=rg.Vector3d(cen.X-touch.X, cen.Y-touch.Y,0); v=rg.Vector3d(0,1,0) if v.IsTiny() else v; v.Unitize()
    return touch, rg.Point3d(touch.X+v.X*max(0.1,inset), touch.Y+v.Y*max(0.1,inset),0)

def _pad_is_clear(rect, trees, waters, tc, wc):
    """Pad valid iff no overlap with trees and disjoint from pond buffered by wc; also min wc to all water."""
    if not _ok(rect): return False
    trees=[t for t in (trees or []) if _ok(t)]; waters=[w for w in (waters or []) if _ok(w)]
    # Trees
    for t in trees:
        r,c=_tree_radius_center(t)
        if _contains(rect, c): return False
        if _min_dist_pt_crv(c, rect) < (r+tc-1e-6): return False
        if _curves_intersect(rect, t): return False
    # Water
    for w in waters:
        if _curves_intersect(rect, w): return False
        if w.IsClosed:
            buf=_buffer_closed(w, wc)
            if buf and not _closed_disjoint(rect, buf): return False
            try:
                rel=rg.Curve.PlanarClosedCurveRelationship(rect, w, rg.Plane.WorldXY, TOL)
                if rel != rg.RegionContainment.Disjoint: return False
            except:
                # fallback: sample rect on pond test
                for k in range(32):
                    p=rect.PointAtNormalizedLength(float(k)/31.0)
                    if _contains(w,p): return False
        if _curve_min_dist(rect, w) < (wc-1e-6): return False
    return True

def _rect_clear(rect, trees, waters, tc, wc, samples=96):
    """Return True if the rectangular pad is clear of trees and water.
       - No tree center inside pad
       - Distance from pad to each tree >= r + tc
       - No pad-water intersections
       - For closed ponds: regions must be disjoint
       - Clearance to any water (closed/open) >= wc
    """
    if not _ok(rect): return False
    trees  = [t for t in (trees  or []) if _ok(t)]
    waters = [w for w in (waters or []) if _ok(w)]

    # perimeter points for robust inside checks (also hits corners)
    ring = [rect.PointAtNormalizedLength(float(i)/(max(2, samples)-1)) for i in range(max(2, samples))]

    # ---- Trees ----
    for t in trees:
        r, c = _tree_radius_center(t)
        if _contains(rect, c):                      # tree center inside pad
            return False
        if _min_dist_pt_crv(c, rect) < r + tc - 1e-6:
            return False
        try:
            ccx = Rhino.Geometry.Intersect.Intersection.CurveCurve(rect, t, TOL, TOL)
            if ccx and ccx.Count > 0:               # paranoid guard
                return False
        except: 
            pass

    # ---- Water ----
    for w in waters:
        try:
            ccx = Rhino.Geometry.Intersect.Intersection.CurveCurve(rect, w, TOL, TOL)
            if ccx and ccx.Count > 0:               # no geometric crossings
                return False
        except:
            pass

        if w.IsClosed:
            # strict region-disjoint with pond
            try:
                rel = rg.Curve.PlanarClosedCurveRelationship(rect, w, rg.Plane.WorldXY, TOL)
                if rel != rg.RegionContainment.Disjoint:
                    return False
            except:
                # fallback: any pad-perimeter point inside pond?
                if any(_contains(w, p) for p in ring):
                    return False

        # numeric clearance to any water (closed or open)
        if _curve_min_dist(rect, w, samples, samples) < wc - 1e-6:
            return False

    return True


def _pad_is_clear(rect, trees, waters, tc, wc, samples=96):
    # simple alias so place_pads can call one function
    return _rect_clear(rect, trees, waters, tc, wc, samples)


# (Only if you DON'T already have this in your file, add it too.)
def _curve_inside(boundary, crv, samples=64):
    if not (_ok(boundary) and _ok(crv)): return False
    for i in range(samples):
        p = crv.PointAtNormalizedLength(float(i)/max(1, samples-1))
        if not _contains(boundary, p): 
            return False
    return True

# --- replace your place_pads with this version ---
def place_pads(boundary, size_info, trees, waters, one_per=True):
    if not _ok(boundary): return []

    # size from sliders (with optional overrides)
    default_area = (size_info.get("building_size", 40.0)**2) * 0.8
    A  = float(globals().get('pad_area',   default_area))
    AR = float(globals().get('pad_aspect', 1.25))
    W  = max(2.0, math.sqrt(max(1.0, A)*AR))
    H  = max(2.0, A/W)
    W  = float(globals().get('pad_width',  W))
    H  = float(globals().get('pad_height', H))
    angs = [0.0, math.pi*0.5]
    rdeg = float(globals().get('pad_rotation', 0.0))
    if abs(rdeg) > 1e-9: angs.append(math.radians(rdeg))

    # envelope with setback (fallback to boundary if offset fails)
    env = _inward_offset(boundary, pad_setback) or _inward_offset(boundary, 0.5*pad_setback) or boundary

    bb = env.GetBoundingBox(True); m = 6.0
    sx = max(0.1, bb.Max.X - bb.Min.X - 2*m)
    sy = max(0.1, bb.Max.Y - bb.Min.Y - 2*m)
    nx = max(6, int((sx / max(6.0, W*0.6)) * GRID_DENSITY_MULT))
    ny = max(6, int((sy / max(6.0, H*0.6)) * GRID_DENSITY_MULT))
    xs = [bb.Min.X + m + i*(sx/max(1, nx-1)) for i in range(nx)]
    ys = [bb.Min.Y + m + j*(sy/max(1, ny-1)) for j in range(ny)]

    # driveway bias
    _, entry_in = boundary_touch_points(boundary, entrance_side, 0.5)
    def _dpt(pt, crv):
        try:
            ok,t = crv.ClosestPoint(pt)
            return pt.DistanceTo(crv.PointAt(t)) if ok else 1e9
        except: return 1e9
    def pond_bonus(pt):
        if not waters: return 0.0
        d = min(_dpt(pt, w) for w in waters if _ok(w))
        return max(0.0, 1.0 - abs(d - 30.0)/25.0)

    best=None; bestS=-1e9
    for soften in PAD_SOFTEN_STEPS:
        tc = max(0.0, pad_tree_clear  - soften)
        wc = max(0.0, pad_water_clear - soften)
        found=False
        for s in (1.0, 0.9, 0.8, MIN_PAD_SCALE):
            w, h = W*s, H*s
            for x in xs:
                for y in ys:
                    p = rg.Point3d(x, y, 0)
                    if not _contains(env, p): continue
                    for a in angs:
                        r = _rect(p, w, h, a)
                        # must be fully inside setback envelope
                        if not _curve_inside(env, r, samples=64): continue
                        # must be clear of trees & water (with clearances)
                        if not _pad_is_clear(r, trees, waters, tc, wc): continue
                        c  = r.GetBoundingBox(True).Center
                        sc = -rg.Point3d(c.X, c.Y, 0).DistanceTo(entry_in)*0.05 + pond_bonus(rg.Point3d(c.X,c.Y,0))*0.5
                        if sc > bestS: best, bestS, found = r, sc, True
            if found: break
        if found: break

    # robust fallback: shrink at env center until it fits & is clear
    if not best:
        c = env.GetBoundingBox(True).Center
        for s in (0.85, 0.75, 0.65, 0.55):
            r = _rect(rg.Point3d(c.X, c.Y, 0), W*s, H*s, 0.0)
            if _curve_inside(env, r, samples=64) and _pad_is_clear(r, trees, waters, pad_tree_clear, pad_water_clear):
                best = r; break

    # final safety: pad must be fully inside the lot boundary
    if best and not _curve_inside(boundary, best, samples=64):
        best = None

    return [best] if best else []

def place_building_zones(boundary, size_info, trees, waters, one_per=True):
    return place_pads(boundary, size_info, trees, waters, one_per)

# ===================== Road (simple polyline) =================
def _edge_mid_and_normal(pad_rect, prefer_from):
    bb=pad_rect.GetBoundingBox(True)
    crn=[rg.Point3d(bb.Min.X,bb.Min.Y,0), rg.Point3d(bb.Max.X,bb.Min.Y,0),
         rg.Point3d(bb.Max.X,bb.Max.Y,0), rg.Point3d(bb.Min.X,bb.Max.Y,0)]
    mids=[]; norms=[]; c=bb.Center
    for i in range(4):
        a,b=crn[i], crn[(i+1)%4]; m=rg.Point3d((a.X+b.X)*.5,(a.Y+b.Y)*.5,0)
        n=rg.Vector3d(m.X-c.X, m.Y-c.Y, 0)
        if not n.IsTiny(): n.Unitize()
        mids.append(m); norms.append(n)
    d=rg.Vector3d(prefer_from.X-c.X, prefer_from.Y-c.Y,0)
    if not d.IsTiny(): d.Unitize()
    idx=max(range(4), key=lambda k: rg.Vector3d.Multiply(norms[k], d))
    return mids[idx], norms[idx]

def _goal_points(pad_rect, from_pt, apron_out=0.7, lead=APPROACH_LEAD_IN):
    mid,n=_edge_mid_and_normal(pad_rect, from_pt)
    goal=rg.Point3d(mid.X+n.X*max(0.25,apron_out), mid.Y+n.Y*max(0.25,apron_out),0)
    pre =rg.Point3d(goal.X+n.X*lead, goal.Y+n.Y*lead,0)
    return goal, pre, n

def _segment_clear(a,b,boundary,trees,waters,clear,pads=None):
    trees=[t for t in (trees or []) if _ok(t)]
    waters=[w for w in (waters or []) if _ok(w)]
    pads=[p for p in (pads or []) if _ok(p)]
    # parametric sampling + intersection checks
    S=12
    for i in range(S+1):
        t=float(i)/S; p=rg.Point3d(a.X+(b.X-a.X)*t, a.Y+(b.Y-a.Y)*t, 0)
        if not _contains(boundary,p): return False
        if any(_contains(P,p) for P in pads): return False
        for tr in trees:
            r,c=_tree_radius_center(tr)
            if p.DistanceTo(c) < r+clear-1e-6: return False
        if any(_min_dist_pt_crv(p,w) < clear-1e-6 for w in waters): return False
    seg=rg.PolylineCurve([a,b])
    if any(_curves_intersect(seg,w) for w in waters): return False
    if any(_curves_intersect(seg,P) for P in pads):   return False
    return True

def _drop_kinks(P, boundary, trees, waters, clear, pad=None, min_keep_deg=MIN_BEND_KEEP_DEG, passes=3):
    if len(P)<3: return list(P)
    for _ in range(passes):
        changed=False; Q=[P[0]]
        for i in range(1,len(P)-1):
            a,b,c=Q[-1], P[i], P[i+1]
            ang=_angle_deg(rg.Vector3d(b.X-a.X,b.Y-a.Y,0), rg.Vector3d(c.X-b.X,c.Y-b.Y,0))
            if ang < min_keep_deg and _segment_clear(a, c, boundary, trees, waters, clear, pads=[pad] if pad else None):
                changed=True  # drop the sharp vertex
            else:
                Q.append(b)
        Q.append(P[-1]); P=Q
        if not changed: break
    return P

def _merge_short_segments(P, min_len=ROAD_MIN_SEG_LEN):
    if len(P)<2: return list(P)
    Q=[P[0]]
    for i in range(1,len(P)):
        if Q[-1].DistanceTo(P[i]) < min_len:
            if i<len(P)-1: continue
        Q.append(P[i])
    R=[Q[0]]
    for i in range(1,len(Q)):
        if R[-1].DistanceTo(Q[i])>1e-6: R.append(Q[i])
    return R

# ---- A* fallback bits ----
def _snap(p,o,s): return (int(round((p.X-o.X)/s)), int(round((p.Y-o.Y)/s)))
def _grid(ij,o,s): return rg.Point3d(o.X+ij[0]*s, o.Y+ij[1]*s, 0)
def _build_mask(boundary, trees, waters, pads, step, clear):
    bb=boundary.GetBoundingBox(True)
    origin=rg.Point3d(math.floor(bb.Min.X/step)*step, math.floor(bb.Min.Y/step)*step, 0)
    trees=[t for t in (trees or []) if _ok(t)]; waters=[w for w in (waters or []) if _ok(w)]
    def blocked(i,j):
        p=_grid((i,j),origin,step)
        if not _contains(boundary,p): return True
        if any(_contains(r,p) for r in (pads or [])): return True
        for t in trees:
            r,c=_tree_radius_center(t)
            if p.DistanceTo(c) < r+clear: return True
        if any(_min_dist_pt_crv(p,w)<clear for w in waters): return True
        return False
    return origin, blocked, bb

def _dirang(a,b):
    if a is None or b is None: return 0.0
    A=math.atan2(a[1],a[0]); B=math.atan2(b[1],b[0])
    return abs((B-A+math.pi)%(2*math.pi)-math.pi)

def _astar(start, goal, origin, blocked, bb, step, max_expand=35000):
    si,sj=_snap(start,origin,step); gi,gj=_snap(goal,origin,step)
    imin=int(math.floor((bb.Min.X-origin.X)/step))-2; imax=int(math.ceil((bb.Max.X-origin.X)/step))+2
    jmin=int(math.floor((bb.Min.Y-origin.Y)/step))-2; jmax=int(math.ceil((bb.Max.Y-origin.Y)/step))+2
    inb=lambda i,j:(imin<=i<=imax) and (jmin<=j<=jmax)
    h=lambda i,j: math.hypot(i-gi,j-gj)
    def nearfree(i0,j0,r=3):
        best=None; d0=1e9
        for di in range(-r,r+1):
            for dj in range(-r,r+1):
                ii,jj=i0+di,j0+dj
                if inb(ii,jj) and not blocked(ii,jj):
                    d=di*di+dj*dj
                    if d<d0: d0=d; best=(ii,jj)
        return best
    if blocked(si,sj):
        nf=nearfree(si,sj); 
        if nf: si,sj=nf
    if blocked(gi,gj):
        nf=nearfree(gi,gj); 
        if nf: gi,gj=nf
    moves=[(-1,0,1.0),(1,0,1.0),(0,-1,1.0),(0,1,1.0),(-1,-1,math.sqrt(2)),(-1,1,math.sqrt(2)),(1,-1,math.sqrt(2)),(1,1,math.sqrt(2))]
    pq=[]; heapq.heappush(pq,(h(si,sj),0.0,(si,sj),None,None))
    came={}; g={(si,sj):0.0}; seen=set(); expands=0
    while pq:
        _,gc,node,parent,prev=heapq.heappop(pq)
        if node in seen: continue
        came[node]=parent; seen.add(node); expands+=1
        if expands>max_expand: return None
        if node==(gi,gj):
            path=[]; cur=node
            while cur is not None: path.append(cur); cur=came[cur]
            path.reverse(); return [_grid(n,origin,step) for n in path]
        i,j=node
        for di,dj,base in moves:
            ii,jj=i+di,j+dj
            if not inb(ii,jj) or blocked(ii,jj): continue
            ang=_dirang(prev,(di,dj)); ng=gc+base+TURN_PENALTY*(ang/math.pi)
            if (ii,jj) not in g or ng<g[(ii,jj)]:
                g[(ii,jj)]=ng; heapq.heappush(pq,(ng+h(ii,jj),ng,(ii,jj),node,(di,dj)))
    return None

# ---- router with simple fallbacks ----
def route_polyline(boundary, trees, waters, pad_rect, side, step, clear, apron_out):
    touch, entry = boundary_touch_points(boundary, side, 0.5)
    goal, pre, n = _goal_points(pad_rect, entry, apron_out, APPROACH_LEAD_IN)
    pads=[pad_rect]

    # 1) direct line
    if _segment_clear(entry, goal, boundary, trees, waters, clear, pads=pads):
        pts=[touch, entry, goal]
    else:
        # 2) L-shape candidates
        via1=rg.Point3d(entry.X, goal.Y, 0)
        via2=rg.Point3d(goal.X,  entry.Y, 0)
        paths=[]
        for via in (via1, via2):
            if (_segment_clear(entry, via, boundary, trees, waters, clear, pads=pads) and
                _segment_clear(via, goal, boundary, trees, waters, clear, pads=pads)):
                paths.append([touch, entry, via, goal])
        if paths:
            pts=min(paths, key=lambda P: sum(P[i].DistanceTo(P[i+1]) for i in range(len(P)-1)))
        else:
            # 3) A* fallback, then compress
            origin,blocked,bb=_build_mask(boundary, trees, waters, pads, step, clear)
            path=_astar(entry, pre, origin, blocked, bb, step) or _astar(entry, goal, origin, blocked, bb, step)
            if not path: return None
            # line-of-sight compression
            mid=[path[0]]
            for k in range(1,len(path)):
                if not _segment_clear(mid[-1], path[k], boundary, trees, waters, clear, pads=pads):
                    mid.append(path[k-1])
            mid.append(path[-1])
            pts=[touch, entry]+mid

    # keep last leg straight out of the pad and simplify
    if pts[-1].DistanceTo(goal)>1e-6: pts.append(goal)
    # drop vertices inside pad
    pts=[q for q in pts if not _contains(pad_rect, q)]
    pts=_drop_kinks(pts, boundary, trees, waters, clear, pad_rect, MIN_BEND_KEEP_DEG, passes=4)
    pts=_merge_short_segments(pts, ROAD_MIN_SEG_LEN)

    # final safety
    for i in range(len(pts)-1):
        if not _segment_clear(pts[i], pts[i+1], boundary, trees, waters, clear, pads=pads): return None
    return rg.PolylineCurve(pts) if len(pts)>=2 else None

def route_road(boundary, trees, waters, pads):
    if not pads: return None
    sides=[entrance_side, ("east" if entrance_side in ("south","north") else "south")]
    for p in pads:
        for s in sides:
            st=ROAD_STEP_DEFAULT
            for _ in range(2):
                r=route_polyline(boundary, trees, waters, p, s, st, ROAD_CLEAR, 0.7)
                if r: return r
                st*=0.5
    # last tiny fallback
    touch,entry=boundary_touch_points(boundary, sides[0], 0.5)
    goal,_,_=_goal_points(pads[0], entry, 0.7, APPROACH_LEAD_IN)
    if not (_segment_clear(touch, entry, boundary, trees, waters, ROAD_CLEAR, pads=pads) and
            _segment_clear(entry, goal,  boundary, trees, waters, ROAD_CLEAR, pads=pads)):
        return None
    return rg.PolylineCurve([touch,entry,goal])

# =========================== Main ============================
def run():
    random.seed(seed)
    size=LOT_SIZES[lot_type]
    boundary=create_organic_boundary(size["width"], size["depth"], 0,0)
    road=None; pads=[]; waters=[]; trees=[]
    for _ in range(MAX_SITE_RETRIES+1):
        waters=add_water_feature(boundary, True)
        trees =add_trees(boundary, tree_clusters, waters)
        pads  =place_building_zones(boundary, size, trees, waters, one_per_lot)
        road  =route_road(boundary, trees, waters, pads) if pads else None
        if pads and road: break

    site_boundaries.append(boundary)
    buildable_zones.extend(pads)
    water_features.extend(waters)
    tree_zones.extend(trees)
    if road: access_roads.append(road)

    info="{} LOT\nSize: {}x{}m\nTrees: {}\nPads: {}\nWater features: {}\nRoad: {}".format(
        lot_type.upper(), size["width"], size["depth"], len(trees), len(pads), len(waters),
        "Yes" if road else "No path")
    site_info.append(info)

run()
# ---------- end python_3_script ----------

# ----
number_slider_2 = Slider(3, range=0..10)
negative = Negative(Value=number_slider_2)
curve = Curve(python_3_script.tree_zones)
curve_2 = Curve(python_3_script.access_roads)
curve_3 = Curve(python_3_script.site_boundaries)
curve_4 = Curve(python_3_script.water_features)
curve_5 = Curve(python_3_script.buildable_zones)
offset_curve = OffsetCurve(Curve=curve_2, Plane=PlaneXY(0, 0, 0), Distance=number_slider_2, BothSides=negative, Kinks=0, CapType=1)
area = Area(Geometry=curve_5)  # -> Area, Centroid

# ---- group: set to true to run LLMS
boolean_toggle = BooleanToggle(True)
boolean_toggle_2 = BooleanToggle(True)
boolean_toggle_3 = BooleanToggle(False)
group_toggle = GroupToggle(ToggleActive=True, ToggleVisible=False)  # disabled

# ----
json_directory_file_path = FilePath("G:\My Drive\MACAD\THESIS\outputs\json_outputs\cities\")
save_final_plot = FilePath("G:\My Drive\MACAD\THESIS\outputs\json_outputs\images\")

set_city_index = Slider(13, range=0..21)
familyuserindex = Slider(0, range=0..21)
brute_force_classic = BruteForceClassic(Run=Toggle(False), NumberSliders=familyuserindex)

boundary_surfaces = BoundarySurfaces(Edges=curve)
boundary_surfaces_2 = BoundarySurfaces(Edges=curve_4)
boundary_surfaces_3 = BoundarySurfaces(Edges=curve_5)
boundary_surfaces_4 = BoundarySurfaces(Edges=offset_curve)
number_slider_3 = Slider(10, range=0..10)
boundary_surfaces_5 = BoundarySurfaces(Edges=curve_3)
bounding_rectangle = BoundingRectangle(Geometry=boundary_surfaces_5, Plane=PlaneXY(0, 0, 0), Axis=0, Slide=0, Union=True)  # -> Bounding, DimensionX, DimensionY
division = Division(A=bounding_rectangle.DimensionX, B=number_slider_3)
division_2 = Division(A=bounding_rectangle.DimensionY, B=number_slider_3)
custom_preview = CustomPreview(Geometry=boundary_surfaces, Material=ColourSwatch(SwatchColor=RGB(106, 217, 78)))
custom_preview_2 = CustomPreview(Geometry=boundary_surfaces_2, Material=ColourSwatch(SwatchColor=RGB(19, 214, 201)))
custom_preview_3 = CustomPreview(Geometry=boundary_surfaces_4, Material=ColourSwatch(SwatchColor=RGB(158, 158, 158)))
custom_preview_4 = CustomPreview(Geometry=boundary_surfaces_3, Material=ColourSwatch(SwatchColor=RGB(252, 154, 154)))
custom_preview_5 = CustomPreview(Geometry=boundary_surfaces_5, Material=ColourSwatch(SwatchColor=RGBA(255, 255, 255, 0)))  # disabled
custom_preview_lineweights = CustomPreviewLineweights(Geometry=curve_3, Shader=ColourSwatch(SwatchColor=RGB(0, 0, 0)), Thickness=Slider(3, range=0..10), Absolute=False)
divide_surface = DivideSurface(Surface=bounding_rectangle.Bounding, UCount=division, VCount=division_2)  # -> Points, Normals, Parameters

# ---- group: Users
python_3_script_2 = Python3Script(idx=familyuserindex)  # -> out, family, prompt; inputs idx: Int32
# ---------- python_3_script_2: Python ----------
location = {
  "P1_Locations": [
    { "id": 1, "city": "Cairo", "country": "Egypt", "climate": "Hot Desert (BWh)", "notes": "Very dry, extreme heat" },
    { "id": 2, "city": "Riyadh", "country": "Saudi Arabia", "climate": "Hot Desert (BWh)", "notes": "High diurnal variation" },
    { "id": 3, "city": "Istanbul", "country": "Turkey", "climate": "Mediterranean (Csa)", "notes": "Mixed seasonal performance" },
    { "id": 4, "city": "Barcelona", "country": "Spain", "climate": "Mediterranean (Csa)", "notes": "Warm summers, mild winters" },
    { "id": 5, "city": "Paris", "country": "France", "climate": "Oceanic (Cfb)", "notes": "Mild, humid year-round" },
    { "id": 6, "city": "London", "country": "United Kingdom", "climate": "Oceanic (Cfb)", "notes": "Cool summers, rainy winters" },
    { "id": 7, "city": "Berlin", "country": "Germany", "climate": "Continental (Dfb)", "notes": "Cold winters, warm summers" },
    { "id": 8, "city": "Moscow", "country": "Russia", "climate": "Cold Continental (Dfb/Dfc)", "notes": "Harsh winters" },
    { "id": 9, "city": "Helsinki", "country": "Finland", "climate": "Subarctic (Dfc)", "notes": "Short cool summers" },
    { "id": 10, "city": "New Delhi", "country": "India", "climate": "Humid Subtropical (Cwa)", "notes": "Hot summers, monsoon" },
    { "id": 11, "city": "Mumbai", "country": "India", "climate": "Tropical Wet & Dry (Aw)", "notes": "Heavy monsoon rains" },
    { "id": 12, "city": "Bangkok", "country": "Thailand", "climate": "Tropical Monsoon (Am)", "notes": "High humidity, rainfall" },
    { "id": 13, "city": "Singapore", "country": "Singapore", "climate": "Tropical Rainforest (Af)", "notes": "Uniformly hot & humid" },
    { "id": 14, "city": "Beijing", "country": "China", "climate": "Monsoon-Influenced Continental (Dwa)", "notes": "Cold dry winters, humid summers" },
    { "id": 15, "city": "Tokyo", "country": "Japan", "climate": "Humid Subtropical (Cfa)", "notes": "Hot humid summers, mild winters" },
    { "id": 16, "city": "Sydney", "country": "Australia", "climate": "Humid Subtropical (Cfa)", "notes": "Moderate year-round" },
    { "id": 17, "city": "Melbourne", "country": "Australia", "climate": "Oceanic (Cfb)", "notes": "Cool, changeable" },
    { "id": 18, "city": "Mexico City", "country": "Mexico", "climate": "Subtropical Highland (Cwb)", "notes": "Mild due to altitude" },
    { "id": 19, "city": "São Paulo", "country": "Brazil", "climate": "Humid Subtropical (Cfa)", "notes": "Warm wet summers" },
    { "id": 20, "city": "Buenos Aires", "country": "Argentina", "climate": "Humid Subtropical (Cfa)", "notes": "Hot summers, mild winters" },
    { "id": 21, "city": "Los Angeles", "country": "USA", "climate": "Mediterranean (Csa)", "notes": "Hot dry summers, mild winters" }
  ]
}


# for i in location['P1_Locations']:
#     print(i)

# city = location['P1_Locations'][idx]["city"]
# country = location['P1_Locations'][idx]["country"]
# climate = location['P1_Locations'][idx]["climate"]
# notes = location['P1_Locations'][idx]["notes"]

# prompt = f"""The site that is located in {city}, {country}, with this climate {climate} {notes}."""

families = {
  "P2_FamilyTypologies": [
    { "id": 1, "family": "Single adult", "profession": "Remote tech worker", "notes": "High digital needs, home office" },
    { "id": 2, "family": "Single adult", "profession": "Artist / Freelancer", "notes": "Studio or workshop space" },
    { "id": 3, "family": "Couple (2 adults)", "profession": "Both office workers", "notes": "Daily commuting" },
    { "id": 4, "family": "Couple (2 adults)", "profession": "Remote worker + healthcare", "notes": "Mixed schedules" },
    { "id": 5, "family": "Couple (2 adults)", "profession": "Retired", "notes": "Focus on comfort & accessibility" },
    { "id": 6, "family": "3 members (2 adults + 1 child)", "profession": "Tech + teacher", "notes": "School commute" },
    { "id": 7, "family": "3 members (2 adults + 1 elder parent)", "profession": "Mixed work", "notes": "Multigenerational living" },
    { "id": 8, "family": "4 members (2 adults + 2 children)", "profession": "Engineers", "notes": "Need study and play spaces" },
    { "id": 9, "family": "4 members (2 adults + 2 children)", "profession": "Healthcare + retail", "notes": "Shift-based routines" },
    { "id": 10, "family": "4 members (2 adults + 2 children)", "profession": "Artists", "notes": "Creative use of space" },
    { "id": 11, "family": "5 members (2 adults + 3 children)", "profession": "Tech + homemaker", "notes": "Larger bedrooms required" },
    { "id": 12, "family": "5 members (3 adults + 2 children)", "profession": "Family business", "notes": "Shared workspace needed" },
    { "id": 13, "family": "5 members (2 adults + 2 children + 1 elder)", "profession": "Teacher + doctor", "notes": "Care responsibilities" },
    { "id": 14, "family": "6 members (2 adults + 4 children)", "profession": "Mixed professions", "notes": "Large family housing" },
    { "id": 15, "family": "6 members (3 adults + 3 children)", "profession": "Family-owned shop", "notes": "Work/live mixed" },
    { "id": 16, "family": "7 members (2 adults + 5 children)", "profession": "Farming", "notes": "Outdoor/agricultural needs" },
    { "id": 17, "family": "7 members (2 adults + 3 children + 2 elders)", "profession": "Mixed work", "notes": "Generational overlap" },
    { "id": 18, "family": "8 members (Extended family)", "profession": "Retail + service jobs", "notes": "Shared kitchen priority" },
    { "id": 19, "family": "9 members (Large family)", "profession": "Mixed professions", "notes": "Multi-bedroom demand" },
    { "id": 20, "family": "10 members (3 generations)", "profession": "Farming + trades", "notes": "Strong communal areas" },
    { "id": 21, "family": "Cohousing (Unrelated adults)", "profession": "Students / professionals", "notes": "Shared facilities" }
  ]
}

family = families["P2_FamilyTypologies"][idx]["family"]
profession = families["P2_FamilyTypologies"][idx]["profession"]
notes = families["P2_FamilyTypologies"][idx]["notes"]

prompt = f"""The people who are going to live here are {family}, that are {profession}, and will need {notes}."""

print(prompt)

# city = location['P1_Locations'][idx]["city"]
# country = location['P1_Locations'][idx]["country"]
# climate = location['P1_Locations'][idx]["climate"]
# notes = location['P1_Locations'][idx]["notes"]

# prompt = f"""The site that is located in {city}, {country}, with this climate {climate} {notes}."""

# # for i in families['P2_FamilyTypologies']:
# #     print(i)
# #     # family = families["P2_FamilyTypologies"][idx]["family"]
# #     # profession = families["P2_FamilyTypologies"][idx]["profession"]
# #     # notes = families["P2_FamilyTypologies"][idx]["notes"]

# #     # user_prompt = f"""The people who are going to live here are {family}, that are {profession}, and will need {notes}."""
# ---------- end python_3_script_2 ----------

# ---- group: Site Analysis
python_3_script_3 = Python3Script(idx=set_city_index)  # -> out, city, prompt; inputs idx: Int32
# ---------- python_3_script_3: Python ----------
location = {
  "P1_Locations": [
    { "id": 1, "city": "Cairo", "country": "Egypt", "climate": "Hot Desert (BWh)", "notes": "Very dry, extreme heat" },
    { "id": 2, "city": "Riyadh", "country": "Saudi Arabia", "climate": "Hot Desert (BWh)", "notes": "High diurnal variation" },
    { "id": 3, "city": "Istanbul", "country": "Turkey", "climate": "Mediterranean (Csa)", "notes": "Mixed seasonal performance" },
    { "id": 4, "city": "Barcelona", "country": "Spain", "climate": "Mediterranean (Csa)", "notes": "Warm summers, mild winters" },
    { "id": 5, "city": "Paris", "country": "France", "climate": "Oceanic (Cfb)", "notes": "Mild, humid year-round" },
    { "id": 6, "city": "London", "country": "United Kingdom", "climate": "Oceanic (Cfb)", "notes": "Cool summers, rainy winters" },
    { "id": 7, "city": "Berlin", "country": "Germany", "climate": "Continental (Dfb)", "notes": "Cold winters, warm summers" },
    { "id": 8, "city": "Moscow", "country": "Russia", "climate": "Cold Continental (Dfb/Dfc)", "notes": "Harsh winters" },
    { "id": 9, "city": "Helsinki", "country": "Finland", "climate": "Subarctic (Dfc)", "notes": "Short cool summers" },
    { "id": 10, "city": "New Delhi", "country": "India", "climate": "Humid Subtropical (Cwa)", "notes": "Hot summers, monsoon" },
    { "id": 11, "city": "Mumbai", "country": "India", "climate": "Tropical Wet & Dry (Aw)", "notes": "Heavy monsoon rains" },
    { "id": 12, "city": "Bangkok", "country": "Thailand", "climate": "Tropical Monsoon (Am)", "notes": "High humidity, rainfall" },
    { "id": 13, "city": "Singapore", "country": "Singapore", "climate": "Tropical Rainforest (Af)", "notes": "Uniformly hot & humid" },
    { "id": 14, "city": "Beijing", "country": "China", "climate": "Monsoon-Influenced Continental (Dwa)", "notes": "Cold dry winters, humid summers" },
    { "id": 15, "city": "Tokyo", "country": "Japan", "climate": "Humid Subtropical (Cfa)", "notes": "Hot humid summers, mild winters" },
    { "id": 16, "city": "Sydney", "country": "Australia", "climate": "Humid Subtropical (Cfa)", "notes": "Moderate year-round" },
    { "id": 17, "city": "Melbourne", "country": "Australia", "climate": "Oceanic (Cfb)", "notes": "Cool, changeable" },
    { "id": 18, "city": "Mexico City", "country": "Mexico", "climate": "Subtropical Highland (Cwb)", "notes": "Mild due to altitude" },
    { "id": 19, "city": "São Paulo", "country": "Brazil", "climate": "Humid Subtropical (Cfa)", "notes": "Warm wet summers" },
    { "id": 20, "city": "Buenos Aires", "country": "Argentina", "climate": "Humid Subtropical (Cfa)", "notes": "Hot summers, mild winters" },
    { "id": 21, "city": "Los Angeles", "country": "USA", "climate": "Mediterranean (Csa)", "notes": "Hot dry summers, mild winters" },
    { "id": 22, "city": "Lima", "country": "Peru", "climate": "Subtropical Desert (BWh)", "notes": "Very low rainfall; cool overcast winters (garúa) and mild year-round due to the Humboldt Current" }
  ]
}


for i in location['P1_Locations']:
    print(i)

city = location['P1_Locations'][idx]["city"]
country = location['P1_Locations'][idx]["country"]
climate = location['P1_Locations'][idx]["climate"]
notes = location['P1_Locations'][idx]["notes"]

prompt = f"""The site that is located in {city}, {country}, with this climate {climate} {notes}."""
# ---------- end python_3_script_3 ----------

# ----
panel_2 = Panel("""You are an architect conducting site analysis for building massing and program layout.

INPUTS
1) Site diagram (Legend: North=top; Green=Trees; Blue=Water Feature; Red=Buildable Zone (BZ); Grey=Access Road; Black=Property Boundary; Grid=10 m).
2) Location string.
3) Users string.

TASK
Write one concise paragraph (max 150 words) describing the site conditions for program layout.  
- Always locate features explicitly in relation to the Buildable Zone using cardinal directions.  
- Summarize site reading, massing concept, climate response, orientation, and program strategy (living/social, private, entry, outdoor) within the same paragraph.  
- Include three critical moves: view axis, threshold sequence, and edge condition.  
- End with a verbal “spatial diagram” that narrates how BZ, road, water, and trees are arranged as if sketching for someone off-site.

OUTPUT
Return only the single paragraph, no headings or lists.""")
flip_matrix = FlipMatrix(Data=divide_surface.Points)
panel_3 = Panel(python_3_script_3.prompt)
panel_4 = Panel(python_3_script_2.prompt)
polyline = PolyLine(Vertices=flip_matrix, Closed=False)
polyline_2 = PolyLine(Vertices=divide_surface.Points, Closed=False)
custom_preview_lineweights_2 = CustomPreviewLineweights(
    Geometry=[polyline_2, polyline],
    Shader=ColourSwatch(SwatchColor=RGB(173, 173, 173)),
    Thickness=Slider(1, range=0..10),
    Absolute=False)
panel_5 = Panel(python_3_script_3.prompt)
panel_6 = Panel("qwen2.5")
panel_7 = Panel("local")
model = Text("gpt-4o")
client = Text("openai")
panel_8 = Panel(python_3_script_2.prompt)
concatenate = Concatenate(FragmentA=panel_5, FragmentB=panel_8)
panel_9 = Panel(concatenate)
# You are an architect’s copilot.
# Analyze the provided site image and return a clear, structured **site strategy** that will guide another model in laying out building spaces.
# 
# ### INTERPRETATION LEGEND (from image)
# - North = top of image
# - East = right of image
# - West = left of image
# - South = bottom of image
# - Green circles = Trees
# - Blue = Water feature (pond, stream, or pool)
# - Red = Buildable zone
# - Grey = Access road
# - Black = Property boundary
# - Grid = 10 × 10 m squares (scale reference)
# 
# ### REQUIREMENTS
# - Always describe **where features are located** using cardinal directions and zones (north, south, east, west, center, or corners: NW, NE, SW, SE).
# - Be explicit: specify which edge or corner of the plot features belong to.
# - Prioritize: **climate response**, **privacy hierarchy**, and **cultural expectations**.
# - Output must be **valid JSON only** (no comments, no extra text).
# - Limit descriptions to ~200 words across all text fields.
# 
# ---
# 
# ### OUTPUT JSON SCHEMA
# {
#   "site_reading": "<2-sentence summary: dominant spatial condition + key opportunity>",
# 
#   "massing_concept": {
#     "form": "<linear | courtyard | L-shaped | cluster | bar | compact | other>",
#     "climate_response": "<how form/orientation responds to sun, wind, shade>",
#     "orientation": "<primary axis and why (e.g., east–west bar to shade south)>"
#   },
# 
#   "program_strategy": {
# "entry": "<where & why (e.g., south edge from road)>
#     "living_spaces": "<where & why (e.g., north edge to face trees)>",
#     "private_spaces": "<where & why (e.g., east side for morning sun, privacy)>",
#     },
# 
#   "critical_moves": {
#     "view_axis": "from <location> to <feature>",
#     "threshold": "<entry sequence and first reveal>",
#     "edge": "<how building meets water/trees/road/boundary>"
#   },
# 
#   "spatial_diagram": {
# "entry": "<relative placement (e.g., south edge from access road)>"
#     "living": "<relative placement (e.g., north center facing trees)>",
#     "bedrooms": "<relative placement (e.g., east edge for privacy)>",
#     "kitchen_dining": "<relative placement (e.g., south near entry)>",
#         "notes": "<key adjacencies/orientation cues>"
#   },
# 
#   "early_adjacency_graph": {
#     "nodes": [
#       {
#         "id": "<lowercase identifier>",
#         "role": "<entry | living | kitchen | dining | bedroom | bath | service | outdoor | circulation>",
#         "preferred_zone": "<north|south|east|west|center|nw|ne|sw|se>",
#         "level": "<0|1|2>",
#         "priority": "<primary|secondary>",
#         "notes": "<short rationale>"
#       }
#     ],
#     "edges": [
#       ["<node_id_A>", "<node_id_B>", "<connection type: direct|visual|service>", "<strength: strong|moderate|weak>"]
#     ]
#   },
# 
#   "site_features": {
#     "road_access": "<where (e.g., south edge, mid)>",
#     "water_feature": "<where (e.g., northwest corner, along north edge)>",
#     "tree_clusters": "<where (e.g., north band, sparse east)>",
#     "buildable_zone": "<shape & where (e.g., central rectangle set back from water)>",
#     "constraints": "<setbacks, no-build edges, steep/flood areas if any>"
#   }
# }
# {
#   "P1_Locations": [
#     { "id": 1, "city": "Cairo", "country": "Egypt", "climate": "Hot Desert (BWh)", "notes": "Very dry, extreme heat" },
#     { "id": 2, "city": "Riyadh", "country": "Saudi Arabia", "climate": "Hot Desert (BWh)", "notes": "High diurnal variation" },
#     { "id": 3, "city": "Istanbul", "country": "Turkey", "climate": "Mediterranean (Csa)", "notes": "Mixed seasonal performance" },
#     { "id": 4, "city": "Barcelona", "country": "Spain", "climate": "Mediterranean (Csa)", "notes": "Warm summers, mild winters" },
#     { "id": 5, "city": "Paris", "country": "France", "climate": "Oceanic (Cfb)", "notes": "Mild, humid year-round" },
#     { "id": 6, "city": "London", "country": "United Kingdom", "climate": "Oceanic (Cfb)", "notes": "Cool summers, rainy winters" },
#     { "id": 7, "city": "Berlin", "country": "Germany", "climate": "Continental (Dfb)", "notes": "Cold winters, warm summers" },
#     { "id": 8, "city": "Moscow", "country": "Russia", "climate": "Cold Continental (Dfb/Dfc)", "notes": "Harsh winters" },
#     { "id": 9, "city": "Helsinki", "country": "Finland", "climate": "Subarctic (Dfc)", "notes": "Short cool summers" },
#     { "id": 10, "city": "New Delhi", "country": "India", "climate": "Humid Subtropical (Cwa)", "notes": "Hot summers, monsoon" },
#     { "id": 11, "city": "Mumbai", "country": "India", "climate": "Tropical Wet & Dry (Aw)", "notes": "Heavy monsoon rains" },
#     { "id": 12, "city": "Bangkok", "country": "Thailand", "climate": "Tropical Monsoon (Am)", "notes": "High humidity, rainfall" },
#     { "id": 13, "city": "Singapore", "country": "Singapore", "climate": "Tropical Rainforest (Af)", "notes": "Uniformly hot & humid" },
#     { "id": 14, "city": "Beijing", "country": "China", "climate": "Monsoon-Influenced Continental (Dwa)", "notes": "Cold dry winters, humid summers" },
#     { "id": 15, "city": "Tokyo", "country": "Japan", "climate": "Humid Subtropical (Cfa)", "notes": "Hot humid summers, mild winters" },
#     { "id": 16, "city": "Sydney", "country": "Australia", "climate": "Humid Subtropical (Cfa)", "notes": "Moderate year-round" },
#     { "id": 17, "city": "Melbourne", "country": "Australia", "climate": "Oceanic (Cfb)", "notes": "Cool, changeable" },
#     { "id": 18, "city": "Mexico City", "country": "Mexico", "climate": "Subtropical Highland (Cwb)", "notes": "Mild due to altitude" },
#     { "id": 19, "city": "São Paulo", "country": "Brazil", "climate": "Humid Subtropical (Cfa)", "notes": "Warm wet summers" },
#     { "id": 20, "city": "Buenos Aires", "country": "Argentina", "climate": "Humid Subtropical (Cfa)", "notes": "Hot summers, mild winters" },
#     { "id": 21, "city": "Los Angeles", "country": "USA", "climate": "Mediterranean (Csa)", "notes": "Hot dry summers, mild winters" }
#   ]
# }
panel_10 = Panel("""{
  "case_id": "<Unique identifier, e.g., CASE_001. Use string format.>",
  "vary": "<Optional variation parameter, leave null if not needed.>",
  "selection": {
    "location": {
      "id": "<Integer ID for location>",
      "city": "<City name>",
      "country": "<Country name>",
      "climate": "<Climate type, e.g., Köppen code>",
      "notes": "<Short notes about environmental/seasonal performance>"
    },
    "family": {
      "id": "<Integer ID for family>",
      "family": "<Family composition, e.g., '4 members (2 adults + 2 children)'>",
      "profession": "<Primary professions or roles>",
      "notes": "<Special needs, e.g., study, play, work-from-home>"
    },
    "planning": {
      "id": "<Integer ID for planning layout>",
      "name": "<Planning strategy, e.g., Linear, Courtyard, Cluster>",
      "bounds": {
        "width": "<Float, overall normalized width>",
        "height": "<Float, overall normalized height>",
        "margin": "<Float, outer margin>"
      },
      "routing": {
        "type": "<Routing type, e.g., corridor, loop>",
        "polyline": [
          [ "<x float>", "<y float>" ],
          [ "<x float>", "<y float>" ]
        ],
        "width": "<Float, corridor width>",
        "orientation": "<String, e.g., north-south>"
      },
      "nodes": [
        {
          "id": "<Node ID, e.g., ENTRY>",
          "role": "<Program role, e.g., Entry, Living, KitchenDining>",
          "center": [ "<x float>", "<y float>" ],
          "size": [ "<w float>", "<h float>" ]
        }
      ],
      "graph_edges": [
        [ "<NodeID1>", "<NodeID2>" ]
      ],
      "constraints": {
        "non_overlap": "<Boolean, true/false>",
        "min_gap": "<Float, minimum gap between elements>",
        "order_along_axis": {
          "axis": "<x or y>",
          "sequence": [ "<Ordered list of NodeIDs>" ]
        },
        "façade_priority": {
          "<direction>": [ "<NodeIDs that prefer this façade>" ]
        },
        "service_stack": [ "<NodeIDs sharing service stack>" ],
        "access_from_corridor": [ "<NodeIDs with corridor access>" ]
      },
      "placement_hints": [
        "<Optional freeform design hints, e.g., snapping rules>"
      ]
    }
  }
}""")
# """Design a single-family house in {{location.city}}, {{location.country}} (climate: {{location.climate}}). Family: {{family.family}} ({{family.profession}}). Use planning type '{{planning.name}}' with routing '{{planning.routing.type}}'. Site: {{site.name}}. Respect setbacks and produce a layout using the planning nodes/edges. Output JSON only following the given schema."""
panel_11 = Panel("""You are an architect's copilot. Reply in JSON matching the provided schema.
You are to review the site analysis and provide a design for a single family house. Take into account local region and cultural factors into the design and any architectural design considerations that will make this a good design.""")
panel_12 = Panel("gpt-4o")
panel_13 = Panel("qwen3")
panel_14 = Panel("deepseek")
panel_15 = Panel("gemma3")
panel_16 = Panel("gpt-oss-20b")
model_2 = Text("gpt-5")
client_2 = Text("openai")
concatenate_2 = Concatenate(FragmentA=panel_11, FragmentB=panel_10)
seed = Integer(number_slider)
model_3 = Text(model)
siteidx = Integer(set_city_index)
useridx = Integer(familyuserindex)
client_3 = Text(client)
client_4 = Text(client_2)
model_4 = Text(model_2)
unit_z = UnitZ(Factor=1)
panel_18 = Panel("""You are an **Architectural Graph Verifier**.

Mission
- Input: {design JSON with nodes/edges/site_area/reason, networkx_analysis (global & per-node), optional policy}.
- Interpret graph metrics (Depth, Integration/Closeness, Choice/Betweenness, Control, Entropy, Random-walk) as evidence of spatial experience.
- Judge parti & topology in terms of: circulation clarity, privacy gradient, social core legibility, adjacency hygiene, multi-floor consistency, climate/cultural fit.
- Always connect metric findings back to **how inhabitants will move, socialize, and feel in the architecture**.
- Propose minimal, surgical fixes (prefer edge edits > node geometry changes). Patches must improve lived experience: smoother flow, more coherent privacy, richer social connections, or climate responsiveness.

Defaults (overridable by policy)
- Graph connected (components==1) → ensures all spaces are reachable.
- Navigability: avg_shortest_path_lcc ≤ 2.4 (soft), diameter_lcc ≤ 4 (hard) → circulation compact, not confusing.
- No over-hub: max betweenness_choice ≤ 0.70 unless parti justifies → avoid bottlenecks.
- Bedrooms deeper than living (↑mean_depth, ↓integration) → supports privacy gradient.
- Bathrooms accessible without crossing kitchen; WC upstairs if floors>1 → hygiene + convenience.
- ≥1 alternate route in public domain when feasible → choice, sociability.
- Courtyard/terrace connected to living/hall/kitchen → usable outdoor room.
- Degree assortativity ~ 0 preferred; clustering in social core > 0 → convivial, redundant ties.

Output (STRICT JSON only)
{
  "verdict": "pass"|"warn"|"fail",
  "parti_summary": "<1 paragraph: interpret parti + circulation as an inhabitant experience>",
  "key_findings": [
    {"id":"<node_id|global>",
     "issue":"<title>",
     "severity":"low|med|high",
     "evidence":{"metrics":{"...":"..."},"topology":"<cause>","use_implication":"<effect on users>"},
     "why_it_matters":"<architectural rationale: comfort, privacy, sociability, legibility>"}
  ],
  "suggestions": [
    {"action":"add_edge|remove_edge|add_node|update_node|remove_node",
     "details":{"...":"..."},
     "expected_effect":{
       "spatial":"<impact on privacy/flow/social life/climate experience>",
       "metrics_direction":{
         "betweenness_choice":"down|up|no_change",
         "average_shortest_path_length_lcc":"down|up|no_change",
         "diameter_lcc":"down|up|no_change",
         "integration_closeness@node":"up|down|no_change",
         "mean_depth@node":"up|down|no_change"}},
     "tradeoffs":"<what might be lost>",
     "priority":1}
  ],
  "patch": {
    "edges_add":[["a","b"],...],
    "edges_remove":[["x","y"],...],
    "nodes_add":[{"id":"...","type":"...","center":[x,y],"width":[w,d],"height":h,"floor":0,"color":"#RRGGBB","unique_features":"..."}],
    "nodes_update":[{"id":"...","set":{"center":[x,y],"width":[w,d],"type":"..."}}],
    "nodes_remove":["id1","id2"]
  },
  "kpi_summary":{
    "targets_met":["connected_graph",...],
    "targets_missed":["over_hub",...]},
  "notes":"<assumptions, uncertainties, cultural/climatic alignment>"
}

Behavior
- Be specific; reference exact ids/edges. Use supplied metrics, do NOT recompute.
- Tie every metric to human experience: integration → legibility, mean_depth → privacy, betweenness → bottlenecks, clustering → social redundancy, entropy → spatial variety, random-walk → long-term occupation balance.
- Suggest the **smallest possible change** that improves experience while respecting the parti.
- Output ONLY the JSON object.""")
site_center = Point(area.Centroid)
# You are an Architectural Graph Verifier.
# 
# Mission
# - Read: {design JSON with nodes/edges/site_area/reason, networkx_analysis (global & per-node), optional policy}.
# - Judge parti & topology via Space Syntax (Depth, Integration/Closeness, Choice/Betweenness, Control, Entropy, Random-walk).
# - Check: circulation, privacy gradient, adjacency hygiene, multi-floor consistency, climate/culture fit.
# - Propose minimal fixes (prefer edge edits over geometry), with precise patches and expected qualitative metric shifts.
# 
# Defaults (overridable by policy)
# - Connected graph (components==1)
# - Navigability: avg_shortest_path_lcc ≤ 2.4 (soft); diameter_lcc ≤ 4 (hard)
# - No over-hub: max betweenness_choice ≤ 0.70 unless justified
# - Bedrooms deeper than living (↑mean_depth, ↓integration vs. living)
# - Bathrooms reachable w/o crossing kitchen; upstairs WC if floors>1
# - ≥1 alternate route in public domain when feasible
# - Courtyard/terrace connected to living/hall/kitchen with purpose
# - Degree assortativity ~ 0 preferred; social core clustering > 0
# 
# Output (STRICT JSON only)
# {
#   "verdict": "pass"|"warn"|"fail",
#   "parti_summary": "<one paragraph>",
#   "key_findings": [
#     {"id":"<node_id|global>","issue":"<title>","severity":"low|med|high",
#      "evidence":{"metrics":{"...":"..."},"topology":"<cause>","use_implication":"<effect>"},
#      "why_it_matters":"<architectural rationale>"}
#   ],
#   "suggestions": [
#     {"action":"add_edge|remove_edge|add_node|update_node|remove_node",
#      "details":{"...":"..."},
#      "expected_effect":{"spatial":"<privacy/flow/legibility>",
#        "metrics_direction":{"betweenness_choice":"down|up|no_change",
#                             "average_shortest_path_length_lcc":"down|up|no_change",
#                             "diameter_lcc":"down|up|no_change",
#                             "integration_closeness@node":"up|down|no_change",
#                             "mean_depth@node":"up|down|no_change"}},
#      "tradeoffs":"<loss>", "priority":1}
#   ],
#   "patch": {
#     "edges_add":[["a","b"],...], "edges_remove":[["x","y"],...],
#     "nodes_add":[{"id":"...","type":"...","center":[x,y],"width":[w,d],"height":h,"floor":0,"color":"#RRGGBB","unique_features":"..."}],
#     "nodes_update":[{"id":"...","set":{"center":[x,y],"width":[w,d],"type":"..."}}],
#     "nodes_remove":["id1","id2"]
#   },
#   "kpi_summary":{"targets_met":["connected_graph",...],"targets_missed":["over_hub",...]},
#   "notes":"<assumptions/uncertainties; climate/culture alignment>"
# }
# 
# Behavior
# - Be specific; reference exact ids/edges. Use supplied metrics; do NOT recompute—reason qualitatively about directions.
# - Prefer smallest change that solves the issue; preserve design intent.
# - Output ONLY the JSON object.
panel_19 = Panel("llm")
unit_z_2 = UnitZ(Factor=1)
model_5 = Text("gpt-oss-20b")
client_5 = Text("local")
unit_z_3 = UnitZ(Factor=Slider(0.1, range=0..0.1))
curve_6 = Curve(curve_3)
colour_swatch = ColourSwatch(SwatchColor=RGB(0, 0, 0))

# ---- group: saving site image
panel_20 = Panel(python_3_script.site_info)
panel_21 = Panel(area.Area)
number = Number(number_slider)
number_2 = Number(panel_21)
file_path = FilePath("C:\Users\user\Documents\GitHub\ThesisDesignAgent\grasshopperFiles\site_plans\")
curve_7 = Curve(curve_3)

# ---- group: saving site image / create path name
python_3_script_4 = Python3Script(site_info=panel_20, seed=number, pad_area=number_2)  # -> out, fname; inputs site_info: list of String, seed: Int32, pad_area: Double
# ---------- python_3_script_4: Python ----------
import os, re, datetime

def parse_info_card(s, fallback_meta=None):
    """
    Robustly parse the info block:
      XL LOT
      Size: 150x120m
      Trees: 18
      Pads: 1
      Water features: 1
      Road: Yes
    Returns {} if something essential is missing.
    """
    s = (s or "")
    # normalize newlines & strip weird chars (ANSI, etc.)
    s = s.replace("\r\n", "\n")
    s = "".join(ch for ch in s if ch == "\n" or 32 <= ord(ch) <= 126)
    lines = [ln.strip() for ln in s.split("\n") if ln.strip()]

    meta = dict(fallback_meta or {})

    # LOT
    for ln in lines:
        m = re.search(r"([A-Za-z]+)\s+LOT\b", ln, re.I)
        if m: meta["lot"] = m.group(1).upper(); break

    # Size
    for ln in lines:
        m = re.search(r"Size:\s*(\d+)\s*[x×]\s*(\d+)\s*m", ln, re.I)
        if m: meta["width"], meta["depth"] = int(m.group(1)), int(m.group(2)); break

    # Trees / Pads / Water / Road
    for ln in lines:
        m = re.search(r"Trees:\s*(\d+)", ln, re.I)
        if m: meta["trees"] = int(m.group(1)); break

    for ln in lines:
        m = re.search(r"Pads:\s*(\d+)", ln, re.I)
        if m: meta["pads"] = int(m.group(1)); break

    for ln in lines:
        m = re.search(r"Water\s*features?:\s*(\d+)", ln, re.I)
        if m: meta["waters"] = int(m.group(1)); break

    for ln in lines:
        m = re.search(r"Road:\s*(Yes|No)", ln, re.I)
        if m: meta["road"] = (m.group(1).lower() == "yes"); break

    required = ("lot","width","depth","trees","pads","waters","road")
    if not all(k in meta for k in required):
        return {}
    return meta

def meta_from_variables():
    size = globals().get("size") or {}
    return {
        "lot": (globals().get("lot_type","LOT") or "LOT").upper(),
        "width": int(size.get("width", 0) or 0),
        "depth": int(size.get("depth", 0) or 0),
        "trees": len(globals().get("tree_zones", []) or []),
        "pads": len(globals().get("buildable_zones", []) or []),
        "waters": len(globals().get("water_features", []) or []),
        "road": bool(globals().get("access_roads", []) )
    }

def safe_slug(s):
    return re.sub(r"[^A-Za-z0-9._-]+", "_", str(s)).strip("_")

def build_plot_filename_from_info(info_string, seed=None, extra=None, ext="png"):
    # Try parsing the card; if it fails, derive from variables
    meta = parse_info_card(info_string)
    if not meta:
        meta = meta_from_variables()
    if not meta.get("width"):  # final fallback: timestamp
        stamp = datetime.datetime.now().strftime("%Y%m%d_%H%M%S")
        return f"site_{stamp}.{ext}"

    base = f"{meta['lot']}_{meta['width']}x{meta['depth']}m_T{meta['trees']}_P{meta['pads']}_W{meta['waters']}_R{'Y' if meta['road'] else 'N'}"
    if extra:
        base += "_" + safe_slug(extra)
    if seed is not None:
        base += f"_seed{seed}"
    return base + "." + ext

info_str = site_info[-1] if site_info else ""

fname = build_plot_filename_from_info(info_str, seed=seed, extra=f"area{int(globals().get('pad_area',0))}")
print(fname)   # e.g. XL_150x120m_T18_P1_W1_RY_seed42.png
# ---------- end python_3_script_4 ----------

# ---- group: saving site image (continued)
panel_22 = Panel(python_3_script_4.fname)

# ---- group: saving site image / save plot for LLM
python_3_script_5 = Python3Script(plot_outline_curve=curve_7, SAVE_DIR=file_path, fname=panel_22)  # -> out, png_path; inputs plot_outline_curve: Curve
# ---------- python_3_script_5: Python ----------
import os, base64, uuid, tempfile
import Rhino
import Rhino.Geometry as rg
import scriptcontext as sc
from System.Drawing.Imaging import ImageFormat

# --- Focus Top on plot outline (keeps it fully inside frame) ---
def focus_top_on(plot_geom, pad_frac=0.04, view_name="Top"):
    if plot_geom is None:
        raise ValueError("plot_geom is None")
    bbox = plot_geom.GetBoundingBox(True)
    if not bbox.IsValid:
        raise ValueError("Invalid plot bbox")

    # Pad the bbox a bit so geometry isn't glued to the image edge
    dx = bbox.Max.X - bbox.Min.X
    dy = bbox.Max.Y - bbox.Min.Y
    pad = max(dx, dy) * float(pad_frac)
    bbox = rg.BoundingBox(
        rg.Point3d(bbox.Min.X - pad, bbox.Min.Y - pad, bbox.Min.Z - 1.0),
        rg.Point3d(bbox.Max.X + pad, bbox.Max.Y + pad, bbox.Max.Z + 1.0)
    )

    # Find the Top view if it exists, otherwise use the active view
    view = sc.doc.Views.Find(view_name, False) or sc.doc.Views.ActiveView
    if view is None:
        raise RuntimeError("No Rhino view available")

    vp = view.ActiveViewport

    # Force a Top/parallel projection (try several APIs for compatibility)
    proj = Rhino.Display.DefinedViewportProjection.Top
    ok = False
    for args in [
        (proj, True, True, True),   # Rhino 8
        (proj, True, True),         # some builds
        (proj, True),               # some builds
        (proj,)                     # older builds
    ]:
        try:
            if vp.SetProjection(*args):
                ok = True
                break
        except:
            pass
    try:
        vp.ChangeToParallelProjection(True)
    except:
        pass
    try:
        vp.SetToPlanView(rg.Plane.WorldXY, True)
    except:
        pass

    # Canonical Top orientation
    try:
        vp.SetCameraDirection(rg.Vector3d(0, 0, -1), True)
    except:
        vp.CameraDirection = rg.Vector3d(0, 0, -1)
    vp.CameraUp = rg.Vector3d(0, 1, 0)

    # Clean capture (hide grids/axes)
    vp.ConstructionGridVisible = False
    vp.ConstructionAxesVisible = False
    vp.WorldAxesVisible = False

    # Zoom to bbox
    vp.ZoomBoundingBox(bbox)
    view.Redraw()
    return view

# --- Capture (instance-based ViewCapture → avoids your error) ---
def capture_view(view, path, width=1400, height=1400, display_mode="Arctic", transparent=False):
    dm = Rhino.Display.DisplayModeDescription.FindByName(display_mode)
    if dm:
        view.ActiveViewport.DisplayMode = dm
    sc.doc.Views.Redraw()

    vc = Rhino.Display.ViewCapture()
    vc.Width = int(width)
    vc.Height = int(height)
    vc.ScaleScreenItems = False
    vc.DrawGrid = False
    vc.DrawAxes = False
    vc.DrawGridAxes = False
    vc.TransparentBackground = bool(transparent)

    # IMPORTANT: instance method expects a RhinoView (not settings)
    bmp = vc.CaptureToBitmap(view)
    if bmp is None:
        raise RuntimeError("Capture failed (bitmap is None)")
    bmp.Save(path, ImageFormat.Png)
    return path

# --- Encode PNG/JPG to data-URI for LLMs ---
def encode_image_to_data_uri(path):
    ext = os.path.splitext(path)[1].lower().lstrip(".")
    mime = "image/jpeg" if ext in ("jpg", "jpeg") else "image/png"
    with open(path, "rb") as f:
        b64 = base64.b64encode(f.read()).decode("utf-8")
    return "data:%s;base64,%s" % (mime, b64)

# --- One-call helper: frame Top → capture → data-URI ---
def capture_topview_to_data_uri(plot_geom,
                                path=None,
                                width=1400,
                                height=1400,
                                pad_frac=0.04,
                                display_mode="Arctic",
                                transparent=False):
    import os, uuid, tempfile
    # If no explicit path, build one in SAVE_DIR (or temp if SAVE_DIR is not set/valid)
    if not path:
        out_dir = SAVE_DIR if (isinstance(SAVE_DIR, str) and len(SAVE_DIR) > 0) else tempfile.gettempdir()
        if not os.path.isdir(out_dir):
            try: os.makedirs(out_dir)
            except: out_dir = tempfile.gettempdir()
        path = os.path.join(out_dir, "site_top_%s.png" % uuid.uuid4().hex[:8])

    view = focus_top_on(plot_geom, pad_frac, view_name="Top")
    capture_view(view, path, width, height, display_mode, transparent)
    return path, encode_image_to_data_uri(path)

path = os.path.join(SAVE_DIR, fname)
png_path, data_uri = capture_topview_to_data_uri(plot_outline_curve,
                                                path = path,
                                                 width=1600, height=1600,
                                                 display_mode="Rendered",
                                                 transparent=False)
# ---------- end python_3_script_5 ----------

# ---- group: saving site image (continued)
panel_23 = Panel(python_3_script_5.png_path)

# ---- group: VLM
python_3_script_6 = Python3Script(
    run=boolean_toggle,
    project_name="HouseX",
    api_mode=client,
    model_id=model,
    use_mode="vlm",
    image_path=panel_23,
    system_prompt=panel_2,
    input_text=panel_9)  # -> out, response; inputs image_path: String
# ---------- python_3_script_6: Python ----------
import requests
import re
from ghpythonlib.treehelpers import list_to_tree

url = 'http://localhost:5000/llm_call'
# print(f"Sending db_path: {db_path}")
payload = {
    'input_text': input_text,
    'system_prompt': system_prompt,
    'image_path': image_path,
    'model_id': model_id,
    'project_name': project_name,
    'use_mode': use_mode,
    'api_mode':api_mode
}
print(payload)


response = None
question_classification = None
json_data = None

if run:
    response = requests.post(url, json=payload)
    
    if response.status_code == 200:
        data = response.json()
        response = data['response']
        
    else:
        out = "Failed to connect:"

print(response)
# ---------- end python_3_script_6 ----------

# ----
python_3_script_7 = Python3Script(site_analysis=python_3_script_6.response)  # -> out, a
# ---------- python_3_script_7: Python ----------
print(site_analysis)
# ---------- end python_3_script_7 ----------
panel_24 = Panel(python_3_script_6.response)

# ---- group: prompt to LLM for planning
python_3_script_8 = Python3Script(site_info=panel_20, site_analysis=panel_24, users=panel_8, location=panel_5)  # -> out, system_prompt, prompt
# ---------- python_3_script_8: Python ----------
system_promptv0 = """You are an architects copilot.  
Your task is to design a house based on a given **site analysis**, **local region**, **cultural context**, and **architectural best practices**.  

You must propose the **spaces, their adjacencies, and logical arrangement**, reflecting how inhabitants will move through and experience the home. Think like an architect:
- Snap rooms to one another logically, respecting circulation and adjacency.  
- If the house has multiple floors, include stairs to connect floors and ensure stacked rooms align structurally.
- If you suggest that the house has a courtyard then include it as a room.  
- Orient rooms correctly with **north at the top** of the site plan.  
- Reflect privacy, climate, and cultural expectations.  
- Output should be both **functional** and **experiential**, as if explaining a design intent.
- The Rooms should have correct dimensions as you believe are accurate for the design to meet the design intent and maximize the best experience for the users.

Your output must be **strictly valid JSON** conforming to the schema below.  
Do not include explanations, comments, or extra text—return **only JSON**.  

---

### JSON Schema
{
  "name": "<Design name, e.g. 'Linear house'>",
  "description": "<Brief description of the spatial concept>",
  "families": "<Family composition, e.g. '2 adults + 2 children'>",
  "profession": "<Primary profession(s) of family>",
  "location": "<City, Country>",
  "climate": "<Climate string, e.g. 'Arid'>",
  "roof_type": "<Roof type and material based on local and regional inspiration>",
  "facade_materials": "<Facade material(s) based on local and regional inspiration>",
  "floors": <integer number of floors>,
  "reason": "<Summary of key design decisions and site response>",
  "entry_strategy": {
    "side": "<north|south|east|west>",
    "anchor_point": [<float x>, <float y>],
    "rationale": "<short reason>"
  },

  "nodes": [
    {
      "id": "<unique identifier, lowercase>",
      "type": "<room type>",
      "center": [<float x>, <float y>],         // meters, relative to site_area
      "width": [<float, float>],                // room dimensions in meters (x,y)
      "height": <float>,                        // ceiling height in meters
      "floor": <integer>,                       // floor number
      "color": "<hex color string>",
      "unique_features": "<unique attributes, e.g. skylight, sliding doors>"
    }
  ],

  "edges": [
    ["<node_id_A>", "<node_id_B>"]              // adjacency connections
  ],

  "site_area": {
    "width": <float>,                           // plot width in meters
    "height": <float>                           // plot depth in meters
  }
}

---

### Rules
- Every node must include: id, type, center, width, height, floor, and color.  
- Edges = logical circulation links (entry → living, living → kitchen, etc.).  
- **Entry node** must align with `entry_strategy.side` and its `anchor_point` inside the buildable zone.  
- Centers must respect **north-up orientation** of the site.  
- Floors must stack logically if >1.  
- Design must reflect **climate adaptation**, **privacy hierarchy**, and **cultural context**.  
- JSON must be valid: consistent quotes, commas, and closed brackets.
- Think through it step by step logically and reflect on your answer to make sure it is correct and that the rooms are not overlapping and their relationship logic makes sense architecturally.  
- Output must be **one single JSON object** only.
"""


promptv0 = f"""Your task is to Design a house in {location}:  {users} Use the following site analysis as a starting guide to design the floor plan. Take into account where the entry should be and follow the design from there logically, think through it carefully and reflect on it before saying the solution:

{site_analysis}

Based on this site and context, return the **complete JSON design** following the schema provided in the system prompt.  

- Include all and add more spaces and connections to make the home functional, culturally appropriate, and inspiring for the inhabitants to live in their best space.  
- make sure the entry is correctly placed.  
- If multiple floors are needed, include stairs and ensure stacked rooms align structurally.  
- Reflect the **local climate**, **cultural expectations**, and **lifestyle needs** of the family.  
- Be creative like a world-class architect, ensuring each design decision improves the lived experience.
- Think through it step by step, and reflect on it before answering, so you get the best possible answer.  

Return only the JSON object, nothing else."""

system_promptv2 = """
You are an famous architect.

Design a residential building from a given site analysis, local region, cultural context, and best practices. Produce a complete spatial configuration as STRICT JSON only, following the schema and rules below.

## Creative intent (think privately; do NOT include your chain-of-thought)
- Aim for a clear CREATIVE AND INNOVATIVE PARTI that feels avant-garde yet livable and tied to the local region and culture with a focus on the spatial experience for users.
- Invent spaces that elevate daily life. Use them only if they make the architecture better and the experience for the inhabitants.
- Create a compelling privacy gradient (public → semi-private → private) and a legible procession from entry that is architecturally meaningful and interesting.
- Compose sectionally: where meaningful for spatial experience generate multiple levels and double height spaces if it adds to the spatial experience.
- Always include the entry as room


REASON FIELD (required keys inside the single string)
- parti: <short name>;
- moments: <3 concise experiential moments>;
- climate_tactics: <2–3 tactics>;
- program_rationale: <how spaces enrich life & reflect local culture>;
- cultural_motifs: <3 short phrases>;
- assumptions: <3 short user-lifestyle or cultural assumptions the design serves>.

## Spatial & geometric conventions
- Use the reasons to layout the house floor plan
- Units: meters. North is up.
- Site frame: (0,0) at **south-west**; x → east, y → north.
- All rooms must lie fully within `site_area`. **No overlaps** between room rectangles.
- Floors: **0 = ground**, 1 = upper, etc. If `floors > 1`, include `"staircase"` and connect it properly across the floors.
- If more than one floor, rooms must aligned vertically structurally.

## JSON SCHEMA (output must conform)
{
  "name": "…",
  "description": "…",
  "users": "<echo users>",
  "profession": "…",
  "location": "<echo location>",
  "climate": "<echo climate>",
  "roof_type": "…",
  "facade_materials": "…",
  "floors": <integer>,
  "reason": "…",
  "entry_strategy": {
    "side": "north|south|east|west",
    "anchor_point": [<float x>, <float y>],
    "rationale": "…"
  },
  "nodes": [
    {
      "id": "<unique snake_case>",
      "type": "<room label>",
      "center": [<float x>, <float y>],
      "width": [<float x_dim>, <float y_dim>],
      "height": <float>, //add ceiling height for room 
      "floor": <integer>,
      "color": "#RRGGBB",
      "unique_features": "<succinct features for the space>"
      "privacy_level": "public|semi_private|private",
          }
  ],
  "edges": [
    ["<node_id_A>", "<node_id_B>"]
  ],
  "site_area": { "width": <float>, "height": <float> }
}

Return **one** JSON object that satisfies all the above.
"""

system_prompt = """
<Think logically step by step before providing answer and reflect on your logic/>

Design a residential building from a given site analysis, local region, cultural context, and best practices. Produce a complete spatial configuration as STRICT JSON only, following the schema and rules below.

## Creative intent (think privately; do NOT include your chain-of-thought)
- Aim for a clear CREATIVE AND INNOVATIVE PARTI that feels avant-garde yet livable and tied to the local region and culture with a focus on the spatial experience for users.
- Invent spaces that elevate daily life. Use them only if they make the architecture better and the experience for the inhabitants.
- Create a compelling privacy gradient (public → semi-private → private) and a legible procession from entry.
- Compose sectionally: double heights, mezzanines, or stepped floors where meaningful for spatial experience.
- Make climate your ally. If you place a courtyard or terrace, include it as a node and connect it.

REASON FIELD (required keys inside the single string)
- parti: <short name>;
- moments: <3 concise experiential moments>;
- climate_tactics: <2–3 tactics>;
- program_rationale: <how spaces enrich life & reflect local culture>;
- cultural_motifs: <3 short phrases>;
- assumptions: <3 short user-lifestyle or cultural assumptions the design serves>.

## Spatial & geometric conventions
- Units: meters. North is up.
- Site frame: (0,0) at **south-west**; x → east, y → north.
- All rooms must lie fully within `site_area`. **No overlaps** between room rectangles.
- Floors: **0 = ground**, 1 = upper, etc. If `floors > 1`, include `"staircase"` and connect it vertically across the floors.

## JSON SCHEMA (output must conform)
{
  "name": "…",
  "description": "…",
  "users": "<echo users>",
  "profession": "…",
  "location": "<echo location>",
  "climate": "<echo climate>",
  "roof_type": "…" this roof should relate to local climate,
  "facade_materials": "…",
  "floors": <integer>,
  "reason": "…",
  "entry_strategy": {
    "side": "north|south|east|west",
    "anchor_point": [<float x>, <float y>],
    "rationale": "…"
  },
  "nodes": [
    {
      "id": "<unique snake_case>",
      "type": "<room label>",
      "center": [<float x>, <float y>],
      "width": [<float x_dim>, <float y_dim>],
      "height": <float>,
      "floor": <integer>,
      "color": "#RRGGBB",
      "unique_features": "<succinct features for the space>"
      "privacy_level": "public|semi_private|private",
          }
  ],
  "edges": [
    ["<node_id_A>", "<node_id_B>"]
  ],
  "site_area": { "width": <float>, "height": <float> }
}

Return **one** JSON object that satisfies all the above.
"""



sytem_promptv2 = """<ROLE>
    You are an experienced architectural designer with over 20 years designing houses internationally.
  </ROLE>

  <TASK>
    Design a residential building from a given site analysis, local region, cultural context, and best practices. 
    Produce a complete spatial configuration as STRICT JSON only, following the schema and rules.
  </TASK>

  <CREATIVE_INTENT>
    - Aim for a clear CREATIVE AND INNOVATIVE PARTI that is avant-garde yet livable and tied to the local region and culture, focusing on spatial experience for users.  
    - Invent spaces that elevate daily life; only include them if they make the architecture better for inhabitants.  
    - Create a compelling privacy gradient (public → semi-private → private) and a legible procession from entry that is architecturally meaningful.  
    - Compose sectionally: generate multiple levels where spatially meaningful.  
  </CREATIVE_INTENT>

  <REASON_FIELD>
    Required keys inside the single string:
    - parti: <short name>;
    - moments: <3 concise experiential moments>;
    - climate_tactics: <2–3 tactics>;
    - program_rationale: <how spaces enrich life & reflect local culture>;
    - cultural_motifs: <3 short phrases>;
    - assumptions: <3 short user-lifestyle or cultural assumptions the design serves>.
  </REASON_FIELD>

  <SPATIAL_GEOMETRIC_CONVENTIONS>
    - Units: meters. North is up.  
    - Site frame: (0,0) at south-west; x → east, y → north.  
    - All rooms must lie fully within site_area. No overlaps between room rectangles.  
    - Floors: 0 = ground, 1 = upper, etc. If floors > 1, include "staircase" and connect across floors.Can have multiple floors if concept requires.  
  </SPATIAL_GEOMETRIC_CONVENTIONS>

  <JSON_SCHEMA>
{
  "name": "…",
  "description": "…",
  "users": "<echo users>",
  "profession": "…",
  "location": "<echo location>",
  "climate": "<echo climate>",
  "roof_type": "…",
  "facade_materials": "…",
  "floors": <integer>,
  "reason": "…",
  "entry_strategy": {
    "side": "north|south|east|west",
    "anchor_point": [<float x>, <float y>],
    "rationale": "…"
  },
  "nodes": [
    {
      "id": "<unique snake_case>",
      "type": "<room label>",
      "center": [<float x>, <float y>],
      "width": [<float x_dim>, <float y_dim>],
      "height": <float>,
      "floor": <integer>,
      "color": "#RRGGBB",
      "unique_features": "<succinct features>",
      "privacy_level": "public|semi_private|private"
    }
  ],
  "edges": [
    ["<node_id_A>", "<node_id_B>"]
  ],
  "site_area": { "width": <float>, "height": <float> }
}
  </JSON_SCHEMA>

  <OUTPUT_RULES>
    - Return ONE JSON object only.  
    - Strict JSON: no comments, no trailing commas, no prose outside JSON.  
  </OUTPUT_RULES>


"""

prompt = f"""Design a house in {location} for {users}.

SITE ANALYSIS (verbatim):
{site_analysis}

Honor the entry side/anchor, climate, and local culture. Invent 2–4 **creative program** spaces only if they strengthen the parti and daily cutlural rituals for its users and inhabitants.

"""
# ---------- end python_3_script_8 ----------

# ----
panel_25 = Panel(python_3_script_8.system_prompt)
# You are an architect’s copilot.
# 
# Design a house from a given site analysis, local region, and cultural context. Output ONE STRICT JSON object only (no prose), using the schema and rules below. Think privately; do not reveal chain-of-thought.
# 
# INTENT (internal only)
# - Form a clear parti (procession, moments, public→semi_private→private).
# - Let program emerge from users’ rituals and local culture; program types are OPEN.
# - Let site & climate lead (orientation, cross-vent, shading, thermal mass, courtyard/terrace if used).
# - Use sectional moves (double-height, mezzanine, steps) when they improve experience.
# - Keep circulation legible and resilient; offer an alternate public route when feasible.
# 
# SPATIAL CONVENTIONS
# - Units: meters. North is up. Site origin at SW; +x east, +y north.
# - All rooms inside `site_area`. No overlaps.
# - Floors: 0=ground, 1=upper, … If `floors > 1`, include a `"staircase"` connected on each level.
# 
# JSON SCHEMA (must conform exactly)
# {
#   "name": "…",
#   "description": "…",
#   "families": "…",
#   "profession": "…",
#   "location": "City, Country",
#   "climate": "…",
#   "roof_type": "…",
#   "facade_materials": "…",
#   "floors": <integer>,
#   "reason": "…",
#   "entry_strategy": {
#     "side": "north|south|east|west",
#     "anchor_point": [<float x>, <float y>],
#     "rationale": "…"
#   },
#   "nodes": [
#     {
#       "id": "<unique snake_case>",
#       "type": "<freeform program type>",
#       "center": [<float x>, <float y>],
#       "width": [<float x_dim>, <float y_dim>],
#       "height": <float>,
#       "floor": <integer>,
#       "color": "#RRGGBB",
#       "unique_features": "…",
#       "tags": ["<short semantic tags>"],
#       "privacy_level": "public|semi_private|private",
#       "program_purpose": "<1 sentence>",
#       "base_type_hint": "<optional closest conventional type>"
#     }
#   ],
#   "edges": [["<node_id_A>", "<node_id_B>"]],
#   "site_area": { "width": <float>, "height": <float> }
# }
# 
# REASON FIELD (required keys inside the single string)
# - parti: <short name>; moments: <3 concise experiential moments>;
# - climate_tactics: <2–3 tactics>;
# - program_rationale: <how spaces enrich life & reflect local culture>.
# 
# VALIDATION & QUALITY
# - Strict JSON only; no extra keys; valid hex colors.
# - Every node has: id, type, center, width, height, floor, color, tags, privacy_level, program_purpose.
# - Graph connected. `edges` reference existing ids; no self-loops/duplicates.
# - `entry` node required; connect it to circulation and match `entry_strategy.side`; `anchor_point` inside site.
# - Bounds must hold for each node:
#   - 0 ≤ center.x − width.x/2; 0 ≤ center.y − width.y/2;
#   - center.x + width.x/2 ≤ site_area.width; center.y + width.y/2 ≤ site_area.height.
# - If multiple floors: include `"staircase"`; stack/align sensibly.
# 
# ADJACENCY NORMS (semantic; deviate only if justified in "reason")
# - `social` ↔ `cook`/`dine` and to an `outdoor` space when present.
# - `sleep` near `hygiene`, buffered from `active`/`social`.
# - Avoid direct `cook`–`hygiene` adjacency without a buffer (hall/corridor).
# - Outdoor spaces connect purposefully to everyday life and climate comfort.
# 
# FINAL
# Return ONLY the JSON object (starts with “{”, ends with “}”).
panel_26 = Panel(python_3_script_8.prompt)

# ---- group: LLM
python_3_script_9 = Python3Script(
    run=boolean_toggle_2,
    project_name="HouseX",
    api_mode=client_2,
    model_id=model_2,
    use_mode="llm",
    system_prompt=panel_25,
    input_text=panel_26)  # -> out, response
# ---------- python_3_script_9: Python ----------
import requests
import re
from ghpythonlib.treehelpers import list_to_tree

url = 'http://localhost:5000/llm_call'
# print(f"Sending db_path: {db_path}")
payload = {
    'input_text': input_text,
    'model_id': model_id,
    'project_name': project_name,
    'use_mode': use_mode,
    'system_prompt': system_prompt,
    'input_text': input_text,
    'api_mode':api_mode
}
print(payload)


response = None
question_classification = None
json_data = None

if run:
    response = requests.post(url, json=payload)
    
    if response.status_code == 200:
        data = response.json()
        response = data['response']
        
    else:
        out = "Failed to connect:"

print(response)
# ---------- end python_3_script_9 ----------

# ----
python_3_script_10 = Python3Script(
    json_text=python_3_script_9.response,
    save_folder=json_directory_file_path,
    SiteIDX=siteidx,
    UserIDX=useridx,
    seed=seed,
    modelvlm=model_3,
    clientvlm=client_3,
    modelllm=model_4,
    clientllm=client_4,
    site_analysisVLM=panel_24)  # -> out, room_breps, room_names, room_colors, floor_plan_img_path, json_data, file_path, meta_data; inputs seed: Int32
# ---------- python_3_script_10: Python ----------
# GhPython script (Rhino/Grasshopper)
# Inputs expected in the GH component:
#   - json_text (string): the generated house JSON (your LLM output)
#   - save_folder (string): folder path to save the JSON
#   - SiteIDX, UserIDX, seed, modelvlm, modelllm (scalars/strings) for filename
#   - floor_to_floor (number, optional): default 3.2 if absent
#   - site_analysisVLM (dict or JSON string, optional): attached to output JSON
#
# Outputs (optional to wire out if you want):
#   - room_breps  : list[Rhino.Geometry.Brep]
#   - room_names  : list[str]
#   - room_colors : list[System.Drawing.Color]
#
# Notes:
# - If NetworkX is not installed in Rhino's Python, the script will still run and save
#   your original JSON but will include a warning under "networkx_analysis".
# - Space Syntax / Configurational measures follow the interpretations in §3.10:
#   Depth, Integration (closeness), Control, Choice (betweenness), Entropy (of depth distribution),
#   Random-walk value; plus eccentricity and justified graph (from an "entry" root if present).

import os, json, math
import Rhino.Geometry as rg
from System.Drawing import Color

# -----------------------------
# Optional: NetworkX import
# -----------------------------
try:
    import networkx as nx
    _HAS_NX = True
except Exception as _e:
    _HAS_NX = False
    _NX_ERR = _e

# -----------------------------
# Helpers
# -----------------------------
def hex_to_color(s, fallback=Color.LightGray):
    """Convert #RRGGBB or #RGB to System.Drawing.Color."""
    try:
        s = s.strip()
        if s.startswith("#"):
            s = s[1:]
        if len(s) == 3:
            s = "".join(ch*2 for ch in s)
        if len(s) != 6:
            return fallback
        r = int(s[0:2], 16)
        g = int(s[2:4], 16)
        b = int(s[4:6], 16)
        return Color.FromArgb(r, g, b)
    except:
        return fallback

def as_pair(v, default=(4.0, 4.0)):
    """Interpret a width/depth value that may be a scalar or a pair."""
    try:
        if isinstance(v, (list, tuple)) and len(v) == 2:
            return float(v[0]), float(v[1])
        f = float(v)
        return f, f
    except:
        return default

def make_box(center_xy, w, d, z0, h):
    """Create a simple room box Brep from plan center, width/depth, base z, and height."""
    cx, cy = float(center_xy[0]), float(center_xy[1])
    w, d, h = float(w), float(d), float(h)
    x0, x1 = cx - 0.5*w, cx + 0.5*w
    y0, y1 = cy - 0.5*d, cy + 0.5*d
    bb = rg.BoundingBox(rg.Point3d(x0, y0, z0), rg.Point3d(x1, y1, z0 + h + 0.1))
    return rg.Box(bb).ToBrep()

import Rhino  # for document tolerance

def _model_tol(fallback=1e-3):
    try:
        return float(Rhino.RhinoDoc.ActiveDoc.ModelAbsoluteTolerance or fallback)
    except:
        return float(fallback)

def _brep_volume(brep):
    try:
        mp = rg.VolumeMassProperties.Compute(brep)
        return float(mp.Volume) if mp else 0.0
    except:
        return 0.0

def _bbox_might_overlap(bb1, bb2, tol):
    # cheap AABB test with tolerance
    return not (
        (bb1.Max.X < bb2.Min.X - tol) or (bb2.Max.X < bb1.Min.X - tol) or
        (bb1.Max.Y < bb2.Min.Y - tol) or (bb2.Max.Y < bb1.Min.Y - tol) or
        (bb1.Max.Z < bb2.Min.Z - tol) or (bb2.Max.Z < bb1.Min.Z - tol)
    )

def find_volumetric_overlaps(room_breps, room_names, require_positive_volume=True, tol=None):
    """
    Returns a list of overlaps:
      [{"a": "<nameA>", "b": "<nameB>", "overlap_volume": <m3>}, ...]
    If require_positive_volume=True, only reports true 3D overlaps (no mere touching).
    """
    tol = _model_tol() if tol is None else float(tol)
    overlaps = []
    n = len(room_breps)
    for i in range(n):
        bi = room_breps[i]
        if bi is None: 
            continue
        bbi = bi.GetBoundingBox(True)
        for j in range(i+1, n):
            bj = room_breps[j]
            if bj is None:
                continue
            bbj = bj.GetBoundingBox(True)

            # Quick reject using bounding boxes
            if not _bbox_might_overlap(bbi, bbj, tol):
                continue

            # Compute volumetric intersection
            try:
                inter_breps = rg.Brep.CreateBooleanIntersection(bi, bj, tol)
            except:
                inter_breps = None

            if not inter_breps:
                # No solid overlap (could be touching or disjoint)
                if require_positive_volume:
                    continue
                else:
                    # If you want to count touching as overlap, detect with curve/point intersections:
                    import Rhino.Geometry.Intersect as rgi
                    crvs, pts = rgi.Intersection.BrepBrep(bi, bj, tol)
                    if (crvs and len(crvs) > 0) or (pts and len(pts) > 0):
                        overlaps.append({"a": room_names[i], "b": room_names[j], "overlap_volume": 0.0})
                continue

            # Sum volume of intersection pieces
            vol_sum = 0.0
            for ib in inter_breps:
                vol_sum += _brep_volume(ib)

            if vol_sum > (tol**3):  # positive 3D overlap
                overlaps.append({"a": room_names[i], "b": room_names[j], "overlap_volume": vol_sum})

    return overlaps
# -----------------------------
# Space Syntax / NetworkX helpers (per §3.10)
# -----------------------------
def _mean_depth(G, v):
    """
    MEAN DEPTH (Space Syntax 'Depth'): average topological distance (geodesic steps)
    from node v to all other nodes it can reach. Lower mean depth => more accessible / less segregated.
    (§3.10.1 Depth; the Space Syntax variant of graph distance)
    """
    lengths = nx.single_source_shortest_path_length(G, v)
    if len(lengths) <= 1:
        return None
    return sum(d for u, d in lengths.items() if u != v) / float(len(lengths) - 1)

def _depth_distribution_entropy(G, v):
    """
    ENTROPY of the depth distribution (Shannon entropy over counts at each depth level from v).
    Higher entropy => more dispersed distance profile (greater variability/complexity of routes).
    Lower entropy => tighter, more ordered/legible spacing around v.
    (§3.10.4 Entropy; Space Syntax variant of Shannon information entropy)
    """
    lengths = nx.single_source_shortest_path_length(G, v)
    if len(lengths) <= 1:
        return 0.0
    counts = {}
    for u, d in lengths.items():
        if u == v:
            continue
        counts[d] = counts.get(d, 0) + 1
    total = float(sum(counts.values()))
    S = 0.0
    for c in counts.values():
        p = c / total
        if p > 0:
            S -= p * (math.log(p, 2))  # log base 2 for bits
    return S

def _eccentricity_per_component(G):
    """
    ECCENTRICITY: for each connected component, max shortest-path distance from v to any other
    reachable node. Indicates the 'furthest' topological reach from v within its component.
    (Standard graph measure; useful for bounds on depth).
    """
    ecc = {}
    for comp in nx.connected_components(G):
        H = G.subgraph(comp).copy()
        if H.number_of_nodes() == 1:
            node = list(H.nodes())[0]
            ecc[node] = 0
        else:
            ecc.update(nx.eccentricity(H))
    return ecc

def _justified_from_root(G, root_id):
    """
    JUSTIFIED GRAPH LEVELS from a chosen root (e.g., 'entry'):
    Layers = sets of nodes grouped by their topological depth from root (0,1,2,...).
    This is the canonical Space Syntax way to visualize depth structure from an entry.
    (§3.8.3 Drawing Justified Graphs)
    """
    if root_id is None or root_id not in G:
        return [], {v: None for v in G.nodes()}
    lengths = nx.single_source_shortest_path_length(G, root_id)
    levels = {}
    for node, d in lengths.items():
        levels.setdefault(d, []).append(node)
    justified = [levels[k] for k in sorted(levels)]
    depth_map = {v: lengths.get(v, None) for v in G.nodes()}
    return justified, depth_map

def analyze_layout_with_networkx(data):
    """
    Build an undirected connectivity graph from 'nodes' and 'edges', then compute:
      - GLOBAL metrics: size, density, components, average shortest path & diameter on LCC,
        assortativity, average clustering, justified levels from entry (if found).
      - PER-NODE metrics:
          * degree (local connectivity)
          * clustering (local transitivity)
          * mean_depth (Space Syntax 'Depth')
          * integration_closeness (Space Syntax 'Integration' via closeness centrality)
          * betweenness_choice (Space Syntax 'Choice' via betweenness centrality)
          * control (Hillier & Hanson: sum over neighbors of 1/deg(neighbor))
          * eccentricity (max geodesic distance in its component)
          * depth_entropy (Shannon entropy of depth distribution)
          * random_walk_stationary (steady-state prob ~ degree / 2m)
          * depth_from_entry (layer in justified graph if 'entry' exists)
    """
    nodes = data.get('nodes', [])
    edges = data.get('edges', [])

    # Build graph with node attributes preserved for reference
    G = nx.Graph()
    for n in nodes:
        if 'id' in n:
            G.add_node(n['id'], **n)
    for e in edges:
        # edges are specified as ["u","v"]
        if not isinstance(e, (list, tuple)) or len(e) != 2:
            continue
        u, v = e[0], e[1]
        if u in G and v in G:
            G.add_edge(u, v)

    n = G.number_of_nodes()
    m = G.number_of_edges()

    # Connected components bookkeeping
    comps = list(nx.connected_components(G))
    comp_index = {}
    for i, comp in enumerate(comps):
        for v in comp:
            comp_index[v] = i

    # DEGREE & CLUSTERING
    degree = dict(G.degree())  # local connectivity at each node (k)
    clustering = nx.clustering(G)  # local transitivity (triadic closure)
    avg_clustering = nx.average_clustering(G) if n > 0 else 0.0

    # INTEGRATION (CLOSENESS CENTRALITY)
    # Space Syntax 'Integration' is commonly computed as closeness centrality on the topology:
    # higher = node is, on average, a few steps away from all others (more 'integrated').
    # (§3.10.2 Integration; Space Syntax variant of closeness)
    closeness = nx.closeness_centrality(G) if n else {}

    # CHOICE (BETWEENNESS CENTRALITY)
    # Space Syntax 'Choice' is betweenness centrality: fraction of shortest paths between all pairs
    # that pass through a node. Identifies 'through' spaces/bottlenecks that channel movement.
    # (§3.10.6 Choice; Space Syntax variant of betweenness)
    betweenness = nx.betweenness_centrality(G, normalized=True, endpoints=False) if n else {}

    # CONTROL (HILLIER & HANSON)
    # For node v, sum over neighbors u of 1/deg(u). A node connected to low-degree neighbors
    # exerts more 'control' over access (acts as a local gatekeeper).
    # (§3.10.5 Control)
    control = {}
    for v in G.nodes():
        s = 0.0
        for u in G.neighbors(v):
            du = degree.get(u, 0)
            if du > 0:
                s += 1.0 / du
        control[v] = s

    # MEAN DEPTH & ENTROPY on depth distribution (per node)
    mean_depth = {v: _mean_depth(G, v) for v in G.nodes()}
    depth_entropy = {v: _depth_distribution_entropy(G, v) for v in G.nodes()}

    # ECCENTRICITY (max distance to any reachable node; per component)
    eccentricity = _eccentricity_per_component(G)

    # RANDOM-WALK STATIONARY DISTRIBUTION
    # In an unbiased random walk on an undirected graph, the steady-state probability at v
    # is proportional to degree(v) / (2m). Interpretable as long-run 'presence likelihood'.
    # (§3.10.7 Random Walk Value)
    total_degree = float(sum(degree.values()))
    random_walk_stationary = {v: (degree[v] / total_degree if total_degree > 0 else 0.0) for v in G.nodes()}

    # Choose a root for JUSTIFIED GRAPH: prefer id == "entry" or type starting with "Entry"
    root_id = None
    for nobj in nodes:
        if str(nobj.get('id', '')).lower() == 'entry' or str(nobj.get('type', '')).lower().startswith('entry'):
            root_id = nobj['id']
            break
    justified_levels, depth_from_entry = _justified_from_root(G, root_id)

    # GLOBAL metrics on the largest connected component (LCC)
    if comps:
        largest = max(comps, key=len)
        H = G.subgraph(largest).copy()
        if H.number_of_nodes() > 1:
            avg_spl = nx.average_shortest_path_length(H)  # average geodesic length in LCC
            diameter = nx.diameter(H)                     # longest geodesic in LCC
        else:
            avg_spl, diameter = 0.0, 0
    else:
        largest = set()
        avg_spl, diameter = 0.0, 0

    density = nx.density(G) if n > 1 else 0.0            # E = 2m / (n(n-1))
    try:
        assort = nx.degree_assortativity_coefficient(G)   # correlation of degrees at edge ends
    except Exception:
        assort = None

    # Assemble per-node metrics
    per_node = {}
    for v in G.nodes():
        per_node[v] = {
            "component": comp_index.get(v),
            "degree": degree.get(v, 0),
            "clustering": clustering.get(v, 0.0),
            "mean_depth": mean_depth.get(v),
            "integration_closeness": closeness.get(v, 0.0),      # Integration proxy
            "betweenness_choice": betweenness.get(v, 0.0),       # Choice proxy
            "control": control.get(v, 0.0),
            "eccentricity": eccentricity.get(v),
            "depth_entropy": depth_entropy.get(v, 0.0),
            "random_walk_stationary": random_walk_stationary.get(v, 0.0),
            "depth_from_entry": depth_from_entry.get(v)          # justified layer index if root defined
        }

    # Package analysis
    analysis = {
        "global": {
            "n_nodes": n,
            "n_edges": m,
            "density": density,
            "components": len(comps),
            "largest_component_size": len(largest),
            "average_shortest_path_length_lcc": avg_spl,
            "diameter_lcc": diameter,
            "degree_assortativity": assort,
            "average_clustering": avg_clustering,
            "entry_node": root_id,
            "justified_graph_levels_from_entry": justified_levels  # [[root], [neighbors], [depth2], ...]
        },
        "per_node": per_node
    }
    return analysis

# -----------------------------
# Parse input JSON
# -----------------------------
try:
    data = json.loads(json_text)
except Exception as e:
    raise ValueError("Invalid JSON: {}".format(e))

nodes = data.get("nodes", [])
if not isinstance(nodes, list):
    nodes = []
floor_to_floor = 3
F2F = float(floor_to_floor) if 'floor_to_floor' in globals() and floor_to_floor is not None else 3.2

# -----------------------------
# Build simple room Breps for preview
# -----------------------------
room_breps  = []
room_names  = []
room_colors = []

for n in nodes:
    nid    = str(n.get("id", "room")).strip()
    center = n.get("center", [0.0, 0.0])
    w, d   = as_pair(n.get("width", [4.0, 4.0]), default=(4.0, 4.0))
    h      = float(n.get("height", 3.0))
    floor  = int(n.get("floor", 0))
    color  = hex_to_color(n.get("color", "#CCCCCC"))

    z0     = floor * F2F
    brep   = make_box(center, w, d, z0, h)

    room_breps.append(brep)
    room_names.append(nid)
    room_colors.append(color)

# --- After you finish building room_breps / room_names / room_colors ---
overlap_list = find_volumetric_overlaps(room_breps, room_names, require_positive_volume=True)

# Attach to JSON for validation/QA
validation = data.setdefault("validation", {})
validation["volume_overlaps"] = {
    "count": len(overlap_list),
    "pairs": overlap_list
}

# -----------------------------
# Attach NetworkX analysis
# -----------------------------
if _HAS_NX:
    try:
        data["networkx_analysis"] = analyze_layout_with_networkx(data)
    except Exception as e:
        # Fail gracefully; preserve original data
        data["networkx_analysis"] = {"error": "analysis_failed", "message": str(e)}
else:
    data["networkx_analysis"] = {
        "warning": "networkx_not_available",
        "message": "Install the 'networkx' package in Rhino Python to compute graph metrics.",
        "import_error": str(_NX_ERR)
    }

# -----------------------------
# Attach site_analysisVLM to JSON
# -----------------------------
try:
    # If it's a JSON string, parse; otherwise store as-is
    if isinstance(site_analysisVLM, str):
        try:
            data["site_analysisVLM"] = json.loads(site_analysisVLM)
        except Exception:
            data["site_analysisVLM"] = site_analysisVLM  # keep raw string if not parseable
    else:
        data["site_analysisVLM"] = site_analysisVLM
except NameError:
    # Variable not defined; skip gracefully
    data["site_analysisVLM"] = {"warning": "site_analysisVLM not defined in this context"}

# -----------------------------
# Save JSON to folder
# -----------------------------
os.makedirs(save_folder, exist_ok=True)
from datetime import datetime

timestamp = datetime.now().strftime("%Y%m%d_%H%M%S")
base_name = data.get("name", "site_design").replace(" ", "_")
file_path = os.path.join(save_folder, f"{base_name}_{SiteIDX}_{UserIDX}_{seed}_{modelvlm}_{modelllm}_{timestamp}.json")
floor_plan_img_path = f"{base_name}_{SiteIDX}_{UserIDX}_{seed}_{modelvlm}_{modelllm}_{timestamp}.png"

with open(file_path, "w", encoding="utf-8") as f:
    json.dump(data, f, indent=2, ensure_ascii=False)

print("JSON saved to:", file_path)
print(json_text)
print(site_analysisVLM)

class Data(object):
    def __init__(self, payload):
        self.payload = payload

meta_data = Data(data)  # send this only to another GhPython input
json_data=json.dumps(data["networkx_analysis"], ensure_ascii=False)
# ---------- end python_3_script_10 ----------
panel_27 = Panel(python_3_script_9.response)
bounding_box = BoundingBox(Content=python_3_script_10.room_breps, Plane=PlaneXY(0, 0, 0), UnionBox=True)  # -> Box, Box_2
panel_28 = Panel(python_3_script_10.json_data)
deconstruct_brep = DeconstructBrep(Brep=bounding_box.Box)  # -> Faces, Edges, Vertices
area_2 = Area(Geometry=deconstruct_brep.Faces)  # -> Area, Centroid
evaluate_surface = EvaluateSurface(Surface=deconstruct_brep.Faces, Point=area_2.Centroid)  # -> Point, Normal, UDirection, VDirection, Frame
dot_product = DotProduct(VectorA=evaluate_surface.Normal, VectorB=unit_z, Unitize=False)
equality = Equality(FirstNumber=dot_product, SecondNumber=Slider(-1, range=-1..1))  # -> Equality, Inequality
dispatch = Dispatch(List=deconstruct_brep.Faces, DispatchPattern=equality.Equality)  # -> ListA, ListB
area_3 = Area(Geometry=dispatch.ListA)  # -> Area, Centroid

# ---- group: LLM verifier
python_3_script_11 = Python3Script(
    run=boolean_toggle_3,
    project_name="HouseX",
    api_mode=client_5,
    model_id=model_5,
    use_mode=panel_19,
    system_prompt=panel_18,
    input_text=python_3_script_10.json_data)  # -> out, response; inputs input_text: String; same code as python_3_script_9

# ----
vector_2pt = Vector2Pt(PointA=area_3.Centroid, PointB=site_center, Unitize=False)  # -> Vector, Length
move = Move(Geometry=python_3_script_10.room_breps, Motion=vector_2pt.Vector)  # -> Geometry, Transform
deconstruct_brep_2 = DeconstructBrep(Brep=move.Geometry)  # -> Faces, Edges, Vertices
area_4 = Area(Geometry=deconstruct_brep_2.Faces)  # -> Area, Centroid
evaluate_surface_2 = EvaluateSurface(Surface=deconstruct_brep_2.Faces, Point=area_4.Centroid)  # -> Point, Normal, UDirection, VDirection, Frame
dot_product_2 = DotProduct(VectorA=evaluate_surface_2.Normal, VectorB=unit_z_2, Unitize=False)
equality_2 = Equality(FirstNumber=dot_product_2, SecondNumber=Slider(1, range=-1..1))  # -> Equality, Inequality
equality_3 = Equality(FirstNumber=dot_product_2, SecondNumber=Slider(-1, range=-1..1))  # -> Equality, Inequality

# ---- group: saves out full json
python_3_script_12 = Python3Script(
    meta_data_in=python_3_script_10.meta_data,
    json_path=python_3_script_10.file_path,
    save_folder=json_directory_file_path,
    verifier_json_text=python_3_script_11.response)  # -> out, json_path
# ---------- python_3_script_12: Python ----------
import os, re, json
from datetime import datetime

# ---------- Helpers ----------
def extract_design(obj):
    """Accept Data(payload) | dict | JSON string → dict"""
    if hasattr(obj, "payload"):
        return obj.payload
    if isinstance(obj, dict):
        return obj
    raise TypeError("Unsupported meta_data_in type: %r" % type(obj))



# ---------- Main ----------
# 1) Extract design payload
try:
    design = extract_design(meta_data_in)
except Exception as e:
    raise ValueError("Could not extract design: %s" % e)
if not isinstance(design, dict):
    raise ValueError("Design is not a dict after extraction")

# print(design)

verifier = json.loads(verifier_json_text)

print(verifier)

#  1) Attach the verifier object (not a string)
design["graph_verifier"] = verifier

# 3) Save to disk (pretty, unicode-safe)
save_dir = save_folder if 'save_folder' in globals() and isinstance(save_folder, str) else os.getcwd()
os.makedirs(save_dir, exist_ok=True)

# name = (design.get("name") or "design").replace(" ", "_")
# ts = datetime.now().strftime("%Y%m%d_%H%M%S")
# out_path = os.path.join(save_dir, f"{name}_verified_{ts}.json")

with open(json_path, "w", encoding="utf-8") as f:
    json.dump(design, f, indent=2, ensure_ascii=False)

print("Saved:", json_path)
# ---------- end python_3_script_12 ----------

# ----
panel_29 = Panel(python_3_script_11.response)
dispatch_2 = Dispatch(List=deconstruct_brep_2.Faces, DispatchPattern=equality_2.Equality)  # -> ListA, ListB
dispatch_3 = Dispatch(List=deconstruct_brep_2.Faces, DispatchPattern=equality_3.Equality)  # -> ListA, ListB
area_5 = Area(Geometry=dispatch_2.ListA)  # -> Area, Centroid
list_length_2 = ListLength(List=python_3_script_10.room_colors)
surface = Surface(flatten(dispatch_3.ListA))
larger_than = LargerThan(FirstNumber=list_length_2, SecondNumber=Slider(1, range=0..1))  # -> LargerThan, OrEqualTo
area_6 = Area(Geometry=move.Geometry)  # -> Area, Centroid
extrude = Extrude(Base=surface, Direction=unit_z_3)
brep_edges = BrepEdges(Brep=move.Geometry)  # -> Naked, Interior, NonManifold
boolean = Boolean(larger_than.LargerThan)

# ---- group: save plot for LLM
python_3_script_13 = Python3Script(run=boolean, plot_outline_curve=curve_6, SAVE_DIR=save_final_plot, fname=python_3_script_10.floor_plan_img_path)  # -> out, png_path; inputs plot_outline_curve: Curve
# ---------- python_3_script_13: Python ----------
import os, base64, uuid, tempfile
import Rhino
import Rhino.Geometry as rg
import scriptcontext as sc
from System.Drawing.Imaging import ImageFormat

# --- Focus Top on plot outline (keeps it fully inside frame) ---
def focus_top_on(plot_geom, pad_frac=0.04, view_name="Top"):
    if plot_geom is None:
        raise ValueError("plot_geom is None")
    bbox = plot_geom.GetBoundingBox(True)
    if not bbox.IsValid:
        raise ValueError("Invalid plot bbox")

    # Pad the bbox a bit so geometry isn't glued to the image edge
    dx = bbox.Max.X - bbox.Min.X
    dy = bbox.Max.Y - bbox.Min.Y
    pad = max(dx, dy) * float(pad_frac)
    bbox = rg.BoundingBox(
        rg.Point3d(bbox.Min.X - pad, bbox.Min.Y - pad, bbox.Min.Z - 1.0),
        rg.Point3d(bbox.Max.X + pad, bbox.Max.Y + pad, bbox.Max.Z + 1.0)
    )

    # Find the Top view if it exists, otherwise use the active view
    view = sc.doc.Views.Find(view_name, False) or sc.doc.Views.ActiveView
    if view is None:
        raise RuntimeError("No Rhino view available")

    vp = view.ActiveViewport

    # Force a Top/parallel projection (try several APIs for compatibility)
    proj = Rhino.Display.DefinedViewportProjection.Top
    ok = False
    for args in [
        (proj, True, True, True),   # Rhino 8
        (proj, True, True),         # some builds
        (proj, True),               # some builds
        (proj,)                     # older builds
    ]:
        try:
            if vp.SetProjection(*args):
                ok = True
                break
        except:
            pass
    try:
        vp.ChangeToParallelProjection(True)
    except:
        pass
    try:
        vp.SetToPlanView(rg.Plane.WorldXY, True)
    except:
        pass

    # Canonical Top orientation
    try:
        vp.SetCameraDirection(rg.Vector3d(0, 0, -1), True)
    except:
        vp.CameraDirection = rg.Vector3d(0, 0, -1)
    vp.CameraUp = rg.Vector3d(0, 1, 0)

    # Clean capture (hide grids/axes)
    vp.ConstructionGridVisible = False
    vp.ConstructionAxesVisible = False
    vp.WorldAxesVisible = False

    # Zoom to bbox
    vp.ZoomBoundingBox(bbox)
    view.Redraw()
    return view

# --- Capture (instance-based ViewCapture → avoids your error) ---
import time

def capture_view(view, path, width=1400, height=1400, display_mode="Arctic", transparent=False):
    dm = Rhino.Display.DisplayModeDescription.FindByName(display_mode)
    if dm:
        view.ActiveViewport.DisplayMode = dm

    # Force redraw and give rendering a moment to catch up
    sc.doc.Views.Redraw()
    time.sleep(0.1)   # small pause (100ms), adjust if still too fast

    vc = Rhino.Display.ViewCapture()
    vc.Width = int(width)
    vc.Height = int(height)
    vc.ScaleScreenItems = False
    vc.DrawGrid = False
    vc.DrawAxes = False
    vc.DrawGridAxes = False
    vc.TransparentBackground = bool(transparent)

    bmp = vc.CaptureToBitmap(view)
    if bmp is None:
        raise RuntimeError("Capture failed (bitmap is None)")
    bmp.Save(path, ImageFormat.Png)
    return path

# --- Encode PNG/JPG to data-URI for LLMs ---
def encode_image_to_data_uri(path):
    ext = os.path.splitext(path)[1].lower().lstrip(".")
    mime = "image/jpeg" if ext in ("jpg", "jpeg") else "image/png"
    with open(path, "rb") as f:
        b64 = base64.b64encode(f.read()).decode("utf-8")
    return "data:%s;base64,%s" % (mime, b64)

# --- One-call helper: frame Top → capture → data-URI ---
def capture_topview_to_data_uri(plot_geom,
                                path=None,
                                width=1400,
                                height=1400,
                                pad_frac=0.04,
                                display_mode="Rendered",
                                transparent=False):
    import os, uuid, tempfile
    # If no explicit path, build one in SAVE_DIR (or temp if SAVE_DIR is not set/valid)
    if not path:
        out_dir = SAVE_DIR if (isinstance(SAVE_DIR, str) and len(SAVE_DIR) > 0) else tempfile.gettempdir()
        if not os.path.isdir(out_dir):
            try: os.makedirs(out_dir)
            except: out_dir = tempfile.gettempdir()
        path = os.path.join(out_dir, "site_top_%s.png" % uuid.uuid4().hex[:8])

    view = focus_top_on(plot_geom, pad_frac, view_name="Top")
    capture_view(view, path, width, height, display_mode, transparent)
    return path, encode_image_to_data_uri(path)
if run:
    path = os.path.join(SAVE_DIR, fname)
    png_path, data_uri = capture_topview_to_data_uri(plot_outline_curve,
                                                    path = path,
                                                    width=2000, height=2000,
                                                    display_mode="Rendered",
                                                    transparent=False)
# ---------- end python_3_script_13 ----------

# ----
custom_preview_lineweights_3 = CustomPreviewLineweights(Geometry=simplify(brep_edges.Interior), Shader=graft(colour_swatch), Thickness=Slider(3, range=0..10), Absolute=False)
custom_preview_6 = CustomPreview(Geometry=extrude, Material=python_3_script_10.room_colors)
text_tag_3d = TextTag3D(
    Location=graft(area_6.Centroid),
    Text=graft(python_3_script_10.room_names),
    Size=Slider(0.3, range=0..1),
    Colour=colour_swatch,
    Justification=5)
panel_30 = Panel(python_3_script_13.png_path)
